# Grasshopper definition 101_Meeting_Room.ghx (Grasshopper 1.0.8)
# plug-ins: Human, Opossum2_0_Proto_A

reload = Python3Script(reload=Button())  # inputs reload: Boolean
# ---------- reload: Python ----------
# venv: rhino_compas_acoustics
# r: compas
# r: pyroomacoustics
# r: matplotlib
# r: librosa
# r: soundfile
# r: sounddevice
# r: sofar
# r: pyfar
# r: pyrato

import sys
import os
from compas_rhino import unload_modules


gh_path = ghenv.Component.OnPingDocument().FilePath
dire_path = os.path.dirname(os.path.dirname(gh_path))
target_path = os.path.join(dire_path, "src")

if target_path not in sys.path:
    sys.path.insert(0, target_path)

if reload:
    unload_modules('compas_acoustics')

try:
    import compas_acoustics as ca
except Exception as e:
    raise ValueError(e)
# ---------- end reload ----------

crv = Curve(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)
seatpts = Point([Point(14.875, -6.04, 1.2), Point(15.625, -6.04, 1.2), Point(16.375, -6.04, 1.2), Point(17.125, -6.04, 1.2), Point(14.875, -7.94, 1.2), Point(15.625, -7.94, 1.2), Point(16.375, -7.94, 1.2), Point(17.125, -7.94, 1.2), Point(14.1, -6.99, 1.2)])

Z = UnitZ(Factor="-3.6")
move = Move(Geometry=crv, Motion=Z)  # -> Geometry, Transform
disc = Discontinuity(Curve=crv, Level=1)  # -> Points, Parameters
disc_2 = Discontinuity(Curve=move.Geometry, Level=1)  # -> Points, Parameters
shift = ShiftList(List=disc.Points, Shift=1, Wrap=True)
shift_2 = ShiftList(List=disc_2.Points, Shift=1, Wrap=True)
merge = Merge(
    Data1=simplify(graft(disc.Points)),
    Data2=simplify(graft(shift)),
    Data3=simplify(graft(shift_2)),
    Data4=simplify(graft(disc_2.Points)))
pline = PolyLine(Vertices=merge, Closed=invert(False))  # -> flatten(Polyline)

concrete = Compas_acousticsMaterialLibrary()  # -> material
#   port material: AcousticMaterial object.
# ---------- concrete: Python ----------
"""Preset picker for AcousticMaterial. Right-click to choose a material from the materials_library folder."""
# flake8: noqa
import Grasshopper
from System.Windows.Forms import ToolStripSeparator
from compas_acoustics.materials_library import MaterialsLibrary


class MaterialLibraryPicker(Grasshopper.Kernel.GH_ScriptInstance):

    def __init__(self):
        super().__init__()
        self.library = MaterialsLibrary()
        nickname = ghenv.Component.NickName
        self.material_name = nickname if nickname in self.library.material_names else None

    def RunScript(self):
        names = sorted(self.library.material_names)
        if not names:
            ghenv.Component.AddRuntimeMessage(
                Grasshopper.Kernel.GH_RuntimeMessageLevel.Error, "No material presets found in the materials library."
            )
            return None

        if self.material_name not in names:
            ghenv.Component.AddRuntimeMessage(
                Grasshopper.Kernel.GH_RuntimeMessageLevel.Remark, "Right-click the icon to choose a material."
            )
            ghenv.Component.Message = None
            return None

        ghenv.Component.Message = self.material_name
        return self.library.material_from_name(self.material_name)

    def AppendAdditionalMenuItems(self, menu):
        for name in sorted(self.library.material_names):
            item = menu.Items.Add(name, None, self.on_item_click)
            item.Checked = (name == self.material_name)

        menu.Items.Add(ToolStripSeparator())

    def on_item_click(self, sender, event_info):
        name = str(sender)
        if name == self.material_name:
            return
        self.material_name = name
        ghenv.Component.NickName = name
        ghenv.Component.ExpireSolution(True)
# ---------- end concrete ----------
wall_absorber_50mm = Compas_acousticsMaterialLibrary()  # -> material; same code as concrete
merge_2 = Merge(Data1=concrete, Data2=wall_absorber_50mm)  # -> flatten(Result)

# ----
# Genes for Determine Materials,
# if <= .5 -> concrete, if > .5 -> absorber
wlc_genes_1 = GenePool(Decimals=1, Maximum=1, Minimum=0, Value=[0.2, 0.1, 0.4, 0.1, 0.1, 0.4, 0.3, 0.6, 0.1, 0.4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])
py3 = Python3Script(thresholds=wlc_genes_1, materials=merge_2)  # -> out, materials_out, absorber_count, absorber_indices; inputs thresholds: list of Double, materials: list
# ---------- py3: Python ----------
materials_out = [materials[0] if thres <= 0.5 else materials[1] for thres in thresholds]
absorber_count = sum(1 for thres in thresholds if thres > 0.5)
absorber_indices = [i for i, thres in enumerate(thresholds) if thres > 0.5]
# ---------- end py3 ----------

panel = Panel("""0.18
0.40
0.65
0.80
0.85
0.80
0.75""")
lng = ListLength(List=panel)
repeat = RepeatData(Data="0.35", Length=lng)
conmat = Compas_acousticsConstructMaterial(absorption=panel, scattering=repeat, name="human_clothing")  # -> material; inputs absorption: list of Double, scattering: list of Double, name: String
#   port absorption: List of absorption coefficients for each frequency band. e.g. '0.1, 0.2, 0.3, 0.4, 0.5, 0.6, 0.7' for 7 frequency bands.
#   port scattering: Optional. List of scattering coefficients for each frequency band. e.g. '0.1, 0.2, 0.3, 0.4, 0.5, 0.6, 0.7' for 7 frequency bands.
#   port name: Name of the material preset in the library (e.g. 'concrete', 'carpet').
#   port material: AcousticMaterial object.
# ---------- conmat: Python ----------
"""Create an AcousticMaterial for AcousticObject(s)."""
# flake8: noqa
import Grasshopper
import System
from compas_acoustics.acoustic_material import AcousticMaterial


class ConstructMaterial(Grasshopper.Kernel.GH_ScriptInstance):

    def RunScript(self,
            absorption: System.Collections.Generic.List[float],
            scattering: System.Collections.Generic.List[float],
            name: str):
        if absorption is None:
            ghenv.Component.AddRuntimeMessage(
                Grasshopper.Kernel.GH_RuntimeMessageLevel.Warning,
                "Input parameter 'absorption' failed to collect data."
            )
            return
        if name is None:
            ghenv.Component.AddRuntimeMessage(
                Grasshopper.Kernel.GH_RuntimeMessageLevel.Warning,
                "Input parameter 'name' failed to collect data."
            )
            return

        return AcousticMaterial(
            name=name,
            absorption_coefficients=absorption,
            scattering_coefficients=scattering,
        )
# ---------- end conmat ----------

panel_2 = Panel("""0.05
0.04
0.05
0.06
0.06
0.07
0.08""")
panel_3 = Panel("wood_laminate_desk_30mm")
lng_2 = ListLength(List=panel_2)
repeat_2 = RepeatData(Data="0.08", Length=lng_2)
conmat_2 = Compas_acousticsConstructMaterial(absorption=panel_2, scattering=repeat_2, name=panel_3)  # -> material; inputs absorption: list of Double, scattering: list of Double, name: String; same code as conmat

disc_3 = Discontinuity(Curve=crv, Level=1)  # -> Points, Parameters
avr = Average(Input=disc_3.Points)
Z_2 = UnitZ(Factor="-2.85")
move_2 = Move(Geometry=avr, Motion=Z_2)  # -> Geometry, Transform
py3_2 = Python3Script(centroid=move_2.Geometry, x_size="3.0", y_size="1.2")  # -> out, rec; inputs centroid: Point3d, x_size: Double, y_size: Double
# ---------- py3_2: Python ----------
import Rhino.Geometry as rg


corner_1 = centroid - rg.Vector3d(x_size/2, y_size/2, 0)
corner_2  = centroid + rg.Vector3d(x_size/2, y_size/2, 0)

rec = rg.Rectangle3d(
    rg.Plane(centroid, rg.Vector3d.ZAxis), corner_1, corner_2
)
# ---------- end py3_2 ----------

Z_3 = UnitZ(Factor="-0.75")
move_3 = Move(Geometry=seatpts, Motion=Z_3)  # -> Geometry, Transform
crv_cp = CurveClosestPoint(Point=move_3.Geometry, Curve=py3_2.rec)  # -> Point, Parameter, Distance
py3_3 = Python3Script(centroid=move_3.Geometry, x_size="0.45", y_size="0.45")  # -> out, rec; inputs centroid: Point3d, x_size: Double, y_size: Double; same code as py3_2
py3_4 = Python3Script(centroid=move_3.Geometry, toward=crv_cp.Point, x_size="0.45", y_size="0.65")  # -> out, rec; inputs centroid: Point3d, toward: Point3d, x_size: Double, y_size: Double
# ---------- py3_4: Python ----------
import Rhino.Geometry as rg

vec = toward - centroid
vec = rg.Vector3d(vec.X, vec.Y, 0)

dire_1 = rg.Vector3d(vec)
dire_1.Unitize()

dire_2 = rg.Vector3d.CrossProduct(dire_1, rg.Vector3d.ZAxis)

corner = centroid - dire_1 * x_size / 2 + dire_2 * x_size / 2

pln = rg.Plane(corner, -dire_2, rg.Vector3d.ZAxis)

rec = rg.Rectangle3d(
    pln, x_size, y_size
)
# ---------- end py3_4 ----------

# ---- group: all rays must pass through the mesh face in even numbers
data = Data(py3_4.rec)
flip = FlipCurve(Curve=data)  # -> Curve, Flag
data_2 = Data([data, flip.Curve])

# ----
# Sources & Receivers
number_slider = Slider(0.37, range=0..1)
crv_2 = Curve(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)
pt = Point(seatpts)
end = EndPoints(Curve=crv_2)  # -> Start, End
cardioid = Compas_acousticsDirectivity()  # -> directivity
#   port directivity: Directivity pattern.
# ---------- cardioid: Python ----------
"""Preset picker for directivity patterns. Right-click to choose a pattern from the available options."""
# flake8: noqa
import Grasshopper
from System.Windows.Forms import ToolStripSeparator
from compas_acoustics.materials_library import MaterialsLibrary


class DirectivitySelector(Grasshopper.Kernel.GH_ScriptInstance):
    ITEMS = ["Bidirectional", "Hypercardioid", "Supercardioid", "Cardioid", "Omnidirectional"]

    def __init__(self):
        super().__init__()
        nickname = ghenv.Component.NickName
        self.directivity_name = nickname if nickname in self.ITEMS else None

    def RunScript(self):
        names = self.ITEMS
        if not names:
            ghenv.Component.AddRuntimeMessage(
                Grasshopper.Kernel.GH_RuntimeMessageLevel.Error, "No directivity patterns found."
            )
            return None

        if self.directivity_name not in names:
            ghenv.Component.AddRuntimeMessage(
                Grasshopper.Kernel.GH_RuntimeMessageLevel.Remark, "Right-click the icon to choose a directivity pattern."
            )
            ghenv.Component.Message = None
            return None

        ghenv.Component.Message = self.directivity_name
        return self.directivity_name.lower()

    def AppendAdditionalMenuItems(self, menu):
        for name in self.ITEMS:
            item = menu.Items.Add(name, None, self.on_item_click)
            item.Checked = (name == self.directivity_name)

        menu.Items.Add(ToolStripSeparator())

    def on_item_click(self, sender, event_info):
        name = str(sender)
        if name == self.directivity_name:
            return
        self.directivity_name = name
        ghenv.Component.NickName = name
        ghenv.Component.ExpireSolution(True)
# ---------- end cardioid ----------
points = PointList(Points=pt, Size=number_slider)
pt_2 = Point(end.Start)
source = Compas_acousticsSource(position=pt_2, direction=crv_2, directivity=cardioid, name="my_source")  # -> source; inputs position: Point3d, direction: Vector3d, directivity: String, name: String, sound_file: String
#   port position: Position of the source.
#   port direction: Direction of the source.
#   port directivity: Directivity of the source. Default is Omnidirectional. Options: - Bidirectional - Hypercardioid - Supercardioid - Cardioid - Omnidirectional
#   port name: Name of the source.
#   port sound_file: Sound file associated with the source.
#   port source: Source object.
# ---------- source: Python ----------
"""Acoustic Source object (speaker, human, etc.)."""
# flake8: noqa
import Grasshopper
import Rhino
from compas_acoustics import Source


class CreateSource(Grasshopper.Kernel.GH_ScriptInstance):
    ITEMS = ["bidirectional", "hypercardioid", "supercardioid", "cardioid", "omnidirectional"]

    def RunScript(self,
            position: Rhino.Geometry.Point3d,
            direction: Rhino.Geometry.Vector3d,
            directivity: str,
            name: str,
            sound_file: str):
        if position is None:
            position = Rhino.Geometry.Point3d(0, 0, 0)
        if direction is None:
            direction = Rhino.Geometry.Vector3d(1, 0, 0)

        if directivity is None:
            dirt = "omnidirectional"
        elif directivity not in self.ITEMS:
            ghenv.Component.AddRuntimeMessage(
                Grasshopper.Kernel.GH_RuntimeMessageLevel.Error, "Input parameter 'directivity' is not valid."
            )
            return None
        else:
            dirt = directivity

        if name is None:
            name = "my_source"

        return Source(
            name,
            *position,
            directivity=dirt,
            direction=[*direction],
            sound_file=sound_file
        )
# ---------- end source ----------
receiver = Compas_acousticsReceiver(position=pt, name="my_receiver")  # -> receiver; inputs position: Point3d, name: String
#   port position: Position of the receiver.
#   port name: Name of the receiver.
#   port receiver: Receiver object.
# ---------- receiver: Python ----------
"""Acoustic Receiver object (microphone, human ear, etc.)."""
# flake8: noqa
import Grasshopper
import Rhino
from compas_acoustics import Receiver

# TODO: Implement direction
class CreateReceiver(Grasshopper.Kernel.GH_ScriptInstance):

    def RunScript(self, position: Rhino.Geometry.Point3d, name: str):
        if position is None:
            position = Rhino.Geometry.Point3d(0, 0, 1)
        if name is None:
            name = "my_receiver"

        return Receiver(name, *position)
# ---------- end receiver ----------

# ---- group: all rays must pass through the mesh face in even numbers
data_3 = Data(py3_3.rec)
flip_2 = FlipCurve(Curve=data_3)  # -> Curve, Flag
data_4 = Data([data_3, flip_2.Curve])

data_5 = Data(py3_2.rec)
flip_3 = FlipCurve(Curve=data_5)  # -> Curve, Flag
data_6 = Data([data_5, flip_3.Curve])

# ----
# Human Sitting
panel_4 = Panel("human_sitting")
merge_3 = Merge(Data1=data_4, Data2=data_2)  # -> flatten(Result)
obj = Compas_acousticsAcousticObject(geometry=merge_3, material=conmat, name=panel_4)  # -> acoustic_object; inputs geometry: GeometryBase, name: String
#   port geometry: Geometry of the AcousticObject.
#   port material: Material of the AcousticObject.
#   port name: Name of the AcousticObject.
#   port acoustic_object: AcousticObject object.
# ---------- obj: Python ----------
"""Create an AcousticObject with the specified geometry and material."""
# flake8: noqa
import Grasshopper
import Rhino
from compas_acoustics.geometry import AcousticObject
from compas_rhino.conversions import mesh_to_compas
from compas_rhino.conversions import polyline_to_compas

# TODO: Change the typeHintID in metadata.json from "mesh" to "geometrybase"

class CreateAcousticObject(Grasshopper.Kernel.GH_ScriptInstance):

    def RunScript(self, geometry: Rhino.Geometry.GeometryBase, material, name: str):

        if geometry is None:
            ghenv.Component.AddRuntimeMessage(
                Grasshopper.Kernel.GH_RuntimeMessageLevel.Warning, "No geometry provided."
            )
            return
        if material is None:
            ghenv.Component.AddRuntimeMessage(
                Grasshopper.Kernel.GH_RuntimeMessageLevel.Warning, "No material provided."
            )
            return

        # Gemetry conversion from Rhino to Compas
        # TODO: Figure out how to handle other geometry types (e.g., Brep, Surface, etc.)
        if isinstance(geometry, Rhino.Geometry.Mesh):
            geometry = mesh_to_compas(geometry)
        elif isinstance(geometry, Rhino.Geometry.Polyline):
            geometry = polyline_to_compas(geometry)
        elif isinstance(geometry, Rhino.Geometry.PolylineCurve):
            geometry = polyline_to_compas(geometry.ToPolyline())
        else:
            ghenv.Component.AddRuntimeMessage(
                Grasshopper.Kernel.GH_RuntimeMessageLevel.Error, "Unsupported geometry type."
            )
            return
        return AcousticObject(acoustic_geometry=geometry, material=material, name=name)
# ---------- end obj ----------

# ----
# Table
obj_2 = Compas_acousticsAcousticObject(geometry=data_6, material=conmat_2, name=panel_3)  # -> acoustic_object; inputs geometry: GeometryBase, name: String; same code as obj

# ----
# Internal Objects
merge_4 = Merge(Data1=obj_2, Data2=obj)

wlc_minimize_absorber_count = Number(py3.absorber_count)
movopossum_3_2_0 = Opossum(
    OpossumData_OptimizationType=0,
    OpossumData_ResultSerializationStatus=0,
    OpossumData_objective=[wlc_target_t20, wlc_target_c50, wlc_minimize_absorber_count],
    OpossumData_variable=wlc_genes_1)

# ----
# Closed Room
panel_5 = Panel("2")
item = ListItem(List=pline, Index=panel_5, Wrap=True)
item_2 = ListItem(List=pline, Index="3", Wrap=True)
panel_6 = Panel(py3.absorber_count)

flip_4 = FlipCurve(Curve=crv)  # -> Curve, Flag
cull_i = CullIndex(List=pline, Indices=[panel_5, "3"], Wrap=True)
merge_5 = Merge(Data1=flatten(flip_4.Curve), Data2=flatten(cull_i))
py3_5 = Python3Script(polyline=merge_5, space=Slider(0.7, range=0..1))  # -> out, div_u, div_v, space_u, space_v; inputs polyline: Polyline, space: Double
# ---------- py3_5: Python ----------
import Rhino.Geometry as rg

def division(length, space):
    div = round(length / space)
    return div, length / div

len_a = (polyline[0] - polyline[1]).Length
len_b = (polyline[0] - polyline[3]).Length


div_u, space_u = division(len_a, space)
div_v, space_v = division(len_b, space)
# ---------- end py3_5 ----------
mplane = MeshPlane(Boundary=merge_5, WidthCount=py3_5.div_u, HeightCount=py3_5.div_v)  # -> Mesh, Area
item_3 = ListItem(List=mplane.Mesh, Index=0, Wrap=True)  # -> Item, Item1, Item2
panel_7 = Panel("""28
29
38
39
48
49""")
demesh = DeconstructMesh(Mesh=item_3.Item2)  # -> Vertices, Faces, Colours, Normals
cull_i_2 = CullIndex(List=demesh.Faces, Indices=panel_7, Wrap=True)
conmesh = ConstructMesh(Vertices=demesh.Vertices, Faces=cull_i_2)
merge_6 = Merge(Data1=[item_3.Item, item_3.Item1], Data2=conmesh)
faceb = FaceBoundaries(Mesh=merge_6)  # -> flatten(Boundaries)
obj_3 = Compas_acousticsAcousticObject(geometry=faceb, material=py3.materials_out)  # -> acoustic_object; inputs geometry: GeometryBase, name: String; same code as obj

panel_8 = Panel("""0.14
0.10
0.06
0.08
0.10
0.10
0.10""")
panel_9 = Panel("""0.03
0.03
0.04
0.05
0.05
0.06
0.08""")
conmat_3 = Compas_acousticsConstructMaterial(absorption=panel_8, scattering=panel_9, name="solid_wood")  # -> material; inputs absorption: list of Double, scattering: list of Double, name: String; same code as conmat
item_4 = ListItem(List=demesh.Faces, Index=panel_7, Wrap=True)
conmesh_2 = ConstructMesh(Vertices=demesh.Vertices, Faces=item_4)
mesh = Mesh(conmesh_2)
mc = MeshCorners(Mesh=mesh, Angle=2.35619449)
pline_2 = PolyLine(Vertices=mc, Closed=invert(False))
flip_5 = FlipCurve(Curve=pline_2)  # -> Curve, Flag
obj_4 = Compas_acousticsAcousticObject(geometry=flip_5.Curve, material=conmat_3, name="wood_door")  # -> acoustic_object; inputs geometry: GeometryBase, name: String; same code as obj

panel_10 = Panel("""0.15
0.08
0.04
0.03
0.02
0.02
0.02""")
panel_11 = Panel("""0.02
0.02
0.03
0.04
0.05
0.05
0.07""")
crv_3 = Curve(item_2)
conmat_4 = Compas_acousticsConstructMaterial(absorption=panel_10, scattering=panel_11, name="insulated_double_glazing")  # -> material; inputs absorption: list of Double, scattering: list of Double, name: String; same code as conmat
obj_5 = Compas_acousticsAcousticObject(geometry=crv_3, material=conmat_4, name="curtain_glass_wall")  # -> acoustic_object; inputs geometry: GeometryBase, name: String; same code as obj

crv_4 = Curve(item)
crv_5 = Curve(move.Geometry)
concrete_2 = Compas_acousticsMaterialLibrary()  # -> material; same code as concrete
obj_6 = Compas_acousticsAcousticObject(geometry=crv_4, material=concrete_2, name="concrete_front_wall")  # -> acoustic_object; inputs geometry: GeometryBase, name: String; same code as obj
obj_7 = Compas_acousticsAcousticObject(geometry=crv_5, material=concrete_2, name="concrete_floor")  # -> acoustic_object; inputs geometry: GeometryBase, name: String; same code as obj

# ---- group: enable them after optimization, for phenotype
data_7 = Data(faceb)
int = Integer(py3.absorber_indices)
cull_i_3 = CullIndex(List=data_7, Indices=int, Wrap=True)
item_5 = ListItem(List=data_7, Index=int, Wrap=True)
mcol = MeshColours(Mesh=item_5, Colours=ColourSwatch(SwatchColor=RGB(0, 255, 242)))
mcol_2 = MeshColours(Mesh=cull_i_3, Colours=ColourSwatch(SwatchColor=RGB(145, 145, 145)))
mjoin = MeshJoin(Meshes=flatten([mcol, mcol_2]))

# ----
merge_7 = Merge(Data1=obj_6, Data2=obj_7, Data3=obj_3, Data4=obj_5, Data5=obj_4)

merge_8 = Merge(Data1=merge_7, Data2=merge_4)
scene = Compas_acousticsRoomScene(objects=flatten(merge_8), sources=flatten(source), receivers=flatten(receiver), name="my_scene")  # -> scene; inputs objects: list, sources: list, receivers: list, name: String
#   port objects: List of AcousticObject
#   port sources: List of Source objects.
#   port receivers: List of Receiver objects.
#   port name: Name of the room scene.
#   port scene: Room scene object.
# ---------- scene: Python ----------
"""Create a room scene with the specified objects, sources, and receivers."""
# flake8: noqa
import Grasshopper

import System
from compas_acoustics.scene import Scene
from compas_acoustics.source import Source
from compas_acoustics.receiver import Receiver


class CreateModelScene(Grasshopper.Kernel.GH_ScriptInstance):

    def RunScript(self,
            objects: System.Collections.Generic.List[object],
            sources: System.Collections.Generic.List[object],
            receivers: System.Collections.Generic.List[object],
            name: str):

        if objects is None:
            ghenv.Component.AddRuntimeMessage(
                Grasshopper.Kernel.GH_RuntimeMessageLevel.Warning, "No objects provided."
            )
            return
        if sources is None:
            ghenv.Component.AddRuntimeMessage(
                Grasshopper.Kernel.GH_RuntimeMessageLevel.Warning, "No sources provided."
            )
            return
        if receivers is None:
            ghenv.Component.AddRuntimeMessage(
                Grasshopper.Kernel.GH_RuntimeMessageLevel.Warning, "No receivers provided."
            )
            return

        scene = Scene(name=name)
        scene.add_acoustic_objects(objects)
        for src in sources:
            if isinstance(src, Source):
                scene.add_source(src)
            else:
                ghenv.Component.AddRuntimeMessage(
                    Grasshopper.Kernel.GH_RuntimeMessageLevel.Error,
                    f"Invalid source type: {type(src)}. Expected a Source object.",
                )
        for rcv in receivers:
            if isinstance(rcv, Receiver):
                scene.add_receiver(rcv)
            else:
                ghenv.Component.AddRuntimeMessage(
                    Grasshopper.Kernel.GH_RuntimeMessageLevel.Error,
                    f"Invalid receiver type: {type(rcv)}. Expected a Receiver object.",
                )

        return scene
# ---------- end scene ----------

# ----
# Simulate & Analyse
number_slider_2 = Slider(0.6, range=0..1)
simrt = Compas_acousticsSimulateRayTracing(
    scene=scene,
    max_order="2",
    n_rays=Slider(5000, range=0..10000),
    energy_thres="1e-04",
    time_thres=number_slider_2,
    seed=Slider(1, range=0..10))  # -> ir_graph; inputs sample_rate: Int32, max_order: Int32, n_rays: Int32, absorb_air: Boolean, energy_thres: Double, time_thres: Double, seed: Int32
#   port scene: Room scene object.
#   port sample_rate: Sample rate for the simulation.
#   port max_order: Maximum order of image sources.
#   port n_rays: Number of rays for ray tracing.
#   port absorb_air: Whether to consider air absorption.
#   port energy_thres: Energy threshold for ray tracing.
#   port time_thres: Time threshold for ray tracing.
#   port seed: Random seed for reproducibility.
#   port ir_graph: Impulse response graph structure.
# ---------- simrt: Python ----------
"""Simulate room acoustics using Image Source Method (ISM) and Ray Tracing (RT) to generate impulse response graph structure."""
# flake8: noqa
import Grasshopper

from compas_acoustics.simulator import Simulator

class SimulateRayTracing(Grasshopper.Kernel.GH_ScriptInstance):

    def RunScript(self,
            scene,
            sample_rate: int,
            max_order: int,
            n_rays: int,
            absorb_air: bool,
            energy_thres: float,
            time_thres: float,
            seed: int):

        if scene is None:
            ghenv.Component.AddRuntimeMessage(
                Grasshopper.Kernel.GH_RuntimeMessageLevel.Warning, "Input parameter 'scene' failed to collect data."
            )
            return

        if max_order is None:
            max_order = 2
        if n_rays is None:
            n_rays = 1000
        if absorb_air is None:
            absorb_air = True
        if energy_thres is None:
            energy_thres = 1e-7
        if time_thres is None:
            time_thres = 10.0

        sim = Simulator(scene)
        if sample_rate is not None:
            sim.sampling_rate = sample_rate

        sim.rir_from_ray_tracing(
            image_source_order=max_order,
            n_rays=n_rays,
            air_absorption=absorb_air,
            energy_thres=energy_thres,
            time_thres=time_thres,
            random_seed=seed,
        )

        ghenv.Component.Message = "{}Hz, order={}, rays={}, air={}, seed={}, energy_thres={}, time_thres={}".format(
            sim.sampling_rate, max_order, n_rays, absorb_air, seed if seed is not None else "random", energy_thres, time_thres
        )

        return sim.scene.ir_graph
# ---------- end simrt ----------
decirgraph = Compas_acousticsDeconstructIRGraph(ir_graph=simrt)  # -> ir, sources, receivers, edges; inputs receiver_idx: list of Int32
#   port ir_graph: Impulse response graph structure.
#   port receiver_idx: Index(s) of the receiver(s) to filter.
#   port ir: ImpulseResponse object(s).
#   port sources: Source object(s).
#   port receivers: Receiver object(s).
#   port edges: Relationships between sources and receivers as Line(s).
# ---------- decirgraph: Python ----------
"""Deconstruct impulse response graph structure into ImpulseResponse(s)."""
# flake8: noqa
import Grasshopper
from Grasshopper import DataTree
from Grasshopper.Kernel.Data import GH_Path
from Rhino.Geometry import Line
import System

class DeconstructIRGraph(Grasshopper.Kernel.GH_ScriptInstance):

    def RunScript(self,
            ir_graph,
            receiver_idx: System.Collections.Generic.List[int]):

        if ir_graph is None:
            ghenv.Component.AddRuntimeMessage(
                Grasshopper.Kernel.GH_RuntimeMessageLevel.Warning, "Input parameter 'ir_graph' failed to collect data."
            )

        ir_out = DataTree[object]()
        source_out = DataTree[object]()
        receiver_out = DataTree[object]()
        edge_out = DataTree[object]()

        # 1. Set order of receivers
        receiver_list = [
            ir_graph.node_attribute(node, 'data')
            for node in ir_graph.nodes()
            if ir_graph.node_attribute(node, 'type') == 'receiver'
        ]
        receiver_set = {rec.guid for rec in receiver_list}

        # 2. Make ir group as {receiver_0: [src_0, ...], ...}
        source_group = {}
        ir_group = {}

        for u, v in ir_graph.edges():
            ir = ir_graph.edge_attribute((u, v), 'data')
            data_u = ir_graph.node_attribute(u, 'data')
            data_v = ir_graph.node_attribute(v, 'data')

            if data_u.guid in receiver_set:
                rec, src = data_u, data_v
            elif data_v.guid in receiver_set:
                rec, src = data_v, data_u
            else:
                continue
            
            source_group.setdefault(rec.guid, []).append(src)
            ir_group.setdefault(rec.guid, []).append(ir)

        # 3. Filter receiver, optional
        if receiver_idx is None:
            indices = list(range(len(receiver_list)))
        else:
            indices = receiver_idx  # Already set to list access

        for idx in indices:
            rec = receiver_list[idx]
            path = GH_Path(idx)

            sources = source_group.get(rec.guid, [])
            irs = ir_group.get(rec.guid, [])

            receiver_out.Add(rec, path)
            source_out.AddRange(sources, path)
            ir_out.AddRange(irs, path)
            edge_out.AddRange([Line(*src.position, *rec.position) for src in sources], path)

        return ir_out, source_out, receiver_out, edge_out
# ---------- end decirgraph ----------
analyseir = Compas_acousticsAnalyseImpulseResponse(ir=decirgraph.ir)  # -> params
#   port ir: ImpulseResponse (IR) object.
#   port params: List of acoustic parameters ('EDT', 'T20', 'T30', 'C50', 'C80', 'D50', 'DRR', 'Ts', 'STI').
# ---------- analyseir: Python ----------
"""Analyse impulse response (IR) and return acoustic parameters such as EDT, T20, C50, etc."""
# flake8: noqa
import Grasshopper
from compas_acoustics.analyser import AcousticAnalyser
from compas_acoustics import AcousticParameter
from compas_acoustics import Defaults


class AnalyseIR(Grasshopper.Kernel.GH_ScriptInstance):
    def RunScript(self, ir):
        if ir is None:
            ghenv.Component.AddRuntimeMessage(Grasshopper.Kernel.GH_RuntimeMessageLevel.Warning, "Input parameter 'ir' failed to collect data.")
            return None

        analyser = AcousticAnalyser(ir.ir)
        analyser.analyse()

        return [AcousticParameter().from_analyser(analyser, name) for name in Defaults().PARAM_NAMES]
# ---------- end analyseir ----------
item_6 = ListItem(List=analyseir, Index=Slider(1, range=0..10), Wrap=True)
item_7 = ListItem(List=analyseir, Index=Slider(3, range=0..10), Wrap=True)
deparam = Compas_acousticsDeconstructParameter(param=item_6)  # -> name, values, flatten(overall), frequencies
#   port param: AcousticParameter (AP) object.
#   port name: Nmae of the acoustic parameter.
#   port values: Values of the acoustic parameter.
#   port overall: Overall value of the acoustic parameter.
#   port frequencies: Frequencies of the acoustic parameter.
# ---------- deparam: Python ----------
"""Deconstruct acoustic parameter."""
# flake8: noqa
import Grasshopper
from compas_acoustics.analyser import AcousticAnalyser
from compas_acoustics import AcousticParameter
from compas_acoustics import Defaults


class DeconstructParam(Grasshopper.Kernel.GH_ScriptInstance):
    def RunScript(self, param):
        if param is None:
            ghenv.Component.AddRuntimeMessage(Grasshopper.Kernel.GH_RuntimeMessageLevel.Warning, "Input parameter 'param' failed to collect data.")
            return None
        
        return param.title, param.values, param.overall, param.frequencies
# ---------- end deparam ----------
panel_12 = Panel(deparam.name)
deparam_2 = Compas_acousticsDeconstructParameter(param=item_7)  # -> name, values, flatten(overall), frequencies; same code as deparam
panel_13 = Panel(deparam_2.name)
panel_14 = Panel(deparam.overall)
panel_15 = Panel(deparam_2.overall)

# ----
# Display
mesh_2 = Mesh(mjoin)
X = UnitX(Factor=1)
pt_3 = Point(pt_2)
crv_6 = Curve([py3_2.rec, py3_3.rec, py3_4.rec])
crv_7 = Curve([flip_5.Curve, crv_4, crv_3])
medges = MeshEdges(Mesh=mesh_2)  # -> NakedEdges, InteriorEdges, NonManifoldEdges
number_slider_3 = Slider(1.2, range=0..10)
rev = Reverse(Vector=X)
line = LineSDL(Start=pt_3, Direction=rev, Length=Slider(0.47, range=0..1))
swatch = ColourSwatch(SwatchColor=RGB(0, 0, 0))
swatch_2 = ColourSwatch(SwatchColor=RGB(255, 255, 255))
previewlw = CustomPreviewLineweights(Geometry=medges.NakedEdges, Shader=swatch, Thickness=number_slider_3, Absolute=False)
previewlw_2 = CustomPreviewLineweights(Geometry=medges.InteriorEdges, Shader=ColourSwatch(SwatchColor=RGB(255, 255, 255)), Absolute=False)
previewlw_3 = CustomPreviewLineweights(Geometry=crv_6, Shader=swatch, Thickness=number_slider_3, Absolute=False)
previewlw_4 = CustomPreviewLineweights(Geometry=crv_7, Shader=swatch, Thickness=Slider(2, range=0..10), Absolute=False)
dots = DotDisplay(Point=pt_3, Colour=swatch_2, Size=Slider(0.08, range=0..0.1))
vdisex = VectorDisplayEx(Point=pt_3, Vector=line, Colour=swatch_2, Width=2)

# ----
# Auralise
panel_16 = Panel("mono_adult_female_speech.wav")  # disabled
number_slider_4 = Slider(3, range=0..10)  # disabled
py3_6 = Python3Script(name=panel_16)  # -> out, path; inputs name: String; disabled
# ---------- py3_6: Python ----------
import sys
import os

gh_path = ghenv.Component.OnPingDocument().FilePath
dire_path = os.path.dirname(gh_path)
sound_path = os.path.join(dire_path, "sound_files", name)

path = sound_path
# ---------- end py3_6 ----------
item_8 = ListItem(List=flatten(decirgraph.ir), Index=number_slider_4, Wrap=True)  # disabled
stop = Button()  # disabled
play = Button()  # disabled
auralise = Compas_acousticsAuralise(irs=item_8, signals=py3_6.path)  # -> signals; inputs irs: tree, signals: tree, multiconvolve: Boolean, save_file_path: String, save_file_name: String, save: Boolean; disabled
#   port irs: ImpulseResponse object(s)
#   port signals: Optional source signal(s). If not provided, it will take the signal(s) from the Source object(s) in the scene.
#   port multiconvolve: Whether to convolve multiple signals with multiple impulse responses. If False, it will convolve each signal with the corresponding impulse response.
#   port save_file_path: File path to save the convolved signal(s). Default is the current working directory.
#   port save_file_name: File name for the saved convolved signal(s). Default is 'convolved_sound'.
#   port save: Whether to save the convolved signal(s) to a file.
#   port signals: Convolved signal(s).
# ---------- auralise: Python ----------
"""Auralise the room scene by convolving the impulse response with the source signal(s)."""
# flake8: noqa
import Grasshopper
from Grasshopper import DataTree
import numpy as np
import os

from compas_acoustics.auraliser import Auraliser


class Auralise(Grasshopper.Kernel.GH_ScriptInstance):

    def RunScript(self,
            irs: Grasshopper.DataTree[object],
            signals: Grasshopper.DataTree[object],
            multiconvolve: bool,
            save_file_path: str,
            save_file_name: str,
            save: bool):
        if irs is None:
            ghenv.Component.AddRuntimeMessage(
                Grasshopper.Kernel.GH_RuntimeMessageLevel.Warning, "Input parameter 'irs' failed to collect data."
            )
            return
        
        has_signals = signals is not None and signals.DataCount > 0
        if has_signals:
            if irs.BranchCount != signals.BranchCount:
                raise ValueError("DataTree branch count mismatch.")
            if any(len(irs.Branch(i)) != len(signals.Branch(i)) for i in range(irs.BranchCount)):
                raise ValueError("DataTree branch length mismatch.")

        signals_out = DataTree[object]()
        # 1. Data conversions
        for i in range(irs.BranchCount):
            path = irs.Paths[i]

            br = irs.Branch(i)
            sound_files = signals.Branch(i) if has_signals else [ir.source.sound_file for ir in br]

            ir_groups = {}
            sound_groups = {}

            for idx, (IR, sound_file) in enumerate(zip(br, sound_files)):
                receiver_id = str(IR.receiver.guid)

                ir_groups.setdefault(receiver_id, {})
                sound_groups.setdefault(receiver_id, {})
                
                sub_key = f"source_{idx}"

                # ir_data = IR.ir
                ir_data = IR.ir[:, np.newaxis] if IR.ir.ndim == 1 else IR.ir

                ir_groups[receiver_id][sub_key] = {
                    'ir': ir_data,
                    'sample_rate': IR.sample_rate,
                    'ambisonic_order': 0,
                    'channel_order': 'acn',
                    'normalisation': 'sn3d'
                }

                sound_groups[receiver_id][sub_key] = {
                    'filepath': sound_file
                }

            # 2. Construct auraliser(s) and convolve signals
            for i, receiver_id in enumerate(ir_groups.keys()):
                if multiconvolve:
                    tasks = [(receiver_id, ir_groups[receiver_id], sound_groups[receiver_id], f"{i}")]
                else:
                    tasks = [
                        (
                            sub_key,
                            {sub_key: ir_groups[receiver_id][sub_key]},
                            {sub_key: sound_groups[receiver_id][sub_key]},
                            f"{i}_{j}",
                        )
                        for j, sub_key in enumerate(ir_groups[receiver_id].keys())
                    ]
                
                for name, ir_data, sound_data, suffix in tasks:
                    auraliser = Auraliser(
                        name=name,
                        impulse_responses=ir_data,
                        anechoic_sounds=sound_data,
                        output_format="mono",
                        # sample_rate=ir_groups[receiver_id][f"source_{0}"]['sample_rate']
                        sample_rate=48000
                    )
                    convolved_matrix = auraliser.multiconvolution()
                    
                    signals_out.Add(convolved_matrix, path)

                    if save:
                        filepath = self.set_save_file_path(save_file_path, save_file_name, suffix)
                        auraliser.export_convolved_sound(filepath, convolved_matrix)
        return signals_out
    
    @staticmethod
    def set_save_file_path(save_file_path=None, save_file_name=None, suffix=0):
        if save_file_path:
            base_dir = save_file_path
        else:
            base_dir = os.path.dirname(ghenv.Component.OnPingDocument().FilePath)

        if save_file_name:
            base_filename = save_file_name
        else:
            base_filename = "convolved_sound"
        return os.path.join(base_dir, f"{base_filename}_mic_{suffix}.wav")
# ---------- end auralise ----------
player = Compas_acousticsAudioPlayer(sound=auralise, play=play, stop=stop)  # inputs play: Boolean, stop: Boolean; disabled
#   port sound: Audio file path, numpy array, or Source object.
#   port play: Play the audio.
#   port stop: Stop the audio.
# ---------- player: Python ----------
"""Play audio files, accepting .wav, numpy arrays, and Source objects."""
# flake8: noqa
import Grasshopper
import System
from compas_acoustics import AudioPlayer
import scriptcontext as sc
import soundfile as sf


class PlayAudio(Grasshopper.Kernel.GH_ScriptInstance):

    def offer_buttons(self):
        component = ghenv.Component
        offered_key = "audio_player_buttons_offered_{}".format(component.InstanceGuid)
        if sc.sticky.get(offered_key):
            return
        sc.sticky[offered_key] = True

        doc = component.OnPingDocument()
        if doc is None:
            return

        targets = [(index, nickname) for index, nickname in ((1, "Play"), (2, "Stop")) if component.Params.Input[index].SourceCount == 0]
        if not targets:
            return

        def deferred(gh_doc):
            base = component.Attributes.Pivot
            for row, (index, nickname) in enumerate(targets):
                input_param = component.Params.Input[index]
                if input_param.SourceCount > 0:
                    continue

                button = Grasshopper.Kernel.Special.GH_ButtonObject()
                button.CreateAttributes()
                button.NickName = nickname
                button.Attributes.Pivot = System.Drawing.PointF(base.X - 180, base.Y - 15 + row * 30)
                gh_doc.AddObject(button, False)
                input_param.AddSource(button)
                button.ExpireSolution(True)

        doc.ScheduleSolution(1, deferred)

    def RunScript(self, sound, play: bool, stop: bool):
        self.offer_buttons()

        sample_rate = None

        if sound is None:
            return

        if isinstance(sound, str):  # file path
            try:
                sample_rate = sf.info(sound).samplerate
            except:
                pass
        elif hasattr(sound, "sound_file"):  # Source object
            sound = sound.sound_file
            try:
                sample_rate = sf.info(sound).samplerate
            except:
                pass
        elif hasattr(sound, "shape") and hasattr(sound, "ndim"):  # numpy array
            pass
        else:
            ghenv.Component.AddRuntimeMessage(
                Grasshopper.Kernel.GH_RuntimeMessageLevel.Error, "Input parameter 'sound' is not valid."
            )
            return

        player_key = "player"
        if player_key not in sc.sticky:
            sc.sticky[player_key] = AudioPlayer()

        player = sc.sticky[player_key]

        if play:
            player.play(sound, sample_rate)
        if stop:
            player.stop()
# ---------- end player ----------

fitness = Compas_acousticsRegularizedFitness(values=panel_14, target="0.5")  # -> fitness; inputs values: list of Double, target: Double, k: Double
#   port values: A list of numerical values to evaluate.
#   port target: The target value to compare against.
#   port k: A regularization parameter that controls the weight of the STD in the loss function. Default is 1.0.
#   port fitness: The fitness score, a lower value indicates better fitness.
# ---------- fitness: Python ----------
"""A loss function that combines the Mean Absolute Error (MAE) and Standard Deviation (STD) of a list of values with respect to a target value. 
MAE evaluates the Accuracy to the target, while STD evaluates the Consistency of the values. 
The lower the fitness score, the better the fitness."""
# flake8: noqa
import Grasshopper
import System
from compas_acoustics.numerical.fitness import regularized_fitness


class RegularizedFitness(Grasshopper.Kernel.GH_ScriptInstance):
    def RunScript(self,
            values: System.Collections.Generic.List[float],
            target: float,
            k: float):
        if values is None:
            ghenv.Component.AddRuntimeMessage(
                Grasshopper.Kernel.GH_RuntimeMessageLevel.Warning,
                "Input parameter 'values' failed to collect data."
            )
            return
        if target is None:
            ghenv.Component.AddRuntimeMessage(
                Grasshopper.Kernel.GH_RuntimeMessageLevel.Warning,
                "Input parameter 'target' failed to collect data."
            )
            return
        if k is None:
            k = 1.0
        return regularized_fitness(values, target, k)
# ---------- end fitness ----------
fitness_2 = Compas_acousticsRegularizedFitness(values=panel_15, target="7.0")  # -> fitness; inputs values: list of Double, target: Double, k: Double; same code as fitness
panel_17 = Panel(fitness)
panel_18 = Panel(fitness_2)
wlc_target_t20 = Number(fitness)
wlc_target_c50 = Number(fitness_2)
