# Grasshopper definition 102_Outdoor_Canopy.ghx (Grasshopper 1.0.8)
# plug-ins: Opossum2_0_Proto_A

pln = Plane(PlaneXY(122.7538795, -3.740785054, 0))

# ----
# Unamplified outdoor 16-peices chamber srings
button = Button()
reload = Python3Script(reload=button)  # inputs reload: Boolean
# ---------- reload: Python ----------
# venv: rhino_compas_acoustics
# r: compas
# r: pyroomacoustics
# r: matplotlib
# r: librosa
# r: soundfile
# r: sounddevice
# r: sofar
# r: pyfar
# r: pyrato

import sys
import os
from compas_rhino import unload_modules


gh_path = ghenv.Component.OnPingDocument().FilePath
dire_path = os.path.dirname(os.path.dirname(gh_path))
target_path = os.path.join(dire_path, "src")

if target_path not in sys.path:
    sys.path.insert(0, target_path)

if reload:
    unload_modules('compas_acoustics')

try:
    import compas_acoustics as ca
except Exception as e:
    raise ValueError(e)
# ---------- end reload ----------

deplane = DeconstructPlane(Plane=pln)  # -> Origin, XAxis, YAxis, ZAxis
rev = Reverse(Vector=deplane.YAxis)
amp = Amplitude(Vector=rev, Amplitude=Slider(18, range=0..100))
wlc_translations = GenePool(
    Decimals=2,
    Maximum=1.5,
    Minimum=-1,
    Value=[0.38, 0.57, 0.43, 1.13, 1.3, -0.18, 0.7, -0.51, 0.71, 1.09, 0.42, 0.97, 1.24, 1.3, 0.29, -0.05, 1.21, 0.56, 1.4, 0.57, 1.25, 0.8, 0.84, 0.55])

# ----
# Shell geometry
number_slider = Slider(1, range=0..10)
wlc_shell_angle = Slider(111, range=100..145)
wlc_fan_angle = Slider(105, range=80..105)
amp_2 = Amplitude(Vector=deplane.YAxis, Amplitude=number_slider)
move = Move(Geometry=pln, Motion=amp_2)  # -> Geometry, Transform
py3 = Python3Script(
    pln=move.Geometry,
    radius=Slider(5, range=0..10),
    fan_angle=wlc_fan_angle,
    shell_angle=wlc_shell_angle,
    div_arc=Slider(7, range=0..10),
    div_shell=Slider(4, range=0..10))  # -> out, shell; inputs pln: Plane, radius: Double, fan_angle: Double, shell_angle: Double, div_arc: Int32, div_shell: Int32
# ---------- py3: Python ----------
import Rhino.Geometry as rg
import math


class FlatHalfPoints:
    def __init__(self, plane: rg.Plane, points: list[rg.Point3d]):
        self.plane = plane
        self.original_points = [rg.Point3d(p) for p in points]
        self.points = [rg.Point3d(p) for p in points]

    @property
    def mirrored_plane(self):
        return rg.Plane(self.plane.Origin, self.plane.ZAxis, self.plane.YAxis)

    def unfolded_points(self, include=False, sort=False):
        M = rg.Transform.Mirror(self.mirrored_plane)

        def _mirrored(p):
            pt = rg.Point3d(p)
            pt.Transform(M)
            return pt
        
        to_mirror = self.points if include else self.points[1:]
        if sort:
            to_mirror.reverse()

        return [_mirrored(p) for p in to_mirror] + self.points

    def polyline(self, unfold=False):
        pts = self.unfolded_points(include=False, sort=True) if unfold else self.points

        if len(pts) < 2:
            return

        polyline = rg.Polyline()
        polyline.AddRange(pts)
        return polyline

    @classmethod
    def half_arc_points(cls, plane, radius, angle, count):

        if count < 2:
            count = 2

        rad_step = math.radians(angle / (count - 1))
        
        pts = []
        for i in range(count):
            x = radius * math.sin(rad_step * i)
            y = radius * math.cos(rad_step * i)

            pt = plane.PointAt(x, y, 0)
            pts.append(pt)
        return cls(plane, pts)

    def move_control_points(self, amplitudes: list[float], fix_gap=False):
        if len(self.points) - 1 != len(amplitudes):
            raise ValueError("Number of amplitudes is not equalivant to number of points - 1.")

        for i in range(len(self.points) - 1):
            amp = amplitudes[i]
            origin_pt = self.original_points[i]

            dire = origin_pt - self.plane.Origin
            dire.Unitize()

            self.points[i] = origin_pt + (dire * amp)

        if fix_gap:
            p1 = self.points[1]
            dire = self.plane.XAxis
            dist = self.mirrored_plane.DistanceTo(p1)

            self.points[0] = p1 + (dire * dist)

class Shell:
    def __init__(self, point_groups: list[FlatHalfPoints]):
        self.point_groups = point_groups

    @property
    def meshes(self):
        meshes = []

        for i in range(len(self.point_groups) - 1):
            mesh = rg.Mesh()

            curr_pts = self.point_groups[i].points
            next_pts = self.point_groups[i+1].points

            len_pts = len(curr_pts)
            if len(next_pts) != len_pts or len_pts < 3:
                continue

            vts = curr_pts + next_pts[:-1]
            mesh.Vertices.AddVertices(vts)

            for j in range(0, len_pts - 2):
                curr_a = j
                curr_b = j + 1
                next_a = len_pts + j
                next_b = len_pts + (j + 1)

                mesh.Faces.AddFace(curr_a, next_a, curr_b)
                mesh.Faces.AddFace(next_b, curr_b, next_a)
            
            # Add the last tri face
            idx_a = len_pts - 2
            idx_b = 2 * len_pts - 2
            idx_c = len_pts - 1
            mesh.Faces.AddFace(idx_a, idx_b, idx_c)

            meshes.append(mesh)

        return meshes

    @property
    def unfolded_meshes(self):

        all_meshes = []
        
        for mesh, pg in zip(self.meshes, self.point_groups):
            m = mesh.DuplicateMesh()
            M = rg.Transform.Mirror(pg.mirrored_plane)

            m.Transform(M)
            m.Flip(True, True, True)
            m.Append(mesh)

            all_meshes.append(m)

        return all_meshes

    @classmethod
    def create(cls, first_point_group, angle_deg, division):
        rad_step = math.radians(angle_deg / (division - 1))
        
        rot_axis = first_point_group.plane.XAxis
        rot_origin = first_point_group.points[-1]
        
        p_groups = []
        for i in range(division):
            R = rg.Transform.Rotation(rad_step * i, rot_axis, rot_origin)
            pln = rg.Plane(first_point_group.plane)
            pln.Transform(R)
            
            pts = [rg.Point3d(p) for p in first_point_group.points]
            for p in pts:
                p.Transform(R)

            pg = FlatHalfPoints(pln, pts)
            p_groups.append(pg)

        return Shell(p_groups)


# Main API ---------------------------------
half_arc_pts = FlatHalfPoints.half_arc_points(pln, radius, fan_angle, div_arc)

shell = Shell.create(half_arc_pts, shell_angle, div_shell)
# ---------- end py3 ----------
toggle = BooleanToggle(True)
py3_2 = Python3Script(shell=py3.shell, offsets=wlc_translations, fix_gap=Toggle(False))  # -> out, shell; inputs offsets: list of Double, fix_gap: Boolean
# ---------- py3_2: Python ----------
if offsets:
    for idx, pg in enumerate(shell.point_groups):
        len_to_move = len(pg.points) - 1
        start_idx = idx * len_to_move
        offs = offsets[start_idx:start_idx + len_to_move]

        pg.move_control_points(offs, fix_gap=fix_gap)
# ---------- end py3_2 ----------
py3_3 = Python3Script(shell=py3_2.shell, unfold=toggle)  # -> out, points, polylines
# ---------- py3_3: Python ----------
from Grasshopper import DataTree
from Grasshopper.Kernel.Data import GH_Path


points = DataTree[object]()
polylines = DataTree[object]()


for idx, pg in enumerate(shell.point_groups):
    path = GH_Path(idx)

    if unfold:
        points.AddRange(pg.unfolded_points(include=False, sort=True), path)
    else:
        points.AddRange(pg.points, path)
    polylines.Add(pg.polyline(unfold))
# ---------- end py3_3 ----------
py3_4 = Python3Script(shell=py3_2.shell, unfold=toggle)  # -> out, meshes
# ---------- py3_4: Python ----------
from Grasshopper import DataTree
from Grasshopper.Kernel.Data import GH_Path


points = DataTree[object]()
polylines = DataTree[object]()

if unfold:
    meshes = shell.unfolded_meshes
else:
    meshes = shell.meshes
# ---------- end py3_4 ----------
panel = Panel("""0.1
0.07
0.05
0.04
0.04
0.03
0.03""")
clean = CombineClean(Meshes=py3_4.meshes)
branch = TreeBranch(Tree=py3_3.points, Path="0", MaintainPaths=True)
panel_2 = Panel("""0.01
0.04
0.15
0.45
0.77
0.8
0.8""")
pline = PolyLine(Vertices=branch, Closed=invert(False))
mesh = Mesh(clean)
conmat = Compas_acousticsConstructMaterial(absorption=panel, scattering=panel_2, name="stage_reflect")  # -> material; inputs absorption: list of Double, scattering: list of Double, name: String
#   port absorption: List of absorption coefficients for each frequency band. e.g. '0.1, 0.2, 0.3, 0.4, 0.5, 0.6, 0.7' for 7 frequency bands.
#   port scattering: Optional. List of scattering coefficients for each frequency band. e.g. '0.1, 0.2, 0.3, 0.4, 0.5, 0.6, 0.7' for 7 frequency bands.
#   port name: Name of the material preset in the library (e.g. 'concrete', 'carpet').
#   port material: AcousticMaterial object.
# ---------- conmat: Python ----------
"""Create an AcousticMaterial for AcousticObject(s)."""
# flake8: noqa
import Grasshopper
import System
from compas_acoustics.acoustic_material import AcousticMaterial


class ConstructMaterial(Grasshopper.Kernel.GH_ScriptInstance):

    def RunScript(self,
            absorption: System.Collections.Generic.List[float],
            scattering: System.Collections.Generic.List[float],
            name: str):
        if absorption is None:
            ghenv.Component.AddRuntimeMessage(
                Grasshopper.Kernel.GH_RuntimeMessageLevel.Warning,
                "Input parameter 'absorption' failed to collect data."
            )
            return
        if name is None:
            ghenv.Component.AddRuntimeMessage(
                Grasshopper.Kernel.GH_RuntimeMessageLevel.Warning,
                "Input parameter 'name' failed to collect data."
            )
            return

        return AcousticMaterial(
            name=name,
            absorption_coefficients=absorption,
            scattering_coefficients=scattering,
        )
# ---------- end conmat ----------
obj = Compas_acousticsAcousticObject(geometry=mesh, material=conmat, name="stage_floor")  # -> acoustic_object; inputs geometry: GeometryBase, name: String
#   port geometry: Geometry of the AcousticObject.
#   port material: Material of the AcousticObject.
#   port name: Name of the AcousticObject.
#   port acoustic_object: AcousticObject object.
# ---------- obj: Python ----------
"""Create an AcousticObject with the specified geometry and material."""
# flake8: noqa
import Grasshopper
import Rhino
from compas_acoustics.geometry import AcousticObject
from compas_rhino.conversions import mesh_to_compas
from compas_rhino.conversions import polyline_to_compas

# TODO: Change the typeHintID in metadata.json from "mesh" to "geometrybase"

class CreateAcousticObject(Grasshopper.Kernel.GH_ScriptInstance):

    def RunScript(self, geometry: Rhino.Geometry.GeometryBase, material, name: str):

        if geometry is None:
            ghenv.Component.AddRuntimeMessage(
                Grasshopper.Kernel.GH_RuntimeMessageLevel.Warning, "No geometry provided."
            )
            return
        if material is None:
            ghenv.Component.AddRuntimeMessage(
                Grasshopper.Kernel.GH_RuntimeMessageLevel.Warning, "No material provided."
            )
            return

        # Gemetry conversion from Rhino to Compas
        # TODO: Figure out how to handle other geometry types (e.g., Brep, Surface, etc.)
        if isinstance(geometry, Rhino.Geometry.Mesh):
            geometry = mesh_to_compas(geometry)
        elif isinstance(geometry, Rhino.Geometry.Polyline):
            geometry = polyline_to_compas(geometry)
        elif isinstance(geometry, Rhino.Geometry.PolylineCurve):
            geometry = polyline_to_compas(geometry.ToPolyline())
        else:
            ghenv.Component.AddRuntimeMessage(
                Grasshopper.Kernel.GH_RuntimeMessageLevel.Error, "Unsupported geometry type."
            )
            return
        return AcousticObject(acoustic_geometry=geometry, material=material, name=name)
# ---------- end obj ----------
obj_2 = Compas_acousticsAcousticObject(geometry=pline, material=conmat, name="stage")  # -> acoustic_object; inputs geometry: GeometryBase, name: String; same code as obj
merge = Merge(Data1=obj, Data2=obj_2)

move_2 = Move(Geometry=pln, Motion=amp)  # -> Geometry, Transform
number_slider_2 = Slider(65, range=0..100)

repeat = RepeatData(Data="1", Length="7")
repeat_2 = RepeatData(Data="0", Length="7")
conmat_2 = Compas_acousticsConstructMaterial(absorption=repeat, scattering=repeat_2, name="air")  # -> material; inputs absorption: list of Double, scattering: list of Double, name: String; same code as conmat

panel_3 = Panel("""0.15
0.25
0.40
0.60
0.75
0.85
0.90""")
panel_4 = Panel("""0.10
0.15
0.25
0.35
0.50
0.65
0.75""")
conmat_3 = Compas_acousticsConstructMaterial(absorption=panel_3, scattering=panel_4, name="grass")  # -> material; inputs absorption: list of Double, scattering: list of Double, name: String; same code as conmat

# ----
# Simulation Boundary
number_slider_3 = Slider(60, range=0..100)
py3_5 = Python3Script(base_pln=move_2.Geometry, width=number_slider_3, depth=Slider(60, range=0..100), height="9")  # -> out, box; inputs base_pln: Plane, width: Double, depth: Double, height: Double
# ---------- py3_5: Python ----------
import Rhino.Geometry as rg


box = rg.Box(
    base_pln,
    rg.Interval(- width / 2, width / 2),
    rg.Interval(- depth / 2, depth / 2),
    rg.Interval(-1, height - 1)
)
# ---------- end py3_5 ----------
smesh = SimpleMesh(Brep=py3_5.box)
faceb = FaceBoundaries(Mesh=smesh)
cull_i = CullIndex(List=faceb, Indices="4", Wrap=True)
item = ListItem(List=faceb, Index="4", Wrap=True)
obj_3 = Compas_acousticsAcousticObject(geometry=cull_i, material=conmat_2)  # -> acoustic_object; inputs geometry: GeometryBase, name: String; same code as obj
obj_4 = Compas_acousticsAcousticObject(geometry=item, material=conmat_3)  # -> acoustic_object; inputs geometry: GeometryBase, name: String; same code as obj
merge_2 = Merge(Data1=obj_3, Data2=obj_4)  # -> flatten(Result)

chamber_strings_16 = Compas_acousticsOrchestraLayout(plane=pln)  # -> points, names; inputs plane: Plane
#   port plane: Plane the layout is built on. Defaults to WorldXY if omitted.
#   port points: Named performer positions.
#   port names: Names matching each point, e.g. 'violin_1'.
# ---------- chamber_strings_16: Python ----------
"""Named performer positions for a standard string ensemble formation, for use as Source/Receiver positions.

Options:
- string_quartet (4 players)
- chamber_strings (16 players)
- chamber_strings_24 (24 players)
- symphonic_strings_50 (50 players)"""
# flake8: noqa
import Grasshopper
import Rhino
from Rhino.Geometry import Point3d
from System.Windows.Forms import ToolStripSeparator

from compas_rhino.conversions import plane_to_compas_frame

from compas_acoustics.orchestra_layouts import (
    string_quartet,
    chamber_strings,
    medium_chamber_strings,
    symphonic_strings,
)


class OrchestraLayoutSelector(Grasshopper.Kernel.GH_ScriptInstance):
    LAYOUTS = {
        "string_quartet_4": string_quartet,
        "chamber_strings_16": chamber_strings,
        "chamber_strings_24": medium_chamber_strings,
        "symphonic_strings_50": symphonic_strings,
    }
    ITEMS = list(LAYOUTS.keys())

    def __init__(self):
        super().__init__()
        nickname = ghenv.Component.NickName
        self.layout_name = nickname if nickname in self.ITEMS else None

    def RunScript(self, plane: Rhino.Geometry.Plane):
        if self.layout_name not in self.ITEMS:
            ghenv.Component.AddRuntimeMessage(
                Grasshopper.Kernel.GH_RuntimeMessageLevel.Remark, "Right-click the icon to choose an orchestra layout."
            )
            ghenv.Component.Message = None
            return

        ghenv.Component.Message = self.layout_name
        frame = plane_to_compas_frame(plane) if plane is not None else None

        layout_fn = self.LAYOUTS[self.layout_name]
        points, names = layout_fn(frame)
        return [Point3d(*p) for p in points], names
    
    def AppendAdditionalMenuItems(self, menu):
        for name in self.ITEMS:
            item = menu.Items.Add(name, None, self.on_item_click)
            item.Checked = (name == self.layout_name)

        menu.Items.Add(ToolStripSeparator())

    def on_item_click(self, sender, event_info):
        name = str(sender)
        if name == self.layout_name:
            return
        self.layout_name = name
        ghenv.Component.NickName = name
        ghenv.Component.ExpireSolution(True)
# ---------- end chamber_strings_16 ----------

# ----
# Audiences (1m space)
number_slider_4 = Slider(1, range=0..2)
pi = Pi(Factor=1)
prot = RotatePlane(Plane=pln, Angle=pi)
py3_6 = Python3Script(
    pln=prot,
    dist_min="7.0",
    dist_max=Slider(40, range=0..100),
    theta_fan=Slider(90, range=60..100),
    row_spacing=Slider(1, range=0..2),
    seat_spacing=number_slider_4,
    height="-0.4")  # -> out, fan_grid, b; inputs pln: Plane, dist_min: Double, dist_max: Double, theta_fan: Double, row_spacing: Double, seat_spacing: Double, height: Double
# ---------- py3_6: Python ----------
import math
from Grasshopper import DataTree
from Grasshopper.Kernel.Data import GH_Path
import Rhino.Geometry as rg


class FanGrid:
    def __init__(self, plane, height, d_min, d_max, theta_deg, row_spacing, seat_spacing):
        self.plane = plane
        self.height = height
        self.d_min = d_min
        self.d_max = d_max
        self.theta_deg = theta_deg
        self.row_spacing = row_spacing
        self.seat_spacing = seat_spacing

        self.points = []

    @property
    def theta_rad(self):
        return math.radians(self.theta_deg)

    @property
    def total_depth(self):
        return max(0.1, self.d_max - self.d_min)

    @property
    def n_rows(self):
        return int(self.total_depth // self.row_spacing + 1)

    @property
    def ns_seats_and_radius(self):
        ns = []
        rs = []

        for i in range(self.n_rows):
            r = self.d_min + i * self.row_spacing
            if r > self.d_max:
                r = self.d_max

            # Arc length at this radius
            arc_len = r * self.theta_rad
            n_seat = int(math.ceil(arc_len / self.seat_spacing) + 1)

            ns.append(n_seat)
            rs.append(r)
        return ns, rs
    
    @staticmethod
    def point_on_plane(plane, x, y, z):
        return plane.PointAt(x, y, z)

    @property
    def grid(self):
        ns_seats, rs = self.ns_seats_and_radius

        point_group = {}

        for row_idx in range(self.n_rows):
            n_seats = ns_seats[row_idx]

            point_group.setdefault(row_idx, [])

            for s_idx in range(n_seats):
                # t value from -1.0 to 1.0
                t = -1.0 + (2.0 / (ns_seats[row_idx] - 1) * s_idx)
                angle = t * (self.theta_rad / 2.0)

                # Local coordinates
                lx = rs[row_idx] * math.sin(angle)
                ly = rs[row_idx] * math.cos(angle)
                lz = self.height

                pt = self.point_on_plane(self.plane, lx, ly, lz)
                point_group[row_idx].append(pt)

        return point_group

    @property
    def half_grid(self):
        point_group = self.grid

        ns_seats, _ = self.ns_seats_and_radius
        half_ns = [int(n // 2.0 + 1) if n % 2 == 1 else int(n // 2.0) for n in ns_seats]

        return {k: vs[:half_ns[k]] for k, vs in point_group.items()}

    def mirror_half_grid_and_spls(self, spls_tree):
        ns_seats, _ = self.ns_seats_and_radius

        mirrored = []
        for n_seats, spls in zip(ns_seats, spls_tree):
            if n_seats % 2 == 0:
                all_spls = spls + list(reversed(spls))
            else:
                all_spls = spls[:-1] + list(reversed(spls))
            mirrored.append(all_spls)
        return mirrored

fan_grid = FanGrid(
    plane=pln,
    height=height,
    d_min=dist_min,
    d_max=dist_max,
    theta_deg=theta_fan,
    row_spacing=row_spacing,
    seat_spacing=seat_spacing
)

point_group = fan_grid.half_grid

b = DataTree[rg.Point3d]()
for row_idx, points in point_group.items():
    path = GH_Path(row_idx)
    b.AddRange(points, path)
# ---------- end py3_6 ----------
pt = Point(py3_6.b)
receiver = Compas_acousticsReceiver(position=pt)  # -> receiver; inputs position: Point3d, name: String
#   port position: Position of the receiver.
#   port name: Name of the receiver.
#   port receiver: Receiver object.
# ---------- receiver: Python ----------
"""Acoustic Receiver object (microphone, human ear, etc.)."""
# flake8: noqa
import Grasshopper
import Rhino
from compas_acoustics import Receiver

# TODO: Implement direction
class CreateReceiver(Grasshopper.Kernel.GH_ScriptInstance):

    def RunScript(self, position: Rhino.Geometry.Point3d, name: str):
        if position is None:
            position = Rhino.Geometry.Point3d(0, 0, 1)
        if name is None:
            name = "my_receiver"

        return Receiver(name, *position)
# ---------- end receiver ----------

# ----
# Source
avr = Average(Input=chamber_strings_16.points)
pdecon = Deconstruct(Point=avr)  # -> XComponent, YComponent, ZComponent
pdecon_2 = Deconstruct(Point=deplane.Origin)  # -> XComponent, YComponent, ZComponent
pt_2 = ConstructPoint(XCoordinate=pdecon_2.XComponent, YCoordinate=pdecon.YComponent, ZCoordinate=pdecon.ZComponent)
omnidirectional = Compas_acousticsDirectivity()  # -> directivity
#   port directivity: Directivity pattern.
# ---------- omnidirectional: Python ----------
"""Preset picker for directivity patterns. Right-click to choose a pattern from the available options."""
# flake8: noqa
import Grasshopper
from System.Windows.Forms import ToolStripSeparator
from compas_acoustics.materials_library import MaterialsLibrary


class DirectivitySelector(Grasshopper.Kernel.GH_ScriptInstance):
    ITEMS = ["Bidirectional", "Hypercardioid", "Supercardioid", "Cardioid", "Omnidirectional"]

    def __init__(self):
        super().__init__()
        nickname = ghenv.Component.NickName
        self.directivity_name = nickname if nickname in self.ITEMS else None

    def RunScript(self):
        names = self.ITEMS
        if not names:
            ghenv.Component.AddRuntimeMessage(
                Grasshopper.Kernel.GH_RuntimeMessageLevel.Error, "No directivity patterns found."
            )
            return None

        if self.directivity_name not in names:
            ghenv.Component.AddRuntimeMessage(
                Grasshopper.Kernel.GH_RuntimeMessageLevel.Remark, "Right-click the icon to choose a directivity pattern."
            )
            ghenv.Component.Message = None
            return None

        ghenv.Component.Message = self.directivity_name
        return self.directivity_name.lower()

    def AppendAdditionalMenuItems(self, menu):
        for name in self.ITEMS:
            item = menu.Items.Add(name, None, self.on_item_click)
            item.Checked = (name == self.directivity_name)

        menu.Items.Add(ToolStripSeparator())

    def on_item_click(self, sender, event_info):
        name = str(sender)
        if name == self.directivity_name:
            return
        self.directivity_name = name
        ghenv.Component.NickName = name
        ghenv.Component.ExpireSolution(True)
# ---------- end omnidirectional ----------
source = Compas_acousticsSource(position=pt_2, directivity=omnidirectional, name="test_spl_src")  # -> source; inputs position: Point3d, direction: Vector3d, directivity: String, name: String, sound_file: String
#   port position: Position of the source.
#   port direction: Direction of the source.
#   port directivity: Directivity of the source. Default is Omnidirectional. Options: - Bidirectional - Hypercardioid - Supercardioid - Cardioid - Omnidirectional
#   port name: Name of the source.
#   port sound_file: Sound file associated with the source.
#   port source: Source object.
# ---------- source: Python ----------
"""Acoustic Source object (speaker, human, etc.)."""
# flake8: noqa
import Grasshopper
import Rhino
from compas_acoustics import Source


class CreateSource(Grasshopper.Kernel.GH_ScriptInstance):
    ITEMS = ["bidirectional", "hypercardioid", "supercardioid", "cardioid", "omnidirectional"]

    def RunScript(self,
            position: Rhino.Geometry.Point3d,
            direction: Rhino.Geometry.Vector3d,
            directivity: str,
            name: str,
            sound_file: str):
        if position is None:
            position = Rhino.Geometry.Point3d(0, 0, 0)
        if direction is None:
            direction = Rhino.Geometry.Vector3d(1, 0, 0)

        if directivity is None:
            dirt = "omnidirectional"
        elif directivity not in self.ITEMS:
            ghenv.Component.AddRuntimeMessage(
                Grasshopper.Kernel.GH_RuntimeMessageLevel.Error, "Input parameter 'directivity' is not valid."
            )
            return None
        else:
            dirt = directivity

        if name is None:
            name = "my_source"

        return Source(
            name,
            *position,
            directivity=dirt,
            direction=[*direction],
            sound_file=sound_file
        )
# ---------- end source ----------

movopossum_3_2_0 = Opossum(
    OpossumData_OptimizationType=0,
    OpossumData_ResultSerializationStatus=0,
    OpossumData_objective=[wlc_maximize_receiver_count, wlc_spl_continuity, wlc_target_st1],
    OpossumData_variable=[wlc_fan_angle, wlc_shell_angle, wlc_translations])
merge_3 = Merge(Data1=merge_2, Data2=merge)

# ----
# Scene for simulating SPL
scene = Compas_acousticsRoomScene(objects=flatten(merge_3), sources=flatten(source), receivers=flatten(receiver))  # -> scene; inputs objects: list, sources: list, receivers: list, name: String
#   port objects: List of AcousticObject
#   port sources: List of Source objects.
#   port receivers: List of Receiver objects.
#   port name: Name of the room scene.
#   port scene: Room scene object.
# ---------- scene: Python ----------
"""Create a room scene with the specified objects, sources, and receivers."""
# flake8: noqa
import Grasshopper

import System
from compas_acoustics.scene import Scene
from compas_acoustics.source import Source
from compas_acoustics.receiver import Receiver


class CreateModelScene(Grasshopper.Kernel.GH_ScriptInstance):

    def RunScript(self,
            objects: System.Collections.Generic.List[object],
            sources: System.Collections.Generic.List[object],
            receivers: System.Collections.Generic.List[object],
            name: str):

        if objects is None:
            ghenv.Component.AddRuntimeMessage(
                Grasshopper.Kernel.GH_RuntimeMessageLevel.Warning, "No objects provided."
            )
            return
        if sources is None:
            ghenv.Component.AddRuntimeMessage(
                Grasshopper.Kernel.GH_RuntimeMessageLevel.Warning, "No sources provided."
            )
            return
        if receivers is None:
            ghenv.Component.AddRuntimeMessage(
                Grasshopper.Kernel.GH_RuntimeMessageLevel.Warning, "No receivers provided."
            )
            return

        scene = Scene(name=name)
        scene.add_acoustic_objects(objects)
        for src in sources:
            if isinstance(src, Source):
                scene.add_source(src)
            else:
                ghenv.Component.AddRuntimeMessage(
                    Grasshopper.Kernel.GH_RuntimeMessageLevel.Error,
                    f"Invalid source type: {type(src)}. Expected a Source object.",
                )
        for rcv in receivers:
            if isinstance(rcv, Receiver):
                scene.add_receiver(rcv)
            else:
                ghenv.Component.AddRuntimeMessage(
                    Grasshopper.Kernel.GH_RuntimeMessageLevel.Error,
                    f"Invalid receiver type: {type(rcv)}. Expected a Receiver object.",
                )

        return scene
# ---------- end scene ----------

# ----
# Sound Pressure levels by ISM
number_slider_5 = Slider(85, range=0..150)
expression = Expression(x=number_slider_4, Expression="x * 0.6")
splsfromimagesourcemethod = Python3Script(
    scene=scene,
    ref_db=number_slider_5,
    target_db=Slider(45, range=0..150),
    radius=expression,
    max_order=Slider(2, range=0..2))  # -> out, spls; inputs ref_db: Double, target_db: Double, radius: Double, max_order: Int32
# ---------- splsfromimagesourcemethod: Python ----------
import numpy as np
from compas_acoustics.pra_converter import source_to_pra
from compas_acoustics.pra_converter import receivers_to_pra_mic_array
from compas_acoustics.pra_converter import scene_to_pra_room

def spls_from_image_source_method(room, sources, receivers, start_db, target_db, time_window=0.125):
    """
    Deterministic alternative to trace_rays_to_receivers, for use inside
    optimization loops where a noisy, n_rays-dependent objective is a
    problem: uses pyroomacoustics's compiled image-source engine to find
    every exact specular reflection path from each source to each receiver,
    up to room.max_order. No random sampling -- the same geometry always
    gives the same result.

    room must have been constructed with the reflection order you want,
    e.g. `scene_to_pra_room(scene, fs, max_order=3, ...)` -- max_order
    is baked into the compiled room engine at construction and cannot be
    changed on the room object afterwards.

    Parameters
    ----------
    time_window : float, default=0.125
        Only image sources arriving within this many seconds of the direct
        sound are summed into a receiver's total SPL. Without this, every
        visible image up to room.max_order gets summed as if it arrived
        simultaneously -- physically fine as *total energy*, but not what
        "SPL" means: a real meter (and human loudness perception) integrates
        over a short window, not the full reflection sequence, which is why
        that gave inflated readings especially close to the shell (more
        higher-order images are geometrically visible there, arriving well
        after the direct sound). The default, 0.125 s, is the IEC 61672
        "Fast" time constant -- the standard approximation of how long
        loudness perception actually integrates over.
    """
    for rcv in receivers:
        rcv.received_spls = []

    for source in sources:
        room.add_soundsource(source_to_pra(source))
    room.add_microphone_array(receivers_to_pra_mic_array(receivers, sample_rate=room.fs))

    room.image_source_model()

    sound_speed = float(getattr(room, 'c', 343.0))
    rcv_positions = np.array([rcv.position for rcv in receivers], dtype=float)
    rcv_radii = np.array([rcv.radius for rcv in receivers], dtype=float)

    for si, src in enumerate(room.sources):
        n_images = src.images.shape[1]
        if n_images == 0:
            continue

        # damping is amplitude-domain; square + band-average to get the
        # broadband energy reflection coefficient, matching how absorption
        # is averaged everywhere else in this module.
        energy_damping = np.mean(src.damping ** 2, axis=0)
        damping_db = 10.0 * np.log10(np.maximum(energy_damping, 1e-30))
        visible = np.asarray(room.visibility[si]).astype(bool)

        # Every (receiver, image source) pair at once: (n_receivers, n_images).
        diffs = src.images[None, :, :] - rcv_positions[:, :, None]
        distances = np.linalg.norm(diffs, axis=1)
        # Clamp to each receiver's own radius -- see the same clamp in
        # trace_rays_to_receivers for why (spl_at_distance is unbounded as
        # distance -> 0, and a receiver isn't a point).
        distances = np.maximum(distances, rcv_radii[:, None])

        arrival_time = distances / sound_speed
        within_window = arrival_time <= time_window

        spl_dist_drop = 20.0 * np.log10(distances / 1.0)  # spherical spread start at 1 meter
        raw_spls = start_db - spl_dist_drop + damping_db[None, :]
        mask = visible & within_window & (raw_spls > target_db)

        rows, cols = np.nonzero(mask)
        for m, k in zip(rows, cols):
            receivers[m].received_spls.append(float(raw_spls[m, k]))

    return [rcv.total_spl for rcv in receivers]


# Main code
room = scene_to_pra_room(
    scene, 16000, max_order=max_order, ray_tracing=False, air_absorption=False
)
sources = scene.sources
receivers = scene.receivers

if radius is not None:
    for rcv in receivers:
        rcv.radius = radius

spls = spls_from_image_source_method(
    room, sources, receivers, ref_db, target_db
)
# ---------- end splsfromimagesourcemethod ----------

# ----
# Display Result
toggle_2 = BooleanToggle(True)
unflatten = UnflattenTree(Tree=splsfromimagesourcemethod.spls, Guide=pt)
py3_7 = Python3Script(fan_grid=py3_6.fan_grid, spls_tree=unflatten, as_tree=toggle_2)  # -> out, points, spls; inputs spls_tree: tree, as_tree: Boolean
# ---------- py3_7: Python ----------
from Grasshopper import DataTree
from Grasshopper.Kernel.Data import GH_Path


point_group = fan_grid.grid

if as_tree:
    points = DataTree[object]()
    spls = DataTree[object]()

    for i, pts in enumerate(point_group.values()):
        path = GH_Path(i)
        points.AddRange(pts, path)

    spls_tree = [list(spls_tree.Branch(path)) for path in spls_tree.Paths]
    new_spls = fan_grid.mirror_half_grid_and_spls(spls_tree)

    for i, spl_list in enumerate(new_spls):
        path = GH_Path(i)
        spls.AddRange(spl_list, path)

else:
    points = [p for pts in point_group.values() for p in pts]

    spls_tree = [list(spls_tree.Branch(path)) for path in spls_tree.Paths]

    new_spls = fan_grid.mirror_half_grid_and_spls(spls_tree)
    spls = [spl for lst in new_spls for spl in lst]
# ---------- end py3_7 ----------
gradient = Gradient(
    LowerLimit=number_slider_5,
    UpperLimit=Slider(50, range=0..100),
    Parameter=flatten(py3_7.spls),
    stops=[0: RGB(234, 38, 0), 0.25: RGB(234, 126, 0), 0.5: RGB(254, 244, 84), 0.75: RGB(173, 203, 249), 1: RGB(75, 107, 169)])
del = DelaunayMesh(Points=flatten(py3_7.points), Plane=pln)
py3_8 = Python3Script(pts=flatten(py3_7.points), spls=flatten(py3_7.spls), target_db=Slider(65, range=0..100))  # -> out, spls_out, pts_out; inputs pts: list of Point3d, spls: list, target_db: Double
# ---------- py3_8: Python ----------
result = [(pt, spl) for pt, spl in zip(pts, spls) if spl >= target_db]

pts_out, spls_out = map(list, zip(*result)) if result else ([], [])
# ---------- end py3_8 ----------
lng = ListLength(List=py3_8.pts_out)
panel_5 = Panel(lng)
mcol = MeshColours(Mesh=del, Colours=gradient)

pts = Point(py3_7.points)
spls = Number(py3_7.spls)

# ----
# OBJ 1: Maximize number of seats
# (above 65 dB)
py3_9 = Python3Script(pts=pts, spls=spls, target_db=number_slider_2)  # -> out, spls_out, pts_out; inputs pts: list of Point3d, spls: list, target_db: Double; same code as py3_8
pt_3 = Point(flatten(py3_9.pts_out))
lng_2 = ListLength(List=pt_3)
panel_6 = Panel(lng_2)
neg = Negative(Value=lng_2)
wlc_maximize_receiver_count = Number(neg)

# ----
# OBJ 2: Continuity of Seats in Row
number_slider_6 = Slider(1, range=0..1)
number_slider_7 = Slider(2, range=0..10)
py3_10 = Python3Script(spls=spls, target_db=number_slider_2, k=number_slider_6)  # -> out, fragment; inputs spls: tree, target_db: Double, k: Double
# ---------- py3_10: Python ----------
# In-row Continuity

def monotonic_falloff_penalty(values):
    n = len(values)
    if n < 2:
        return 0.0

    return sum(
        max(0.0, values[i+1] - values[i]) ** 2
        for i in range(n - 1)
    )

def row_holes_penalty(mask_list):
    total_frag = 0.0

    for row in mask_list:
        n = len(row)
        if n == 0:
            continue
        
        half = row[n // 2 :]
        if sum(1 for v in half if v == 1) < 3:
            continue
        
        # Find the edgest valid mask 
        last_valid_idx = (len(half) - 1) - half[::-1].index(1)

        hole_count = sum(1 for v in half[: last_valid_idx + 1] if v == 0)
        
        frag = (hole_count / float(len(half)))
        total_frag += frag

    return total_frag


dic = {
    "coverage_ratios": [],
    "valid_masks": [],
}

for row_idx, path in enumerate(spls.Paths):
    row = spls.Branch(path)

    if not row:
        continue

    # 1 is valid, 0 is invalid
    valid_mask = [1 if spl >= target_db else 0 for spl in row]

    valid_count = sum(valid_mask)

    # Coverage ratio in each row
    cover_ratio = valid_count / len(row)

    dic["coverage_ratios"].append(cover_ratio)
    dic["valid_masks"].append(valid_mask)


mono = monotonic_falloff_penalty(dic["coverage_ratios"])
patch = row_holes_penalty(dic["valid_masks"])

k = k if k else 1.0

fragment = mono + k * patch

print (mono, patch)
print (fragment)
# ---------- end py3_10 ----------
panel_7 = Panel(py3_10.fragment)
wlc_spl_continuity = Number(py3_10.fragment)

panel_8 = Panel(py3_10.out)
number_slider_8 = Slider(70, range=0..100)

srf = Surface(item)
mesh_2 = Mesh(mesh)
preview = CustomPreview(Geometry=srf, Material=ColourSwatch(SwatchColor=RGB(204, 255, 206)))
preview_2 = CustomPreview(Geometry=mesh_2, Material=ColourSwatch(SwatchColor=RGB(143, 143, 143)))
mesh_3 = Mesh(mcol)
dots = DotDisplay(Point=py3_8.pts_out, Colour=ColourSwatch(SwatchColor=RGB(61, 61, 61)), Size=0.2)

# ----
# OBJ 3: Target Early Stage Support to -14 dB
panel_9 = Panel("-14")

amp_3 = Amplitude(Vector=deplane.YAxis, Amplitude="-1.0")
pt_4 = Point(chamber_strings_16.points)
move_3 = Move(Geometry=pt_4, Motion=amp_3)  # -> Geometry, Transform
txt = Text(chamber_strings_16.names)
source_2 = Compas_acousticsSource(position=pt_4, name=txt)  # -> source; inputs position: Point3d, direction: Vector3d, directivity: String, name: String, sound_file: String; same code as source
receiver_2 = Compas_acousticsReceiver(position=move_3.Geometry, name=txt)  # -> receiver; inputs position: Point3d, name: String; same code as receiver

# ---- group: *I hacked the script. Needs another comp Multi Scene
scene_2 = Compas_acousticsRoomScene(objects=flatten(merge_3), src=source_2, rcv=receiver_2)  # -> scene; inputs objects: list, name: String
#   port objects: List of AcousticObject
#   port src: List of Source objects.
#   port rcv: List of Receiver objects.
#   port name: Name of the room scene.
#   port scene: Room scene object.
# ---------- scene_2: Python ----------
"""Create a room scene with the specified objects, sources, and receivers."""
# flake8: noqa
import Grasshopper

import System
from compas_acoustics.scene import Scene
from compas_acoustics.source import Source
from compas_acoustics.receiver import Receiver


class CreateModelScene(Grasshopper.Kernel.GH_ScriptInstance):

    def RunScript(self,
            objects: System.Collections.Generic.List[object],
            src,
            rcv,
            name: str):

        if objects is None:
            ghenv.Component.AddRuntimeMessage(
                Grasshopper.Kernel.GH_RuntimeMessageLevel.Warning, "No objects provided."
            )
            return

        scene = Scene(name=name)
        scene.add_acoustic_objects(objects)

        scene.add_source(src)
        scene.add_receiver(rcv)
        return scene
# ---------- end scene_2 ----------

# ----
simrt = Compas_acousticsSimulateRayTracing(
    scene=scene_2,
    max_order="2",
    n_rays=Slider(1000, range=0..1000),
    absorb_air=Toggle(False),
    energy_thres="1e-04",
    time_thres=Slider(0.2, range=0..1),
    seed=Slider(4, range=0..10))  # -> ir_graph; inputs sample_rate: Int32, max_order: Int32, n_rays: Int32, absorb_air: Boolean, energy_thres: Double, time_thres: Double, seed: Int32
#   port scene: Room scene object.
#   port sample_rate: Sample rate for the simulation.
#   port max_order: Maximum order of image sources.
#   port n_rays: Number of rays for ray tracing.
#   port absorb_air: Whether to consider air absorption.
#   port energy_thres: Energy threshold for ray tracing.
#   port time_thres: Time threshold for ray tracing.
#   port seed: Random seed for reproducibility.
#   port ir_graph: Impulse response graph structure.
# ---------- simrt: Python ----------
"""Simulate room acoustics using Image Source Method (ISM) and Ray Tracing (RT) to generate impulse response graph structure."""
# flake8: noqa
import Grasshopper

from compas_acoustics.simulator import Simulator

class SimulateRayTracing(Grasshopper.Kernel.GH_ScriptInstance):

    def RunScript(self,
            scene,
            sample_rate: int,
            max_order: int,
            n_rays: int,
            absorb_air: bool,
            energy_thres: float,
            time_thres: float,
            seed: int):

        if scene is None:
            ghenv.Component.AddRuntimeMessage(
                Grasshopper.Kernel.GH_RuntimeMessageLevel.Warning, "Input parameter 'scene' failed to collect data."
            )
            return

        if max_order is None:
            max_order = 2
        if n_rays is None:
            n_rays = 1000
        if absorb_air is None:
            absorb_air = True
        if energy_thres is None:
            energy_thres = 1e-7
        if time_thres is None:
            time_thres = 10.0

        sim = Simulator(scene)
        if sample_rate is not None:
            sim.sampling_rate = sample_rate

        sim.rir_from_ray_tracing(
            image_source_order=max_order,
            n_rays=n_rays,
            air_absorption=absorb_air,
            energy_thres=energy_thres,
            time_thres=time_thres,
            random_seed=seed,
        )

        ghenv.Component.Message = "{}Hz, order={}, rays={}, air={}, seed={}, energy_thres={}, time_thres={}".format(
            sim.sampling_rate, max_order, n_rays, absorb_air, seed if seed is not None else "random", energy_thres, time_thres
        )

        return sim.scene.ir_graph
# ---------- end simrt ----------
deirgraph = Compas_acousticsDeconstructIRGraph(ir_graph=simrt)  # -> ir, sources, receivers, edges; inputs receiver_idx: list of Int32
#   port ir_graph: Impulse response graph structure.
#   port receiver_idx: Index(s) of the receiver(s) to filter.
#   port ir: ImpulseResponse object(s).
#   port sources: Source object(s).
#   port receivers: Receiver object(s).
#   port edges: Relationships between sources and receivers as Line(s).
# ---------- deirgraph: Python ----------
"""Deconstruct impulse response graph structure into ImpulseResponse(s)."""
# flake8: noqa
import Grasshopper
from Grasshopper import DataTree
from Grasshopper.Kernel.Data import GH_Path
from Rhino.Geometry import Line
import System

class DeconstructIRGraph(Grasshopper.Kernel.GH_ScriptInstance):

    def RunScript(self,
            ir_graph,
            receiver_idx: System.Collections.Generic.List[int]):

        if ir_graph is None:
            ghenv.Component.AddRuntimeMessage(
                Grasshopper.Kernel.GH_RuntimeMessageLevel.Warning, "Input parameter 'ir_graph' failed to collect data."
            )

        ir_out = DataTree[object]()
        source_out = DataTree[object]()
        receiver_out = DataTree[object]()
        edge_out = DataTree[object]()

        # 1. Set order of receivers
        receiver_list = [
            ir_graph.node_attribute(node, 'data')
            for node in ir_graph.nodes()
            if ir_graph.node_attribute(node, 'type') == 'receiver'
        ]
        receiver_set = {rec.guid for rec in receiver_list}

        # 2. Make ir group as {receiver_0: [src_0, ...], ...}
        source_group = {}
        ir_group = {}

        for u, v in ir_graph.edges():
            ir = ir_graph.edge_attribute((u, v), 'data')
            data_u = ir_graph.node_attribute(u, 'data')
            data_v = ir_graph.node_attribute(v, 'data')

            if data_u.guid in receiver_set:
                rec, src = data_u, data_v
            elif data_v.guid in receiver_set:
                rec, src = data_v, data_u
            else:
                continue
            
            source_group.setdefault(rec.guid, []).append(src)
            ir_group.setdefault(rec.guid, []).append(ir)

        # 3. Filter receiver, optional
        if receiver_idx is None:
            indices = list(range(len(receiver_list)))
        else:
            indices = receiver_idx  # Already set to list access

        for idx in indices:
            rec = receiver_list[idx]
            path = GH_Path(idx)

            sources = source_group.get(rec.guid, [])
            irs = ir_group.get(rec.guid, [])

            receiver_out.Add(rec, path)
            source_out.AddRange(sources, path)
            ir_out.AddRange(irs, path)
            edge_out.AddRange([Line(*src.position, *rec.position) for src in sources], path)

        return ir_out, source_out, receiver_out, edge_out
# ---------- end deirgraph ----------
clean_2 = CleanTree(RemoveNulls=True, RemoveInvalid=True, RemoveEmpty=False, Tree=deirgraph.ir)

py3_11 = Python3Script(ir=clean_2)  # -> out, st1
# ---------- py3_11: Python ----------
from compas_acoustics import stage_acoustics as sa


st1 = sa.compute_ST1(ir)
# ---------- end py3_11 ----------
fitness = Compas_acousticsRegularizedFitness(values=py3_11.st1, target=panel_9)  # -> fitness; inputs values: list of Double, target: Double, k: Double
#   port values: A list of numerical values to evaluate.
#   port target: The target value to compare against.
#   port k: A regularization parameter that controls the weight of the STD in the loss function. Default is 1.0.
#   port fitness: The fitness score, a lower value indicates better fitness.
# ---------- fitness: Python ----------
"""A loss function that combines the Mean Absolute Error (MAE) and Standard Deviation (STD) of a list of values with respect to a target value. 
MAE evaluates the Accuracy to the target, while STD evaluates the Consistency of the values. 
The lower the fitness score, the better the fitness."""
# flake8: noqa
import Grasshopper
import System
from compas_acoustics.numerical.fitness import regularized_fitness


class RegularizedFitness(Grasshopper.Kernel.GH_ScriptInstance):
    def RunScript(self,
            values: System.Collections.Generic.List[float],
            target: float,
            k: float):
        if values is None:
            ghenv.Component.AddRuntimeMessage(
                Grasshopper.Kernel.GH_RuntimeMessageLevel.Warning,
                "Input parameter 'values' failed to collect data."
            )
            return
        if target is None:
            ghenv.Component.AddRuntimeMessage(
                Grasshopper.Kernel.GH_RuntimeMessageLevel.Warning,
                "Input parameter 'target' failed to collect data."
            )
            return
        if k is None:
            k = 1.0
        return regularized_fitness(values, target, k)
# ---------- end fitness ----------
wlc_target_st1 = Number(fitness)
panel_10 = Panel(wlc_target_st1)
panel_11 = Panel(py3_11.st1)
