# Grasshopper definition 261007_ca_test.ghx (Grasshopper 1.0.8)
# plug-ins: MeshEdit Components, Pufferfish, LunchBox

# ----
# Reload the compas_acoustics module
# every time you change something
# outside Rhino/Grasshopper
button = Button()
# Option A: Create single AcousticObject with one Material
reload_modules = Python3Script(reload=button)
# ---------- reload_modules: Python ----------
# venv rhino_compas_acoustics
# r: compas, pyroomacoustics, matplotlib, librosa, soundfile, spaudiopy, sofar
# env: /Users/jerrywang/Local/DFAB/T3/compas_acoustics/src

from compas_rhino import DevTools
DevTools.unload_modules('compas_acoustics')
# ---------- end reload_modules ----------

# ----
# Material from Library
# (should have only one component)
list = ValueList({"CONCRETE": 0, "BRICKWALL": 1, "CARPET": 2, "ACOUSTIC_PLASTER": 3}, selected="CARPET")
list_2 = ValueList({"CONCRETE": 0, "BRICKWALL": 1, "CARPET": 2, "ACOUSTIC_PLASTER": 3}, selected="ACOUSTIC_PLASTER")
list_3 = ValueList({"CONCRETE": 0, "BRICKWALL": 1, "CARPET": 2, "ACOUSTIC_PLASTER": 3}, selected="BRICKWALL")
py3 = Python3Script(select=list_2)  # -> out, material
# ---------- py3: Python ----------
# venv rhino_compas_acoustics
# env: /Users/jerrywang/Local/DFAB/T3/compas_acoustics/src

import compas_acoustics as ca

if select == 0:
    material = ca.AcousticMaterial(
        name='concrete',
        absorption_coefficients=[0.01, 0.01, 0.02, 0.02, 0.02, 0.05, 0.05],
        scattering_coefficients=[0.01, 0.01, 0.03, 0.05, 0.1, 0.1, 0.1]
    )
elif select == 1:
    material = ca.AcousticMaterial(
        name='brickwall',
        absorption_coefficients=[0.01, 0.02, 0.02, 0.03, 0.03, 0.04, 0.04],
        scattering_coefficients=[0.01, 0.01, 0.03, 0.05, 0.2, 0.25, 0.3]
    )
elif select == 2:
    material = ca.AcousticMaterial(
        name='carpet',
        absorption_coefficients=[0.07, 0.31, 0.49, 0.81, 0.66, 0.54, 0.48],
        scattering_coefficients=0.2
    )
elif select == 3:
    material = ca.AcousticMaterial(
        name='acoustic_plaster',
        absorption_coefficients=[0.17, 0.36, 0.66, 0.65, 0.62, 0.68, 0.80],
        scattering_coefficients=0.2
    )
# ---------- end py3 ----------
py3_2 = Python3Script(select=list_3)  # -> out, material; same code as py3
py3_3 = Python3Script(select=list)  # -> out, material; same code as py3

# ----
# Option B: Create multiple AcousticObjects with different Materials
# Rhino Geometry
brep = Brep(<brep referenced from the Rhino model>)
debrep = DeconstructBrep(Brep=brep)  # -> Faces, Edges, Vertices
py3_4 = Python3Script(geos=debrep.Faces)  # -> out, ceilings, walls, floors; inputs geos: list
# ---------- py3_4: Python ----------
ceilings = geos[6]
walls = geos[:5]
floors = geos[5]
# ---------- end py3_4 ----------

# ----
# Material from Params
panel = Panel("0.01, 0.01, 0.02, 0.02, 0.02, 0.05, 0.05")
py3_5 = Python3Script(absorption=panel, scattering="0.01, 0.01, 0.03, 0.05, 0.1, 0.1, 0.1", name="concrete")  # -> out, material; inputs absorption: String, scattering: String
# ---------- py3_5: Python ----------
# venv rhino_compas_acoustics
# env: /Users/jerrywang/Local/DFAB/T3/compas_acoustics/src

import compas_acoustics as ca

import importlib
importlib.reload(ca)

absorption = [float(x) for x in absorption.split(",")]
scattering = [float(x) for x in scattering.split(",")]

material = ca.AcousticMaterial(
    name=name,
    absorption_coefficients=absorption,
    scattering_coefficients=scattering,
)
# ---------- end py3_5 ----------

number_slider = Slider(2.2, range=0..10)  # disabled
number_slider_2 = Slider(1, range=0..1)  # disabled
_3dsupershape = _3DSupershape(
    UDivisions=80,
    VDivisions=80,
    MParameter=14.074,
    AParameter=-0.06,
    BParameter=2.75,
    N1Parameter=3.75,
    N2Parameter=-0.48,
    N3Parameter=1.46,
    ScaleParameter=number_slider,
    D1Interval=Domain(-3.141592654, 3.141592654),
    D2Interval=Domain(-1.570796327, 1.570796327))  # disabled
triremesh = TriRemesh(Geometry=_3dsupershape, Length=number_slider_2, Iterations=25)  # -> Triangulation, Dual, Creases; disabled
mshclsd = IsMeshClosed(Mesh=triremesh.Triangulation)  # disabled
explode = MeshExplode(Mesh=triremesh.Triangulation, Interpolate=False)  # disabled
pt = Point(Point(0.4868665562, 1.641025576, 1.944516102))  # disabled
py3_6 = Python3Script(meshes=explode, position=pt)  # -> out, is_inside; inputs meshes: list of Mesh, polylines: list of Polyline, position: Point3d; disabled
# ---------- py3_6: Python ----------
import pyroomacoustics as pra
import numpy as np

walls = []
for mesh in meshes:
    pts = np.array([[*vtx] for vtx in mesh.Vertices]).T
    # print (pts)
    walls.append(pra.Wall(pts))

room = pra.Room(walls)



# Test if the point inside the room or not
p = np.array([*position]).T

is_inside = room.is_inside(p, False)
print (room)
print (is_inside)
# ---------- end py3_6 ----------
panel_2 = Panel(py3_6.is_inside)  # disabled

# ----
# Acoustic Objects
data = Data(py3_4.walls)
lng = ListLength(List=data)
series = Series(Start=0, Step=1, Count=lng)
concat = Concatenate(FragmentA="brick_wall_", FragmentB=series)
ca_acousticobject = Python3Script(room_geometry=py3_4.ceilings, material=py3.material, name="plaster_ceiling")  # -> out, objects; inputs room_geometry: Mesh, name: String
# ---------- ca_acousticobject: Python ----------
# venv rhino_compas_acoustics
# env: /Users/jerrywang/Local/DFAB/T3/compas_acoustics/src

import compas_acoustics as ca
from compas_rhino.conversions import mesh_to_compas

geometry = mesh_to_compas(room_geometry)

objects = ca.AcousticObject(acoustic_geometry=geometry, material=material, name=name)
# ---------- end ca_acousticobject ----------
ca_acousticobject_2 = Python3Script(room_geometry=data, material=py3_2.material, name=concat)  # -> out, objects; inputs room_geometry: Mesh, name: String; same code as ca_acousticobject
ca_acousticobject_3 = Python3Script(room_geometry=py3_4.floors, material=py3_3.material, name="carpet floor")  # -> out, objects; inputs room_geometry: Mesh, name: String
# ---------- ca_acousticobject_3: Python ----------
# venv rhino_compas_acoustics
# env: /Users/jerrywang/Local/DFAB/T3/compas_acoustics/src


import compas_acoustics as ca
from compas_rhino.conversions import mesh_to_compas

geometry = mesh_to_compas(room_geometry)

objects = ca.AcousticObject(acoustic_geometry=geometry, material=material, name=name)
# ---------- end ca_acousticobject_3 ----------
merge = Merge(Data1=ca_acousticobject.objects, Data2=ca_acousticobject_2.objects, Data3=ca_acousticobject_3.objects)  # -> flatten(Result)

list_4 = ValueList({"BIDIRECTIONAL": 0, "HYPERCARDIOID": 1, "SUPERCARDIOID": 2, "CARDIOID": 3, "OMNIDIRECTIONAL": 4, "CUSTOM": 5}, selected="CARDIOID")

# ----
# Soruces
crv = Curve([<curve referenced from the Rhino model> x3])
list_5 = ValueList({"BIDIRECTIONAL": 0, "HYPERCARDIOID": 1, "SUPERCARDIOID": 2, "CARDIOID": 3, "OMNIDIRECTIONAL": 4, "CUSTOM": 5}, selected="HYPERCARDIOID")
list_6 = ValueList({"BIDIRECTIONAL": 0, "HYPERCARDIOID": 1, "SUPERCARDIOID": 2, "CARDIOID": 3, "OMNIDIRECTIONAL": 4, "CUSTOM": 5}, selected="CARDIOID")
lng_2 = ListLength(List=crv)
series_2 = Series(Start=0, Step=1, Count=lng_2)
eval = EvaluateCurve(Curve=reparameterize(crv), Parameter="0")  # -> Point, Tangent, Angle
concat_2 = Concatenate(FragmentA="source_", FragmentB=series_2)
merge_2 = Merge(Data1=list_5, Data2=list_6, Data3=list_4)
ca_source = Python3Script(position=eval.Point, direction=crv, directivity=merge_2, name=concat_2)  # -> out, source; inputs position: Point3d, direction: Vector3d, directivity: Int32, name: String
# ---------- ca_source: Python ----------
# venv rhino_compas_acoustics
# env: /Users/jerrywang/Local/DFAB/T3/compas_acoustics/src

from compas_acoustics import Source



if directivity == 0:
    dirt = "bidirectional"
elif directivity == 1:
    dirt = "hypercardioid"
elif directivity == 2:
    dirt = "supercardioid"
elif directivity == 3:
    dirt = "cardioid"
elif directivity == 4:
    dirt = "omnidirectional"
else:
    raise ValueError()


x, y, z = position
source = Source(
    name=name,
    x=x,
    y=y,
    z=z,
    directivity=dirt,
    direction=[*direction]
)
# ---------- end ca_source ----------

# ----
# Rhino Geometry
brep_2 = Brep(<brep referenced from the Rhino model>)
mesh = MeshBrep(
    Brep=brep_2,
    Settings={GridMaxCount=0, GridMinCount=16, JaggedSeams=False, MaxEdgeLength=0, MinEdgeLength=0.0001, MinTolerance=0, Refine=True, RefineAngle=0, RelativeTolerance=0.65, SimplePlanes=True, Tolerance=0})
tri = Triangulate(Mesh=mesh)  # -> Mesh, Count

# ----
# Receivers
pt_2 = Point(<point referenced from the Rhino model>)
dots = DotDisplay(Point=pt_2, Colour=RGB(0, 0, 0), Size=0.1)
ca_receiver = Python3Script(position=pt_2, name="receiver_1")  # -> out, receiver; inputs position: Point3d, name: String
# ---------- ca_receiver: Python ----------
# venv rhino_compas_acoustics
# env: /Users/jerrywang/Local/DFAB/T3/compas_acoustics/src

from compas_acoustics import Receiver


# position = deepcopy(position)

x, y, z = position
receiver = Receiver(x=x, y=y, z=z, name=name)
# ---------- end ca_receiver ----------

# ----
# Acoustic Objects
panel_3 = Panel("test_room")
ca_acousticobject_4 = Python3Script(room_geometry=tri.Mesh, material=py3_5.material, name=panel_3)  # -> out, room; inputs room_geometry: Mesh, name: String
# ---------- ca_acousticobject_4: Python ----------
# venv rhino_compas_acoustics
# env: /Users/jerrywang/Local/DFAB/T3/compas_acoustics/src

from compas_rhino.conversions import mesh_to_compas
import compas_acoustics as ca

geometry = mesh_to_compas(room_geometry)

room = ca.AcousticObject(acoustic_geometry=geometry, material=material, name=name)
# ---------- end ca_acousticobject_4 ----------

panel_4 = Panel("/Users/jerrywang/Local/DFAB/T3/compas_acoustics/examples/rir_mono.wav")

# ----
# Scene
panel_5 = Panel("test_scene")
ca_scene = Python3Script(name=panel_5, objects=merge, sources=ca_source.source, receivers=ca_receiver.receiver)  # -> out, scene; inputs objects: list, sources: list, receivers: list
# ---------- ca_scene: Python ----------
# venv rhino_compas_acoustics
# env: /Users/jerrywang/Local/DFAB/T3/compas_acoustics/src

import numpy
from compas_acoustics import Scene
from compas_acoustics import AcousticMaterial

import compas_acoustics
from copy import deepcopy



scene = Scene(name=name)
scene.add_acoustic_objects(list(objects))

for source in sources:
    scene.add_source(source)

for receiver in receivers:
    scene.add_receiver(receiver)


########### create acoustic materials
concrete = AcousticMaterial(name='concrete', absorption_coefficients=[0.01, 0.01, 0.02, 0.02, 0.02, 0.05, 0.05], scattering_coefficients=[0.01, 0.01, 0.03, 0.05, 0.1, 0.1, 0.1])
brickwall = AcousticMaterial(name='brickwall', absorption_coefficients=[0.01, 0.02, 0.02, 0.03, 0.03, 0.04, 0.04], scattering_coefficients=[0.1, 0.1, 0.3, 0.5, 0.6, 0.5, 0.8])
carpet = AcousticMaterial(name='carpet', absorption_coefficients=[0.07, 0.31, 0.49, 0.81, 0.66, 0.54, 0.48], scattering_coefficients=0.2)
# ---------- end ca_scene ----------

py3_7 = Python3Script(path=panel_4, play=Button())  # -> out, a; inputs path: String, play: Boolean
# ---------- py3_7: Python ----------
import platform
import os

def play_sound(file_path):
    """
    Plays a sound file based on the operating system.

    Parameters:
    file_path (str): The path to the sound file to be played.
    Only supports .wav files for Windows.
    """
    if not os.path.exists(file_path):
        raise FileNotFoundError(f"The file {file_path} does not exist.")
    
    current_os = platform.system()
    if current_os == "Windows":
        import System.Media as sm  # type: ignore
        try:
            player = sm.SoundPlayer(file_path)
            player.Play()
        except Exception as e:
            print (f"Error playing sound on Windows: {e}")
    
    elif current_os == "Darwin":  # macOS
        import subprocess
        try:
            subprocess.Popen(["afplay", file_path])
        except Exception as e:
            print(f"Error playing sound on macOS: {e}")
    
    else:
        raise NotImplementedError(f"Sound playback is not implemented for system {current_os}.")

if play and path:
    play_sound(path)
# ---------- end py3_7 ----------

# ----
# Analyze RIR
number_slider_3 = Slider(1000, range=100..3000)
ca_simulation = Python3Script(scene=ca_scene.scene, n_rays=number_slider_3, seed=Slider(6, range=0..100))  # -> out, ir_names, ir_data; inputs n_rays: Int32, seed: Int32
# ---------- ca_simulation: Python ----------
# venv rhino_compas_acoustics
# env: /Users/jerrywang/Local/DFAB/T3/compas_acoustics/src

from compas_acoustics import Simulator


simulator = Simulator(scene)

irs = simulator.rir_from_ray_tracing(
    n_rays=n_rays, air_absorption=True, random_seed=seed
)

# print(irs.ir)

ir_names = []
ir_data = []

for ir in irs.values():
    ir_names.append(ir.description)
    ir_data.append(ir.ir)
    # print(ir.source)
    print (len(list(ir.ir)))
# ---------- end ca_simulation ----------
ca_analyser = Python3Script(ir=ca_simulation.ir_data)  # -> out, results, data, edt, t20, t30, c50, c80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
# ---------- ca_analyser: Python ----------
# venv rhino_compas_acoustics
# env: /Users/jerrywang/Local/DFAB/T3/compas_acoustics/src

import numpy as np
from compas_acoustics import AcousticAnalyser



analyser = AcousticAnalyser(ir)
results = analyser.analyse()

analyser.print_table()

data = np.transpose(results['data'])
parameters = results['params']
frequencies = results['freqs']

edt = []
t20 = []
t30 = []
c50 = []
c80 = []
d50 = []
drr = []
ts = []
sti = []

for result in data[:-1]:
    edt.append(result[0])
    t20.append(result[1])
    t30.append(result[2])
    c50.append(result[3])
    c80.append(result[4])
    d50.append(result[5])
    drr.append(result[6])
    ts.append(result[7])
    sti.append(result[8])

print (data)
# ---------- end ca_analyser ----------

# ----
# optional
number_slider_4 = Slider(0, range=0..10)
relay = Relay([number_slider_4, Slider(1, range=0..10)])

graph = QuickGraph(ca_analyser.c50, SortOrder=0)

# ----
# Simulate Rays
number_slider_5 = Slider(2, range=0..10)
py3_8 = Python3Script(
    scene=ca_scene.scene,
    angle=Slider(4, range=0..180),
    num_of_rays=Slider(19, range=0..180),
    reflection_order=number_slider_5,
    include_scattering=Toggle(True),
    seed=Slider(37, range=0..100))  # -> out, specular_reflections, diffuse_reflections; inputs source_idx: list of Int32, angle: Int32, num_of_rays: Int32, reflection_order: Int32, seed: Int32
# ---------- py3_8: Python ----------
# venv rhino_compas_acoustics
# env: /Users/jerrywang/Local/DFAB/T3/compas_acoustics/src

import ghpythonlib.treehelpers as th

from compas.geometry import Vector, Polyline
import compas_rhino.conversions as cv 
import compas_acoustics as ca


from Grasshopper import DataTree
from Grasshopper.Kernel.Data import GH_Path

########### trace the rays
simulator = ca.Simulator(scene, simulation_platform="pyroomacoustics")
# traced_rays = simulator.trace_rays(n_rays=500, max_reflection_order=reflection_order)

specular_reflections = DataTree[object]()
diffuse_reflections = DataTree[object]()

if source_idx:
    selected_sources = [scene.sources[i] for i in source_idx]
else:
    selected_sources = scene.sources

for i, src in enumerate(selected_sources):
    rayfield = simulator.trace_rays(
        n_rays=num_of_rays,
        max_reflection_order=reflection_order,
        direction=src.direction,
        angle=angle,
        sources=[src],
        include_scattering=include_scattering,
        random_seed=seed
    )

    for j, ray in enumerate(rayfield.rays):
        specular_reflections.Add(cv.polyline_to_rhino(Polyline(ray.points)), GH_Path(i))
        for scat_ray in ray.scattered_reflections:
            diffuse_reflections.Add(cv.polyline_to_rhino(Polyline(scat_ray.points)), GH_Path(i, j))
# ---------- end py3_8 ----------
number_slider_6 = Slider(0, range=0..10)
py3_9 = Python3Script(x=number_slider_6)  # -> a; inputs x: Int32
# ---------- py3_9: Python ----------
a = f"{{{x};?}}"
# ---------- end py3_9 ----------
split = SplitTree(Data=py3_8.diffuse_reflections, Masks=flatten(py3_9))  # -> Positive, Negative
branch = TreeBranch(Tree=py3_8.specular_reflections, Path=number_slider_6, MaintainPaths=True)

viewer = ParamViewer(py3_8.specular_reflections)
panel_6 = Panel(ca_simulation.ir_names)
panel_7 = Panel(ca_analyser.data)
viewer_2 = ParamViewer(py3_8.diffuse_reflections)
panel_8 = Panel(ca_analyser.c80)
