# Grasshopper definition Scenario_01.ghx (Grasshopper 1.0.8)
# plug-ins: MeshEdit Components, Pufferfish, Weaverbird, Leopard version 0a1

lamcp = LAMCPBridge(enable=Toggle(True))  # -> status; inputs enable: Boolean, port: Int32
#   port enable: Toggle to start (True) or stop (False) the local HTTP server.
#   port port: Port to listen on (loopback only). Defaults to 8765.
#   port status: Current server status string.
# ---------- lamcp: Python ----------
"""
LAMCP Bridge: local HTTP server inside Rhino 8 / Grasshopper CPython.

Exposes `POST /exec` (JSON: `{"code": "...", "timeout": 30}`) which
exec()s `code` and returns
`{"stdout": "...", "stderr": "...", "result": "...", "error": null|str}`.

Pair with the `lamcp` FastMCP server, which translates Claude's
`run_python_script` MCP tool calls into POSTs to this endpoint.

Binds to 127.0.0.1 only. NEVER expose beyond localhost â€” it exec()s
arbitrary Python with full Rhino API access.

LAMCP v0.1.0
"""

import contextlib
import io
import json
import threading
import traceback
from http.server import BaseHTTPRequestHandler
from http.server import HTTPServer

import Grasshopper
import scriptcontext as sc


SHARED_GLOBALS_KEY = "_lamcp_bridge_globals"
SERVER_KEY = "_lamcp_bridge_server"


def _exec_code(code, timeout):
    """Run `code` on the HTTP-server thread and capture stdout/stderr/result.

    NOTE: this is intentionally NOT marshalled to Rhino's UI thread for the
    spike â€” `Rhino.RhinoApp.InvokeOnUiThread` was queueing actions that
    never fired in Rhino 8 CPython. Most read-only RhinoCommon access is
    safe cross-thread; mutations may crash. Add Eto-based marshalling
    back here when we need it.
    """
    out = io.StringIO()
    err = io.StringIO()
    g = sc.sticky.setdefault(SHARED_GLOBALS_KEY, {"__name__": "__lamcp_bridge__"})
    error_text = None
    result_repr = None
    try:
        with contextlib.redirect_stdout(out), contextlib.redirect_stderr(err):
            exec(code, g, g)
            result_repr = repr(g.get("_"))
    except BaseException:
        error_text = traceback.format_exc()

    return {
        "stdout": out.getvalue(),
        "stderr": err.getvalue(),
        "result": result_repr,
        "error": error_text,
    }


class _ExecHandler(BaseHTTPRequestHandler):
    # Silence default request logging so it doesn't clog the Rhino command line.
    def log_message(self, fmt, *args):
        pass

    def _send(self, code, payload):
        body = json.dumps(payload).encode("utf-8")
        self.send_response(code)
        self.send_header("Content-Type", "application/json")
        self.send_header("Content-Length", str(len(body)))
        self.end_headers()
        self.wfile.write(body)

    def do_GET(self):
        if self.path == "/health":
            self._send(200, {"status": "ok"})
        else:
            self._send(404, {"error": "not found"})

    def do_POST(self):
        if self.path != "/exec":
            self._send(404, {"error": "not found"})
            return
        length = int(self.headers.get("Content-Length", "0"))
        try:
            raw = self.rfile.read(length).decode("utf-8")
            body = json.loads(raw)
            code = body.get("code", "")
            timeout = float(body.get("timeout", 30.0))
        except Exception as exc:
            self._send(400, {"error": "bad request: " + repr(exc)})
            return
        result = _exec_code(code, timeout)
        self._send(200, result)


def _start_server(port):
    server = HTTPServer(("127.0.0.1", port), _ExecHandler)
    thread = threading.Thread(
        target=server.serve_forever, daemon=True, name="lamcp-bridge"
    )
    thread.start()
    return {"server": server, "thread": thread, "port": port}


def _stop_server(state):
    try:
        state["server"].shutdown()
        state["server"].server_close()
    except Exception:
        pass


class LamcpBridgeComponent(Grasshopper.Kernel.GH_ScriptInstance):
    def RunScript(self, enable: bool, port: int):
        port = int(port) if port else 8765

        state = sc.sticky.get(SERVER_KEY)

        if not enable:
            if state is not None:
                _stop_server(state)
                del sc.sticky[SERVER_KEY]
            return "stopped"

        # Already running on the requested port: no-op.
        if (
            state is not None
            and state.get("port") == port
            and state["thread"].is_alive()
        ):
            return "listening on http://127.0.0.1:{}".format(port)

        # Port changed or server died: tear down and restart.
        if state is not None:
            _stop_server(state)
            del sc.sticky[SERVER_KEY]

        try:
            sc.sticky[SERVER_KEY] = _start_server(port)
        except OSError as exc:
            ghenv.Component.AddRuntimeMessage(  # noqa: F821
                Grasshopper.Kernel.GH_RuntimeMessageLevel.Error,
                "Failed to bind 127.0.0.1:{}: {}".format(port, exc),
            )
            return "error: {}".format(exc)

        return "listening on http://127.0.0.1:{}".format(port)
# ---------- end lamcp ----------

reload = Python3Script(reload=Button())  # inputs reload: Boolean
# ---------- reload: Python ----------
# venv: rhino_compas_acoustics
# r: compas
# r: pyroomacoustics
# r: matplotlib
# r: librosa
# r: soundfile
# r: sounddevice
# r: sofar
# r: pyfar
# r: pyrato

import sys
import os
from compas_rhino import unload_modules


gh_path = ghenv.Component.OnPingDocument().FilePath
dire_path = os.path.dirname(os.path.dirname(gh_path))
target_path = os.path.join(dire_path, "src")

if target_path not in sys.path:
    sys.path.insert(0, target_path)

if reload:
    unload_modules('compas_acoustics')

try:
    import compas_acoustics as ca
except Exception as e:
    raise ValueError(e)
# ---------- end reload ----------

mesh = Mesh([<mesh referenced from the Rhino model> x48])
lselgeo = LeopardsSelectGeometry(
    Geometry=mesh,
    lock=True,
    maintain=False,
    order=False,
    selectedobject="47|45|44|43|42|41|40|39|38|37|36|35|33|32|31|30|29|28|27|26|25|24|23|21|20|19|18|17|16|15|14|13|12|11|9|8|7|6|5|4|3|2|1|0")  # -> Geometry, Path, Index, Order
number_slider = Slider(0.6, range=0..2)
number_slider_2 = Slider(0.8, range=0..2)
crv = Curve(<curve referenced from the Rhino model>)
disc = Discontinuity(Curve=crv, Level=1)  # -> Points, Parameters
clean = CombineClean(Meshes=lselgeo.Geometry)
X = UnitX(Factor=Slider(1.12, range=0..5))
mplane = MeshPlane(Boundary=crv, WidthCount=Slider(4, range=0..10), HeightCount=Slider(6, range=0..10))  # -> Mesh, Area
avr = Average(Input=disc.Points)
neg = Negative(Value=number_slider)
neg_2 = Negative(Value=number_slider_2)
rev = Reverse(Vector=X)
dom = ConstructDomain(DomainStart=neg, DomainEnd=number_slider)
dom_2 = ConstructDomain(DomainStart=neg_2, DomainEnd=number_slider_2)
move = Move(Geometry=avr, Motion=rev)  # -> Geometry, Transform
Z = UnitZ(Factor=Slider(2.4, range=0..10))
number_slider_3 = Slider(0, range=0..0.1)

# ---- group: best
number_slider_4 = Slider(0.009, range=0..0.1)

# ----
galapagos = Galapagos(fitness=py3_2, gene=number_slider_3)
mesh_2 = Mesh(clean)
rev_2 = Reverse(Vector=Z)
rectangle = Rectangle(Plane=move.Geometry, XSize=dom, YSize=dom_2, Radius=0)  # -> Rectangle, Length
multiconvolve = BooleanToggle(False)
save = Button()
nv = NakedVertices(Mesh=mesh_2)  # -> ClothedIndex, NakedIndex, ClothedPts, NakedPts
number_slider_5 = Slider(1, range=0..10)  # disabled
move_2 = Move(Geometry=rectangle.Rectangle, Motion=rev_2)  # -> Geometry, Transform
neg_3 = Negative(Value=number_slider_4)
disc_2 = Discontinuity(Curve=move_2.Geometry, Level=1)  # -> Points, Parameters
edgelengths = EdgeLengths(Mesh=mesh_2, LengthFactor=1, Strength=1)
anchor = Anchor(Point=nv.NakedPts, Strength=10000)
vertexloads = VertexLoads(Mesh=mesh_2, Strength=neg_3)
show = Show(G=mesh_2)
stop = Button()
play = Button()
entwine = Entwine(Branch00=show, Branch01=edgelengths, Branch02=anchor, Branch03=vertexloads, FlattenInputs=True)

flat = Mesh(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)
dome = Mesh(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)
reversed_dome = Mesh(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)

zombiesolver = ZombieSolver(GoalObjects=entwine, Threshold=1e-10, Tolerance=0.0001, MaxIterations=50000)  # -> I, V, O
unflatten = UnflattenTree(Tree=zombiesolver.O, Guide=entwine)
bang = ExplodeTree(Data=unflatten)
flip = MeshFlip(Mesh=bang)
wbnaked = WeaverbirdsNakedBoundary(MeshClosedPolylines=flip)
crv_2 = Curve(wbnaked)
explode = Explode(Curve=crv_2, Recursive=True)  # -> Segments, Vertices
Z_2 = UnitZ(Factor=Slider(3.6, range=0..10))
explode_2 = Explode(Curve=crv_2, Recursive=True)  # -> Segments, Vertices
disc_3 = Discontinuity(Curve=explode.Segments, Level=1)  # -> Points, Parameters
rev_3 = Reverse(Vector=Z_2)
project = Project(Geometry=explode_2.Vertices, Plane=PlaneXY(0, 0, 0))  # -> Geometry, Transform
move_3 = Move(Geometry=crv_2, Motion=rev_2)  # -> Geometry, Transform
move_4 = Move(Geometry=disc_3.Points, Motion=rev_3)  # -> Geometry, Transform
pline = PolyLine(Vertices=project.Geometry, Closed=False)
offcrv = OffsetCurve(Curve=move_3.Geometry, Plane=PlaneXY(0, 0, 0), Distance=Slider(0.39, range=0..1), BothSides=0, Kinks=0, CapType=1)
merge = Merge(Data1=disc_3.Points, Data2=reverse(move_4.Geometry))
boundary = BoundarySurfaces(Edges=offcrv)
crv_3 = Curve(<curve referenced from the Rhino model>)
conmesh = ConstructMesh(Vertices=merge, Faces={A=0, B=1, C=2, D=3})  # -> flatten(Mesh)
popgeo = PopulateGeometry(Geometry=boundary, Count=Slider(10, range=0..100), Seed=1)
mesh_3 = Mesh(flip)
eval = EvaluateCurve(Curve=reparameterize(crv_3), Parameter="0")  # -> Point, Tangent, Angle
cardioid = Compas_acousticsDirectivity()  # -> directivity
#   port directivity: Directivity pattern.
# ---------- cardioid: Python ----------
"""Preset picker for directivity patterns. Right-click to choose a pattern from the available options."""
# flake8: noqa
import Grasshopper
from System.Windows.Forms import ToolStripSeparator
from compas_acoustics.materials_library import MaterialsLibrary


class DirectivitySelector(Grasshopper.Kernel.GH_ScriptInstance):
    ITEMS = ["Bidirectional", "Hypercardioid", "Supercardioid", "Cardioid", "Omnidirectional"]

    def __init__(self):
        super().__init__()
        nickname = ghenv.Component.NickName
        self.directivity_name = nickname if nickname in self.ITEMS else None

    def RunScript(self):
        names = self.ITEMS
        if not names:
            ghenv.Component.AddRuntimeMessage(
                Grasshopper.Kernel.GH_RuntimeMessageLevel.Error, "No directivity patterns found."
            )
            return None

        if self.directivity_name not in names:
            ghenv.Component.AddRuntimeMessage(
                Grasshopper.Kernel.GH_RuntimeMessageLevel.Remark, "Right-click the icon to choose a directivity pattern."
            )
            ghenv.Component.Message = None
            return None

        ghenv.Component.Message = self.directivity_name
        return self.directivity_name.lower()

    def AppendAdditionalMenuItems(self, menu):
        for name in self.ITEMS:
            item = menu.Items.Add(name, None, self.on_item_click)
            item.Checked = (name == self.directivity_name)

        menu.Items.Add(ToolStripSeparator())

    def on_item_click(self, sender, event_info):
        name = str(sender)
        if name == self.directivity_name:
            return
        self.directivity_name = name
        ghenv.Component.NickName = name
        ghenv.Component.ExpireSolution(True)
# ---------- end cardioid ----------
py3 = Python3Script(name="adult_female_speech.wav")  # -> out, path; inputs name: String
# ---------- py3: Python ----------
import sys
import os

gh_path = ghenv.Component.OnPingDocument().FilePath
dire_path = os.path.dirname(gh_path)
sound_path = os.path.join(dire_path, "sound_files", name)

path = sound_path
# ---------- end py3 ----------
item = ListItem(List=popgeo, Index=0, Wrap=True)
pt = Point(popgeo)
carpet = Compas_acousticsMaterialLibrary()  # -> material
#   port material: AcousticMaterial object.
# ---------- carpet: Python ----------
"""Preset picker for AcousticMaterial. Right-click to choose a material from the materials_library folder."""
# flake8: noqa
import Grasshopper
from System.Windows.Forms import ToolStripSeparator
from compas_acoustics.materials_library import MaterialsLibrary


class MaterialLibraryPicker(Grasshopper.Kernel.GH_ScriptInstance):

    def __init__(self):
        super().__init__()
        self.library = MaterialsLibrary()
        nickname = ghenv.Component.NickName
        self.material_name = nickname if nickname in self.library.material_names else None

    def RunScript(self):
        names = sorted(self.library.material_names)
        if not names:
            ghenv.Component.AddRuntimeMessage(
                Grasshopper.Kernel.GH_RuntimeMessageLevel.Error, "No material presets found in the materials library."
            )
            return None

        if self.material_name not in names:
            ghenv.Component.AddRuntimeMessage(
                Grasshopper.Kernel.GH_RuntimeMessageLevel.Remark, "Right-click the icon to choose a material."
            )
            ghenv.Component.Message = None
            return None

        ghenv.Component.Message = self.material_name
        return self.library.material_from_name(self.material_name)

    def AppendAdditionalMenuItems(self, menu):
        for name in sorted(self.library.material_names):
            item = menu.Items.Add(name, None, self.on_item_click)
            item.Checked = (name == self.material_name)

        menu.Items.Add(ToolStripSeparator())

    def on_item_click(self, sender, event_info):
        name = str(sender)
        if name == self.material_name:
            return
        self.material_name = name
        ghenv.Component.NickName = name
        ghenv.Component.ExpireSolution(True)
# ---------- end carpet ----------
concrete = Compas_acousticsMaterialLibrary()  # -> material; same code as carpet
concrete_2 = Compas_acousticsMaterialLibrary()  # -> material; same code as carpet
source = Compas_acousticsSource(position=eval.Point, direction=crv_3, directivity=cardioid, sound_file=py3.path)  # -> source; inputs position: Point3d, direction: Vector3d, directivity: String, name: String, sound_file: String
#   port position: Position of the source.
#   port direction: Direction of the source.
#   port directivity: Directivity of the source. Default is Omnidirectional. Options: - Bidirectional - Hypercardioid - Supercardioid - Cardioid - Omnidirectional
#   port name: Name of the source.
#   port sound_file: Sound file associated with the source.
#   port source: Source object.
# ---------- source: Python ----------
"""Acoustic Source object (speaker, human, etc.)."""
# flake8: noqa
import Grasshopper
import Rhino
from compas_acoustics import Source


class CreateSource(Grasshopper.Kernel.GH_ScriptInstance):
    ITEMS = ["bidirectional", "hypercardioid", "supercardioid", "cardioid", "omnidirectional"]

    def RunScript(self,
            position: Rhino.Geometry.Point3d,
            direction: Rhino.Geometry.Vector3d,
            directivity: str,
            name: str,
            sound_file: str):
        if position is None:
            position = Rhino.Geometry.Point3d(0, 0, 0)
        if direction is None:
            direction = Rhino.Geometry.Vector3d(1, 0, 0)

        if directivity is None:
            dirt = "omnidirectional"
        elif directivity not in self.ITEMS:
            ghenv.Component.AddRuntimeMessage(
                Grasshopper.Kernel.GH_RuntimeMessageLevel.Error, "Input parameter 'directivity' is not valid."
            )
            return None
        else:
            dirt = directivity

        if name is None:
            name = "my_source"

        return Source(
            name,
            *position,
            directivity=dirt,
            direction=[*direction],
            sound_file=sound_file
        )
# ---------- end source ----------
receiver = Compas_acousticsReceiver(position=pt)  # -> receiver; inputs position: Point3d, name: String
#   port position: Position of the receiver.
#   port name: Name of the receiver.
#   port receiver: Receiver object.
# ---------- receiver: Python ----------
"""Acoustic Receiver object (microphone, human ear, etc.)."""
# flake8: noqa
import Grasshopper
import Rhino
from compas_acoustics import Receiver

# TODO: Implement direction
class CreateReceiver(Grasshopper.Kernel.GH_ScriptInstance):

    def RunScript(self, position: Rhino.Geometry.Point3d, name: str):
        if position is None:
            position = Rhino.Geometry.Point3d(0, 0, 1)
        if name is None:
            name = "my_receiver"

        return Receiver(name, *position)
# ---------- end receiver ----------
points = PointList(Points=pt, Size=Slider(0.53, range=0..1))
obj = Compas_acousticsAcousticObject(geometry=mesh_3, material=concrete, name="concrete_ceiling")  # -> acoustic_object; inputs geometry: GeometryBase, name: String
#   port geometry: Geometry of the AcousticObject.
#   port material: Material of the AcousticObject.
#   port name: Name of the AcousticObject.
#   port acoustic_object: AcousticObject object.
# ---------- obj: Python ----------
"""Create an AcousticObject with the specified geometry and material."""
# flake8: noqa
import Grasshopper
import Rhino
from compas_acoustics.geometry import AcousticObject
from compas_rhino.conversions import mesh_to_compas
from compas_rhino.conversions import polyline_to_compas

# TODO: Change the typeHintID in metadata.json from "mesh" to "geometrybase"

class CreateAcousticObject(Grasshopper.Kernel.GH_ScriptInstance):

    def RunScript(self, geometry: Rhino.Geometry.GeometryBase, material, name: str):

        if geometry is None:
            ghenv.Component.AddRuntimeMessage(
                Grasshopper.Kernel.GH_RuntimeMessageLevel.Warning, "No geometry provided."
            )
            return
        if material is None:
            ghenv.Component.AddRuntimeMessage(
                Grasshopper.Kernel.GH_RuntimeMessageLevel.Warning, "No material provided."
            )
            return

        # Gemetry conversion from Rhino to Compas
        # TODO: Figure out how to handle other geometry types (e.g., Brep, Surface, etc.)
        if isinstance(geometry, Rhino.Geometry.Mesh):
            geometry = mesh_to_compas(geometry)
        elif isinstance(geometry, Rhino.Geometry.Polyline):
            geometry = polyline_to_compas(geometry)
        elif isinstance(geometry, Rhino.Geometry.PolylineCurve):
            geometry = polyline_to_compas(geometry.ToPolyline())
        else:
            ghenv.Component.AddRuntimeMessage(
                Grasshopper.Kernel.GH_RuntimeMessageLevel.Error, "Unsupported geometry type."
            )
            return
        return AcousticObject(acoustic_geometry=geometry, material=material, name=name)
# ---------- end obj ----------
obj_2 = Compas_acousticsAcousticObject(geometry=conmesh, material=concrete_2, name="concrete_wall")  # -> acoustic_object; inputs geometry: GeometryBase, name: String; same code as obj
obj_3 = Compas_acousticsAcousticObject(geometry=pline, material=carpet, name="carpet_floor")  # -> acoustic_object; inputs geometry: GeometryBase, name: String; same code as obj
merge_2 = Merge(Data1=obj, Data2=obj_2, Data3=obj_3)  # -> flatten(Result)
scene = Compas_acousticsRoomScene(objects=flatten(merge_2), sources=flatten(source), receivers=flatten(receiver))  # -> scene; inputs objects: list, sources: list, receivers: list, name: String
#   port objects: List of AcousticObject
#   port sources: List of Source objects.
#   port receivers: List of Receiver objects.
#   port name: Name of the room scene.
#   port scene: Room scene object.
# ---------- scene: Python ----------
"""Create a room scene with the specified objects, sources, and receivers."""
# flake8: noqa
import Grasshopper

import System
from compas_acoustics.scene import Scene
from compas_acoustics.source import Source
from compas_acoustics.receiver import Receiver


class CreateModelScene(Grasshopper.Kernel.GH_ScriptInstance):

    def RunScript(self,
            objects: System.Collections.Generic.List[object],
            sources: System.Collections.Generic.List[object],
            receivers: System.Collections.Generic.List[object],
            name: str):

        if objects is None:
            ghenv.Component.AddRuntimeMessage(
                Grasshopper.Kernel.GH_RuntimeMessageLevel.Warning, "No objects provided."
            )
            return
        if sources is None:
            ghenv.Component.AddRuntimeMessage(
                Grasshopper.Kernel.GH_RuntimeMessageLevel.Warning, "No sources provided."
            )
            return
        if receivers is None:
            ghenv.Component.AddRuntimeMessage(
                Grasshopper.Kernel.GH_RuntimeMessageLevel.Warning, "No receivers provided."
            )
            return

        scene = Scene(name=name)
        scene.add_acoustic_objects(objects)
        for src in sources:
            if isinstance(src, Source):
                scene.add_source(src)
            else:
                ghenv.Component.AddRuntimeMessage(
                    Grasshopper.Kernel.GH_RuntimeMessageLevel.Error,
                    f"Invalid source type: {type(src)}. Expected a Source object.",
                )
        for rcv in receivers:
            if isinstance(rcv, Receiver):
                scene.add_receiver(rcv)
            else:
                ghenv.Component.AddRuntimeMessage(
                    Grasshopper.Kernel.GH_RuntimeMessageLevel.Error,
                    f"Invalid receiver type: {type(rcv)}. Expected a Receiver object.",
                )

        return scene
# ---------- end scene ----------
number_slider_6 = Slider(5000, range=0..10000)
simrt = Compas_acousticsSimulateRayTracing(scene=scene, max_order="0", n_rays=Slider(1000, range=0..10000), seed=Slider(0, range=0..10))  # -> ir_graph; inputs sample_rate: Int32, max_order: Int32, n_rays: Int32, absorb_air: Boolean, seed: Int32
#   port scene: Room scene object.
#   port sample_rate: Sample rate for the simulation.
#   port max_order: Maximum order of image sources.
#   port n_rays: Number of rays for ray tracing.
#   port absorb_air: Whether to consider air absorption.
#   port seed: Random seed for reproducibility.
#   port ir_graph: Impulse response graph structure.
# ---------- simrt: Python ----------
"""Simulate room acoustics using Image Source Method (ISM) and Ray Tracing (RT) to generate impulse response graph structure."""
# flake8: noqa
import Grasshopper

from compas_acoustics.simulator import Simulator

class SimulateRayTracing(Grasshopper.Kernel.GH_ScriptInstance):

    def RunScript(self,
            scene,
            sample_rate: int,
            max_order: int,
            n_rays: int,
            absorb_air: bool,
            seed: int):

        if scene is None:
            ghenv.Component.AddRuntimeMessage(
                Grasshopper.Kernel.GH_RuntimeMessageLevel.Warning, "Input parameter 'scene' failed to collect data."
            )
            return

        if max_order is None:
            max_order = 2
        if n_rays is None:
            n_rays = 1000
        if absorb_air is None:
            absorb_air = True

        sim = Simulator(scene)
        if sample_rate is not None:
            sim.sampling_rate = sample_rate

        sim.rir_from_ray_tracing(
            image_source_order=max_order,
            n_rays=n_rays,
            air_absorption=absorb_air,
            random_seed=seed,
        )

        ghenv.Component.Message = "{}Hz, order={}, rays={}, air={}, seed={}".format(
            sim.sampling_rate, max_order, n_rays, absorb_air, seed if seed is not None else "random"
        )

        return sim.scene.ir_graph
# ---------- end simrt ----------
decirgraph = Compas_acousticsDeconstructIRGraph(ir_graph=simrt, receiver_idx=number_slider_5)  # -> ir, sources, receivers, edges; inputs receiver_idx: list of Int32
#   port ir_graph: Impulse response graph structure.
#   port receiver_idx: Index(s) of the receiver(s) to filter.
#   port ir: ImpulseResponse object(s).
#   port sources: Source object(s).
#   port receivers: Receiver object(s).
#   port edges: Relationships between sources and receivers as Line(s).
# ---------- decirgraph: Python ----------
"""Deconstruct impulse response graph structure into ImpulseResponse(s)."""
# flake8: noqa
import Grasshopper
from Grasshopper import DataTree
from Grasshopper.Kernel.Data import GH_Path
from Rhino.Geometry import Line
import System

class DeconstructIRGraph(Grasshopper.Kernel.GH_ScriptInstance):

    def RunScript(self,
            ir_graph,
            receiver_idx: System.Collections.Generic.List[int]):

        if ir_graph is None:
            ghenv.Component.AddRuntimeMessage(
                Grasshopper.Kernel.GH_RuntimeMessageLevel.Warning, "Input parameter 'ir_graph' failed to collect data."
            )

        ir_out = DataTree[object]()
        source_out = DataTree[object]()
        receiver_out = DataTree[object]()
        edge_out = DataTree[object]()

        # 1. Set order of receivers
        receiver_list = [
            ir_graph.node_attribute(node, 'data')
            for node in ir_graph.nodes()
            if ir_graph.node_attribute(node, 'type') == 'receiver'
        ]
        receiver_set = {rec.guid for rec in receiver_list}

        # 2. Make ir group as {receiver_0: [src_0, ...], ...}
        source_group = {}
        ir_group = {}

        for u, v in ir_graph.edges():
            ir = ir_graph.edge_attribute((u, v), 'data')
            data_u = ir_graph.node_attribute(u, 'data')
            data_v = ir_graph.node_attribute(v, 'data')

            if data_u.guid in receiver_set:
                rec, src = data_u, data_v
            elif data_v.guid in receiver_set:
                rec, src = data_v, data_u
            else:
                continue
            
            source_group.setdefault(rec.guid, []).append(src)
            ir_group.setdefault(rec.guid, []).append(ir)

        # 3. Filter receiver, optional
        if receiver_idx is None:
            indices = list(range(len(receiver_list)))
        else:
            indices = receiver_idx  # Already set to list access

        for idx in indices:
            rec = receiver_list[idx]
            path = GH_Path(idx)

            sources = source_group.get(rec.guid, [])
            irs = ir_group.get(rec.guid, [])

            receiver_out.Add(rec, path)
            source_out.AddRange(sources, path)
            ir_out.AddRange(irs, path)
            edge_out.AddRange([Line(*src.position, *rec.position) for src in sources], path)

        return ir_out, source_out, receiver_out, edge_out
# ---------- end decirgraph ----------
analyseir = Compas_acousticsAnalyseImpulseResponse(ir=decirgraph.ir)  # -> params
#   port ir: ImpulseResponse (IR) object.
#   port params: List of acoustic parameters ('EDT', 'T20', 'T30', 'C50', 'C80', 'D50', 'DRR', 'Ts', 'STI').
# ---------- analyseir: Python ----------
"""Analyse impulse response (IR) and return acoustic parameters such as EDT, T20, C50, etc."""
# flake8: noqa
import Grasshopper
from compas_acoustics.analyser import AcousticAnalyser
from compas_acoustics import AcousticParameter
from compas_acoustics import Defaults


class AnalyseIR(Grasshopper.Kernel.GH_ScriptInstance):
    def RunScript(self, ir):
        if ir is None:
            ghenv.Component.AddRuntimeMessage(Grasshopper.Kernel.GH_RuntimeMessageLevel.Warning, "Input parameter 'ir' failed to collect data.")
            return None

        analyser = AcousticAnalyser(ir.ir)
        analyser.analyse()

        return [AcousticParameter().from_analyser(analyser, name) for name in Defaults().PARAM_NAMES]
# ---------- end analyseir ----------
panel = Panel(analyseir)
item_2 = ListItem(List=analyseir, Index=Slider(3, range=0..10), Wrap=True)
deparam = Compas_acousticsDeconstructParameter(param=item_2)  # -> name, values, overall, frequencies
#   port param: AcousticParameter (AP) object.
#   port name: Nmae of the acoustic parameter.
#   port values: Values of the acoustic parameter.
#   port overall: Overall value of the acoustic parameter.
#   port frequencies: Frequencies of the acoustic parameter.
# ---------- deparam: Python ----------
"""Deconstruct acoustic parameter."""
# flake8: noqa
import Grasshopper
from compas_acoustics.analyser import AcousticAnalyser
from compas_acoustics import AcousticParameter
from compas_acoustics import Defaults


class DeconstructParam(Grasshopper.Kernel.GH_ScriptInstance):
    def RunScript(self, param):
        if param is None:
            ghenv.Component.AddRuntimeMessage(Grasshopper.Kernel.GH_RuntimeMessageLevel.Warning, "Input parameter 'param' failed to collect data.")
            return None
        
        return param.title, param.values, param.overall, param.frequencies
# ---------- end deparam ----------
panel_2 = Panel(deparam.name)
panel_3 = Panel(deparam.values)
py3_2 = Python3Script(values=flatten(deparam.overall))  # -> out, fitness; inputs values: list of Double
# ---------- py3_2: Python ----------
import math

def calculate_fitness(c50_list, target=3.0, k=1.0):
    n = len(c50_list)
    if n == 0:
        return -999.0

    mae = sum(abs(x - target) for x in c50_list) / float(n)
    
    mean_c50 = sum(c50_list) / float(n)
    
    if n > 1:
        variance = sum((x - mean_c50) ** 2 for x in c50_list) / float(n - 1)
        std_dev = math.sqrt(variance)
    else:
        std_dev = 0.0

    fitness = - mae - (k * std_dev)
    
    return fitness

fitness = calculate_fitness(values,)
# ---------- end py3_2 ----------
panel_4 = Panel(py3_2.fitness)
panel_5 = Panel(deparam.overall)
auralise = Compas_acousticsAuralise(irs=decirgraph.ir, multiconvolve=multiconvolve, save=save)  # -> signals; inputs irs: tree, signals: tree, multiconvolve: Boolean, save_file_path: String, save_file_name: String, save: Boolean; disabled
#   port irs: ImpulseResponse object(s)
#   port signals: Optional source signal(s). If not provided, it will take the signal(s) from the Source object(s) in the scene.
#   port multiconvolve: Whether to convolve multiple signals with multiple impulse responses. If False, it will convolve each signal with the corresponding impulse response.
#   port save_file_path: File path to save the convolved signal(s). Default is the current working directory.
#   port save_file_name: File name for the saved convolved signal(s). Default is 'convolved_sound'.
#   port save: Whether to save the convolved signal(s) to a file.
#   port signals: Convolved signal(s).
# ---------- auralise: Python ----------
"""Auralise the room scene by convolving the impulse response with the source signal(s)."""
# flake8: noqa
import Grasshopper
from Grasshopper import DataTree
from Grasshopper.Kernel.Data import GH_Path
import System
import scriptcontext as sc
import numpy as np
import os

from compas_acoustics.auraliser import Auraliser


class Auralise(Grasshopper.Kernel.GH_ScriptInstance):

    def offer_buttons(self):
        component = ghenv.Component
        offered_key = "Auraliser_buttons_offered_{}".format(component.InstanceGuid)
        if sc.sticky.get(offered_key):
            return
        sc.sticky[offered_key] = True

        doc = component.OnPingDocument()
        if doc is None:
            return

        targets = [
            (index, nickname, comp) for index, nickname, comp in ((2, "Multiconvolve", "tog"), (5, "Save", "but"))
            if component.Params.Input[index].SourceCount == 0
        ]
        if not targets:
            return

        def deferred(gh_doc):
            base = component.Attributes.Pivot
            for row, (index, nickname, comp) in enumerate(targets):
                input_param = component.Params.Input[index]
                if input_param.SourceCount > 0:
                    continue

                if comp == "tog":
                    popout = Grasshopper.Kernel.Special.GH_BooleanToggle()
                elif comp == "but":
                    popout = Grasshopper.Kernel.Special.GH_ButtonObject()
                else:
                    continue
                popout.CreateAttributes()
                popout.NickName = nickname
                popout.Attributes.Pivot = System.Drawing.PointF(base.X - 280, base.Y - 20 + row * 60)
                gh_doc.AddObject(popout, False)
                input_param.AddSource(popout)
                popout.ExpireSolution(True)

        doc.ScheduleSolution(1, deferred)

    def RunScript(self,
            irs: Grasshopper.DataTree[object],
            signals: Grasshopper.DataTree[object],
            multiconvolve: bool,
            save_file_path: str,
            save_file_name: str,
            save: bool):

        self.offer_buttons()

        if irs is None:
            ghenv.Component.AddRuntimeMessage(
                Grasshopper.Kernel.GH_RuntimeMessageLevel.Warning, "Input parameter 'irs' failed to collect data."
            )
            return
        
        has_signals = signals is not None and signals.DataCount > 0
        if has_signals:
            if irs.BranchCount != signals.BranchCount:
                raise ValueError("DataTree branch count mismatch.")
            if any(len(irs.Branch(i)) != len(signals.Branch(i)) for i in range(irs.BranchCount)):
                raise ValueError("DataTree branch length mismatch.")

        signals_out = DataTree[object]()
        # 1. Data conversions
        for i in range(irs.BranchCount):
            path = irs.Paths[i]

            br = irs.Branch(i)
            sound_files = signals.Branch(i) if has_signals else [ir.source.sound_file for ir in br]

            ir_groups = {}
            sound_groups = {}

            for idx, (IR, sound_file) in enumerate(zip(br, sound_files)):
                receiver_id = str(IR.receiver.guid)

                ir_groups.setdefault(receiver_id, {})
                sound_groups.setdefault(receiver_id, {})
                
                sub_key = f"source_{idx}"

                # ir_data = IR.ir
                ir_data = IR.ir[:, np.newaxis] if IR.ir.ndim == 1 else IR.ir

                ir_groups[receiver_id][sub_key] = {
                    'ir': ir_data,
                    'sample_rate': IR.sample_rate,
                    'ambisonic_order': 0,
                    'channel_order': 'acn',
                    'normalisation': 'sn3d'
                }

                sound_groups[receiver_id][sub_key] = {
                    'filepath': sound_file
                }

            # 2. Construct auraliser(s) and convolve signals
            for i, receiver_id in enumerate(ir_groups.keys()):
                if multiconvolve:
                    tasks = [(receiver_id, ir_groups[receiver_id], sound_groups[receiver_id], f"{i}")]
                else:
                    tasks = [
                        (
                            sub_key,
                            {sub_key: ir_groups[receiver_id][sub_key]},
                            {sub_key: sound_groups[receiver_id][sub_key]},
                            f"{i}_{j}",
                        )
                        for j, sub_key in enumerate(ir_groups[receiver_id].keys())
                    ]
                
                for name, ir_data, sound_data, suffix in tasks:
                    auraliser = Auraliser(
                        name=name,
                        impulse_responses=ir_data,
                        anechoic_sounds=sound_data,
                        output_format="mono",
                        # sample_rate=ir_groups[receiver_id][f"source_{0}"]['sample_rate']
                        sample_rate=48000
                    )
                    convolved_matrix = auraliser.multiconvolution()
                    
                    signals_out.Add(convolved_matrix, path)

                    if save:
                        filepath = self.set_save_file_path(save_file_path, save_file_name, suffix)
                        auraliser.export_convolved_sound(filepath, convolved_matrix)
        return signals_out
    
    @staticmethod
    def set_save_file_path(save_file_path=None, save_file_name=None, suffix=0):
        if save_file_path:
            base_dir = save_file_path
        else:
            base_dir = os.path.dirname(ghenv.Component.OnPingDocument().FilePath)

        if save_file_name:
            base_filename = save_file_name
        else:
            base_filename = "convolved_sound"
        return os.path.join(base_dir, f"{base_filename}_mic_{suffix}.wav")
# ---------- end auralise ----------
player = Compas_acousticsAudioPlayer(sound=auralise, play=play, stop=stop)  # inputs play: Boolean, stop: Boolean
#   port sound: Audio file path, numpy array, or Source object.
#   port play: Play the audio.
#   port stop: Stop the audio.
# ---------- player: Python ----------
"""Play audio files, accepting .wav, numpy arrays, and Source objects."""
# flake8: noqa
import Grasshopper
import System
from compas_acoustics import AudioPlayer
import scriptcontext as sc
import soundfile as sf


class PlayAudio(Grasshopper.Kernel.GH_ScriptInstance):

    def offer_buttons(self):
        component = ghenv.Component
        offered_key = "audio_player_buttons_offered_{}".format(component.InstanceGuid)
        if sc.sticky.get(offered_key):
            return
        sc.sticky[offered_key] = True

        doc = component.OnPingDocument()
        if doc is None:
            return

        targets = [(index, nickname) for index, nickname in ((1, "Play"), (2, "Stop")) if component.Params.Input[index].SourceCount == 0]
        if not targets:
            return

        def deferred(gh_doc):
            base = component.Attributes.Pivot
            for row, (index, nickname) in enumerate(targets):
                input_param = component.Params.Input[index]
                if input_param.SourceCount > 0:
                    continue

                button = Grasshopper.Kernel.Special.GH_ButtonObject()
                button.CreateAttributes()
                button.NickName = nickname
                button.Attributes.Pivot = System.Drawing.PointF(base.X - 180, base.Y - 15 + row * 30)
                gh_doc.AddObject(button, False)
                input_param.AddSource(button)
                button.ExpireSolution(True)

        doc.ScheduleSolution(1, deferred)

    def RunScript(self, sound, play: bool, stop: bool):
        self.offer_buttons()

        sample_rate = None

        if sound is None:
            return

        if isinstance(sound, str):  # file path
            try:
                sample_rate = sf.info(sound).samplerate
            except:
                pass
        elif hasattr(sound, "sound_file"):  # Source object
            sound = sound.sound_file
            try:
                sample_rate = sf.info(sound).samplerate
            except:
                pass
        elif hasattr(sound, "shape") and hasattr(sound, "ndim"):  # numpy array
            pass
        else:
            ghenv.Component.AddRuntimeMessage(
                Grasshopper.Kernel.GH_RuntimeMessageLevel.Error, "Input parameter 'sound' is not valid."
            )
            return

        player_key = "player"
        if player_key not in sc.sticky:
            sc.sticky[player_key] = AudioPlayer()

        player = sc.sticky[player_key]

        if play:
            player.play(sound, sample_rate)
        if stop:
            player.stop()
# ---------- end player ----------
