# Grasshopper definition Scenario_02_2.ghx (Grasshopper 1.0.8)
# plug-ins: Wallacei

button = Button()  # disabled
reload = Python3Script(reload=button)  # inputs reload: Boolean; disabled
# ---------- reload: Python ----------
# venv: rhino_compas_acoustics
# r: compas
# r: pyroomacoustics
# r: matplotlib
# r: librosa
# r: soundfile
# r: sounddevice
# r: sofar
# r: pyfar
# r: pyrato

import sys
import os
from compas_rhino import unload_modules


gh_path = ghenv.Component.OnPingDocument().FilePath
dire_path = os.path.dirname(os.path.dirname(gh_path))
target_path = os.path.join(dire_path, "src")

if target_path not in sys.path:
    sys.path.insert(0, target_path)

if reload:
    unload_modules('compas_acoustics')

try:
    import compas_acoustics as ca
except Exception as e:
    raise ValueError(e)
# ---------- end reload ----------

# ----
# w/ table and chairs (humans)
toggle = BooleanToggle(False)  # disabled
lamcp = LAMCPBridge(enable=toggle)  # -> status; inputs enable: Boolean, port: Int32; disabled
#   port enable: Toggle to start (True) or stop (False) the local HTTP server.
#   port port: Port to listen on (loopback only). Defaults to 8765.
#   port status: Current server status string.
# ---------- lamcp: Python ----------
"""
LAMCP Bridge: local HTTP server inside Rhino 8 / Grasshopper CPython.

Exposes `POST /exec` (JSON: `{"code": "...", "timeout": 30}`) which
exec()s `code` and returns
`{"stdout": "...", "stderr": "...", "result": "...", "error": null|str}`.

Pair with the `lamcp` FastMCP server, which translates Claude's
`run_python_script` MCP tool calls into POSTs to this endpoint.

Binds to 127.0.0.1 only. NEVER expose beyond localhost â€” it exec()s
arbitrary Python with full Rhino API access.

LAMCP v0.1.0
"""

import contextlib
import io
import json
import threading
import traceback
from http.server import BaseHTTPRequestHandler
from http.server import HTTPServer

import Grasshopper
import scriptcontext as sc


SHARED_GLOBALS_KEY = "_lamcp_bridge_globals"
SERVER_KEY = "_lamcp_bridge_server"


def _exec_code(code, timeout):
    """Run `code` on the HTTP-server thread and capture stdout/stderr/result.

    NOTE: this is intentionally NOT marshalled to Rhino's UI thread for the
    spike â€” `Rhino.RhinoApp.InvokeOnUiThread` was queueing actions that
    never fired in Rhino 8 CPython. Most read-only RhinoCommon access is
    safe cross-thread; mutations may crash. Add Eto-based marshalling
    back here when we need it.
    """
    out = io.StringIO()
    err = io.StringIO()
    g = sc.sticky.setdefault(SHARED_GLOBALS_KEY, {"__name__": "__lamcp_bridge__"})
    error_text = None
    result_repr = None
    try:
        with contextlib.redirect_stdout(out), contextlib.redirect_stderr(err):
            exec(code, g, g)
            result_repr = repr(g.get("_"))
    except BaseException:
        error_text = traceback.format_exc()

    return {
        "stdout": out.getvalue(),
        "stderr": err.getvalue(),
        "result": result_repr,
        "error": error_text,
    }


class _ExecHandler(BaseHTTPRequestHandler):
    # Silence default request logging so it doesn't clog the Rhino command line.
    def log_message(self, fmt, *args):
        pass

    def _send(self, code, payload):
        body = json.dumps(payload).encode("utf-8")
        self.send_response(code)
        self.send_header("Content-Type", "application/json")
        self.send_header("Content-Length", str(len(body)))
        self.end_headers()
        self.wfile.write(body)

    def do_GET(self):
        if self.path == "/health":
            self._send(200, {"status": "ok"})
        else:
            self._send(404, {"error": "not found"})

    def do_POST(self):
        if self.path != "/exec":
            self._send(404, {"error": "not found"})
            return
        length = int(self.headers.get("Content-Length", "0"))
        try:
            raw = self.rfile.read(length).decode("utf-8")
            body = json.loads(raw)
            code = body.get("code", "")
            timeout = float(body.get("timeout", 30.0))
        except Exception as exc:
            self._send(400, {"error": "bad request: " + repr(exc)})
            return
        result = _exec_code(code, timeout)
        self._send(200, result)


def _start_server(port):
    server = HTTPServer(("127.0.0.1", port), _ExecHandler)
    thread = threading.Thread(
        target=server.serve_forever, daemon=True, name="lamcp-bridge"
    )
    thread.start()
    return {"server": server, "thread": thread, "port": port}


def _stop_server(state):
    try:
        state["server"].shutdown()
        state["server"].server_close()
    except Exception:
        pass


class LamcpBridgeComponent(Grasshopper.Kernel.GH_ScriptInstance):
    def RunScript(self, enable: bool, port: int):
        port = int(port) if port else 8765

        state = sc.sticky.get(SERVER_KEY)

        if not enable:
            if state is not None:
                _stop_server(state)
                del sc.sticky[SERVER_KEY]
            return "stopped"

        # Already running on the requested port: no-op.
        if (
            state is not None
            and state.get("port") == port
            and state["thread"].is_alive()
        ):
            return "listening on http://127.0.0.1:{}".format(port)

        # Port changed or server died: tear down and restart.
        if state is not None:
            _stop_server(state)
            del sc.sticky[SERVER_KEY]

        try:
            sc.sticky[SERVER_KEY] = _start_server(port)
        except OSError as exc:
            ghenv.Component.AddRuntimeMessage(  # noqa: F821
                Grasshopper.Kernel.GH_RuntimeMessageLevel.Error,
                "Failed to bind 127.0.0.1:{}: {}".format(port, exc),
            )
            return "error: {}".format(exc)

        return "listening on http://127.0.0.1:{}".format(port)
# ---------- end lamcp ----------

seatpts = Point([Point(14.375, -5.84, 1.2), Point(15.125, -5.84, 1.2), Point(15.875, -5.84, 1.2), Point(16.625, -5.84, 1.2), Point(14.375, -7.74, 1.2), Point(15.125, -7.74, 1.2), Point(15.875, -7.74, 1.2), Point(16.625, -7.74, 1.2), Point(13.6, -6.79, 1.2)])

# ---- group: randomize points
jitter_point = JitterPoint(pt=seatpts, dist=Slider(0.02, range=0..0.1))  # -> new_pt; inputs pt: Point3d, dist: Double, seed: Int32
# ---------- jitter_point: Python ----------
import math
import random
import Rhino
import Rhino.Geometry as rg
import Grasshopper


class Script_Instance(Grasshopper.Kernel.GH_ScriptInstance):
    def RunScript(self, pt: Rhino.Geometry.Point3d, dist: float, seed: int):
        if pt is None:
            return None
        if dist is None:
            dist = 0.01
        if seed is None:
            seed = 0

        # Deterministic per-point RNG: the same seed reproduces the same
        # jittered pattern every run, but every distinct point still gets
        # its own random direction (not a single shared vector for all).
        local_seed = hash((seed, round(pt.X, 6), round(pt.Y, 6), round(pt.Z, 6)))
        rng = random.Random(local_seed)

        # uniformly random direction on the unit sphere (Marsaglia method)
        z = rng.uniform(-1.0, 1.0)
        theta = rng.uniform(0.0, 2.0 * math.pi)
        r = math.sqrt(max(0.0, 1.0 - z * z))
        direction = rg.Vector3d(r * math.cos(theta), r * math.sin(theta), z)

        return rg.Point3d(pt.X + direction.X * dist, pt.Y + direction.Y * dist, pt.Z + direction.Z * dist)
# ---------- end jitter_point ----------

# ----
crv = Curve(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)

# ---- group: * face normal should point toward the sound source
facen = FaceNormals()  # -> Centers, Normals
vdisex = VectorDisplayEx(Point=facen.Centers, Vector=facen.Normals, Colour=RGB(0, 0, 0), Width=2)

# ----
panel = Panel("""0.18
0.40
0.65
0.80
0.85
0.80
0.75""")
lng = ListLength(List=panel)
repeat = RepeatData(Data="0.35", Length=lng)
conmat = Compas_acousticsConstructMaterial(absorption=panel, scattering=repeat, name="human_clothing")  # -> material; inputs absorption: list of Double, scattering: list of Double, name: String
#   port absorption: List of absorption coefficients for each frequency band. e.g. '0.1, 0.2, 0.3, 0.4, 0.5, 0.6, 0.7' for 7 frequency bands.
#   port scattering: Optional. List of scattering coefficients for each frequency band. e.g. '0.1, 0.2, 0.3, 0.4, 0.5, 0.6, 0.7' for 7 frequency bands.
#   port name: Name of the material preset in the library (e.g. 'concrete', 'carpet').
#   port material: AcousticMaterial object.
# ---------- conmat: Python ----------
"""Create an AcousticMaterial for AcousticObject(s)."""
# flake8: noqa
import Grasshopper
import System
from compas_acoustics.acoustic_material import AcousticMaterial


class ConstructMaterial(Grasshopper.Kernel.GH_ScriptInstance):

    def RunScript(self,
            absorption: System.Collections.Generic.List[float],
            scattering: System.Collections.Generic.List[float],
            name: str):
        if absorption is None:
            ghenv.Component.AddRuntimeMessage(
                Grasshopper.Kernel.GH_RuntimeMessageLevel.Warning,
                "Input parameter 'absorption' failed to collect data."
            )
            return
        if name is None:
            ghenv.Component.AddRuntimeMessage(
                Grasshopper.Kernel.GH_RuntimeMessageLevel.Warning,
                "Input parameter 'name' failed to collect data."
            )
            return

        return AcousticMaterial(
            name=name,
            absorption_coefficients=absorption,
            scattering_coefficients=scattering,
        )
# ---------- end conmat ----------

panel_2 = Panel("""0.05
0.04
0.05
0.06
0.06
0.07
0.08""")
panel_3 = Panel("wood_laminate_desk_30mm")
lng_2 = ListLength(List=panel_2)
repeat_2 = RepeatData(Data="0.08", Length=lng_2)
conmat_2 = Compas_acousticsConstructMaterial(absorption=panel_2, scattering=repeat_2, name=panel_3)  # -> material; inputs absorption: list of Double, scattering: list of Double, name: String; same code as conmat

concrete = Compas_acousticsMaterialLibrary()  # -> material
#   port material: AcousticMaterial object.
# ---------- concrete: Python ----------
"""Preset picker for AcousticMaterial. Right-click to choose a material from the materials_library folder."""
# flake8: noqa
import Grasshopper
from System.Windows.Forms import ToolStripSeparator
from compas_acoustics.materials_library import MaterialsLibrary


class MaterialLibraryPicker(Grasshopper.Kernel.GH_ScriptInstance):

    def __init__(self):
        super().__init__()
        self.library = MaterialsLibrary()
        nickname = ghenv.Component.NickName
        self.material_name = nickname if nickname in self.library.material_names else None

    def RunScript(self):
        names = sorted(self.library.material_names)
        if not names:
            ghenv.Component.AddRuntimeMessage(
                Grasshopper.Kernel.GH_RuntimeMessageLevel.Error, "No material presets found in the materials library."
            )
            return None

        if self.material_name not in names:
            ghenv.Component.AddRuntimeMessage(
                Grasshopper.Kernel.GH_RuntimeMessageLevel.Remark, "Right-click the icon to choose a material."
            )
            ghenv.Component.Message = None
            return None

        ghenv.Component.Message = self.material_name
        return self.library.material_from_name(self.material_name)

    def AppendAdditionalMenuItems(self, menu):
        for name in sorted(self.library.material_names):
            item = menu.Items.Add(name, None, self.on_item_click)
            item.Checked = (name == self.material_name)

        menu.Items.Add(ToolStripSeparator())

    def on_item_click(self, sender, event_info):
        name = str(sender)
        if name == self.material_name:
            return
        self.material_name = name
        ghenv.Component.NickName = name
        ghenv.Component.ExpireSolution(True)
# ---------- end concrete ----------
wall_absorber_50mm = Compas_acousticsMaterialLibrary()  # -> material; same code as concrete
merge = Merge(Data1=concrete, Data2=wall_absorber_50mm)  # -> flatten(Result)

# ----
# Genes for Determine Materials,
# if <= .5 -> concrete, if > .5 -> absorber
button_2 = Button()
wlc_genes_1 = GenePool(Decimals=1, Maximum=1, Minimum=0, Value=[0.5, 0.2, 0.4, 0.2, 0.8, 0, 0, 0.6, 0, 0.2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])
shuffler = GenePoolAndSliderShuffler(BooleanButton=button_2)
py3 = Python3Script(thresholds=wlc_genes_1, materials=merge)  # -> out, materials_out, absorber_count, absorber_indices; inputs thresholds: list of Double, materials: list
# ---------- py3: Python ----------
materials_out = [materials[0] if thres <= 0.5 else materials[1] for thres in thresholds]
absorber_count = sum(1 for thres in thresholds if thres > 0.5)
absorber_indices = [i for i, thres in enumerate(thresholds) if thres > 0.5]
# ---------- end py3 ----------

# ----
# Closed Room
panel_4 = Panel("-3.6")
disc = Discontinuity(Curve=crv, Level=1)  # -> Points, Parameters
Z = UnitZ(Factor=panel_4)
shift = ShiftList(List=disc.Points, Shift=1, Wrap=True)
move = Move(Geometry=crv, Motion=Z)  # -> Geometry, Transform
disc_2 = Discontinuity(Curve=move.Geometry, Level=1)  # -> Points, Parameters
shift_2 = ShiftList(List=disc_2.Points, Shift=1, Wrap=True)
merge_2 = Merge(
    Data1=simplify(graft(disc.Points)),
    Data2=simplify(graft(shift)),
    Data3=simplify(graft(shift_2)),
    Data4=simplify(graft(disc_2.Points)))
flip = FlipCurve(Curve=crv)  # -> Curve, Flag
pline = PolyLine(Vertices=merge_2, Closed=invert(False))  # -> flatten(Polyline)
acoustic_plaster = Compas_acousticsMaterialLibrary()  # -> material; same code as concrete
carpet = Compas_acousticsMaterialLibrary()  # -> material; same code as concrete
obj = Compas_acousticsAcousticObject(geometry=flip.Curve, material=acoustic_plaster, name="plaster_ceiling")  # -> acoustic_object; inputs geometry: GeometryBase, name: String
#   port geometry: Geometry of the AcousticObject.
#   port material: Material of the AcousticObject.
#   port name: Name of the AcousticObject.
#   port acoustic_object: AcousticObject object.
# ---------- obj: Python ----------
"""Create an AcousticObject with the specified geometry and material."""
# flake8: noqa
import Grasshopper
import Rhino
from compas_acoustics.geometry import AcousticObject
from compas_rhino.conversions import mesh_to_compas
from compas_rhino.conversions import polyline_to_compas

# TODO: Change the typeHintID in metadata.json from "mesh" to "geometrybase"

class CreateAcousticObject(Grasshopper.Kernel.GH_ScriptInstance):

    def RunScript(self, geometry: Rhino.Geometry.GeometryBase, material, name: str):

        if geometry is None:
            ghenv.Component.AddRuntimeMessage(
                Grasshopper.Kernel.GH_RuntimeMessageLevel.Warning, "No geometry provided."
            )
            return
        if material is None:
            ghenv.Component.AddRuntimeMessage(
                Grasshopper.Kernel.GH_RuntimeMessageLevel.Warning, "No material provided."
            )
            return

        # Gemetry conversion from Rhino to Compas
        # TODO: Figure out how to handle other geometry types (e.g., Brep, Surface, etc.)
        if isinstance(geometry, Rhino.Geometry.Mesh):
            geometry = mesh_to_compas(geometry)
        elif isinstance(geometry, Rhino.Geometry.Polyline):
            geometry = polyline_to_compas(geometry)
        elif isinstance(geometry, Rhino.Geometry.PolylineCurve):
            geometry = polyline_to_compas(geometry.ToPolyline())
        else:
            ghenv.Component.AddRuntimeMessage(
                Grasshopper.Kernel.GH_RuntimeMessageLevel.Error, "Unsupported geometry type."
            )
            return
        return AcousticObject(acoustic_geometry=geometry, material=material, name=name)
# ---------- end obj ----------
obj_2 = Compas_acousticsAcousticObject(geometry=move.Geometry, material=carpet, name="carpet_floor")  # -> acoustic_object; inputs geometry: GeometryBase, name: String; same code as obj
mplane = MeshPlane(Boundary=pline, WidthCount=Slider(8, range=0..10), HeightCount=Slider(4, range=0..10))  # -> Mesh, Area
faceb = FaceBoundaries(Mesh=mplane.Mesh)
tstat = TreeStatistics(Tree=faceb)  # -> Paths, Length, Count
py3_2 = Python3Script(lengths=tstat.Length)  # -> out, names; inputs lengths: list
# ---------- py3_2: Python ----------
names = []
for i, lng in enumerate(lengths):
    for j in range(lng):
        name = f"wall_{i}_{j}"
        names.append(name)
# ---------- end py3_2 ----------
obj_3 = Compas_acousticsAcousticObject(geometry=flatten(faceb), material=py3.materials_out)  # -> acoustic_object; inputs geometry: GeometryBase, name: String; same code as obj
panel_5 = Panel(py3_2.names)
merge_3 = Merge(Data1=obj, Data2=obj_2, Data3=obj_3)

disc_3 = Discontinuity(Curve=crv, Level=1)  # -> Points, Parameters
avr = Average(Input=disc_3.Points)
Z_2 = UnitZ(Factor="-2.85")
move_2 = Move(Geometry=avr, Motion=Z_2)  # -> Geometry, Transform
py3_3 = Python3Script(centroid=move_2.Geometry, x_size="3.0", y_size="1.2")  # -> out, rec; inputs centroid: Point3d, x_size: Double, y_size: Double
# ---------- py3_3: Python ----------
import Rhino.Geometry as rg


corner_1 = centroid - rg.Vector3d(x_size/2, y_size/2, 0)
corner_2  = centroid + rg.Vector3d(x_size/2, y_size/2, 0)

rec = rg.Rectangle3d(
    rg.Plane(centroid, rg.Vector3d.ZAxis), corner_1, corner_2
)
# ---------- end py3_3 ----------

Z_3 = UnitZ(Factor="-0.75")
move_3 = Move(Geometry=jitter_point, Motion=Z_3)  # -> Geometry, Transform
crv_cp = CurveClosestPoint(Point=move_3.Geometry, Curve=py3_3.rec)  # -> Point, Parameter, Distance
py3_4 = Python3Script(centroid=move_3.Geometry, x_size="0.45", y_size="0.45")  # -> out, rec; inputs centroid: Point3d, x_size: Double, y_size: Double; same code as py3_3
py3_5 = Python3Script(centroid=move_3.Geometry, toward=crv_cp.Point, x_size="0.45", y_size="0.65")  # -> out, rec; inputs centroid: Point3d, toward: Point3d, x_size: Double, y_size: Double
# ---------- py3_5: Python ----------
import Rhino.Geometry as rg

vec = toward - centroid
vec = rg.Vector3d(vec.X, vec.Y, 0)

dire_1 = rg.Vector3d(vec)
dire_1.Unitize()

dire_2 = rg.Vector3d.CrossProduct(dire_1, rg.Vector3d.ZAxis)

corner = centroid - dire_1 * x_size / 2 + dire_2 * x_size / 2

pln = rg.Plane(corner, -dire_2, rg.Vector3d.ZAxis)

rec = rg.Rectangle3d(
    pln, x_size, y_size
)
# ---------- end py3_5 ----------

# ---- group: all rays must pass through the mesh face in even numbers
data = Data(py3_5.rec)
flip_2 = FlipCurve(Curve=data)  # -> Curve, Flag
data_2 = Data([data, flip_2.Curve])

data_3 = Data(py3_4.rec)
flip_3 = FlipCurve(Curve=data_3)  # -> Curve, Flag
data_4 = Data([data_3, flip_3.Curve])

# ----
# Sources & Receivers
number_slider = Slider(0.37, range=0..1)
crv_2 = Curve(<curve referenced from the Rhino model>)
pt = Point(jitter_point)
end = EndPoints(Curve=crv_2)  # -> Start, End
cardioid = Compas_acousticsDirectivity()  # -> directivity
#   port directivity: Directivity pattern.
# ---------- cardioid: Python ----------
"""Preset picker for directivity patterns. Right-click to choose a pattern from the available options."""
# flake8: noqa
import Grasshopper
from System.Windows.Forms import ToolStripSeparator
from compas_acoustics.materials_library import MaterialsLibrary


class DirectivitySelector(Grasshopper.Kernel.GH_ScriptInstance):
    ITEMS = ["Bidirectional", "Hypercardioid", "Supercardioid", "Cardioid", "Omnidirectional"]

    def __init__(self):
        super().__init__()
        nickname = ghenv.Component.NickName
        self.directivity_name = nickname if nickname in self.ITEMS else None

    def RunScript(self):
        names = self.ITEMS
        if not names:
            ghenv.Component.AddRuntimeMessage(
                Grasshopper.Kernel.GH_RuntimeMessageLevel.Error, "No directivity patterns found."
            )
            return None

        if self.directivity_name not in names:
            ghenv.Component.AddRuntimeMessage(
                Grasshopper.Kernel.GH_RuntimeMessageLevel.Remark, "Right-click the icon to choose a directivity pattern."
            )
            ghenv.Component.Message = None
            return None

        ghenv.Component.Message = self.directivity_name
        return self.directivity_name.lower()

    def AppendAdditionalMenuItems(self, menu):
        for name in self.ITEMS:
            item = menu.Items.Add(name, None, self.on_item_click)
            item.Checked = (name == self.directivity_name)

        menu.Items.Add(ToolStripSeparator())

    def on_item_click(self, sender, event_info):
        name = str(sender)
        if name == self.directivity_name:
            return
        self.directivity_name = name
        ghenv.Component.NickName = name
        ghenv.Component.ExpireSolution(True)
# ---------- end cardioid ----------
points = PointList(Points=pt, Size=number_slider)
pt_2 = Point(end.Start)
source = Compas_acousticsSource(position=pt_2, direction=crv_2, directivity=cardioid, name="my_source")  # -> source; inputs position: Point3d, direction: Vector3d, directivity: String, name: String, sound_file: String
#   port position: Position of the source.
#   port direction: Direction of the source.
#   port directivity: Directivity of the source. Default is Omnidirectional. Options: - Bidirectional - Hypercardioid - Supercardioid - Cardioid - Omnidirectional
#   port name: Name of the source.
#   port sound_file: Sound file associated with the source.
#   port source: Source object.
# ---------- source: Python ----------
"""Acoustic Source object (speaker, human, etc.)."""
# flake8: noqa
import Grasshopper
import Rhino
from compas_acoustics import Source


class CreateSource(Grasshopper.Kernel.GH_ScriptInstance):
    ITEMS = ["bidirectional", "hypercardioid", "supercardioid", "cardioid", "omnidirectional"]

    def RunScript(self,
            position: Rhino.Geometry.Point3d,
            direction: Rhino.Geometry.Vector3d,
            directivity: str,
            name: str,
            sound_file: str):
        if position is None:
            position = Rhino.Geometry.Point3d(0, 0, 0)
        if direction is None:
            direction = Rhino.Geometry.Vector3d(1, 0, 0)

        if directivity is None:
            dirt = "omnidirectional"
        elif directivity not in self.ITEMS:
            ghenv.Component.AddRuntimeMessage(
                Grasshopper.Kernel.GH_RuntimeMessageLevel.Error, "Input parameter 'directivity' is not valid."
            )
            return None
        else:
            dirt = directivity

        if name is None:
            name = "my_source"

        return Source(
            name,
            *position,
            directivity=dirt,
            direction=[*direction],
            sound_file=sound_file
        )
# ---------- end source ----------
receiver = Compas_acousticsReceiver(position=pt, name="my_receiver")  # -> receiver; inputs position: Point3d, name: String
#   port position: Position of the receiver.
#   port name: Name of the receiver.
#   port receiver: Receiver object.
# ---------- receiver: Python ----------
"""Acoustic Receiver object (microphone, human ear, etc.)."""
# flake8: noqa
import Grasshopper
import Rhino
from compas_acoustics import Receiver

# TODO: Implement direction
class CreateReceiver(Grasshopper.Kernel.GH_ScriptInstance):

    def RunScript(self, position: Rhino.Geometry.Point3d, name: str):
        if position is None:
            position = Rhino.Geometry.Point3d(0, 0, 1)
        if name is None:
            name = "my_receiver"

        return Receiver(name, *position)
# ---------- end receiver ----------

vec2pt = Vector2Pt(PointA=jitter_point, PointB=pt_2, Unitize=False)  # -> Vector, Length; disabled
crv_3 = Curve(py3_5.rec)  # disabled
devec = DeconstructVector(Vector=vec2pt.Vector)  # -> XComponent, YComponent, ZComponent; disabled
disc_4 = Discontinuity(Curve=crv_3, Level=1)  # -> Points, Parameters; disabled
vec = VectorXYZ(XComponent=devec.XComponent, YComponent=devec.YComponent, ZComponent=0)  # -> Vector, Length; disabled
item = ListItem(List=disc_4.Points, Index=0, Wrap=True)  # -> Item1, Item, Item1_2; disabled
unit = UnitVector(Vector=vec.Vector)  # disabled
number_slider_2 = Slider(21, range=0..45)  # disabled
pl_3pt = Plane3Pt(PointA=item.Item, PointB=item.Item1_2, PointC=item.Item1)  # -> flatten(Plane); disabled
avr_2 = Average(Input=disc_4.Points)  # disabled
number_slider_3 = Slider(0.1, range=0..1)  # disabled
deplane = DeconstructPlane(Plane=pl_3pt)  # -> Origin, XAxis, YAxis, ZAxis; disabled
xprod = CrossProduct(VectorA=deplane.ZAxis, VectorB=unit, Unitize=False)  # -> Vector, Length; disabled
number_slider_4 = Slider(22, range=0..45)  # disabled
rev = Reverse(Vector=deplane.ZAxis)  # disabled
amp = Amplitude(Vector=rev, Amplitude=number_slider_3)  # disabled
move_4 = Move(Geometry=crv_3, Motion=amp)  # -> Geometry, Transform; disabled
rev_2 = Reverse(Vector=deplane.XAxis)  # disabled
rot3d = Rotate3D(Geometry=move_4.Geometry, Angle=degrees(number_slider_4), Center=deplane.Origin, Axis=rev_2)  # -> Geometry, Transform; disabled
rot3d_2 = Rotate3D(Geometry=rot3d.Geometry, Angle=degrees(number_slider_2), Center=flatten(avr_2), Axis=xprod.Vector)  # -> Geometry, Transform; disabled

# ---- group: all rays must pass through the mesh face in even numbers
data_5 = Data(py3_3.rec)
flip_4 = FlipCurve(Curve=data_5)  # -> Curve, Flag
data_6 = Data([data_5, flip_4.Curve])

# ----
multiconvolve = BooleanToggle(False)
panel_6 = Panel(py3.absorber_count)
save = Button()

# ----
# Human Sitting
panel_7 = Panel("human_sitting")
merge_4 = Merge(Data1=data_4, Data2=data_2)  # -> flatten(Result)
obj_4 = Compas_acousticsAcousticObject(geometry=merge_4, material=conmat, name=panel_7)  # -> acoustic_object; inputs geometry: GeometryBase, name: String; same code as obj

# ---- group: enable them after optimization, for phenotype
data_7 = Data(flatten(faceb))
int = Integer(py3.absorber_indices)
cull_i = CullIndex(List=data_7, Indices=int, Wrap=True)
item_2 = ListItem(List=data_7, Index=int, Wrap=True)
mcol = MeshColours(Mesh=item_2, Colours=ColourSwatch(SwatchColor=RGB(0, 255, 242)))
mcol_2 = MeshColours(Mesh=cull_i, Colours=ColourSwatch(SwatchColor=RGB(145, 145, 145)))
mjoin = MeshJoin(Meshes=flatten([mcol, mcol_2]))

# ----
# Table
obj_5 = Compas_acousticsAcousticObject(geometry=data_6, material=conmat_2, name=panel_3)  # -> acoustic_object; inputs geometry: GeometryBase, name: String; same code as obj

wlc_minimize_absorber_count = Number(py3.absorber_count)

# ----
# Internal Objects
merge_5 = Merge(Data1=obj_5, Data2=obj_4)

distributor = DistributeToGrid(OutputOptions=0)  # -> DistributedFitnessValues, DistributedData, DistributedGeometries, DistributedMeshes, DistributedNumbers, GridLocations
merge_6 = Merge(Data1=merge_3, Data2=merge_5)
scene = Compas_acousticsRoomScene(objects=flatten(merge_6), sources=flatten(source), receivers=flatten(receiver), name="my_scene")  # -> scene; inputs objects: list, sources: list, receivers: list, name: String
#   port objects: List of AcousticObject
#   port sources: List of Source objects.
#   port receivers: List of Receiver objects.
#   port name: Name of the room scene.
#   port scene: Room scene object.
# ---------- scene: Python ----------
"""Create a room scene with the specified objects, sources, and receivers."""
# flake8: noqa
import Grasshopper

import System
from compas_acoustics.scene import Scene
from compas_acoustics.source import Source
from compas_acoustics.receiver import Receiver


class CreateModelScene(Grasshopper.Kernel.GH_ScriptInstance):

    def RunScript(self,
            objects: System.Collections.Generic.List[object],
            sources: System.Collections.Generic.List[object],
            receivers: System.Collections.Generic.List[object],
            name: str):

        if objects is None:
            ghenv.Component.AddRuntimeMessage(
                Grasshopper.Kernel.GH_RuntimeMessageLevel.Warning, "No objects provided."
            )
            return
        if sources is None:
            ghenv.Component.AddRuntimeMessage(
                Grasshopper.Kernel.GH_RuntimeMessageLevel.Warning, "No sources provided."
            )
            return
        if receivers is None:
            ghenv.Component.AddRuntimeMessage(
                Grasshopper.Kernel.GH_RuntimeMessageLevel.Warning, "No receivers provided."
            )
            return

        scene = Scene(name=name)
        scene.add_acoustic_objects(objects)
        for src in sources:
            if isinstance(src, Source):
                scene.add_source(src)
            else:
                ghenv.Component.AddRuntimeMessage(
                    Grasshopper.Kernel.GH_RuntimeMessageLevel.Error,
                    f"Invalid source type: {type(src)}. Expected a Source object.",
                )
        for rcv in receivers:
            if isinstance(rcv, Receiver):
                scene.add_receiver(rcv)
            else:
                ghenv.Component.AddRuntimeMessage(
                    Grasshopper.Kernel.GH_RuntimeMessageLevel.Error,
                    f"Invalid receiver type: {type(rcv)}. Expected a Receiver object.",
                )

        return scene
# ---------- end scene ----------
number_slider_5 = Slider(19, range=0..19)  # disabled
data_8 = Data(distributor.DistributedMeshes)
number_slider_6 = Slider(0, range=0..10)  # disabled
simrt = Compas_acousticsSimulateRayTracing(
    scene=scene,
    max_order="1",
    n_rays=Slider(2000, range=0..10000),
    energy_thres="1e-04",
    time_thres=Slider(0.6, range=0..1),
    seed=Slider(3, range=0..10))  # -> ir_graph; inputs sample_rate: Int32, max_order: Int32, n_rays: Int32, absorb_air: Boolean, energy_thres: Double, time_thres: Double, seed: Int32
#   port scene: Room scene object.
#   port sample_rate: Sample rate for the simulation.
#   port max_order: Maximum order of image sources.
#   port n_rays: Number of rays for ray tracing.
#   port absorb_air: Whether to consider air absorption.
#   port energy_thres: Energy threshold for ray tracing.
#   port time_thres: Time threshold for ray tracing.
#   port seed: Random seed for reproducibility.
#   port ir_graph: Impulse response graph structure.
# ---------- simrt: Python ----------
"""Simulate room acoustics using Image Source Method (ISM) and Ray Tracing (RT) to generate impulse response graph structure."""
# flake8: noqa
import Grasshopper

from compas_acoustics.simulator import Simulator

class SimulateRayTracing(Grasshopper.Kernel.GH_ScriptInstance):

    def RunScript(self,
            scene,
            sample_rate: int,
            max_order: int,
            n_rays: int,
            absorb_air: bool,
            energy_thres: float,
            time_thres: float,
            seed: int):

        if scene is None:
            ghenv.Component.AddRuntimeMessage(
                Grasshopper.Kernel.GH_RuntimeMessageLevel.Warning, "Input parameter 'scene' failed to collect data."
            )
            return

        if max_order is None:
            max_order = 2
        if n_rays is None:
            n_rays = 1000
        if absorb_air is None:
            absorb_air = True
        if energy_thres is None:
            energy_thres = 1e-7
        if time_thres is None:
            time_thres = 10.0

        sim = Simulator(scene)
        if sample_rate is not None:
            sim.sampling_rate = sample_rate

        sim.rir_from_ray_tracing(
            image_source_order=max_order,
            n_rays=n_rays,
            air_absorption=absorb_air,
            energy_thres=energy_thres,
            time_thres=time_thres,
            random_seed=seed,
        )

        ghenv.Component.Message = "{}Hz, order={}, rays={}, air={}, seed={}, energy_thres={}, time_thres={}".format(
            sim.sampling_rate, max_order, n_rays, absorb_air, seed if seed is not None else "random", energy_thres, time_thres
        )

        return sim.scene.ir_graph
# ---------- end simrt ----------

# ----
# Simulate & Analyse
decirgraph = Compas_acousticsDeconstructIRGraph(ir_graph=simrt)  # -> ir, sources, receivers, edges; inputs receiver_idx: list of Int32
#   port ir_graph: Impulse response graph structure.
#   port receiver_idx: Index(s) of the receiver(s) to filter.
#   port ir: ImpulseResponse object(s).
#   port sources: Source object(s).
#   port receivers: Receiver object(s).
#   port edges: Relationships between sources and receivers as Line(s).
# ---------- decirgraph: Python ----------
"""Deconstruct impulse response graph structure into ImpulseResponse(s)."""
# flake8: noqa
import Grasshopper
from Grasshopper import DataTree
from Grasshopper.Kernel.Data import GH_Path
from Rhino.Geometry import Line
import System

class DeconstructIRGraph(Grasshopper.Kernel.GH_ScriptInstance):

    def RunScript(self,
            ir_graph,
            receiver_idx: System.Collections.Generic.List[int]):

        if ir_graph is None:
            ghenv.Component.AddRuntimeMessage(
                Grasshopper.Kernel.GH_RuntimeMessageLevel.Warning, "Input parameter 'ir_graph' failed to collect data."
            )

        ir_out = DataTree[object]()
        source_out = DataTree[object]()
        receiver_out = DataTree[object]()
        edge_out = DataTree[object]()

        # 1. Set order of receivers
        receiver_list = [
            ir_graph.node_attribute(node, 'data')
            for node in ir_graph.nodes()
            if ir_graph.node_attribute(node, 'type') == 'receiver'
        ]
        receiver_set = {rec.guid for rec in receiver_list}

        # 2. Make ir group as {receiver_0: [src_0, ...], ...}
        source_group = {}
        ir_group = {}

        for u, v in ir_graph.edges():
            ir = ir_graph.edge_attribute((u, v), 'data')
            data_u = ir_graph.node_attribute(u, 'data')
            data_v = ir_graph.node_attribute(v, 'data')

            if data_u.guid in receiver_set:
                rec, src = data_u, data_v
            elif data_v.guid in receiver_set:
                rec, src = data_v, data_u
            else:
                continue
            
            source_group.setdefault(rec.guid, []).append(src)
            ir_group.setdefault(rec.guid, []).append(ir)

        # 3. Filter receiver, optional
        if receiver_idx is None:
            indices = list(range(len(receiver_list)))
        else:
            indices = receiver_idx  # Already set to list access

        for idx in indices:
            rec = receiver_list[idx]
            path = GH_Path(idx)

            sources = source_group.get(rec.guid, [])
            irs = ir_group.get(rec.guid, [])

            receiver_out.Add(rec, path)
            source_out.AddRange(sources, path)
            ir_out.AddRange(irs, path)
            edge_out.AddRange([Line(*src.position, *rec.position) for src in sources], path)

        return ir_out, source_out, receiver_out, edge_out
# ---------- end decirgraph ----------
analyseir = Compas_acousticsAnalyseImpulseResponse(ir=decirgraph.ir)  # -> params
#   port ir: ImpulseResponse (IR) object.
#   port params: List of acoustic parameters ('EDT', 'T20', 'T30', 'C50', 'C80', 'D50', 'DRR', 'Ts', 'STI').
# ---------- analyseir: Python ----------
"""Analyse impulse response (IR) and return acoustic parameters such as EDT, T20, C50, etc."""
# flake8: noqa
import Grasshopper
from compas_acoustics.analyser import AcousticAnalyser
from compas_acoustics import AcousticParameter
from compas_acoustics import Defaults


class AnalyseIR(Grasshopper.Kernel.GH_ScriptInstance):
    def RunScript(self, ir):
        if ir is None:
            ghenv.Component.AddRuntimeMessage(Grasshopper.Kernel.GH_RuntimeMessageLevel.Warning, "Input parameter 'ir' failed to collect data.")
            return None

        analyser = AcousticAnalyser(ir.ir)
        analyser.analyse()

        return [AcousticParameter().from_analyser(analyser, name) for name in Defaults().PARAM_NAMES]
# ---------- end analyseir ----------
analyseir_2 = Compas_acousticsAnalyseImpulseResponse(ir=decirgraph.ir)  # -> params; same code as analyseir
item_3 = ListItem(List=analyseir, Index=Slider(1, range=0..10), Wrap=True)
item_4 = ListItem(List=analyseir_2, Index=Slider(3, range=0..10), Wrap=True)
deparam = Compas_acousticsDeconstructParameter(param=item_3)  # -> name, values, flatten(overall), frequencies
#   port param: AcousticParameter (AP) object.
#   port name: Nmae of the acoustic parameter.
#   port values: Values of the acoustic parameter.
#   port overall: Overall value of the acoustic parameter.
#   port frequencies: Frequencies of the acoustic parameter.
# ---------- deparam: Python ----------
"""Deconstruct acoustic parameter."""
# flake8: noqa
import Grasshopper
from compas_acoustics.analyser import AcousticAnalyser
from compas_acoustics import AcousticParameter
from compas_acoustics import Defaults


class DeconstructParam(Grasshopper.Kernel.GH_ScriptInstance):
    def RunScript(self, param):
        if param is None:
            ghenv.Component.AddRuntimeMessage(Grasshopper.Kernel.GH_RuntimeMessageLevel.Warning, "Input parameter 'param' failed to collect data.")
            return None
        
        return param.title, param.values, param.overall, param.frequencies
# ---------- end deparam ----------
panel_8 = Panel(deparam.name)
deparam_2 = Compas_acousticsDeconstructParameter(param=item_4)  # -> name, values, flatten(overall), frequencies; same code as deparam
panel_9 = Panel(deparam_2.name)
panel_10 = Panel(deparam.overall)
panel_11 = Panel(deparam_2.overall)

# ----
# Auralise
panel_12 = Panel("mono_adult_female_speech.wav")
py3_6 = Python3Script(name=panel_12)  # -> out, path; inputs name: String
# ---------- py3_6: Python ----------
import sys
import os

gh_path = ghenv.Component.OnPingDocument().FilePath
dire_path = os.path.dirname(gh_path)
sound_path = os.path.join(dire_path, "sound_files", name)

path = sound_path
# ---------- end py3_6 ----------
item_5 = ListItem(List=flatten(decirgraph.ir), Index=Slider(5, range=0..10), Wrap=True)
stop = Button()
play = Button()
auralise = Compas_acousticsAuralise(irs=item_5, signals=py3_6.path, multiconvolve=multiconvolve, save=save)  # -> signals; inputs irs: tree, signals: tree, multiconvolve: Boolean, save_file_path: String, save_file_name: String, save: Boolean
#   port irs: ImpulseResponse object(s)
#   port signals: Optional source signal(s). If not provided, it will take the signal(s) from the Source object(s) in the scene.
#   port multiconvolve: Whether to convolve multiple signals with multiple impulse responses. If False, it will convolve each signal with the corresponding impulse response.
#   port save_file_path: File path to save the convolved signal(s). Default is the current working directory.
#   port save_file_name: File name for the saved convolved signal(s). Default is 'convolved_sound'.
#   port save: Whether to save the convolved signal(s) to a file.
#   port signals: Convolved signal(s).
# ---------- auralise: Python ----------
"""Auralise the room scene by convolving the impulse response with the source signal(s)."""
# flake8: noqa
import Grasshopper
from Grasshopper import DataTree
from Grasshopper.Kernel.Data import GH_Path
import System
import scriptcontext as sc
import numpy as np
import os

from compas_acoustics.auraliser import Auraliser


class Auralise(Grasshopper.Kernel.GH_ScriptInstance):

    def offer_buttons(self):
        component = ghenv.Component
        offered_key = "Auraliser_buttons_offered_{}".format(component.InstanceGuid)
        if sc.sticky.get(offered_key):
            return
        sc.sticky[offered_key] = True

        doc = component.OnPingDocument()
        if doc is None:
            return

        targets = [
            (index, nickname, comp) for index, nickname, comp in ((2, "Multiconvolve", "tog"), (5, "Save", "but"))
            if component.Params.Input[index].SourceCount == 0
        ]
        if not targets:
            return

        def deferred(gh_doc):
            base = component.Attributes.Pivot
            for row, (index, nickname, comp) in enumerate(targets):
                input_param = component.Params.Input[index]
                if input_param.SourceCount > 0:
                    continue

                if comp == "tog":
                    popout = Grasshopper.Kernel.Special.GH_BooleanToggle()
                elif comp == "but":
                    popout = Grasshopper.Kernel.Special.GH_ButtonObject()
                else:
                    continue
                popout.CreateAttributes()
                popout.NickName = nickname
                popout.Attributes.Pivot = System.Drawing.PointF(base.X - 280, base.Y - 20 + row * 60)
                gh_doc.AddObject(popout, False)
                input_param.AddSource(popout)
                popout.ExpireSolution(True)

        doc.ScheduleSolution(1, deferred)

    def RunScript(self,
            irs: Grasshopper.DataTree[object],
            signals: Grasshopper.DataTree[object],
            multiconvolve: bool,
            save_file_path: str,
            save_file_name: str,
            save: bool):

        self.offer_buttons()

        if irs is None:
            ghenv.Component.AddRuntimeMessage(
                Grasshopper.Kernel.GH_RuntimeMessageLevel.Warning, "Input parameter 'irs' failed to collect data."
            )
            return
        
        has_signals = signals is not None and signals.DataCount > 0
        if has_signals:
            if irs.BranchCount != signals.BranchCount:
                raise ValueError("DataTree branch count mismatch.")
            if any(len(irs.Branch(i)) != len(signals.Branch(i)) for i in range(irs.BranchCount)):
                raise ValueError("DataTree branch length mismatch.")

        signals_out = DataTree[object]()
        # 1. Data conversions
        for i in range(irs.BranchCount):
            path = irs.Paths[i]

            br = irs.Branch(i)
            sound_files = signals.Branch(i) if has_signals else [ir.source.sound_file for ir in br]

            ir_groups = {}
            sound_groups = {}

            for idx, (IR, sound_file) in enumerate(zip(br, sound_files)):
                receiver_id = str(IR.receiver.guid)

                ir_groups.setdefault(receiver_id, {})
                sound_groups.setdefault(receiver_id, {})
                
                sub_key = f"source_{idx}"

                # ir_data = IR.ir
                ir_data = IR.ir[:, np.newaxis] if IR.ir.ndim == 1 else IR.ir

                ir_groups[receiver_id][sub_key] = {
                    'ir': ir_data,
                    'sample_rate': IR.sample_rate,
                    'ambisonic_order': 0,
                    'channel_order': 'acn',
                    'normalisation': 'sn3d'
                }

                sound_groups[receiver_id][sub_key] = {
                    'filepath': sound_file
                }

            # 2. Construct auraliser(s) and convolve signals
            for i, receiver_id in enumerate(ir_groups.keys()):
                if multiconvolve:
                    tasks = [(receiver_id, ir_groups[receiver_id], sound_groups[receiver_id], f"{i}")]
                else:
                    tasks = [
                        (
                            sub_key,
                            {sub_key: ir_groups[receiver_id][sub_key]},
                            {sub_key: sound_groups[receiver_id][sub_key]},
                            f"{i}_{j}",
                        )
                        for j, sub_key in enumerate(ir_groups[receiver_id].keys())
                    ]
                
                for name, ir_data, sound_data, suffix in tasks:
                    auraliser = Auraliser(
                        name=name,
                        impulse_responses=ir_data,
                        anechoic_sounds=sound_data,
                        output_format="mono",
                        # sample_rate=ir_groups[receiver_id][f"source_{0}"]['sample_rate']
                        sample_rate=48000
                    )
                    convolved_matrix = auraliser.multiconvolution()
                    
                    signals_out.Add(convolved_matrix, path)

                    if save:
                        filepath = self.set_save_file_path(save_file_path, save_file_name, suffix)
                        auraliser.export_convolved_sound(filepath, convolved_matrix)
        return signals_out
    
    @staticmethod
    def set_save_file_path(save_file_path=None, save_file_name=None, suffix=0):
        if save_file_path:
            base_dir = save_file_path
        else:
            base_dir = os.path.dirname(ghenv.Component.OnPingDocument().FilePath)

        if save_file_name:
            base_filename = save_file_name
        else:
            base_filename = "convolved_sound"
        return os.path.join(base_dir, f"{base_filename}_mic_{suffix}.wav")
# ---------- end auralise ----------
player = Compas_acousticsAudioPlayer(sound=auralise, play=play, stop=stop)  # inputs play: Boolean, stop: Boolean
#   port sound: Audio file path, numpy array, or Source object.
#   port play: Play the audio.
#   port stop: Stop the audio.
# ---------- player: Python ----------
"""Play audio files, accepting .wav, numpy arrays, and Source objects."""
# flake8: noqa
import Grasshopper
import System
from compas_acoustics import AudioPlayer
import scriptcontext as sc
import soundfile as sf


class PlayAudio(Grasshopper.Kernel.GH_ScriptInstance):

    def offer_buttons(self):
        component = ghenv.Component
        offered_key = "audio_player_buttons_offered_{}".format(component.InstanceGuid)
        if sc.sticky.get(offered_key):
            return
        sc.sticky[offered_key] = True

        doc = component.OnPingDocument()
        if doc is None:
            return

        targets = [(index, nickname) for index, nickname in ((1, "Play"), (2, "Stop")) if component.Params.Input[index].SourceCount == 0]
        if not targets:
            return

        def deferred(gh_doc):
            base = component.Attributes.Pivot
            for row, (index, nickname) in enumerate(targets):
                input_param = component.Params.Input[index]
                if input_param.SourceCount > 0:
                    continue

                button = Grasshopper.Kernel.Special.GH_ButtonObject()
                button.CreateAttributes()
                button.NickName = nickname
                button.Attributes.Pivot = System.Drawing.PointF(base.X - 180, base.Y - 15 + row * 30)
                gh_doc.AddObject(button, False)
                input_param.AddSource(button)
                button.ExpireSolution(True)

        doc.ScheduleSolution(1, deferred)

    def RunScript(self, sound, play: bool, stop: bool):
        self.offer_buttons()

        sample_rate = None

        if sound is None:
            return

        if isinstance(sound, str):  # file path
            try:
                sample_rate = sf.info(sound).samplerate
            except:
                pass
        elif hasattr(sound, "sound_file"):  # Source object
            sound = sound.sound_file
            try:
                sample_rate = sf.info(sound).samplerate
            except:
                pass
        elif hasattr(sound, "shape") and hasattr(sound, "ndim"):  # numpy array
            pass
        else:
            ghenv.Component.AddRuntimeMessage(
                Grasshopper.Kernel.GH_RuntimeMessageLevel.Error, "Input parameter 'sound' is not valid."
            )
            return

        player_key = "player"
        if player_key not in sc.sticky:
            sc.sticky[player_key] = AudioPlayer()

        player = sc.sticky[player_key]

        if play:
            player.play(sound, sample_rate)
        if stop:
            player.stop()
# ---------- end player ----------

fitness = Compas_acousticsRegularizedFitness(values=panel_10, target="0.5")  # -> fitness; inputs values: list of Double, target: Double, k: Double
#   port values: A list of numerical values to evaluate.
#   port target: The target value to compare against.
#   port k: A regularization parameter that controls the weight of the STD in the loss function. Default is 1.0.
#   port fitness: The fitness score, a lower value indicates better fitness.
# ---------- fitness: Python ----------
"""A loss function that combines the Mean Absolute Error (MAE) and Standard Deviation (STD) of a list of values with respect to a target value. 
MAE evaluates the Accuracy to the target, while STD evaluates the Consistency of the values. 
The lower the fitness score, the better the fitness."""
# flake8: noqa
import Grasshopper
import System
from compas_acoustics.numerical.fitness import regularized_fitness


class RegularizedFitness(Grasshopper.Kernel.GH_ScriptInstance):
    def RunScript(self,
            values: System.Collections.Generic.List[float],
            target: float,
            k: float):
        if values is None:
            ghenv.Component.AddRuntimeMessage(
                Grasshopper.Kernel.GH_RuntimeMessageLevel.Warning,
                "Input parameter 'values' failed to collect data."
            )
            return
        if target is None:
            ghenv.Component.AddRuntimeMessage(
                Grasshopper.Kernel.GH_RuntimeMessageLevel.Warning,
                "Input parameter 'target' failed to collect data."
            )
            return
        if k is None:
            k = 1.0
        return regularized_fitness(values, target, k)
# ---------- end fitness ----------
fitness_2 = Compas_acousticsRegularizedFitness(values=panel_11, target="7.0")  # -> fitness; inputs values: list of Double, target: Double, k: Double; same code as fitness
panel_13 = Panel(fitness)
panel_14 = Panel(fitness_2)
wlc_minimize_average_t20 = Number(fitness)
wlc_minimize_average_c50 = Number(fitness_2)
wallacei_x = WallaceiX(
    Genes=wlc_genes_1,
    Objectives=[wlc_minimize_average_c50, wlc_minimize_average_t20, wlc_minimize_absorber_count],
    Phenotype=mjoin,
    allFitness="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",
    allFrontIdx="5|0;8|1;8|2;9|3;9|4;10|5;10|6;10|7;11|9;11|11;11|12;11|13;11|14;12|16;12|17;12|18;12|19;13|4;13|5;13|9;13|10;13|17;13|19;14|1;14|4;14|5;14|14;14|15;14|16;14|17;14|18;14|19;15|2;15|9;15|14;16|7;16|8;16|9;16|10;16|18;16|19;17|2;17|3;17|6;17|8;17|9;17|12;17|13;17|15;17|18;18|2;18|7;18|10;18|13;18|14;18|16;18|19;19|2;19|9;19|13;19|18;19|19",
    allGenomes="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",
    curFrontIdx="19|0;19|1;19|2;19|3;19|4;19|5;19|6;19|7;19|8;19|9;19|10;19|11;19|12;19|13;19|14;19|15;19|16;19|17;19|18;19|19",
    curFrontIdxSave="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",
    popGen="20,20",
    total="1311406",
    wlcDone=True)  # -> WallaceiGenomes, FitnessValues, Data, WPhenotypes
pdecoder = DecodePhenotype(WallaceiPhenotype=wallacei_x.WPhenotypes)  # -> GeometriesList, flatten(MeshesList), NumbersList, TextList; disabled
tstat_2 = TreeStatistics(Tree=wallacei_x.WPhenotypes)  # -> Paths, Length, Count; disabled
branch = TreeBranch(Tree=wallacei_x.WallaceiGenomes, Path=tstat_2.Paths, MaintainPaths=True)  # disabled
branch_2 = TreeBranch(Tree=wallacei_x.FitnessValues, Path=tstat_2.Paths, MaintainPaths=True)  # disabled
item_6 = ListItem(List=pdecoder.MeshesList, Index=number_slider_5, Wrap=True)  # disabled
gdecoder = DecodeGenome(WallaceiGenome=branch)  # disabled
tstat_3 = TreeStatistics(Tree=gdecoder)  # -> Paths, Length, Count; disabled
panel_15 = Panel(branch_2)
item_7 = ListItem(List=tstat_3.Paths, Index=number_slider_6, Wrap=True)  # disabled
branch_3 = TreeBranch(Tree=gdecoder, Path=item_7, MaintainPaths=True)  # disabled
