# Grasshopper definition Scenario_02_3.ghx (Grasshopper 1.0.8)
# plug-ins: MeshEdit Components, Pufferfish, Human, Weaverbird, Wallacei

reload = Python3Script(reload=Button())  # inputs reload: Boolean
# ---------- reload: Python ----------
# venv: rhino_compas_acoustics
# r: compas
# r: pyroomacoustics
# r: matplotlib
# r: librosa
# r: soundfile
# r: sounddevice
# r: sofar
# r: pyfar
# r: pyrato

import sys
import os
from compas_rhino import unload_modules


gh_path = ghenv.Component.OnPingDocument().FilePath
dire_path = os.path.dirname(os.path.dirname(gh_path))
target_path = os.path.join(dire_path, "src")

if target_path not in sys.path:
    sys.path.insert(0, target_path)

if reload:
    unload_modules('compas_acoustics')

try:
    import compas_acoustics as ca
except Exception as e:
    raise ValueError(e)
# ---------- end reload ----------

# ----
# w/ table and chairs (humans)
toggle = BooleanToggle(True)  # disabled
lamcp = LAMCPBridge(enable=toggle)  # -> status; inputs enable: Boolean, port: Int32; disabled
#   port enable: Toggle to start (True) or stop (False) the local HTTP server.
#   port port: Port to listen on (loopback only). Defaults to 8765.
#   port status: Current server status string.
# ---------- lamcp: Python ----------
"""
LAMCP Bridge: local HTTP server inside Rhino 8 / Grasshopper CPython.

Exposes `POST /exec` (JSON: `{"code": "...", "timeout": 30}`) which
exec()s `code` and returns
`{"stdout": "...", "stderr": "...", "result": "...", "error": null|str}`.

Pair with the `lamcp` FastMCP server, which translates Claude's
`run_python_script` MCP tool calls into POSTs to this endpoint.

Binds to 127.0.0.1 only. NEVER expose beyond localhost â€” it exec()s
arbitrary Python with full Rhino API access.

LAMCP v0.1.0
"""

import contextlib
import io
import json
import threading
import traceback
from http.server import BaseHTTPRequestHandler
from http.server import HTTPServer

import Grasshopper
import scriptcontext as sc


SHARED_GLOBALS_KEY = "_lamcp_bridge_globals"
SERVER_KEY = "_lamcp_bridge_server"


def _exec_code(code, timeout):
    """Run `code` on the HTTP-server thread and capture stdout/stderr/result.

    NOTE: this is intentionally NOT marshalled to Rhino's UI thread for the
    spike â€” `Rhino.RhinoApp.InvokeOnUiThread` was queueing actions that
    never fired in Rhino 8 CPython. Most read-only RhinoCommon access is
    safe cross-thread; mutations may crash. Add Eto-based marshalling
    back here when we need it.
    """
    out = io.StringIO()
    err = io.StringIO()
    g = sc.sticky.setdefault(SHARED_GLOBALS_KEY, {"__name__": "__lamcp_bridge__"})
    error_text = None
    result_repr = None
    try:
        with contextlib.redirect_stdout(out), contextlib.redirect_stderr(err):
            exec(code, g, g)
            result_repr = repr(g.get("_"))
    except BaseException:
        error_text = traceback.format_exc()

    return {
        "stdout": out.getvalue(),
        "stderr": err.getvalue(),
        "result": result_repr,
        "error": error_text,
    }


class _ExecHandler(BaseHTTPRequestHandler):
    # Silence default request logging so it doesn't clog the Rhino command line.
    def log_message(self, fmt, *args):
        pass

    def _send(self, code, payload):
        body = json.dumps(payload).encode("utf-8")
        self.send_response(code)
        self.send_header("Content-Type", "application/json")
        self.send_header("Content-Length", str(len(body)))
        self.end_headers()
        self.wfile.write(body)

    def do_GET(self):
        if self.path == "/health":
            self._send(200, {"status": "ok"})
        else:
            self._send(404, {"error": "not found"})

    def do_POST(self):
        if self.path != "/exec":
            self._send(404, {"error": "not found"})
            return
        length = int(self.headers.get("Content-Length", "0"))
        try:
            raw = self.rfile.read(length).decode("utf-8")
            body = json.loads(raw)
            code = body.get("code", "")
            timeout = float(body.get("timeout", 30.0))
        except Exception as exc:
            self._send(400, {"error": "bad request: " + repr(exc)})
            return
        result = _exec_code(code, timeout)
        self._send(200, result)


def _start_server(port):
    server = HTTPServer(("127.0.0.1", port), _ExecHandler)
    thread = threading.Thread(
        target=server.serve_forever, daemon=True, name="lamcp-bridge"
    )
    thread.start()
    return {"server": server, "thread": thread, "port": port}


def _stop_server(state):
    try:
        state["server"].shutdown()
        state["server"].server_close()
    except Exception:
        pass


class LamcpBridgeComponent(Grasshopper.Kernel.GH_ScriptInstance):
    def RunScript(self, enable: bool, port: int):
        port = int(port) if port else 8765

        state = sc.sticky.get(SERVER_KEY)

        if not enable:
            if state is not None:
                _stop_server(state)
                del sc.sticky[SERVER_KEY]
            return "stopped"

        # Already running on the requested port: no-op.
        if (
            state is not None
            and state.get("port") == port
            and state["thread"].is_alive()
        ):
            return "listening on http://127.0.0.1:{}".format(port)

        # Port changed or server died: tear down and restart.
        if state is not None:
            _stop_server(state)
            del sc.sticky[SERVER_KEY]

        try:
            sc.sticky[SERVER_KEY] = _start_server(port)
        except OSError as exc:
            ghenv.Component.AddRuntimeMessage(  # noqa: F821
                Grasshopper.Kernel.GH_RuntimeMessageLevel.Error,
                "Failed to bind 127.0.0.1:{}: {}".format(port, exc),
            )
            return "error: {}".format(exc)

        return "listening on http://127.0.0.1:{}".format(port)
# ---------- end lamcp ----------

# ---- group: * face normal should point toward the sound source
facen = FaceNormals()  # -> Centers, Normals
vdisex = VectorDisplayEx(Point=facen.Centers, Vector=facen.Normals, Colour=RGB(0, 0, 0), Width=2)

# ----
crv = Curve(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)
seatpts = Point([Point(14.875, -6.04, 1.2), Point(15.625, -6.04, 1.2), Point(16.375, -6.04, 1.2), Point(17.125, -6.04, 1.2), Point(14.875, -7.94, 1.2), Point(15.625, -7.94, 1.2), Point(16.375, -7.94, 1.2), Point(17.125, -7.94, 1.2), Point(14.1, -6.99, 1.2)])

# ---- group: randomize points
jitter_point = JitterPoint(pt=seatpts, dist=Slider(0.02, range=0..0.1))  # -> new_pt; inputs pt: Point3d, dist: Double, seed: Int32
# ---------- jitter_point: Python ----------
import math
import random
import Rhino
import Rhino.Geometry as rg
import Grasshopper


class Script_Instance(Grasshopper.Kernel.GH_ScriptInstance):
    def RunScript(self, pt: Rhino.Geometry.Point3d, dist: float, seed: int):
        if pt is None:
            return None
        if dist is None:
            dist = 0.01
        if seed is None:
            seed = 0

        # Deterministic per-point RNG: the same seed reproduces the same
        # jittered pattern every run, but every distinct point still gets
        # its own random direction (not a single shared vector for all).
        local_seed = hash((seed, round(pt.X, 6), round(pt.Y, 6), round(pt.Z, 6)))
        rng = random.Random(local_seed)

        # uniformly random direction on the unit sphere (Marsaglia method)
        z = rng.uniform(-1.0, 1.0)
        theta = rng.uniform(0.0, 2.0 * math.pi)
        r = math.sqrt(max(0.0, 1.0 - z * z))
        direction = rg.Vector3d(r * math.cos(theta), r * math.sin(theta), z)

        return rg.Point3d(pt.X + direction.X * dist, pt.Y + direction.Y * dist, pt.Z + direction.Z * dist)
# ---------- end jitter_point ----------

# ----
disc = Discontinuity(Curve=crv, Level=1)  # -> Points, Parameters
shift = ShiftList(List=disc.Points, Shift=1, Wrap=True)
flip = FlipCurve(Curve=crv)  # -> Curve, Flag

concrete = Compas_acousticsMaterialLibrary()  # -> material
#   port material: AcousticMaterial object.
# ---------- concrete: Python ----------
"""Preset picker for AcousticMaterial. Right-click to choose a material from the materials_library folder."""
# flake8: noqa
import Grasshopper
from System.Windows.Forms import ToolStripSeparator
from compas_acoustics.materials_library import MaterialsLibrary


class MaterialLibraryPicker(Grasshopper.Kernel.GH_ScriptInstance):

    def __init__(self):
        super().__init__()
        self.library = MaterialsLibrary()
        nickname = ghenv.Component.NickName
        self.material_name = nickname if nickname in self.library.material_names else None

    def RunScript(self):
        names = sorted(self.library.material_names)
        if not names:
            ghenv.Component.AddRuntimeMessage(
                Grasshopper.Kernel.GH_RuntimeMessageLevel.Error, "No material presets found in the materials library."
            )
            return None

        if self.material_name not in names:
            ghenv.Component.AddRuntimeMessage(
                Grasshopper.Kernel.GH_RuntimeMessageLevel.Remark, "Right-click the icon to choose a material."
            )
            ghenv.Component.Message = None
            return None

        ghenv.Component.Message = self.material_name
        return self.library.material_from_name(self.material_name)

    def AppendAdditionalMenuItems(self, menu):
        for name in sorted(self.library.material_names):
            item = menu.Items.Add(name, None, self.on_item_click)
            item.Checked = (name == self.material_name)

        menu.Items.Add(ToolStripSeparator())

    def on_item_click(self, sender, event_info):
        name = str(sender)
        if name == self.material_name:
            return
        self.material_name = name
        ghenv.Component.NickName = name
        ghenv.Component.ExpireSolution(True)
# ---------- end concrete ----------
wall_absorber_50mm = Compas_acousticsMaterialLibrary()  # -> material; same code as concrete
merge = Merge(Data1=concrete, Data2=wall_absorber_50mm)  # -> flatten(Result)

# ----
# Genes for Determine Materials,
# if <= .5 -> concrete, if > .5 -> absorber
button = Button()
wlc_genes_1 = GenePool(Decimals=1, Maximum=1, Minimum=0, Value=[0.2, 0.1, 0.4, 0.1, 0.1, 0.4, 0.3, 0.6, 0.1, 0.4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])
shuffler = GenePoolAndSliderShuffler(BooleanButton=button)
py3 = Python3Script(thresholds=wlc_genes_1, materials=merge)  # -> out, materials_out, absorber_count, absorber_indices; inputs thresholds: list of Double, materials: list
# ---------- py3: Python ----------
materials_out = [materials[0] if thres <= 0.5 else materials[1] for thres in thresholds]
absorber_count = sum(1 for thres in thresholds if thres > 0.5)
absorber_indices = [i for i, thres in enumerate(thresholds) if thres > 0.5]
# ---------- end py3 ----------

# ----
# Closed Room
panel = Panel("-3.6")
Z = UnitZ(Factor=panel)

panel_2 = Panel("""0.18
0.40
0.65
0.80
0.85
0.80
0.75""")
lng = ListLength(List=panel_2)
repeat = RepeatData(Data="0.35", Length=lng)
conmat = Compas_acousticsConstructMaterial(absorption=panel_2, scattering=repeat, name="human_clothing")  # -> material; inputs absorption: list of Double, scattering: list of Double, name: String
#   port absorption: List of absorption coefficients for each frequency band. e.g. '0.1, 0.2, 0.3, 0.4, 0.5, 0.6, 0.7' for 7 frequency bands.
#   port scattering: Optional. List of scattering coefficients for each frequency band. e.g. '0.1, 0.2, 0.3, 0.4, 0.5, 0.6, 0.7' for 7 frequency bands.
#   port name: Name of the material preset in the library (e.g. 'concrete', 'carpet').
#   port material: AcousticMaterial object.
# ---------- conmat: Python ----------
"""Create an AcousticMaterial for AcousticObject(s)."""
# flake8: noqa
import Grasshopper
import System
from compas_acoustics.acoustic_material import AcousticMaterial


class ConstructMaterial(Grasshopper.Kernel.GH_ScriptInstance):

    def RunScript(self,
            absorption: System.Collections.Generic.List[float],
            scattering: System.Collections.Generic.List[float],
            name: str):
        if absorption is None:
            ghenv.Component.AddRuntimeMessage(
                Grasshopper.Kernel.GH_RuntimeMessageLevel.Warning,
                "Input parameter 'absorption' failed to collect data."
            )
            return
        if name is None:
            ghenv.Component.AddRuntimeMessage(
                Grasshopper.Kernel.GH_RuntimeMessageLevel.Warning,
                "Input parameter 'name' failed to collect data."
            )
            return

        return AcousticMaterial(
            name=name,
            absorption_coefficients=absorption,
            scattering_coefficients=scattering,
        )
# ---------- end conmat ----------

panel_3 = Panel("""0.05
0.04
0.05
0.06
0.06
0.07
0.08""")
panel_4 = Panel("wood_laminate_desk_30mm")
lng_2 = ListLength(List=panel_3)
repeat_2 = RepeatData(Data="0.08", Length=lng_2)
conmat_2 = Compas_acousticsConstructMaterial(absorption=panel_3, scattering=repeat_2, name=panel_4)  # -> material; inputs absorption: list of Double, scattering: list of Double, name: String; same code as conmat

disc_2 = Discontinuity(Curve=crv, Level=1)  # -> Points, Parameters
avr = Average(Input=disc_2.Points)
Z_2 = UnitZ(Factor="-2.85")
move = Move(Geometry=avr, Motion=Z_2)  # -> Geometry, Transform
py3_2 = Python3Script(centroid=move.Geometry, x_size="3.0", y_size="1.2")  # -> out, rec; inputs centroid: Point3d, x_size: Double, y_size: Double
# ---------- py3_2: Python ----------
import Rhino.Geometry as rg


corner_1 = centroid - rg.Vector3d(x_size/2, y_size/2, 0)
corner_2  = centroid + rg.Vector3d(x_size/2, y_size/2, 0)

rec = rg.Rectangle3d(
    rg.Plane(centroid, rg.Vector3d.ZAxis), corner_1, corner_2
)
# ---------- end py3_2 ----------

Z_3 = UnitZ(Factor="-0.75")
move_2 = Move(Geometry=jitter_point, Motion=Z_3)  # -> Geometry, Transform
crv_cp = CurveClosestPoint(Point=move_2.Geometry, Curve=py3_2.rec)  # -> Point, Parameter, Distance
py3_3 = Python3Script(centroid=move_2.Geometry, x_size="0.45", y_size="0.45")  # -> out, rec; inputs centroid: Point3d, x_size: Double, y_size: Double; same code as py3_2
py3_4 = Python3Script(centroid=move_2.Geometry, toward=crv_cp.Point, x_size="0.45", y_size="0.65")  # -> out, rec; inputs centroid: Point3d, toward: Point3d, x_size: Double, y_size: Double
# ---------- py3_4: Python ----------
import Rhino.Geometry as rg

vec = toward - centroid
vec = rg.Vector3d(vec.X, vec.Y, 0)

dire_1 = rg.Vector3d(vec)
dire_1.Unitize()

dire_2 = rg.Vector3d.CrossProduct(dire_1, rg.Vector3d.ZAxis)

corner = centroid - dire_1 * x_size / 2 + dire_2 * x_size / 2

pln = rg.Plane(corner, -dire_2, rg.Vector3d.ZAxis)

rec = rg.Rectangle3d(
    pln, x_size, y_size
)
# ---------- end py3_4 ----------

move_3 = Move(Geometry=crv, Motion=Z)  # -> Geometry, Transform
disc_3 = Discontinuity(Curve=move_3.Geometry, Level=1)  # -> Points, Parameters
shift_2 = ShiftList(List=disc_3.Points, Shift=1, Wrap=True)
merge_2 = Merge(
    Data1=simplify(graft(disc.Points)),
    Data2=simplify(graft(shift)),
    Data3=simplify(graft(shift_2)),
    Data4=simplify(graft(disc_3.Points)))
pline = PolyLine(Vertices=merge_2, Closed=invert(False))  # -> flatten(Polyline)

cull_i = CullIndex(List=pline, Indices=["2", "3"], Wrap=True)
merge_3 = Merge(Data1=flatten(flip.Curve), Data2=flatten(cull_i))
py3_5 = Python3Script(polyline=merge_3, space=Slider(0.7, range=0..1))  # -> out, div_u, div_v, space_u, space_v; inputs polyline: Polyline, space: Double
# ---------- py3_5: Python ----------
import Rhino.Geometry as rg

def division(length, space):
    div = round(length / space)
    return div, length / div

len_a = (polyline[0] - polyline[1]).Length
len_b = (polyline[0] - polyline[3]).Length


div_u, space_u = division(len_a, space)
div_v, space_v = division(len_b, space)
# ---------- end py3_5 ----------
mplane = MeshPlane(Boundary=merge_3, WidthCount=py3_5.div_u, HeightCount=py3_5.div_v)  # -> Mesh, Area
item = ListItem(List=mplane.Mesh, Index=0, Wrap=True)  # -> Item, Item1, Item2
panel_5 = Panel("""28
29
38
39
48
49""")
wbreroute = WeaverbirdsRerouteFaces(Mesh=item.Item2, Index=panel_5)  # -> Mesh0, Mesh1
merge_4 = Merge(Data1=[item.Item, item.Item1], Data2=wbreroute.Mesh1)
faceb = FaceBoundaries(Mesh=merge_4)  # -> flatten(Boundaries)
obj = Compas_acousticsAcousticObject(geometry=faceb, material=py3.materials_out)  # -> acoustic_object; inputs geometry: GeometryBase, name: String
#   port geometry: Geometry of the AcousticObject.
#   port material: Material of the AcousticObject.
#   port name: Name of the AcousticObject.
#   port acoustic_object: AcousticObject object.
# ---------- obj: Python ----------
"""Create an AcousticObject with the specified geometry and material."""
# flake8: noqa
import Grasshopper
import Rhino
from compas_acoustics.geometry import AcousticObject
from compas_rhino.conversions import mesh_to_compas
from compas_rhino.conversions import polyline_to_compas

# TODO: Change the typeHintID in metadata.json from "mesh" to "geometrybase"

class CreateAcousticObject(Grasshopper.Kernel.GH_ScriptInstance):

    def RunScript(self, geometry: Rhino.Geometry.GeometryBase, material, name: str):

        if geometry is None:
            ghenv.Component.AddRuntimeMessage(
                Grasshopper.Kernel.GH_RuntimeMessageLevel.Warning, "No geometry provided."
            )
            return
        if material is None:
            ghenv.Component.AddRuntimeMessage(
                Grasshopper.Kernel.GH_RuntimeMessageLevel.Warning, "No material provided."
            )
            return

        # Gemetry conversion from Rhino to Compas
        # TODO: Figure out how to handle other geometry types (e.g., Brep, Surface, etc.)
        if isinstance(geometry, Rhino.Geometry.Mesh):
            geometry = mesh_to_compas(geometry)
        elif isinstance(geometry, Rhino.Geometry.Polyline):
            geometry = polyline_to_compas(geometry)
        elif isinstance(geometry, Rhino.Geometry.PolylineCurve):
            geometry = polyline_to_compas(geometry.ToPolyline())
        else:
            ghenv.Component.AddRuntimeMessage(
                Grasshopper.Kernel.GH_RuntimeMessageLevel.Error, "Unsupported geometry type."
            )
            return
        return AcousticObject(acoustic_geometry=geometry, material=material, name=name)
# ---------- end obj ----------

panel_6 = Panel("""0.14
0.10
0.06
0.08
0.10
0.10
0.10""")
panel_7 = Panel("""0.03
0.03
0.04
0.05
0.05
0.06
0.08""")
conmat_3 = Compas_acousticsConstructMaterial(absorption=panel_6, scattering=panel_7, name="solid_wood")  # -> material; inputs absorption: list of Double, scattering: list of Double, name: String; same code as conmat
mesh = Mesh(wbreroute.Mesh0)
mc = MeshCorners(Mesh=mesh, Angle=2.35619449)
pline_2 = PolyLine(Vertices=mc, Closed=invert(False))
flip_2 = FlipCurve(Curve=pline_2)  # -> Curve, Flag
obj_2 = Compas_acousticsAcousticObject(geometry=flip_2.Curve, material=conmat_3, name="wood_door")  # -> acoustic_object; inputs geometry: GeometryBase, name: String; same code as obj

item_2 = ListItem(List=pline, Index="2", Wrap=True)
item_3 = ListItem(List=pline, Index="3", Wrap=True)

panel_8 = Panel("""0.15
0.08
0.04
0.03
0.02
0.02
0.02""")
panel_9 = Panel("""0.02
0.02
0.03
0.04
0.05
0.05
0.07""")
conmat_4 = Compas_acousticsConstructMaterial(absorption=panel_8, scattering=panel_9, name="insulated_double_glazing")  # -> material; inputs absorption: list of Double, scattering: list of Double, name: String; same code as conmat
obj_3 = Compas_acousticsAcousticObject(geometry=item_3, material=conmat_4, name="curtain_glass_wall")  # -> acoustic_object; inputs geometry: GeometryBase, name: String; same code as obj

panel_10 = Panel(py3.absorber_count)

# ----
# Sources & Receivers
number_slider = Slider(0.37, range=0..1)
crv_2 = Curve(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)
pt = Point(jitter_point)
end = EndPoints(Curve=crv_2)  # -> Start, End
cardioid = Compas_acousticsDirectivity()  # -> directivity
#   port directivity: Directivity pattern.
# ---------- cardioid: Python ----------
"""Preset picker for directivity patterns. Right-click to choose a pattern from the available options."""
# flake8: noqa
import Grasshopper
from System.Windows.Forms import ToolStripSeparator
from compas_acoustics.materials_library import MaterialsLibrary


class DirectivitySelector(Grasshopper.Kernel.GH_ScriptInstance):
    ITEMS = ["Bidirectional", "Hypercardioid", "Supercardioid", "Cardioid", "Omnidirectional"]

    def __init__(self):
        super().__init__()
        nickname = ghenv.Component.NickName
        self.directivity_name = nickname if nickname in self.ITEMS else None

    def RunScript(self):
        names = self.ITEMS
        if not names:
            ghenv.Component.AddRuntimeMessage(
                Grasshopper.Kernel.GH_RuntimeMessageLevel.Error, "No directivity patterns found."
            )
            return None

        if self.directivity_name not in names:
            ghenv.Component.AddRuntimeMessage(
                Grasshopper.Kernel.GH_RuntimeMessageLevel.Remark, "Right-click the icon to choose a directivity pattern."
            )
            ghenv.Component.Message = None
            return None

        ghenv.Component.Message = self.directivity_name
        return self.directivity_name.lower()

    def AppendAdditionalMenuItems(self, menu):
        for name in self.ITEMS:
            item = menu.Items.Add(name, None, self.on_item_click)
            item.Checked = (name == self.directivity_name)

        menu.Items.Add(ToolStripSeparator())

    def on_item_click(self, sender, event_info):
        name = str(sender)
        if name == self.directivity_name:
            return
        self.directivity_name = name
        ghenv.Component.NickName = name
        ghenv.Component.ExpireSolution(True)
# ---------- end cardioid ----------
points = PointList(Points=pt, Size=number_slider)
pt_2 = Point(end.Start)
source = Compas_acousticsSource(position=pt_2, direction=crv_2, directivity=cardioid, name="my_source")  # -> source; inputs position: Point3d, direction: Vector3d, directivity: String, name: String, sound_file: String
#   port position: Position of the source.
#   port direction: Direction of the source.
#   port directivity: Directivity of the source. Default is Omnidirectional. Options: - Bidirectional - Hypercardioid - Supercardioid - Cardioid - Omnidirectional
#   port name: Name of the source.
#   port sound_file: Sound file associated with the source.
#   port source: Source object.
# ---------- source: Python ----------
"""Acoustic Source object (speaker, human, etc.)."""
# flake8: noqa
import Grasshopper
import Rhino
from compas_acoustics import Source


class CreateSource(Grasshopper.Kernel.GH_ScriptInstance):
    ITEMS = ["bidirectional", "hypercardioid", "supercardioid", "cardioid", "omnidirectional"]

    def RunScript(self,
            position: Rhino.Geometry.Point3d,
            direction: Rhino.Geometry.Vector3d,
            directivity: str,
            name: str,
            sound_file: str):
        if position is None:
            position = Rhino.Geometry.Point3d(0, 0, 0)
        if direction is None:
            direction = Rhino.Geometry.Vector3d(1, 0, 0)

        if directivity is None:
            dirt = "omnidirectional"
        elif directivity not in self.ITEMS:
            ghenv.Component.AddRuntimeMessage(
                Grasshopper.Kernel.GH_RuntimeMessageLevel.Error, "Input parameter 'directivity' is not valid."
            )
            return None
        else:
            dirt = directivity

        if name is None:
            name = "my_source"

        return Source(
            name,
            *position,
            directivity=dirt,
            direction=[*direction],
            sound_file=sound_file
        )
# ---------- end source ----------
receiver = Compas_acousticsReceiver(position=pt, name="my_receiver")  # -> receiver; inputs position: Point3d, name: String
#   port position: Position of the receiver.
#   port name: Name of the receiver.
#   port receiver: Receiver object.
# ---------- receiver: Python ----------
"""Acoustic Receiver object (microphone, human ear, etc.)."""
# flake8: noqa
import Grasshopper
import Rhino
from compas_acoustics import Receiver

# TODO: Implement direction
class CreateReceiver(Grasshopper.Kernel.GH_ScriptInstance):

    def RunScript(self, position: Rhino.Geometry.Point3d, name: str):
        if position is None:
            position = Rhino.Geometry.Point3d(0, 0, 1)
        if name is None:
            name = "my_receiver"

        return Receiver(name, *position)
# ---------- end receiver ----------

# ---- group: all rays must pass through the mesh face in even numbers
data = Data(py3_4.rec)
flip_3 = FlipCurve(Curve=data)  # -> Curve, Flag
data_2 = Data([data, flip_3.Curve])

data_3 = Data(py3_3.rec)
flip_4 = FlipCurve(Curve=data_3)  # -> Curve, Flag
data_4 = Data([data_3, flip_4.Curve])

data_5 = Data(py3_2.rec)
flip_5 = FlipCurve(Curve=data_5)  # -> Curve, Flag
data_6 = Data([data_5, flip_5.Curve])

# ----
concrete_2 = Compas_acousticsMaterialLibrary()  # -> material; same code as concrete

# ---- group: enable them after optimization, for phenotype
data_7 = Data(faceb)
int = Integer(py3.absorber_indices)
cull_i_2 = CullIndex(List=data_7, Indices=int, Wrap=True)
item_4 = ListItem(List=data_7, Index=int, Wrap=True)
swatch = ColourSwatch(SwatchColor=RGB(145, 145, 145))
mcol = MeshColours(Mesh=item_4, Colours=ColourSwatch(SwatchColor=RGB(0, 255, 242)))
mcol_2 = MeshColours(Mesh=cull_i_2, Colours=swatch)
mjoin = MeshJoin(Meshes=flatten([mcol, mcol_2]))

# ----
# Human Sitting
panel_11 = Panel("human_sitting")
merge_5 = Merge(Data1=data_4, Data2=data_2)  # -> flatten(Result)
obj_4 = Compas_acousticsAcousticObject(geometry=merge_5, material=conmat, name=panel_11)  # -> acoustic_object; inputs geometry: GeometryBase, name: String; same code as obj

obj_5 = Compas_acousticsAcousticObject(geometry=item_2, material=concrete_2, name="plaster_front_wall")  # -> acoustic_object; inputs geometry: GeometryBase, name: String; same code as obj
obj_6 = Compas_acousticsAcousticObject(geometry=move_3.Geometry, material=concrete_2, name="plaster_floor")  # -> acoustic_object; inputs geometry: GeometryBase, name: String; same code as obj

# ----
# Table
obj_7 = Compas_acousticsAcousticObject(geometry=data_6, material=conmat_2, name=panel_4)  # -> acoustic_object; inputs geometry: GeometryBase, name: String; same code as obj

wlc_minimize_absorber_count = Number(py3.absorber_count)
mcol_3 = MeshColours(Mesh=data_7, Colours=swatch)

# ---- group: T20
values_before = Number([0.54, 0.54, 0.54, 0.54, 0.46, 0.53, 0.51, 0.5, 0.49])
panel_12 = Panel("Reverberation Time (T20)")
number_slider_2 = Slider(17, range=0..20)
values_after = Number([0.45, 0.37, 0.43, 0.46, 0.45, 0.41, 0.42, 0.42, 0.4])
number_slider_3 = Slider(7, range=0..10)
num = Number(Tree({16;4;0;2}: [0.47, 0.46, 0.51, 0.54, 0.53, 0.42, 0.52, 0.51, 0.49], {19;0;0;2}: [0.46, 0.47, 0.48, 0.48, 0.46, 0.45, 0.43, 0.45, 0.53], {19;1;0;2}: [0.53, 0.51, 0.54, 0.53, 0.43, 0.43, 0.56, 0.53, 0.47], {19;2;0;2}: [0.47, 0.46, 0.51, 0.54, 0.53, 0.42, 0.52, 0.51, 0.49], {19;3;0;2}: [0.44, 0.4, 0.42, 0.51, 0.45, 0.48, 0.52, 0.54, 0.43], {19;4;0;2}: [0.41, 0.45, 0.51, 0.46, 0.52, 0.46, 0.52, 0.42, 0.46]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))
target = Number(0.5)
panel_13 = Panel("Time (s)")
merge_6 = Merge(Data1=values_before, Data2=num)

# ----
merge_7 = Merge(Data1=obj_5, Data2=obj_6, Data3=obj, Data4=obj_3)

# ----
# Internal Objects
merge_8 = Merge(Data1=obj_7, Data2=obj_4)

# ---- group: C50
values_before_2 = Number([0.54, 0.54, 0.54, 0.54, 0.46, 0.53, 0.51, 0.5, 0.49])
values_after_2 = Number([7.34, 6.85, 7.77, 8.95, 7.12, 6.18, 7.64, 6.93, 8.86])
num_2 = Number(Tree({16;4;0;1}: [6.76, 6, 7.24, 7.02, 7.63, 5.74, 7.08, 6.03, 6.23], {19;0;0;1}: [7.83, 5.96, 6.98, 7.15, 8.11, 7.83, 6.7, 7.01, 9.04], {19;1;0;1}: [8.2, 5.81, 7.5, 7.41, 7.9, 7.11, 7.04, 7.26, 6.86], {19;2;0;1}: [6.76, 6, 7.24, 7.02, 7.63, 5.74, 7.08, 6.03, 6.23], {19;3;0;1}: [6.52, 5.33, 6.45, 6.71, 8.21, 5.14, 6.11, 7.01, 5.89], {19;4;0;1}: [7.69, 6.11, 6.7, 6.69, 7.81, 7.05, 6.95, 6.29, 7.79]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))
number_slider_4 = Slider(7, range=0..20)
number_slider_5 = Slider(0, range=0..10)
panel_14 = Panel("dB")
target_2 = Number(7)
panel_15 = Panel("Clarity (C50)")
merge_9 = Merge(Data1=values_before_2, Data2=num_2)

# ----
panel_16 = Panel("{*;*;*;1}")  # disabled
merge_10 = Merge(Data1=merge_7, Data2=merge_8)
scene = Compas_acousticsRoomScene(objects=flatten(merge_10), sources=flatten(source), receivers=flatten(receiver), name="my_scene")  # -> scene; inputs objects: list, sources: list, receivers: list, name: String
#   port objects: List of AcousticObject
#   port sources: List of Source objects.
#   port receivers: List of Receiver objects.
#   port name: Name of the room scene.
#   port scene: Room scene object.
# ---------- scene: Python ----------
"""Create a room scene with the specified objects, sources, and receivers."""
# flake8: noqa
import Grasshopper

import System
from compas_acoustics.scene import Scene
from compas_acoustics.source import Source
from compas_acoustics.receiver import Receiver


class CreateModelScene(Grasshopper.Kernel.GH_ScriptInstance):

    def RunScript(self,
            objects: System.Collections.Generic.List[object],
            sources: System.Collections.Generic.List[object],
            receivers: System.Collections.Generic.List[object],
            name: str):

        if objects is None:
            ghenv.Component.AddRuntimeMessage(
                Grasshopper.Kernel.GH_RuntimeMessageLevel.Warning, "No objects provided."
            )
            return
        if sources is None:
            ghenv.Component.AddRuntimeMessage(
                Grasshopper.Kernel.GH_RuntimeMessageLevel.Warning, "No sources provided."
            )
            return
        if receivers is None:
            ghenv.Component.AddRuntimeMessage(
                Grasshopper.Kernel.GH_RuntimeMessageLevel.Warning, "No receivers provided."
            )
            return

        scene = Scene(name=name)
        scene.add_acoustic_objects(objects)
        for src in sources:
            if isinstance(src, Source):
                scene.add_source(src)
            else:
                ghenv.Component.AddRuntimeMessage(
                    Grasshopper.Kernel.GH_RuntimeMessageLevel.Error,
                    f"Invalid source type: {type(src)}. Expected a Source object.",
                )
        for rcv in receivers:
            if isinstance(rcv, Receiver):
                scene.add_receiver(rcv)
            else:
                ghenv.Component.AddRuntimeMessage(
                    Grasshopper.Kernel.GH_RuntimeMessageLevel.Error,
                    f"Invalid receiver type: {type(rcv)}. Expected a Receiver object.",
                )

        return scene
# ---------- end scene ----------
random = Random(Range=Slider(799, range=0..1000), Number=Slider(50, range=0..100), Seed=2, Integers=True)
item_5 = ListItem(List=random, Index=Slider(49, range=0..49), Wrap=True)
simrt = Compas_acousticsSimulateRayTracing(
    scene=scene,
    max_order="2",
    n_rays=Slider(5000, range=0..10000),
    energy_thres="1e-04",
    time_thres=Slider(0.6, range=0..1),
    seed=Slider(1, range=0..10))  # -> ir_graph; inputs sample_rate: Int32, max_order: Int32, n_rays: Int32, absorb_air: Boolean, energy_thres: Double, time_thres: Double, seed: Int32
#   port scene: Room scene object.
#   port sample_rate: Sample rate for the simulation.
#   port max_order: Maximum order of image sources.
#   port n_rays: Number of rays for ray tracing.
#   port absorb_air: Whether to consider air absorption.
#   port energy_thres: Energy threshold for ray tracing.
#   port time_thres: Time threshold for ray tracing.
#   port seed: Random seed for reproducibility.
#   port ir_graph: Impulse response graph structure.
# ---------- simrt: Python ----------
"""Simulate room acoustics using Image Source Method (ISM) and Ray Tracing (RT) to generate impulse response graph structure."""
# flake8: noqa
import Grasshopper

from compas_acoustics.simulator import Simulator

class SimulateRayTracing(Grasshopper.Kernel.GH_ScriptInstance):

    def RunScript(self,
            scene,
            sample_rate: int,
            max_order: int,
            n_rays: int,
            absorb_air: bool,
            energy_thres: float,
            time_thres: float,
            seed: int):

        if scene is None:
            ghenv.Component.AddRuntimeMessage(
                Grasshopper.Kernel.GH_RuntimeMessageLevel.Warning, "Input parameter 'scene' failed to collect data."
            )
            return

        if max_order is None:
            max_order = 2
        if n_rays is None:
            n_rays = 1000
        if absorb_air is None:
            absorb_air = True
        if energy_thres is None:
            energy_thres = 1e-7
        if time_thres is None:
            time_thres = 10.0

        sim = Simulator(scene)
        if sample_rate is not None:
            sim.sampling_rate = sample_rate

        sim.rir_from_ray_tracing(
            image_source_order=max_order,
            n_rays=n_rays,
            air_absorption=absorb_air,
            energy_thres=energy_thres,
            time_thres=time_thres,
            random_seed=seed,
        )

        ghenv.Component.Message = "{}Hz, order={}, rays={}, air={}, seed={}, energy_thres={}, time_thres={}".format(
            sim.sampling_rate, max_order, n_rays, absorb_air, seed if seed is not None else "random", energy_thres, time_thres
        )

        return sim.scene.ir_graph
# ---------- end simrt ----------

# ----
# Simulate & Analyse
decirgraph = Compas_acousticsDeconstructIRGraph(ir_graph=simrt)  # -> ir, sources, receivers, edges; inputs receiver_idx: list of Int32
#   port ir_graph: Impulse response graph structure.
#   port receiver_idx: Index(s) of the receiver(s) to filter.
#   port ir: ImpulseResponse object(s).
#   port sources: Source object(s).
#   port receivers: Receiver object(s).
#   port edges: Relationships between sources and receivers as Line(s).
# ---------- decirgraph: Python ----------
"""Deconstruct impulse response graph structure into ImpulseResponse(s)."""
# flake8: noqa
import Grasshopper
from Grasshopper import DataTree
from Grasshopper.Kernel.Data import GH_Path
from Rhino.Geometry import Line
import System

class DeconstructIRGraph(Grasshopper.Kernel.GH_ScriptInstance):

    def RunScript(self,
            ir_graph,
            receiver_idx: System.Collections.Generic.List[int]):

        if ir_graph is None:
            ghenv.Component.AddRuntimeMessage(
                Grasshopper.Kernel.GH_RuntimeMessageLevel.Warning, "Input parameter 'ir_graph' failed to collect data."
            )

        ir_out = DataTree[object]()
        source_out = DataTree[object]()
        receiver_out = DataTree[object]()
        edge_out = DataTree[object]()

        # 1. Set order of receivers
        receiver_list = [
            ir_graph.node_attribute(node, 'data')
            for node in ir_graph.nodes()
            if ir_graph.node_attribute(node, 'type') == 'receiver'
        ]
        receiver_set = {rec.guid for rec in receiver_list}

        # 2. Make ir group as {receiver_0: [src_0, ...], ...}
        source_group = {}
        ir_group = {}

        for u, v in ir_graph.edges():
            ir = ir_graph.edge_attribute((u, v), 'data')
            data_u = ir_graph.node_attribute(u, 'data')
            data_v = ir_graph.node_attribute(v, 'data')

            if data_u.guid in receiver_set:
                rec, src = data_u, data_v
            elif data_v.guid in receiver_set:
                rec, src = data_v, data_u
            else:
                continue
            
            source_group.setdefault(rec.guid, []).append(src)
            ir_group.setdefault(rec.guid, []).append(ir)

        # 3. Filter receiver, optional
        if receiver_idx is None:
            indices = list(range(len(receiver_list)))
        else:
            indices = receiver_idx  # Already set to list access

        for idx in indices:
            rec = receiver_list[idx]
            path = GH_Path(idx)

            sources = source_group.get(rec.guid, [])
            irs = ir_group.get(rec.guid, [])

            receiver_out.Add(rec, path)
            source_out.AddRange(sources, path)
            ir_out.AddRange(irs, path)
            edge_out.AddRange([Line(*src.position, *rec.position) for src in sources], path)

        return ir_out, source_out, receiver_out, edge_out
# ---------- end decirgraph ----------
analyseir = Compas_acousticsAnalyseImpulseResponse(ir=decirgraph.ir)  # -> params
#   port ir: ImpulseResponse (IR) object.
#   port params: List of acoustic parameters ('EDT', 'T20', 'T30', 'C50', 'C80', 'D50', 'DRR', 'Ts', 'STI').
# ---------- analyseir: Python ----------
"""Analyse impulse response (IR) and return acoustic parameters such as EDT, T20, C50, etc."""
# flake8: noqa
import Grasshopper
from compas_acoustics.analyser import AcousticAnalyser
from compas_acoustics import AcousticParameter
from compas_acoustics import Defaults


class AnalyseIR(Grasshopper.Kernel.GH_ScriptInstance):
    def RunScript(self, ir):
        if ir is None:
            ghenv.Component.AddRuntimeMessage(Grasshopper.Kernel.GH_RuntimeMessageLevel.Warning, "Input parameter 'ir' failed to collect data.")
            return None

        analyser = AcousticAnalyser(ir.ir)
        analyser.analyse()

        return [AcousticParameter().from_analyser(analyser, name) for name in Defaults().PARAM_NAMES]
# ---------- end analyseir ----------
item_6 = ListItem(List=analyseir, Index=Slider(1, range=0..10), Wrap=True)
item_7 = ListItem(List=analyseir, Index=Slider(3, range=0..10), Wrap=True)
deparam = Compas_acousticsDeconstructParameter(param=item_6)  # -> name, values, flatten(overall), frequencies
#   port param: AcousticParameter (AP) object.
#   port name: Nmae of the acoustic parameter.
#   port values: Values of the acoustic parameter.
#   port overall: Overall value of the acoustic parameter.
#   port frequencies: Frequencies of the acoustic parameter.
# ---------- deparam: Python ----------
"""Deconstruct acoustic parameter."""
# flake8: noqa
import Grasshopper
from compas_acoustics.analyser import AcousticAnalyser
from compas_acoustics import AcousticParameter
from compas_acoustics import Defaults


class DeconstructParam(Grasshopper.Kernel.GH_ScriptInstance):
    def RunScript(self, param):
        if param is None:
            ghenv.Component.AddRuntimeMessage(Grasshopper.Kernel.GH_RuntimeMessageLevel.Warning, "Input parameter 'param' failed to collect data.")
            return None
        
        return param.title, param.values, param.overall, param.frequencies
# ---------- end deparam ----------
panel_17 = Panel(deparam.name)
deparam_2 = Compas_acousticsDeconstructParameter(param=item_7)  # -> name, values, flatten(overall), frequencies; same code as deparam
panel_18 = Panel(deparam_2.name)
panel_19 = Panel(deparam.overall)
panel_20 = Panel(deparam_2.overall)

# ----
# Auralise
panel_21 = Panel("mono_adult_female_speech.wav")
py3_6 = Python3Script(name=panel_21)  # -> out, path; inputs name: String
# ---------- py3_6: Python ----------
import sys
import os

gh_path = ghenv.Component.OnPingDocument().FilePath
dire_path = os.path.dirname(gh_path)
sound_path = os.path.join(dire_path, "sound_files", name)

path = sound_path
# ---------- end py3_6 ----------
item_8 = ListItem(List=flatten(decirgraph.ir), Index=Slider(3, range=0..10), Wrap=True)
stop = Button()
play = Button()
auralise = Compas_acousticsAuralise(irs=item_8, signals=py3_6.path, save_file_name="after", save=Button())  # -> signals; inputs irs: tree, signals: tree, multiconvolve: Boolean, save_file_path: String, save_file_name: String, save: Boolean
#   port irs: ImpulseResponse object(s)
#   port signals: Optional source signal(s). If not provided, it will take the signal(s) from the Source object(s) in the scene.
#   port multiconvolve: Whether to convolve multiple signals with multiple impulse responses. If False, it will convolve each signal with the corresponding impulse response.
#   port save_file_path: File path to save the convolved signal(s). Default is the current working directory.
#   port save_file_name: File name for the saved convolved signal(s). Default is 'convolved_sound'.
#   port save: Whether to save the convolved signal(s) to a file.
#   port signals: Convolved signal(s).
# ---------- auralise: Python ----------
"""Auralise the room scene by convolving the impulse response with the source signal(s)."""
# flake8: noqa
import Grasshopper
from Grasshopper import DataTree
import numpy as np
import os

from compas_acoustics.auraliser import Auraliser


class Auralise(Grasshopper.Kernel.GH_ScriptInstance):

    def RunScript(self,
            irs: Grasshopper.DataTree[object],
            signals: Grasshopper.DataTree[object],
            multiconvolve: bool,
            save_file_path: str,
            save_file_name: str,
            save: bool):
        if irs is None:
            ghenv.Component.AddRuntimeMessage(
                Grasshopper.Kernel.GH_RuntimeMessageLevel.Warning, "Input parameter 'irs' failed to collect data."
            )
            return
        
        has_signals = signals is not None and signals.DataCount > 0
        if has_signals:
            if irs.BranchCount != signals.BranchCount:
                raise ValueError("DataTree branch count mismatch.")
            if any(len(irs.Branch(i)) != len(signals.Branch(i)) for i in range(irs.BranchCount)):
                raise ValueError("DataTree branch length mismatch.")

        signals_out = DataTree[object]()
        # 1. Data conversions
        for i in range(irs.BranchCount):
            path = irs.Paths[i]

            br = irs.Branch(i)
            sound_files = signals.Branch(i) if has_signals else [ir.source.sound_file for ir in br]

            ir_groups = {}
            sound_groups = {}

            for idx, (IR, sound_file) in enumerate(zip(br, sound_files)):
                receiver_id = str(IR.receiver.guid)

                ir_groups.setdefault(receiver_id, {})
                sound_groups.setdefault(receiver_id, {})
                
                sub_key = f"source_{idx}"

                # ir_data = IR.ir
                ir_data = IR.ir[:, np.newaxis] if IR.ir.ndim == 1 else IR.ir

                ir_groups[receiver_id][sub_key] = {
                    'ir': ir_data,
                    'sample_rate': IR.sample_rate,
                    'ambisonic_order': 0,
                    'channel_order': 'acn',
                    'normalisation': 'sn3d'
                }

                sound_groups[receiver_id][sub_key] = {
                    'filepath': sound_file
                }

            # 2. Construct auraliser(s) and convolve signals
            for i, receiver_id in enumerate(ir_groups.keys()):
                if multiconvolve:
                    tasks = [(receiver_id, ir_groups[receiver_id], sound_groups[receiver_id], f"{i}")]
                else:
                    tasks = [
                        (
                            sub_key,
                            {sub_key: ir_groups[receiver_id][sub_key]},
                            {sub_key: sound_groups[receiver_id][sub_key]},
                            f"{i}_{j}",
                        )
                        for j, sub_key in enumerate(ir_groups[receiver_id].keys())
                    ]
                
                for name, ir_data, sound_data, suffix in tasks:
                    auraliser = Auraliser(
                        name=name,
                        impulse_responses=ir_data,
                        anechoic_sounds=sound_data,
                        output_format="mono",
                        # sample_rate=ir_groups[receiver_id][f"source_{0}"]['sample_rate']
                        sample_rate=48000
                    )
                    convolved_matrix = auraliser.multiconvolution()
                    
                    signals_out.Add(convolved_matrix, path)

                    if save:
                        filepath = self.set_save_file_path(save_file_path, save_file_name, suffix)
                        auraliser.export_convolved_sound(filepath, convolved_matrix)
        return signals_out
    
    @staticmethod
    def set_save_file_path(save_file_path=None, save_file_name=None, suffix=0):
        if save_file_path:
            base_dir = save_file_path
        else:
            base_dir = os.path.dirname(ghenv.Component.OnPingDocument().FilePath)

        if save_file_name:
            base_filename = save_file_name
        else:
            base_filename = "convolved_sound"
        return os.path.join(base_dir, f"{base_filename}_mic_{suffix}.wav")
# ---------- end auralise ----------
player = Compas_acousticsAudioPlayer(sound=auralise, play=play, stop=stop)  # inputs play: Boolean, stop: Boolean
#   port sound: Audio file path, numpy array, or Source object.
#   port play: Play the audio.
#   port stop: Stop the audio.
# ---------- player: Python ----------
"""Play audio files, accepting .wav, numpy arrays, and Source objects."""
# flake8: noqa
import Grasshopper
import System
from compas_acoustics import AudioPlayer
import scriptcontext as sc
import soundfile as sf


class PlayAudio(Grasshopper.Kernel.GH_ScriptInstance):

    def offer_buttons(self):
        component = ghenv.Component
        offered_key = "audio_player_buttons_offered_{}".format(component.InstanceGuid)
        if sc.sticky.get(offered_key):
            return
        sc.sticky[offered_key] = True

        doc = component.OnPingDocument()
        if doc is None:
            return

        targets = [(index, nickname) for index, nickname in ((1, "Play"), (2, "Stop")) if component.Params.Input[index].SourceCount == 0]
        if not targets:
            return

        def deferred(gh_doc):
            base = component.Attributes.Pivot
            for row, (index, nickname) in enumerate(targets):
                input_param = component.Params.Input[index]
                if input_param.SourceCount > 0:
                    continue

                button = Grasshopper.Kernel.Special.GH_ButtonObject()
                button.CreateAttributes()
                button.NickName = nickname
                button.Attributes.Pivot = System.Drawing.PointF(base.X - 180, base.Y - 15 + row * 30)
                gh_doc.AddObject(button, False)
                input_param.AddSource(button)
                button.ExpireSolution(True)

        doc.ScheduleSolution(1, deferred)

    def RunScript(self, sound, play: bool, stop: bool):
        self.offer_buttons()

        sample_rate = None

        if sound is None:
            return

        if isinstance(sound, str):  # file path
            try:
                sample_rate = sf.info(sound).samplerate
            except:
                pass
        elif hasattr(sound, "sound_file"):  # Source object
            sound = sound.sound_file
            try:
                sample_rate = sf.info(sound).samplerate
            except:
                pass
        elif hasattr(sound, "shape") and hasattr(sound, "ndim"):  # numpy array
            pass
        else:
            ghenv.Component.AddRuntimeMessage(
                Grasshopper.Kernel.GH_RuntimeMessageLevel.Error, "Input parameter 'sound' is not valid."
            )
            return

        player_key = "player"
        if player_key not in sc.sticky:
            sc.sticky[player_key] = AudioPlayer()

        player = sc.sticky[player_key]

        if play:
            player.play(sound, sample_rate)
        if stop:
            player.stop()
# ---------- end player ----------

fitness = Compas_acousticsRegularizedFitness(values=panel_19, target="0.5")  # -> fitness; inputs values: list of Double, target: Double, k: Double
#   port values: A list of numerical values to evaluate.
#   port target: The target value to compare against.
#   port k: A regularization parameter that controls the weight of the STD in the loss function. Default is 1.0.
#   port fitness: The fitness score, a lower value indicates better fitness.
# ---------- fitness: Python ----------
"""A loss function that combines the Mean Absolute Error (MAE) and Standard Deviation (STD) of a list of values with respect to a target value. 
MAE evaluates the Accuracy to the target, while STD evaluates the Consistency of the values. 
The lower the fitness score, the better the fitness."""
# flake8: noqa
import Grasshopper
import System
from compas_acoustics.numerical.fitness import regularized_fitness


class RegularizedFitness(Grasshopper.Kernel.GH_ScriptInstance):
    def RunScript(self,
            values: System.Collections.Generic.List[float],
            target: float,
            k: float):
        if values is None:
            ghenv.Component.AddRuntimeMessage(
                Grasshopper.Kernel.GH_RuntimeMessageLevel.Warning,
                "Input parameter 'values' failed to collect data."
            )
            return
        if target is None:
            ghenv.Component.AddRuntimeMessage(
                Grasshopper.Kernel.GH_RuntimeMessageLevel.Warning,
                "Input parameter 'target' failed to collect data."
            )
            return
        if k is None:
            k = 1.0
        return regularized_fitness(values, target, k)
# ---------- end fitness ----------
fitness_2 = Compas_acousticsRegularizedFitness(values=panel_20, target="7.0")  # -> fitness; inputs values: list of Double, target: Double, k: Double; same code as fitness
panel_22 = Panel(fitness_2)
panel_23 = Panel(fitness)
wlc_target_t20 = Number(fitness)
wlc_target_c50 = Number(fitness_2)
entwine = Entwine(
    Branch00=mjoin,
    Branch01=pt_2,
    Branch02=pt,
    Branch03=[py3_2.rec, py3_3.rec, py3_4.rec],
    Branch04=[flip_2.Curve, item_2, item_3],
    Branch05=deparam_2.overall,
    Branch06=deparam.overall,
    FlattenInputs=True)
wallacei_x = WallaceiX(
    Genes=wlc_genes_1,
    Objectives=[wlc_target_c50, wlc_target_t20, wlc_minimize_absorber_count],
    Phenotype=entwine,
    allFitness="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",
    allFrontIdx="13|6;15|2;16|4;16|5;17|6;18|5;18|6;18|7;19|8;19|9;19|10;19|11;19|12;19|13;19|14",
    allGenomes="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",
    curFrontIdx="19|0;19|1;19|2;19|3;19|4;19|5;19|6;19|7;19|8;19|9;19|10;19|11;19|12;19|13;19|14",
    curFrontIdxSave="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",
    popGen="40,20",
    total="6199157",
    wlcDone=True)  # -> WallaceiGenomes, FitnessValues, Data, WPhenotypes
pdecoder = DecodePhenotype(WallaceiPhenotype=wallacei_x.WPhenotypes)  # -> GeometriesList, MeshesList, NumbersList, TextList; disabled
data_8 = Data(wallacei_x.WallaceiGenomes)
split = SplitTree(Data=pdecoder.NumbersList, Masks=flatten(panel_16))  # -> Positive, Negative; disabled
tstat = TreeStatistics(Tree=data_8)  # -> Paths, Length, Count
distributor = DistributeToGrid(
    FitnessValues=wallacei_x.FitnessValues,
    WallaceiPhenotypes=wallacei_x.WPhenotypes,
    SizeOfTheGridInTheXDirection=Slider(12.4, range=0..20),
    SizeOfTheGridInTheYDirection=Slider(11.3, range=0..20),
    OutputOptions=0)  # -> DistributedFitnessValues, DistributedData, DistributedGeometries, DistributedMeshes, DistributedNumbers, GridLocations
item_9 = ListItem(List=tstat.Paths, Index=item_5, Wrap=True)
branch = TreeBranch(Tree=data_8, Path=item_9, MaintainPaths=True)
gdecoder = DecodeGenome(WallaceiGenome=branch)
split_2 = SplitTree(Data=distributor.DistributedGeometries, Masks=flatten("{*;*;*;4}"))  # -> Positive, Negative
split_3 = SplitTree(Data=distributor.DistributedGeometries, Masks=flatten("{*;*;*;1}"))  # -> Positive, Negative
split_4 = SplitTree(Data=distributor.DistributedGeometries, Masks=flatten("{*;*;*;2}"))  # -> Positive, Negative
split_5 = SplitTree(Data=distributor.DistributedGeometries, Masks=flatten("{*;*;*;3}"))  # -> Positive, Negative
py3_7 = Python3Script(thresholds=gdecoder, materials=merge)  # -> out, materials_out, absorber_count, absorber_indices; inputs thresholds: list of Double, materials: list; same code as py3

# ---- group: enable them after optimization, for phenotype
data_9 = Data(faceb)
int_2 = Integer(py3_7.absorber_indices)
cull_i_3 = CullIndex(List=data_9, Indices=int_2, Wrap=True)
item_10 = ListItem(List=data_9, Index=int_2, Wrap=True)
mcol_4 = MeshColours(Mesh=item_10, Colours=ColourSwatch(SwatchColor=RGB(0, 255, 242)))
mcol_5 = MeshColours(Mesh=cull_i_3, Colours=ColourSwatch(SwatchColor=RGB(145, 145, 145)))
mjoin_2 = MeshJoin(Meshes=flatten([mcol_4, mcol_5]))

# ----
mjoin_3 = MeshJoin(Meshes=merge_4)
pt_3 = Point(pt)
number_slider_6 = Slider(0.05, range=0..0.1)
py3_8 = Python3Script(x=pt_3)  # -> out, a, b; inputs x: list of Point3d
# ---------- py3_8: Python ----------
a = x[4:8]
b = x[:4]
b.append(x[8])
# ---------- end py3_8 ----------
weldvertices = MeshWeldVertices(Mesh=mjoin_2, Tolerance=0.01)  # -> RuntimeMessage, Mesh
X = UnitX(Factor=1)
pt_4 = Point(pt_2)
srf = Surface(faceb)
crv_3 = Curve([py3_2.rec, py3_3.rec, py3_4.rec])
swatch_2 = ColourSwatch(SwatchColor=RGB(255, 255, 255))
medges = MeshEdges(Mesh=weldvertices.Mesh)  # -> NakedEdges, InteriorEdges, NonManifoldEdges
rev = Reverse(Vector=X)
dots = DotDisplay(Point=py3_8.b, Colour=swatch_2, Size=number_slider_6)
previewlw = CustomPreviewLineweights(Geometry=medges.InteriorEdges, Shader=ColourSwatch(SwatchColor=RGB(255, 255, 255)), Absolute=False)
mcol_6 = MeshColours(Mesh=mjoin_3, Colours=ColourSwatch(SwatchColor=RGB(196, 196, 196)))  # disabled
crv_4 = Curve([flip_2.Curve, item_2, item_3])
line = LineSDL(Start=pt_4, Direction=rev, Length=Slider(0.47, range=0..1))
dots_2 = DotDisplay(Point=pt_4, Colour=swatch_2, Size=Slider(0.08, range=0..0.1))
number_slider_7 = Slider(1.2, range=0..10)
swatch_3 = ColourSwatch(SwatchColor=RGB(0, 0, 0))
dots_3 = DotDisplay(Point=py3_8.a, Colour=swatch_3, Size=number_slider_6)
previewlw_2 = CustomPreviewLineweights(Geometry=medges.NakedEdges, Shader=swatch_3, Thickness=number_slider_7, Absolute=False)
vdisex_2 = VectorDisplayEx(Point=pt_4, Vector=line, Colour=swatch_2, Width=2)
previewlw_3 = CustomPreviewLineweights(Geometry=crv_4, Shader=swatch_3, Thickness=Slider(2, range=0..10), Absolute=False)
previewlw_4 = CustomPreviewLineweights(Geometry=crv_3, Shader=swatch_3, Thickness=number_slider_7, Absolute=False)

# ---- group: good
num_3 = Number(Tree({16;4}: [1.235795, 0.068442, 24], {19;0}: [1.605975, 0.067075, 33], {19;1}: [1.207829, 0.089329, 23], {19;2}: [1.235795, 0.068442, 24], {19;3}: [1.820789, 0.099018, 22], {19;4}: [1.147791, 0.084192, 30]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))  # disabled
pt_5 = Point(Tree({16;4;0;2}: [Point(2.371920945, 3.212284974, 1.183990361), Point(3.118734724, 3.218794254, 1.193707688), Point(3.868958515, 3.210067415, 1.216933383), Point(4.604340225, 3.198747472, 1.194100872), Point(2.384114779, 1.304777512, 1.216293778), Point(3.118653012, 1.284389556, 1.211033527), Point(3.873197484, 1.298402298, 1.219900447), Point(4.626563871, 1.281247792, 1.20485335), Point(1.591233631, 2.232293501, 1.204642875)], {19;0;0;2}: [Point(14.77192095, 3.212284974, 1.183990361), Point(15.51873472, 3.218794254, 1.193707688), Point(16.26895851, 3.210067415, 1.216933383), Point(17.00434022, 3.198747472, 1.194100872), Point(14.78411478, 1.304777512, 1.216293778), Point(15.51865301, 1.284389556, 1.211033527), Point(16.27319748, 1.298402298, 1.219900447), Point(17.02656387, 1.281247792, 1.20485335), Point(13.99123363, 2.232293501, 1.204642875)], {19;1;0;2}: [Point(27.17192095, 3.212284974, 1.183990361), Point(27.91873472, 3.218794254, 1.193707688), Point(28.66895851, 3.210067415, 1.216933383), Point(29.40434022, 3.198747472, 1.194100872), Point(27.18411478, 1.304777512, 1.216293778), Point(27.91865301, 1.284389556, 1.211033527), Point(28.67319748, 1.298402298, 1.219900447), Point(29.42656387, 1.281247792, 1.20485335), Point(26.39123363, 2.232293501, 1.204642875)], {19;2;0;2}: [Point(39.57192095, 3.212284974, 1.183990361), Point(40.31873472, 3.218794254, 1.193707688), Point(41.06895851, 3.210067415, 1.216933383), Point(41.80434022, 3.198747472, 1.194100872), Point(39.58411478, 1.304777512, 1.216293778), Point(40.31865301, 1.284389556, 1.211033527), Point(41.07319748, 1.298402298, 1.219900447), Point(41.82656387, 1.281247792, 1.20485335), Point(38.79123363, 2.232293501, 1.204642875)], {19;3;0;2}: [Point(2.371920945, 14.51228497, 1.183990361), Point(3.118734724, 14.51879425, 1.193707688), Point(3.868958515, 14.51006742, 1.216933383), Point(4.604340225, 14.49874747, 1.194100872), Point(2.384114779, 12.60477751, 1.216293778), Point(3.118653012, 12.58438956, 1.211033527), Point(3.873197484, 12.5984023, 1.219900447), Point(4.626563871, 12.58124779, 1.20485335), Point(1.591233631, 13.5322935, 1.204642875)], {19;4;0;2}: [Point(14.77192095, 14.51228497, 1.183990361), Point(15.51873472, 14.51879425, 1.193707688), Point(16.26895851, 14.51006742, 1.216933383), Point(17.00434022, 14.49874747, 1.194100872), Point(14.78411478, 12.60477751, 1.216293778), Point(15.51865301, 12.58438956, 1.211033527), Point(16.27319748, 12.5984023, 1.219900447), Point(17.02656387, 12.58124779, 1.20485335), Point(13.99123363, 13.5322935, 1.204642875)]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))  # disabled
mesh_2 = Mesh(Tree({16;4;0;0}: [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], {19;0;0;0}: [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], {19;1;0;0}: [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], {19;2;0;0}: [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], {19;3;0;0}: [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], {19;4;0;0}: [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]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))  # disabled
number_slider_8 = Slider(0.05, range=0..0.1)  # disabled
item_11 = ListItem(List=num_3, Index=0, Wrap=True)  # -> Item, Item1, Item2; disabled
py3_9 = Python3Script(x=pt_5)  # -> out, a, b; inputs x: list of Point3d; disabled; same code as py3_8
number_slider_9 = Slider(0.47, range=0..1)  # disabled
number_slider_10 = Slider(0.08, range=0..0.1)  # disabled
X_2 = UnitX(Factor=1)  # disabled
pt_6 = Point(Tree({16;4;0;1}: [Point(6.329291957, 2.450000366, 1.6)], {19;0;0;1}: [Point(18.72929196, 2.450000366, 1.6)], {19;1;0;1}: [Point(31.12929196, 2.450000366, 1.6)], {19;2;0;1}: [Point(43.52929196, 2.450000366, 1.6)], {19;3;0;1}: [Point(6.329291957, 13.75000037, 1.6)], {19;4;0;1}: [Point(18.72929196, 13.75000037, 1.6)]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))  # disabled
crv_5 = Curve(Tree({16;4;0;3}: [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], {19;0;0;3}: [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], {19;1;0;3}: [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], {19;2;0;3}: [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], {19;3;0;3}: [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], {19;4;0;3}: [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]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))  # disabled
medges_2 = MeshEdges(Mesh=mesh_2)  # -> NakedEdges, InteriorEdges, NonManifoldEdges; disabled
swatch_4 = ColourSwatch(SwatchColor=RGB(255, 255, 255))  # disabled
c50 = Panel(item_11.Item)  # disabled
rev_2 = Reverse(Vector=X_2)  # disabled
swatch_5 = ColourSwatch(SwatchColor=RGB(255, 255, 255))  # disabled
dots_4 = DotDisplay(Point=py3_9.b, Colour=swatch_4, Size=number_slider_8)  # disabled
number_slider_11 = Slider(2, range=0..10)  # disabled
crv_6 = Curve(Tree({16;4;0;4}: [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], {19;0;0;4}: [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], {19;1;0;4}: [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], {19;2;0;4}: [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], {19;3;0;4}: [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], {19;4;0;4}: [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]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))  # disabled
line_2 = LineSDL(Start=pt_6, Direction=rev_2, Length=number_slider_9)  # disabled
dots_5 = DotDisplay(Point=pt_6, Colour=swatch_4, Size=number_slider_10)  # disabled
number_slider_12 = Slider(1.2, range=0..10)  # disabled
t20 = Panel(item_11.Item1)  # disabled
previewlw_5 = CustomPreviewLineweights(Geometry=medges_2.InteriorEdges, Shader=swatch_5, Absolute=False)  # disabled
swatch_6 = ColourSwatch(SwatchColor=RGB(0, 0, 0))  # disabled
dots_6 = DotDisplay(Point=py3_9.a, Colour=swatch_6, Size=number_slider_8)  # disabled
previewlw_6 = CustomPreviewLineweights(Geometry=medges_2.NakedEdges, Shader=swatch_6, Thickness=number_slider_12, Absolute=False)  # disabled
vdisex_3 = VectorDisplayEx(Point=pt_6, Vector=line_2, Colour=swatch_4, Width=2)  # disabled
absorber_count = Panel(item_11.Item2)  # disabled
previewlw_7 = CustomPreviewLineweights(Geometry=crv_6, Shader=swatch_6, Thickness=number_slider_11, Absolute=False)  # disabled
previewlw_8 = CustomPreviewLineweights(Geometry=crv_5, Shader=swatch_6, Thickness=number_slider_12, Absolute=False)  # disabled

geo = Geometry(Tree({16;4;0;1}: [Point(18.83091197, -6.790386597, 1.6)], {16;4;0;2}: [Point(14.87354096, -6.028101989, 1.183990361), Point(15.62035474, -6.021592708, 1.193707688), Point(16.37057853, -6.030319548, 1.216933383), Point(17.10596024, -6.041639491, 1.194100872), Point(14.8857348, -7.935609451, 1.216293778), Point(15.62027303, -7.955997407, 1.211033527), Point(16.3748175, -7.941984665, 1.219900447), Point(17.12818389, -7.95913917, 1.20485335), Point(14.09285365, -7.008093462, 1.204642875)], {16;4;0;3}: [{Plane=PlaneXY(14.87354096, -6.028101989, 0.4339903609), Size=Domain2(u=-0.225..0.225, v=-0.225..0.225)}, {Plane=PlaneXY(15.62035474, -6.021592708, 0.4437076879), Size=Domain2(u=-0.225..0.225, v=-0.225..0.225)}, {Plane=PlaneXY(16.37057853, -6.030319548, 0.4669333833), Size=Domain2(u=-0.225..0.225, v=-0.225..0.225)}, {Plane=PlaneXY(17.10596024, -6.041639491, 0.4441008725), Size=Domain2(u=-0.225..0.225, v=-0.225..0.225)}, {Plane=PlaneXY(14.8857348, -7.935609451, 0.466293778), Size=Domain2(u=-0.225..0.225, v=-0.225..0.225)}, {Plane=PlaneXY(15.62027303, -7.955997407, 0.4610335271), Size=Domain2(u=-0.225..0.225, v=-0.225..0.225)}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], {16;4;0;4}: [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], {19;0;0;1}: [Point(18.83091197, -6.790386597, 1.6)], {19;0;0;2}: [Point(14.87354096, -6.028101989, 1.183990361), Point(15.62035474, -6.021592708, 1.193707688), Point(16.37057853, -6.030319548, 1.216933383), Point(17.10596024, -6.041639491, 1.194100872), Point(14.8857348, -7.935609451, 1.216293778), Point(15.62027303, -7.955997407, 1.211033527), Point(16.3748175, -7.941984665, 1.219900447), Point(17.12818389, -7.95913917, 1.20485335), Point(14.09285365, -7.008093462, 1.204642875)]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))  # disabled
mesh_3 = Mesh(Tree({16;4;0;0}: [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], {19;0;0;0}: [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], {19;1;0;0}: [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], {19;2;0;0}: [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], {19;3;0;0}: [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], {19;4;0;0}: [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]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))  # disabled
num_4 = Number(Tree({16;4;0;5}: [6.76, 6, 7.24, 7.02, 7.63, 5.74, 7.08, 6.03, 6.23], {16;4;0;6}: [0.47, 0.46, 0.51, 0.54, 0.53, 0.42, 0.52, 0.51, 0.49], {19;0;0;5}: [7.83, 5.96, 6.98, 7.15, 8.11, 7.83, 6.7, 7.01, 9.04], {19;0;0;6}: [0.46, 0.47, 0.48, 0.48, 0.46, 0.45, 0.43, 0.45, 0.53], {19;1;0;5}: [8.2, 5.81, 7.5, 7.41, 7.9, 7.11, 7.04, 7.26, 6.86], {19;1;0;6}: [0.53, 0.51, 0.54, 0.53, 0.43, 0.43, 0.56, 0.53, 0.47]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))  # disabled

# ----
pt_7 = Point(Point(9.665050587, 21.52320608, 0))
xy = XYPlane(Origin=pt_7)
number_slider_13 = Slider(60, range=0..100)
number_slider_14 = Slider(40, range=0..100)
pln = Plane(xy)
deplane = DeconstructPlane(Plane=pln)  # -> Origin, XAxis, YAxis, ZAxis
lng_3 = ListLength(List=values_before)
line_3 = LineSDL(Start=deplane.Origin, Direction=deplane.XAxis, Length=number_slider_13)
line_4 = LineSDL(Start=deplane.Origin, Direction=deplane.YAxis, Length=number_slider_14)
subtraction = Subtraction(A=lng_3, B=1)
prot = RotatePlane(Plane=pln, Angle=degrees("90"))
rev_3 = Reverse(Vector=deplane.YAxis)
divide = DivideCurve(Curve=line_3, Count=subtraction, Kinks=False)  # -> Points, Tangents, Parameters
py3_10 = Python3Script(plane=pln, height=number_slider_14, x_pts=divide.Points, v_tree=merge_6, target=target)  # -> out, ticks, data_points, target_point; inputs plane: Plane, height: Double, x_pts: list of Point3d, v_tree: tree of Double, target: Double
# ---------- py3_10: Python ----------
import math
from Grasshopper import DataTree
from Grasshopper.Kernel.Data import GH_Path


def order_of_magnitude(value):
    return 10 ** math.floor(math.log10(value))

def remap_number(value, from_min, from_max, to_min, to_max):
    return to_min + (to_max - to_min) * ((value - from_min) / (from_max - from_min))

def calculate_ticks(values, max_value=None):
    if not values:
        return [0.0]
    
    raw_min = min(values)
    raw_max = max(values)

    if max_value is not None and max_value < raw_max:
        raise ValueError(f"Provide max_value {max_value} is less than the data maximum value {raw_max}.")
    
    if max_value is not None and math.isclose(max_value, 1.0) and raw_min >= 0.0:
        return [0.0, 0.2, 0.4, 0.6, 0.8, 1.0]
    
    if max_value is None:
        val_range = raw_max - raw_min
        if math.isclose(val_range, 0.0):
            val_range = abs(raw_max) if not math.isclose(raw_max, 0.0) else 1.0
        # find the order of magnitude
        magnitude = order_of_magnitude(val_range)

        approx_max = math.ceil(raw_max / magnitude) * magnitude
        approx_min = math.floor(raw_min / magnitude) * magnitude
    else:
        approx_max = max_value
        val_range = approx_max - raw_min
        magnitude = order_of_magnitude(val_range)
        approx_min = math.floor(raw_min / magnitude) * magnitude

    graph_range = approx_max - approx_min
    if math.isclose(graph_range, 0.0):
        return [approx_min]

    # Heckbert's Label Placement Algorithm to determine a "nice" step size for ticks
    segment = 5
    raw_step = graph_range / segment
    step_magnitude = order_of_magnitude(raw_step)
    significand = raw_step / step_magnitude

    if significand < 1.5:
        nice_step = 1.0 * step_magnitude
    elif significand < 3.0:
        nice_step = 2.0 * step_magnitude
    elif significand < 7.0:
        nice_step = 5.0 * step_magnitude
    else:
        nice_step = 10.0 * step_magnitude

    # Snap the range to whole multiples of the chosen step so the generated
    # ticks always reach (or exceed) raw_max instead of stopping short of it
    # (approx_min/approx_max above are rounded to the value's own order of
    # magnitude, not to nice_step, so they don't always land on a tick).
    nice_min = math.floor(raw_min / nice_step) * nice_step
    if math.isclose(nice_min, raw_min):
        # Data's lowest point would land exactly on the axis minimum, i.e. the
        # plotted curve would sit right on top of the x-axis line. Drop the
        # axis one more step below so the curve stays visually clear of it.
        nice_min -= nice_step
    nice_max = approx_max if max_value is not None else math.ceil(raw_max / nice_step) * nice_step

    if nice_step < 1.0:
        decimal = max(0, -math.floor(math.log10(nice_step)))
    else:
        decimal = 0

    ticks = []
    current_tick = nice_min
    while current_tick <= nice_max + (nice_step * 0.001):
        rounded = round(current_tick, decimal)
        if decimal == 0:
            rounded = int(rounded)

        ticks.append(rounded)
        current_tick += nice_step
    return ticks



#####-----Main Code----------###########

total_values = [list(v_tree.Branch(path)) for path in v_tree.Paths]
total_values = [v for vs in total_values for v in vs]
ticks = calculate_ticks(total_values)

data_points = DataTree[object]()

for path in v_tree.Paths:
    br = list(v_tree.Branch(path))

    y_values = [remap_number(value, min(ticks), max(ticks), 0, height) for value in br]

    pts = [pt + plane.YAxis * y for pt, y in zip(x_pts, y_values)]
    data_points.AddRange(pts, path)


target_y_value = remap_number(target, min(ticks), max(ticks), 0, height)
target_point = plane.Origin + plane.YAxis * target_y_value
# ---------- end py3_10 ----------
lng_4 = ListLength(List=py3_10.ticks)  # -> expr("x-1", Length)
series = Series(Start=0, Step=1, Count=lng_3)
midpt = CurveMiddle(Curve=line_4)
rev_4 = Reverse(Vector=deplane.XAxis)
addition = Addition(A=Slider(3.5, range=0..10), B="1")
divide_2 = DivideCurve(Curve=line_4, Count=lng_4, Kinks=False)  # -> Points, Tangents, Parameters
line_5 = LineSDL(Start=divide_2.Points, Direction=rev_4, Length=Slider(1, range=0..1))
addition_2 = Addition(A="2", B=Slider(5, range=0..10))
midpt_2 = CurveMiddle(Curve=line_3)
amp = Amplitude(Vector=rev_4, Amplitude=addition_2)
amp_2 = Amplitude(Vector=rev_3, Amplitude="1")
pl_origin = PlaneOrigin(Base=prot, Origin=midpt)
amp_3 = Amplitude(Vector=rev_3, Amplitude=addition)
amp_4 = Amplitude(Vector=rev_4, Amplitude="2")
pl_origin_2 = PlaneOrigin(Base=pln, Origin=midpt_2)
end_2 = EndPoints(Curve=line_5)  # -> Start, End
pl_origin_3 = PlaneOrigin(Base=pln, Origin=end_2.End)
move_4 = Move(Geometry=pl_origin, Motion=amp)  # -> Geometry, Transform
move_5 = Move(Geometry=pl_origin_3, Motion=amp_4)  # -> Geometry, Transform
move_6 = Move(Geometry=pl_origin_2, Motion=amp_3)  # -> Geometry, Transform
line_6 = LineSDL(Start=divide.Points, Direction=rev_3, Length=Slider(1, range=0..1))
end_3 = EndPoints(Curve=line_6)  # -> Start, End
pl_origin_4 = PlaneOrigin(Base=pln, Origin=end_3.End)
move_7 = Move(Geometry=pl_origin_4, Motion=amp_2)  # -> Geometry, Transform
text_entity = TextEntity(<text entity referenced from the Rhino model>)
text_entity_2 = TextEntity(<text entity referenced from the Rhino model>)
text_entity_3 = TextEntity(<text entity referenced from the Rhino model>)
text_entity_4 = TextEntity(TextEntity=text_entity, Plane=move_7.Geometry, Text=series, Style=<geometry referenced from the Rhino model>)
text_entity_5 = TextEntity(TextEntity=text_entity_3, Plane=move_5.Geometry, Text=py3_10.ticks, Style=<geometry referenced from the Rhino model>)
addition_3 = Addition(A=number_slider_14, B=Slider(2.8, range=0..10))
amp_5 = Amplitude(Vector=deplane.YAxis, Amplitude=addition_3)
number_slider_15 = Slider(0.34, range=0..1)
pt_8 = Point(py3_10.data_points)
line_7 = LineSDL(Start=py3_10.target_point, Direction=deplane.XAxis, Length=number_slider_13)
line_8 = Line([line_6, line_3, line_4, line_5])
move_8 = Move(Geometry=pl_origin_2, Motion=amp_5)  # -> Geometry, Transform
text_entity_6 = TextEntity(<text entity referenced from the Rhino model>)
neg = Negative(Value=number_slider_15)
previewlw_9 = CustomPreviewLineweights(Geometry=line_8, Shader=ColourSwatch(SwatchColor=RGB(0, 0, 0)), Thickness=Slider(2.5, range=0..10), Absolute=False)
pline_3 = PolyLine(Vertices=pt_8, Closed=False)
offcrv = OffsetCurve(Curve=line_7, Plane=pln, Distance=number_slider_15, BothSides=neg, Kinks=0, CapType=1)
text_entity_7 = TextEntity(TextEntity=text_entity_6, Plane=move_8.Geometry, Text=panel_12, Style=<geometry referenced from the Rhino model>)
swatch_7 = ColourSwatch(SwatchColor=RGB(0, 0, 255))
swatch_8 = ColourSwatch(SwatchColor=RGB(255, 0, 255))
swatch_9 = ColourSwatch(SwatchColor=RGBA(255, 0, 0, 100))
split_6 = SplitTree(Data=pline_3, Masks=flatten("{0}"))  # -> Positive, Negative
smesh = SimpleMesh(Brep=offcrv)
merge_11 = Merge(Data1=swatch_7, Data2=swatch_8)  # -> graft(Result)
preview = CustomPreview(Geometry=smesh, Material=swatch_9)
end_4 = EndPoints(Curve=line_7)  # -> Start, End
end_5 = EndPoints(Curve=split_6.Negative)  # -> Start, End
end_6 = EndPoints(Curve=split_6.Positive)  # -> Start, End
dots_7 = DotDisplay(Point=pt_8, Colour=merge_11, Size=Slider(0.23, range=0..1))
previewlw_10 = CustomPreviewLineweights(Geometry=pline_3, Shader=merge_11, Thickness=Slider(3, range=0..10), Absolute=False)
item_12 = ListItem(List=flatten(end_5.End), Index=number_slider_3, Wrap=True)
pl_origin_5 = PlaneOrigin(Base=pln, Origin=flatten([end_6.End, item_12, end_4.End]))
amp_6 = Amplitude(Vector=deplane.XAxis, Amplitude=Slider(1.8, range=0..10))
move_9 = Move(Geometry=pl_origin_5, Motion=amp_6)  # -> Geometry, Transform
panel_24 = Panel("""Default
Solutions
Target""")
text_entity_8 = TextEntity(<text entity referenced from the Rhino model>)
merge_12 = Merge(Data1=swatch_7, Data2=swatch_8, Data3=swatch_9)  # -> graft(Result)
text_entity_9 = TextEntity(TextEntity=text_entity_8, Plane=move_9.Geometry, Text=panel_24, Style=<geometry referenced from the Rhino model>)  # -> graft(TextEntity)
preview_2 = CustomPreview(Geometry=text_entity_9, Material=merge_12)

text_entity_10 = TextEntity(TextEntity=text_entity_2, Plane=move_6.Geometry, Text="Receiver Index", Style=<geometry referenced from the Rhino model>)
text_entity_11 = TextEntity(TextEntity=text_entity_2, Plane=move_4.Geometry, Text=panel_13, Style=<geometry referenced from the Rhino model>)

preview_3 = CustomPreview(
    Geometry=[text_entity_4, text_entity_10, text_entity_11, text_entity_5, text_entity_7],
    Material=ColourSwatch(SwatchColor=RGB(0, 0, 0)))

item_13 = ListItem(List=flatten(split_6.Negative), Index=number_slider_2, Wrap=True)
previewlw_11 = CustomPreviewLineweights(Geometry=item_13, Shader=ColourSwatch(SwatchColor=RGB(255, 0, 255)), Thickness=Slider(10, range=0..10), Absolute=False)
