# Grasshopper definition Scenario_03.ghx (Grasshopper 1.0.8)

panel = Panel("9.2")
panel_2 = Panel("5.8")
panel_3 = Panel("5.0")

reload = Python3Script(reload=Button())  # inputs reload: Boolean
# ---------- reload: Python ----------
# venv: rhino_compas_acoustics
# r: compas
# r: pyroomacoustics
# r: matplotlib
# r: librosa
# r: soundfile
# r: sounddevice
# r: sofar
# r: pyfar
# r: pyrato

import sys
import os
from compas_rhino import unload_modules


gh_path = ghenv.Component.OnPingDocument().FilePath
dire_path = os.path.dirname(os.path.dirname(gh_path))
target_path = os.path.join(dire_path, "src")

if target_path not in sys.path:
    sys.path.insert(0, target_path)

if reload:
    unload_modules('compas_acoustics')

try:
    import compas_acoustics as ca
except Exception as e:
    raise ValueError(e)
# ---------- end reload ----------

lamcp = LAMCPBridge(enable=Toggle(True))  # -> status; inputs enable: Boolean, port: Int32
#   port enable: Toggle to start (True) or stop (False) the local HTTP server.
#   port port: Port to listen on (loopback only). Defaults to 8765.
#   port status: Current server status string.
# ---------- lamcp: Python ----------
"""
LAMCP Bridge: local HTTP server inside Rhino 8 / Grasshopper CPython.

Exposes `POST /exec` (JSON: `{"code": "...", "timeout": 30}`) which
exec()s `code` and returns
`{"stdout": "...", "stderr": "...", "result": "...", "error": null|str}`.

Pair with the `lamcp` FastMCP server, which translates Claude's
`run_python_script` MCP tool calls into POSTs to this endpoint.

Binds to 127.0.0.1 only. NEVER expose beyond localhost â€” it exec()s
arbitrary Python with full Rhino API access.

LAMCP v0.1.0
"""

import contextlib
import io
import json
import threading
import traceback
from http.server import BaseHTTPRequestHandler
from http.server import HTTPServer

import Grasshopper
import scriptcontext as sc


SHARED_GLOBALS_KEY = "_lamcp_bridge_globals"
SERVER_KEY = "_lamcp_bridge_server"


def _exec_code(code, timeout):
    """Run `code` on the HTTP-server thread and capture stdout/stderr/result.

    NOTE: this is intentionally NOT marshalled to Rhino's UI thread for the
    spike â€” `Rhino.RhinoApp.InvokeOnUiThread` was queueing actions that
    never fired in Rhino 8 CPython. Most read-only RhinoCommon access is
    safe cross-thread; mutations may crash. Add Eto-based marshalling
    back here when we need it.
    """
    out = io.StringIO()
    err = io.StringIO()
    g = sc.sticky.setdefault(SHARED_GLOBALS_KEY, {"__name__": "__lamcp_bridge__"})
    error_text = None
    result_repr = None
    try:
        with contextlib.redirect_stdout(out), contextlib.redirect_stderr(err):
            exec(code, g, g)
            result_repr = repr(g.get("_"))
    except BaseException:
        error_text = traceback.format_exc()

    return {
        "stdout": out.getvalue(),
        "stderr": err.getvalue(),
        "result": result_repr,
        "error": error_text,
    }


class _ExecHandler(BaseHTTPRequestHandler):
    # Silence default request logging so it doesn't clog the Rhino command line.
    def log_message(self, fmt, *args):
        pass

    def _send(self, code, payload):
        body = json.dumps(payload).encode("utf-8")
        self.send_response(code)
        self.send_header("Content-Type", "application/json")
        self.send_header("Content-Length", str(len(body)))
        self.end_headers()
        self.wfile.write(body)

    def do_GET(self):
        if self.path == "/health":
            self._send(200, {"status": "ok"})
        else:
            self._send(404, {"error": "not found"})

    def do_POST(self):
        if self.path != "/exec":
            self._send(404, {"error": "not found"})
            return
        length = int(self.headers.get("Content-Length", "0"))
        try:
            raw = self.rfile.read(length).decode("utf-8")
            body = json.loads(raw)
            code = body.get("code", "")
            timeout = float(body.get("timeout", 30.0))
        except Exception as exc:
            self._send(400, {"error": "bad request: " + repr(exc)})
            return
        result = _exec_code(code, timeout)
        self._send(200, result)


def _start_server(port):
    server = HTTPServer(("127.0.0.1", port), _ExecHandler)
    thread = threading.Thread(
        target=server.serve_forever, daemon=True, name="lamcp-bridge"
    )
    thread.start()
    return {"server": server, "thread": thread, "port": port}


def _stop_server(state):
    try:
        state["server"].shutdown()
        state["server"].server_close()
    except Exception:
        pass


class LamcpBridgeComponent(Grasshopper.Kernel.GH_ScriptInstance):
    def RunScript(self, enable: bool, port: int):
        port = int(port) if port else 8765

        state = sc.sticky.get(SERVER_KEY)

        if not enable:
            if state is not None:
                _stop_server(state)
                del sc.sticky[SERVER_KEY]
            return "stopped"

        # Already running on the requested port: no-op.
        if (
            state is not None
            and state.get("port") == port
            and state["thread"].is_alive()
        ):
            return "listening on http://127.0.0.1:{}".format(port)

        # Port changed or server died: tear down and restart.
        if state is not None:
            _stop_server(state)
            del sc.sticky[SERVER_KEY]

        try:
            sc.sticky[SERVER_KEY] = _start_server(port)
        except OSError as exc:
            ghenv.Component.AddRuntimeMessage(  # noqa: F821
                Grasshopper.Kernel.GH_RuntimeMessageLevel.Error,
                "Failed to bind 127.0.0.1:{}: {}".format(port, exc),
            )
            return "error: {}".format(exc)

        return "listening on http://127.0.0.1:{}".format(port)
# ---------- end lamcp ----------

pln = Plane(Plane(origin=(53.49523734, 7.24526873, 0), x=(0.9843087811, -0.1764545933, 0), y=(0.1764545933, 0.9843087811, 0)))
deplane = DeconstructPlane(Plane=pln)  # -> Origin, XAxis, YAxis, ZAxis
rev = Reverse(Vector=deplane.YAxis)
amp = Amplitude(Vector=rev, Amplitude=Slider(45, range=0..100))
move = Move(Geometry=pln, Motion=amp)  # -> Geometry, Transform
srf = Surface([<surface referenced from the Rhino model> x4])
py3 = Python3Script(base_pln=move.Geometry, width=Slider(100, range=0..100), depth=Slider(100, range=0..100), height="18")  # -> out, box; inputs base_pln: Plane, width: Double, depth: Double, height: Double
# ---------- py3: Python ----------
import Rhino.Geometry as rg


box = rg.Box(
    base_pln,
    rg.Interval(- width / 2, width / 2),
    rg.Interval(- depth / 2, depth / 2),
    rg.Interval(-1, height - 1)
)
# ---------- end py3 ----------
debrep = DeconstructBrep(Brep=py3.box)  # -> Faces, Edges, Vertices
srf_2 = Surface(<surface referenced from the Rhino model>)
srf_3 = Surface([<surface referenced from the Rhino model> x3])
panel_4 = Panel("""0.1
0.07
0.05
0.04
0.04
0.03
0.03""")
string_quartet_4 = Compas_acousticsOrchestraLayout(plane=pln)  # -> points, names; inputs plane: Plane
#   port plane: Plane the layout is built on. Defaults to WorldXY if omitted.
#   port points: Named performer positions.
#   port names: Names matching each point, e.g. 'violin_1'.
# ---------- string_quartet_4: Python ----------
"""Named performer positions for a standard string ensemble formation, for use as Source/Receiver positions.

Options:
- string_quartet (4 players)
- chamber_strings (16 players)
- chamber_strings_24 (24 players)
- symphonic_strings_50 (50 players)"""
# flake8: noqa
import Grasshopper
import Rhino
from Rhino.Geometry import Point3d
from System.Windows.Forms import ToolStripSeparator

from compas_rhino.conversions import plane_to_compas_frame

from compas_acoustics.orchestra_layouts import (
    string_quartet,
    chamber_strings,
    medium_chamber_strings,
    symphonic_strings,
)


class OrchestraLayoutSelector(Grasshopper.Kernel.GH_ScriptInstance):
    LAYOUTS = {
        "string_quartet_4": string_quartet,
        "chamber_strings_16": chamber_strings,
        "chamber_strings_24": medium_chamber_strings,
        "symphonic_strings_50": symphonic_strings,
    }
    ITEMS = list(LAYOUTS.keys())

    def __init__(self):
        super().__init__()
        nickname = ghenv.Component.NickName
        self.layout_name = nickname if nickname in self.ITEMS else None

    def RunScript(self, plane: Rhino.Geometry.Plane):
        if self.layout_name not in self.ITEMS:
            ghenv.Component.AddRuntimeMessage(
                Grasshopper.Kernel.GH_RuntimeMessageLevel.Remark, "Right-click the icon to choose an orchestra layout."
            )
            ghenv.Component.Message = None
            return

        ghenv.Component.Message = self.layout_name
        frame = plane_to_compas_frame(plane) if plane is not None else None

        layout_fn = self.LAYOUTS[self.layout_name]
        points, names = layout_fn(frame)
        return [Point3d(*p) for p in points], names
    
    def AppendAdditionalMenuItems(self, menu):
        for name in self.ITEMS:
            item = menu.Items.Add(name, None, self.on_item_click)
            item.Checked = (name == self.layout_name)

        menu.Items.Add(ToolStripSeparator())

    def on_item_click(self, sender, event_info):
        name = str(sender)
        if name == self.layout_name:
            return
        self.layout_name = name
        ghenv.Component.NickName = name
        ghenv.Component.ExpireSolution(True)
# ---------- end string_quartet_4 ----------
repeat = RepeatData(Data="1", Length="7")
repeat_2 = RepeatData(Data="0", Length="7")
crv = Curve(srf)
crv_2 = Curve([srf_2, srf_3])
smesh = SimpleMesh(Brep=py3.box)
item = ListItem(List=debrep.Faces, Index="4", Wrap=True)
panel_5 = Panel("""0.01
0.04
0.15
0.45
0.77
0.8
0.8""")
conmat = Compas_acousticsConstructMaterial(absorption=repeat, scattering=repeat_2, name="air")  # -> material; inputs absorption: list of Double, scattering: list of Double, name: String
#   port absorption: List of absorption coefficients for each frequency band. e.g. '0.1, 0.2, 0.3, 0.4, 0.5, 0.6, 0.7' for 7 frequency bands.
#   port scattering: Optional. List of scattering coefficients for each frequency band. e.g. '0.1, 0.2, 0.3, 0.4, 0.5, 0.6, 0.7' for 7 frequency bands.
#   port name: Name of the material preset in the library (e.g. 'concrete', 'carpet').
#   port material: AcousticMaterial object.
# ---------- conmat: Python ----------
"""Create an AcousticMaterial for AcousticObject(s)."""
# flake8: noqa
import Grasshopper
import System
from compas_acoustics.acoustic_material import AcousticMaterial


class ConstructMaterial(Grasshopper.Kernel.GH_ScriptInstance):

    def RunScript(self,
            absorption: System.Collections.Generic.List[float],
            scattering: System.Collections.Generic.List[float],
            name: str):
        if absorption is None:
            ghenv.Component.AddRuntimeMessage(
                Grasshopper.Kernel.GH_RuntimeMessageLevel.Warning,
                "Input parameter 'absorption' failed to collect data."
            )
            return
        if name is None:
            ghenv.Component.AddRuntimeMessage(
                Grasshopper.Kernel.GH_RuntimeMessageLevel.Warning,
                "Input parameter 'name' failed to collect data."
            )
            return

        return AcousticMaterial(
            name=name,
            absorption_coefficients=absorption,
            scattering_coefficients=scattering,
        )
# ---------- end conmat ----------
Z = UnitZ(Factor="1.5")
disc = Discontinuity(Curve=crv_2, Level=1)  # -> Points, Parameters
number_slider = Slider(20, range=0..20)
number_slider_2 = Slider(20, range=0..20)
omnidirectional = Compas_acousticsDirectivity()  # -> directivity
#   port directivity: Directivity pattern.
# ---------- omnidirectional: Python ----------
"""Preset picker for directivity patterns. Right-click to choose a pattern from the available options."""
# flake8: noqa
import Grasshopper
from System.Windows.Forms import ToolStripSeparator
from compas_acoustics.materials_library import MaterialsLibrary


class DirectivitySelector(Grasshopper.Kernel.GH_ScriptInstance):
    ITEMS = ["Bidirectional", "Hypercardioid", "Supercardioid", "Cardioid", "Omnidirectional"]

    def __init__(self):
        super().__init__()
        nickname = ghenv.Component.NickName
        self.directivity_name = nickname if nickname in self.ITEMS else None

    def RunScript(self):
        names = self.ITEMS
        if not names:
            ghenv.Component.AddRuntimeMessage(
                Grasshopper.Kernel.GH_RuntimeMessageLevel.Error, "No directivity patterns found."
            )
            return None

        if self.directivity_name not in names:
            ghenv.Component.AddRuntimeMessage(
                Grasshopper.Kernel.GH_RuntimeMessageLevel.Remark, "Right-click the icon to choose a directivity pattern."
            )
            ghenv.Component.Message = None
            return None

        ghenv.Component.Message = self.directivity_name
        return self.directivity_name.lower()

    def AppendAdditionalMenuItems(self, menu):
        for name in self.ITEMS:
            item = menu.Items.Add(name, None, self.on_item_click)
            item.Checked = (name == self.directivity_name)

        menu.Items.Add(ToolStripSeparator())

    def on_item_click(self, sender, event_info):
        name = str(sender)
        if name == self.directivity_name:
            return
        self.directivity_name = name
        ghenv.Component.NickName = name
        ghenv.Component.ExpireSolution(True)
# ---------- end omnidirectional ----------
number_slider_3 = Slider(100, range=0..100)
avr = Average(Input=string_quartet_4.points)
neg = Negative(Value=Slider(0.4, range=0..1))
faceb = FaceBoundaries(Mesh=smesh)
tag = TextTag(Location=string_quartet_4.points, Text=string_quartet_4.names)  # disabled
move_2 = Move(Geometry=item, Motion=Z)  # -> Geometry, Transform
pline = PolyLine(Vertices=disc.Points, Closed=invert(False))  # -> flatten(Polyline)
conmat_2 = Compas_acousticsConstructMaterial(absorption=panel_4, scattering=panel_5, name="stage_reflect")  # -> material; inputs absorption: list of Double, scattering: list of Double, name: String; same code as conmat
offset = OffsetCurve(Curve=move_2.Geometry, Distance=neg, Corners=1)
obj = Compas_acousticsAcousticObject(geometry=faceb, material=conmat)  # -> acoustic_object; inputs geometry: GeometryBase, name: String
#   port geometry: Geometry of the AcousticObject.
#   port material: Material of the AcousticObject.
#   port name: Name of the AcousticObject.
#   port acoustic_object: AcousticObject object.
# ---------- obj: Python ----------
"""Create an AcousticObject with the specified geometry and material."""
# flake8: noqa
import Grasshopper
import Rhino
from compas_acoustics.geometry import AcousticObject
from compas_rhino.conversions import mesh_to_compas
from compas_rhino.conversions import polyline_to_compas

# TODO: Change the typeHintID in metadata.json from "mesh" to "geometrybase"

class CreateAcousticObject(Grasshopper.Kernel.GH_ScriptInstance):

    def RunScript(self, geometry: Rhino.Geometry.GeometryBase, material, name: str):

        if geometry is None:
            ghenv.Component.AddRuntimeMessage(
                Grasshopper.Kernel.GH_RuntimeMessageLevel.Warning, "No geometry provided."
            )
            return
        if material is None:
            ghenv.Component.AddRuntimeMessage(
                Grasshopper.Kernel.GH_RuntimeMessageLevel.Warning, "No material provided."
            )
            return

        # Gemetry conversion from Rhino to Compas
        # TODO: Figure out how to handle other geometry types (e.g., Brep, Surface, etc.)
        if isinstance(geometry, Rhino.Geometry.Mesh):
            geometry = mesh_to_compas(geometry)
        elif isinstance(geometry, Rhino.Geometry.Polyline):
            geometry = polyline_to_compas(geometry)
        elif isinstance(geometry, Rhino.Geometry.PolylineCurve):
            geometry = polyline_to_compas(geometry.ToPolyline())
        else:
            ghenv.Component.AddRuntimeMessage(
                Grasshopper.Kernel.GH_RuntimeMessageLevel.Error, "Unsupported geometry type."
            )
            return
        return AcousticObject(acoustic_geometry=geometry, material=material, name=name)
# ---------- end obj ----------
dots = DotDisplay(Point=avr, Colour=RGB(0, 0, 0), Size=0.1)
flip = FlipCurve(Curve=pline)  # -> Curve, Flag
mesh_uv = MeshSurface(Surface=move_2.Geometry, UCount=number_slider_3, VCount=number_slider_3, Overhang=True, Equalize=False)
source = Compas_acousticsSource(position=avr, directivity=omnidirectional, name="test_spl_src")  # -> source; inputs position: Point3d, direction: Vector3d, directivity: String, name: String, sound_file: String
#   port position: Position of the source.
#   port direction: Direction of the source.
#   port directivity: Directivity of the source. Default is Omnidirectional. Options: - Bidirectional - Hypercardioid - Supercardioid - Cardioid - Omnidirectional
#   port name: Name of the source.
#   port sound_file: Sound file associated with the source.
#   port source: Source object.
# ---------- source: Python ----------
"""Acoustic Source object (speaker, human, etc.)."""
# flake8: noqa
import Grasshopper
import Rhino
from compas_acoustics import Source


class CreateSource(Grasshopper.Kernel.GH_ScriptInstance):
    ITEMS = ["bidirectional", "hypercardioid", "supercardioid", "cardioid", "omnidirectional"]

    def RunScript(self,
            position: Rhino.Geometry.Point3d,
            direction: Rhino.Geometry.Vector3d,
            directivity: str,
            name: str,
            sound_file: str):
        if position is None:
            position = Rhino.Geometry.Point3d(0, 0, 0)
        if direction is None:
            direction = Rhino.Geometry.Vector3d(1, 0, 0)

        if directivity is None:
            dirt = "omnidirectional"
        elif directivity not in self.ITEMS:
            ghenv.Component.AddRuntimeMessage(
                Grasshopper.Kernel.GH_RuntimeMessageLevel.Error, "Input parameter 'directivity' is not valid."
            )
            return None
        else:
            dirt = directivity

        if name is None:
            name = "my_source"

        return Source(
            name,
            *position,
            directivity=dirt,
            direction=[*direction],
            sound_file=sound_file
        )
# ---------- end source ----------
merge = Merge(Data1=pline, Data2=flip.Curve)
demesh = DeconstructMesh(Mesh=mesh_uv)  # -> Vertices, Faces, Colours, Normals
item_2 = ListItem(List=demesh.Vertices, Index=0, Wrap=True)  # -> Item, Item1
obj_2 = Compas_acousticsAcousticObject(geometry=merge, material=conmat_2, name="stage")  # -> acoustic_object; inputs geometry: GeometryBase, name: String; same code as obj
receiver = Compas_acousticsReceiver(position=demesh.Vertices)  # -> receiver; inputs position: Point3d, name: String
#   port position: Position of the receiver.
#   port name: Name of the receiver.
#   port receiver: Receiver object.
# ---------- receiver: Python ----------
"""Acoustic Receiver object (microphone, human ear, etc.)."""
# flake8: noqa
import Grasshopper
import Rhino
from compas_acoustics import Receiver

# TODO: Implement direction
class CreateReceiver(Grasshopper.Kernel.GH_ScriptInstance):

    def RunScript(self, position: Rhino.Geometry.Point3d, name: str):
        if position is None:
            position = Rhino.Geometry.Point3d(0, 0, 1)
        if name is None:
            name = "my_receiver"

        return Receiver(name, *position)
# ---------- end receiver ----------
dist = Distance(PointA=item_2.Item, PointB=item_2.Item1)
panel_6 = Panel(dist)
number_slider_4 = Slider(95, range=0..150)
expression = Expression(x=dist, Expression="x * 0.6")
merge_2 = Merge(Data1=obj, Data2=obj_2)
number_slider_5 = Slider(58, range=0..200)  # disabled
scene = Compas_acousticsRoomScene(objects=flatten(merge_2), sources=flatten(source), receivers=flatten(receiver))  # -> scene; inputs objects: list, sources: list, receivers: list, name: String
#   port objects: List of AcousticObject
#   port sources: List of Source objects.
#   port receivers: List of Receiver objects.
#   port name: Name of the room scene.
#   port scene: Room scene object.
# ---------- scene: Python ----------
"""Create a room scene with the specified objects, sources, and receivers."""
# flake8: noqa
import Grasshopper

import System
from compas_acoustics.scene import Scene
from compas_acoustics.source import Source
from compas_acoustics.receiver import Receiver


class CreateModelScene(Grasshopper.Kernel.GH_ScriptInstance):

    def RunScript(self,
            objects: System.Collections.Generic.List[object],
            sources: System.Collections.Generic.List[object],
            receivers: System.Collections.Generic.List[object],
            name: str):

        if objects is None:
            ghenv.Component.AddRuntimeMessage(
                Grasshopper.Kernel.GH_RuntimeMessageLevel.Warning, "No objects provided."
            )
            return
        if sources is None:
            ghenv.Component.AddRuntimeMessage(
                Grasshopper.Kernel.GH_RuntimeMessageLevel.Warning, "No sources provided."
            )
            return
        if receivers is None:
            ghenv.Component.AddRuntimeMessage(
                Grasshopper.Kernel.GH_RuntimeMessageLevel.Warning, "No receivers provided."
            )
            return

        scene = Scene(name=name)
        scene.add_acoustic_objects(objects)
        for src in sources:
            if isinstance(src, Source):
                scene.add_source(src)
            else:
                ghenv.Component.AddRuntimeMessage(
                    Grasshopper.Kernel.GH_RuntimeMessageLevel.Error,
                    f"Invalid source type: {type(src)}. Expected a Source object.",
                )
        for rcv in receivers:
            if isinstance(rcv, Receiver):
                scene.add_receiver(rcv)
            else:
                ghenv.Component.AddRuntimeMessage(
                    Grasshopper.Kernel.GH_RuntimeMessageLevel.Error,
                    f"Invalid receiver type: {type(rcv)}. Expected a Receiver object.",
                )

        return scene
# ---------- end scene ----------

number_slider_6 = Slider(40, range=0..150)  # disabled
number_slider_7 = Slider(7, range=0..10)  # disabled
number_slider_8 = Slider(1000, range=0..10000)  # disabled
number_slider_9 = Slider(91, range=0..150)  # disabled
expression_2 = Expression(x=dist, Expression="x * 0.6")  # disabled
traceraystoreceivers = Python3Script(
    scene=scene,
    ref_db=number_slider_9,
    target_db=number_slider_6,
    radius=expression_2,
    n_rays=number_slider_8,
    seed=number_slider_7)  # -> out, spls; inputs ref_db: Double, target_db: Double, radius: Double, n_rays: Int32, seed: Int32; disabled
# ---------- traceraystoreceivers: Python ----------
import math
import numpy as np
from compas_acoustics import pra_converter as cpc

from compas.geometry import Point
from compas.geometry import Vector
from compas.geometry import Line
from compas.geometry import Polyline

import pyroomacoustics as pra

from Grasshopper import DataTree
from Grasshopper.Kernel.Data import GH_Path


def random_directions(n_rays, seed=None, jitter=0.5):
    """n_rays unit direction vectors on the sphere via a jittered Fibonacci
    lattice -- much more even angular coverage per ray than i.i.d. random
    sampling, while still varying with `seed`.

    jitter : float in [0, 1]
        0 = exact deterministic lattice, no randomness.
        1 = perturbation on the order of one full lattice-cell spacing.
    """
    golden = np.pi * (3.0 - np.sqrt(5.0))
    i = np.arange(n_rays)
    z = 1.0 - 2.0 * (i + 0.5) / n_rays
    radius = np.sqrt(np.maximum(1.0 - z * z, 0.0))
    phi = i * golden

    directions = np.stack([radius * np.cos(phi), radius * np.sin(phi), z], axis=1)

    if jitter > 0:
        rng = np.random.default_rng(seed)
        cell_size = 2.0 / np.sqrt(n_rays)  # ~ spacing between neighboring lattice points
        directions += rng.normal(size=(n_rays, 3)) * cell_size * jitter
        directions /= np.linalg.norm(directions, axis=1, keepdims=True)

    return directions

def spl_at_distance(start_db, distance):
    """
    Calculate sound pressure level (Lp) in dB after geometric spreading over distance (meters).
    Only support omni directivity now.
    """
    if distance <= 0:
        return start_db

    sphere_area = 4.0 * math.pi * (distance ** 2)

    return start_db - 10.0 * math.log10(sphere_area)

def distance_between_spl(from_db, to_db):
    if from_db <= to_db:
        return 0.0

    sphere_angle = 4.0 * math.pi
    exponent = (from_db - to_db) / 10.0

    return math.sqrt((10.0 ** exponent) / sphere_angle)

def trace_rays_to_receivers(
    room, sources, receivers, start_db, target_db, radius=None, n_rays=50, max_order=100, seed=7, jitter=0.5
):

    for rcv in receivers:
        rcv.received_spls = []
        if radius is not None:
            rcv.radius = radius

    engine = room.room_engine
    walls = room.walls
    max_dist = float(engine.max_dist)

    # Precomputed once: batched receiver test avoids building a Line/Vector
    # per receiver per bounce.
    rcv_positions = np.array([rcv.position for rcv in receivers], dtype=float)
    rcv_radii_sq = np.array([rcv.radius ** 2 for rcv in receivers], dtype=float)

    # Each ray represents only a 1/n_rays share of the source's power. Ray
    # propagation/termination still tracks the true (unnormalized) level --
    # otherwise every ray dies near the source and coverage collapses --
    # but only a 1/n_rays share of that level is credited to a receiver,
    # so summed hits converge instead of climbing with n_rays.
    ray_energy_db = -10.0 * math.log10(n_rays)

    for i, source in enumerate(sources):
        dire_lst = random_directions(n_rays, seed * (i + 1) + 7, jitter)

        for dire in dire_lst:
            pos = np.asarray(source.position, dtype=float)
            db = start_db
            dist_travelled = 0.0

            for _ in range(max_order):
                hit, wall_idx, hit_dist = engine.next_wall_hit(pos, pos + dire * max_dist, False)
                if wall_idx == -1:
                    break

                # Project every receiver onto the segment [pos, hit] at once.
                r_vecs = rcv_positions - pos
                t_proj = r_vecs @ dire
                d_perp_sq = np.sum(r_vecs * r_vecs, axis=1) - t_proj ** 2
                captured = (t_proj > 0.0) & (t_proj <= hit_dist) & (d_perp_sq <= rcv_radii_sq)

                if np.any(captured):
                    eff_dist = np.maximum(dist_travelled + t_proj[captured], np.sqrt(rcv_radii_sq[captured]))
                    raw_spls = db - 10.0 * np.log10(4.0 * np.pi * eff_dist ** 2)
                    for j, raw_spl in zip(np.flatnonzero(captured), raw_spls):
                        if raw_spl > target_db:
                            receivers[j].received_spls.append(float(raw_spl + ray_energy_db))

                # Stop the loop when the sound reaches the target_db over the distance
                dist_travelled += hit_dist
                curr_spl = spl_at_distance(db, dist_travelled)
                if curr_spl <= target_db:
                    break

                wall_hitted = walls[wall_idx]

                # Attenuate absorption
                absorption = float(np.mean(np.asarray(wall_hitted.absorption, dtype=float)))
                remaining = 1.0 - absorption
                if remaining <= 0.0:
                    break

                db += 10.0 * math.log10(remaining)

                # Specular reflection update
                dire = np.asarray(wall_hitted.normal_reflect(dire), dtype=float)
                pos = hit

    return [rcv.total_spl for rcv in receivers]

# Main code -------------
room = cpc.scene_to_pra_room(
    scene, 16000, max_order=1, ray_tracing=False, air_absorption=False
)
sources = scene.sources
receivers = scene.receivers
    
received_spls = trace_rays_to_receivers(
    room, sources, receivers, ref_db, target_db,
    radius=radius, max_order=10, n_rays=n_rays, seed=seed
)

spls = received_spls
# ---------- end traceraystoreceivers ----------

splsfromimagesourcemethod = Python3Script(
    scene=scene,
    ref_db=number_slider_4,
    target_db=Slider(40, range=0..150),
    radius=expression,
    max_order=Slider(2, range=0..2))  # -> out, spls; inputs ref_db: Double, target_db: Double, radius: Double, max_order: Int32
# ---------- splsfromimagesourcemethod: Python ----------
import numpy as np
from compas_acoustics.pra_converter import source_to_pra
from compas_acoustics.pra_converter import receivers_to_pra_mic_array
from compas_acoustics.pra_converter import scene_to_pra_room

def spls_from_image_source_method(room, sources, receivers, start_db, target_db):
    """
    Deterministic alternative to trace_rays_to_receivers, for use inside
    optimization loops where a noisy, n_rays-dependent objective is a
    problem: uses pyroomacoustics's compiled image-source engine to find
    every exact specular reflection path from each source to each receiver,
    up to room.max_order. No random sampling -- the same geometry always
    gives the same result.

    room must have been constructed with the reflection order you want,
    e.g. `scene_to_pra_room(scene, fs, max_order=3, ...)` -- max_order
    is baked into the compiled room engine at construction and cannot be
    changed on the room object afterwards.
    """
    for rcv in receivers:
        rcv.received_spls = []

    for source in sources:
        room.add_soundsource(source_to_pra(source))
    room.add_microphone_array(receivers_to_pra_mic_array(receivers, sample_rate=room.fs))

    room.image_source_model()

    rcv_positions = np.array([rcv.position for rcv in receivers], dtype=float)
    rcv_radii = np.array([rcv.radius for rcv in receivers], dtype=float)

    for si, src in enumerate(room.sources):
        n_images = src.images.shape[1]
        if n_images == 0:
            continue

        # damping is amplitude-domain; square + band-average to get the
        # broadband energy reflection coefficient, matching how absorption
        # is averaged everywhere else in this module.
        energy_damping = np.mean(src.damping ** 2, axis=0)
        damping_db = 10.0 * np.log10(np.maximum(energy_damping, 1e-30))
        visible = np.asarray(room.visibility[si]).astype(bool)

        # Every (receiver, image source) pair at once: (n_receivers, n_images).
        diffs = src.images[None, :, :] - rcv_positions[:, :, None]
        distances = np.linalg.norm(diffs, axis=1)
        # Clamp to each receiver's own radius -- see the same clamp in
        # trace_rays_to_receivers for why (spl_at_distance is unbounded as
        # distance -> 0, and a receiver isn't a point).
        distances = np.maximum(distances, rcv_radii[:, None])

        raw_spls = start_db - 10.0 * np.log10(4.0 * np.pi * distances ** 2) + damping_db[None, :]
        mask = visible & (raw_spls > target_db)

        rows, cols = np.nonzero(mask)
        for m, k in zip(rows, cols):
            receivers[m].received_spls.append(float(raw_spls[m, k]))

    return [rcv.total_spl for rcv in receivers]


# Main code
room = scene_to_pra_room(
    scene, 16000, max_order=max_order, ray_tracing=False, air_absorption=False
)
sources = scene.sources
receivers = scene.receivers

if radius is not None:
    for rcv in receivers:
        rcv.radius = radius

spls = spls_from_image_source_method(
    room, sources, receivers, ref_db, target_db
)
# ---------- end splsfromimagesourcemethod ----------
number_slider_10 = Slider(1, range=0..1000)  # disabled
number_slider_11 = Slider(90, range=0..200)  # disabled
number_slider_12 = Slider(5, range=0..10)  # disabled
number_slider_13 = Slider(1, range=0..1)
pt = Point(demesh.Vertices)
py3_2 = Python3Script(pts=pt, spls=splsfromimagesourcemethod.spls, target_db=Slider(60, range=0..100))  # -> out, pts_out; inputs pts: list of Point3d, spls: list, target_db: Double
# ---------- py3_2: Python ----------
pts_out = [pt for pt, spl in zip(pts, spls) if spl >= target_db]
# ---------- end py3_2 ----------
number_slider_14 = Slider(3, range=0..3)  # disabled
traceraysscattered = Python3Script(scene=scene, ref_db=number_slider_11, target_db=number_slider_5, n_rays=number_slider_10, seed=number_slider_12)  # -> out, a; inputs ref_db: Double, target_db: Double, n_rays: Int32, seed: Int32; disabled
# ---------- traceraysscattered: Python ----------
import math
import numpy as np
from compas_acoustics import pra_converter as cpc

from compas.geometry import Point
from compas.geometry import Polyline

import pyroomacoustics as pra

from Grasshopper import DataTree
from Grasshopper.Kernel.Data import GH_Path


def random_directions(n_rays, seed=None, jitter=0.5):
    """n_rays unit direction vectors on the sphere via a jittered Fibonacci
    lattice -- much more even angular coverage per ray than i.i.d. random
    sampling, while still varying with `seed`.

    jitter : float in [0, 1]
        0 = exact deterministic lattice, no randomness.
        1 = perturbation on the order of one full lattice-cell spacing.
    """
    golden = np.pi * (3.0 - np.sqrt(5.0))
    i = np.arange(n_rays)
    z = 1.0 - 2.0 * (i + 0.5) / n_rays
    radius = np.sqrt(np.maximum(1.0 - z * z, 0.0))
    phi = i * golden

    directions = np.stack([radius * np.cos(phi), radius * np.sin(phi), z], axis=1)

    if jitter > 0:
        rng = np.random.default_rng(seed)
        cell_size = 2.0 / np.sqrt(n_rays)  # ~ spacing between neighboring lattice points
        directions += rng.normal(size=(n_rays, 3)) * cell_size * jitter
        directions /= np.linalg.norm(directions, axis=1, keepdims=True)

    return directions

def spl_at_distance(start_db, distance):
    """
    Calculate sound pressure level (Lp) in dB after geometric spreading over distance (meters).
    Only support omni directivity now.
    """
    if distance <= 0:
        return start_db

    sphere_area = 4.0 * math.pi * (distance ** 2)

    return start_db - 10.0 * math.log10(sphere_area)

def distance_between_db(from_db, to_db):
    if from_db <= to_db:
        return 0.0

    sphere_angle = 4.0 * math.pi
    exponent = (from_db - to_db) / 10.0

    return math.sqrt((10.0 ** exponent) / sphere_angle)

def trace_rays_scattered(room, sources, start_db, target_db, n_rays=50, max_order=100, seed=7, jitter=0.5):

    polyline_tree = []

    engine = room.room_engine
    walls = room.walls
    max_dist = float(engine.max_dist)

    for i, source in enumerate(sources):
        dire_lst = random_directions(n_rays, seed * (i + 1) + 7, jitter)
        
        polylines = []
        for dire in dire_lst:
            pos = np.asarray(source.position, dtype=float)
            db = start_db
            dist_travelled = 0.0
            # hits = []
            pts = [Point(*pos)]
            for _ in range(max_order):
                hit, wall_idx, hit_dist = engine.next_wall_hit(pos, pos + dire * max_dist, False)
                if wall_idx == -1:
                    break

                # Stop the loop when the sound reaches the target_db over the distance
                dist_travelled += hit_dist
                curr_spl = spl_at_distance(db, dist_travelled)
                if curr_spl <= target_db:
                    # Generate the stop point
                    dist_at_target = distance_between_db(db, target_db)
                    dist_end = dist_travelled - dist_at_target
                    pt_end = hit + (-dire * dist_end)
                    pts.append(Point(*pt_end))
                    break

                # hits.append({"point": hit, "distance": dist_travelled, "spl": curr_spl})
                pts.append(Point(*hit))
                wall_hitted = walls[wall_idx]

                # Attenuate absorption
                absorption = float(np.mean(np.asarray(wall_hitted.absorption, dtype=float)))
                remaining = 1.0 - absorption
                if remaining <= 0.0:
                    break

                db += 10.0 * math.log10(remaining)

                # Specular reflection update
                dire = np.asarray(wall_hitted.normal_reflect(dire), dtype=float)
                pos = hit

            polylines.append(Polyline(pts))
        polyline_tree.append(polylines)
    return polyline_tree

# Main code -------------
room = cpc.scene_to_pra_room(
    scene, 16000, max_order=1, ray_tracing=False, air_absorption=False
)
sources = scene.sources

polyline_tree = trace_rays_scattered(
    room, sources, ref_db, target_db, n_rays=n_rays, seed=seed
)

a = DataTree[object]()
for i, br in enumerate(polyline_tree):
    a.AddRange(br, GH_Path(i))
spl = spl_at_distance(ref_db, 283.5250)
print (spl)
# ---------- end traceraysscattered ----------
sort = SortList(Keys=splsfromimagesourcemethod.spls)  # -> Keys, ValuesA
panel_7 = Panel(sort.Keys)
simrt = Compas_acousticsSimulateRayTracing(
    scene=scene,
    max_order="3",
    n_rays=Slider(5000, range=0..10000),
    energy_thres="1e-05",
    time_thres=Slider(5, range=0..10),
    seed=Slider(7, range=0..10))  # -> ir_graph; inputs sample_rate: Int32, max_order: Int32, n_rays: Int32, absorb_air: Boolean, energy_thres: Double, time_thres: Double, seed: Int32; disabled
#   port scene: Room scene object.
#   port sample_rate: Sample rate for the simulation.
#   port max_order: Maximum order of image sources.
#   port n_rays: Number of rays for ray tracing.
#   port absorb_air: Whether to consider air absorption.
#   port energy_thres: Energy threshold for ray tracing.
#   port time_thres: Time threshold for ray tracing.
#   port seed: Random seed for reproducibility.
#   port ir_graph: Impulse response graph structure.
# ---------- simrt: Python ----------
"""Simulate room acoustics using Image Source Method (ISM) and Ray Tracing (RT) to generate impulse response graph structure."""
# flake8: noqa
import Grasshopper

from compas_acoustics.simulator import Simulator

class SimulateRayTracing(Grasshopper.Kernel.GH_ScriptInstance):

    def RunScript(self,
            scene,
            sample_rate: int,
            max_order: int,
            n_rays: int,
            absorb_air: bool,
            energy_thres: float,
            time_thres: float,
            seed: int):

        if scene is None:
            ghenv.Component.AddRuntimeMessage(
                Grasshopper.Kernel.GH_RuntimeMessageLevel.Warning, "Input parameter 'scene' failed to collect data."
            )
            return

        if max_order is None:
            max_order = 2
        if n_rays is None:
            n_rays = 1000
        if absorb_air is None:
            absorb_air = True
        if energy_thres is None:
            energy_thres = 1e-7
        if time_thres is None:
            time_thres = 10.0

        sim = Simulator(scene)
        if sample_rate is not None:
            sim.sampling_rate = sample_rate

        sim.rir_from_ray_tracing(
            image_source_order=max_order,
            n_rays=n_rays,
            air_absorption=absorb_air,
            energy_thres=energy_thres,
            time_thres=time_thres,
            random_seed=seed,
        )

        ghenv.Component.Message = "{}Hz, order={}, rays={}, air={}, seed={}, energy_thres={}, time_thres={}".format(
            sim.sampling_rate, max_order, n_rays, absorb_air, seed if seed is not None else "random", energy_thres, time_thres
        )

        return sim.scene.ir_graph
# ---------- end simrt ----------
panel_8 = Panel(simrt)
decirgraph = Compas_acousticsDeconstructIRGraph(ir_graph=simrt)  # -> ir, sources, flatten(receivers), edges; inputs receiver_idx: list of Int32
#   port ir_graph: Impulse response graph structure.
#   port receiver_idx: Index(s) of the receiver(s) to filter.
#   port ir: ImpulseResponse object(s).
#   port sources: Source object(s).
#   port receivers: Receiver object(s).
#   port edges: Relationships between sources and receivers as Line(s).
# ---------- decirgraph: Python ----------
"""Deconstruct impulse response graph structure into ImpulseResponse(s)."""
# flake8: noqa
import Grasshopper
from Grasshopper import DataTree
from Grasshopper.Kernel.Data import GH_Path
from Rhino.Geometry import Line
import System

class DeconstructIRGraph(Grasshopper.Kernel.GH_ScriptInstance):

    def RunScript(self,
            ir_graph,
            receiver_idx: System.Collections.Generic.List[int]):

        if ir_graph is None:
            ghenv.Component.AddRuntimeMessage(
                Grasshopper.Kernel.GH_RuntimeMessageLevel.Warning, "Input parameter 'ir_graph' failed to collect data."
            )

        ir_out = DataTree[object]()
        source_out = DataTree[object]()
        receiver_out = DataTree[object]()
        edge_out = DataTree[object]()

        # 1. Set order of receivers
        receiver_list = [
            ir_graph.node_attribute(node, 'data')
            for node in ir_graph.nodes()
            if ir_graph.node_attribute(node, 'type') == 'receiver'
        ]
        receiver_set = {rec.guid for rec in receiver_list}

        # 2. Make ir group as {receiver_0: [src_0, ...], ...}
        source_group = {}
        ir_group = {}

        for u, v in ir_graph.edges():
            ir = ir_graph.edge_attribute((u, v), 'data')
            data_u = ir_graph.node_attribute(u, 'data')
            data_v = ir_graph.node_attribute(v, 'data')

            if data_u.guid in receiver_set:
                rec, src = data_u, data_v
            elif data_v.guid in receiver_set:
                rec, src = data_v, data_u
            else:
                continue
            
            source_group.setdefault(rec.guid, []).append(src)
            ir_group.setdefault(rec.guid, []).append(ir)

        # 3. Filter receiver, optional
        if receiver_idx is None:
            indices = list(range(len(receiver_list)))
        else:
            indices = receiver_idx  # Already set to list access

        for idx in indices:
            rec = receiver_list[idx]
            path = GH_Path(idx)

            sources = source_group.get(rec.guid, [])
            irs = ir_group.get(rec.guid, [])

            receiver_out.Add(rec, path)
            source_out.AddRange(sources, path)
            ir_out.AddRange(irs, path)
            edge_out.AddRange([Line(*src.position, *rec.position) for src in sources], path)

        return ir_out, source_out, receiver_out, edge_out
# ---------- end decirgraph ----------
num = Number(splsfromimagesourcemethod.spls)
branch = TreeBranch(Tree=traceraysscattered.a, Path=number_slider_14, MaintainPaths=True)  # disabled
draw = COMPASDraw(cg=traceraysscattered.a)  # -> graft(rg); disabled
#   port cg: The COMPAS geometry or datastructure to be drawn.
#   port rg: The Rhino geometry object.
# ---------- draw: Python ----------
# r: compas>=2.14.1
"""
Draws COMPAS geometry in Grasshopper.
"""

from typing import Any

import Grasshopper

from compas.scene import SceneObject


class CompasToRhinoGeometry(Grasshopper.Kernel.GH_ScriptInstance):
    def RunScript(self, cg):
        if not cg:
            return None

        return SceneObject(item=cg).draw()
# ---------- end draw ----------
analyseir = Compas_acousticsAnalyseImpulseResponse(ir=decirgraph.ir)  # -> params
#   port ir: ImpulseResponse (IR) object.
#   port params: List of acoustic parameters ('EDT', 'T20', 'T30', 'C50', 'C80', 'D50', 'DRR', 'Ts', 'STI').
# ---------- analyseir: Python ----------
"""Analyse impulse response (IR) and return acoustic parameters such as EDT, T20, C50, etc."""
# flake8: noqa
import Grasshopper
from compas_acoustics.analyser import AcousticAnalyser
from compas_acoustics import AcousticParameter
from compas_acoustics import Defaults


class AnalyseIR(Grasshopper.Kernel.GH_ScriptInstance):
    def RunScript(self, ir):
        if ir is None:
            ghenv.Component.AddRuntimeMessage(Grasshopper.Kernel.GH_RuntimeMessageLevel.Warning, "Input parameter 'ir' failed to collect data.")
            return None

        analyser = AcousticAnalyser(ir.ir)
        analyser.analyse()

        return [AcousticParameter().from_analyser(analyser, name) for name in Defaults().PARAM_NAMES]
# ---------- end analyseir ----------
gradient = Gradient(
    LowerLimit=number_slider_4,
    UpperLimit=Slider(50, range=0..100),
    Parameter=num,
    stops=[0: RGB(234, 38, 0), 0.25: RGB(234, 126, 0), 0.5: RGB(254, 244, 84), 0.75: RGB(173, 203, 249), 1: RGB(75, 107, 169)])
mesh = Mesh(<mesh referenced from the Rhino model>)  # disabled
item_3 = ListItem(List=analyseir, Index=Slider(0, range=0..10), Wrap=True)
crvdom = CurveDomain(Curve=draw)  # -> Curve, Domain; disabled
mcx = MeshCurve(Mesh=mesh, Curve=draw)  # -> Points, Faces; disabled
splfromirgraph = SPLFromIRGraph(ir_graph=simrt, reference_db=Slider(91, range=0..100))  # -> spl_db, is_valid, positions, energies; inputs receiver_idx: list
# ---------- splfromirgraph: Python ----------
import math
import Grasshopper


class Script_Instance(Grasshopper.Kernel.GH_ScriptInstance):

    def RunScript(self,
            ir_graph,
            receiver_idx: list[object],
            reference_energy,
            reference_db):
        if ir_graph is None:
            ghenv.Component.AddRuntimeMessage(
                Grasshopper.Kernel.GH_RuntimeMessageLevel.Warning, "Input parameter 'ir_graph' failed to collect data."
            )
            return None, None, None, None

        receiver_list = [
            ir_graph.node_attribute(node, 'data')
            for node in ir_graph.nodes()
            if ir_graph.node_attribute(node, 'type') == 'receiver'
        ]
        receiver_set = {rec.guid for rec in receiver_list}

        ir_group = {}
        source_group = {}
        for u, v in ir_graph.edges():
            ir = ir_graph.edge_attribute((u, v), 'data')
            data_u = ir_graph.node_attribute(u, 'data')
            data_v = ir_graph.node_attribute(v, 'data')
            if data_u.guid in receiver_set:
                rec, src = data_u, data_v
            elif data_v.guid in receiver_set:
                rec, src = data_v, data_u
            else:
                continue
            ir_group.setdefault(rec.guid, []).append(ir)
            source_group.setdefault(rec.guid, []).append(src)

        indices = list(range(len(receiver_list))) if receiver_idx is None else receiver_idx

        def distance(a, b):
            return ((a.x - b.x) ** 2 + (a.y - b.y) ** 2 + (a.z - b.z) ** 2) ** 0.5

        def broadband_spl(source):
            # Energy-average across bands so a flat 120 dB source stays 120 dB broadband.
            bands = source.spl if isinstance(source.spl, (list, tuple)) else [source.spl]
            mean_energy = sum(10.0 ** (b / 10.0) for b in bands) / len(bands)
            return 10.0 * math.log10(mean_energy)

        energies = []
        nearest = []  # (distance, source) per receiver, for auto-calibration
        for idx in indices:
            rec = receiver_list[idx]
            irs = ir_group.get(rec.guid, [])
            srcs = source_group.get(rec.guid, [])
            total_energy = sum(float((response.ir ** 2).sum()) for response in irs)
            energies.append(total_energy)
            if srcs:
                d, s = min(((distance(rec, s), s) for s in srcs), key=lambda t: t[0])
            else:
                d, s = None, None
            nearest.append((d, s))

        # Auto-calibration (used unless you override both reference_* inputs):
        # anchor 0 dB physically using the receiver closest to its source, where
        # direct sound dominates, plus the known Source.spl level and free-field
        # 20*log10(distance) falloff -- no manual reference values required.
        candidates = [
            (d, e, s) for (d, s), e in zip(nearest, energies)
            if d is not None and e > 0
        ]
        auto_energy = auto_db = None
        if candidates:
            d_min, e_min, s_min = min(candidates, key=lambda c: c[0])
            auto_energy = e_min
            auto_db = broadband_spl(s_min) - 20.0 * math.log10(max(d_min, 1e-6))

        e_ref = reference_energy if (reference_energy is not None and reference_energy > 0) else auto_energy
        db_offset = reference_db if reference_db is not None else auto_db

        if e_ref is None or e_ref <= 0:
            positive = [e for e in energies if e > 0]
            e_ref = max(positive) if positive else 1.0
        if db_offset is None:
            db_offset = 0.0

        spl_db, is_valid = [], []
        for e in energies:
            if e <= 0:
                spl_db.append(None)
                is_valid.append(False)
            else:
                spl_db.append(db_offset + 10.0 * math.log10(e / e_ref))
                is_valid.append(True)

        positions = [receiver_list[idx] for idx in indices]

        ghenv.Component.Message = "auto-cal: {:.1f} dB @ {:.2f} m".format(
            auto_db, [d for d, s in nearest if d is not None][0]
        ) if (reference_db is None and auto_db is not None) else "manual reference"

        return spl_db, is_valid, positions, energies
# ---------- end splfromirgraph ----------
deparam = Compas_acousticsDeconstructParameter(param=item_3)  # -> name, values, flatten(overall), frequencies
#   port param: AcousticParameter (AP) object.
#   port name: Nmae of the acoustic parameter.
#   port values: Values of the acoustic parameter.
#   port overall: Overall value of the acoustic parameter.
#   port frequencies: Frequencies of the acoustic parameter.
# ---------- deparam: Python ----------
"""Deconstruct acoustic parameter."""
# flake8: noqa
import Grasshopper
from compas_acoustics.analyser import AcousticAnalyser
from compas_acoustics import AcousticParameter
from compas_acoustics import Defaults


class DeconstructParam(Grasshopper.Kernel.GH_ScriptInstance):
    def RunScript(self, param):
        if param is None:
            ghenv.Component.AddRuntimeMessage(Grasshopper.Kernel.GH_RuntimeMessageLevel.Warning, "Input parameter 'param' failed to collect data.")
            return None
        
        return param.title, param.values, param.overall, param.frequencies
# ---------- end deparam ----------
panel_9 = Panel(deparam.values)
dedomain = DeconstructDomain(Domain=crvdom.Domain)  # -> Start, End; disabled
crv_cp = CurveClosestPoint(Point=mcx.Points, Curve=draw)  # -> Point, Parameter, Distance; disabled
mcol = MeshColours(Mesh=mesh_uv, Colours=gradient)
dom = ConstructDomain(DomainStart=dedomain.Start, DomainEnd=crv_cp.Parameter)  # disabled
num_2 = Number(splfromirgraph.spl_db)
bnd = Bounds(Numbers=splfromirgraph.spl_db)
subcrv = SubCurve(BaseCurve=draw, Domain=dom)  # disabled
lng = ListLength(List=flatten(subcrv))  # disabled
panel_10 = Panel(lng)  # disabled

# ---- group: dB
panel_11 = Panel("90")
panel_12 = Panel("50")

# ----
dedomain_2 = DeconstructDomain(Domain=bnd)  # -> Start, End
panel_13 = Panel(bnd)
gradient_2 = Gradient(
    LowerLimit=panel_11,
    UpperLimit=panel_12,
    Parameter=num_2,
    stops=[0: RGB(234, 38, 0), 0.25: RGB(234, 126, 0), 0.5: RGB(254, 244, 84), 0.75: RGB(173, 203, 249), 1: RGB(75, 107, 169)])

# ---- group: 21 x 21
w_top_sides = Mesh(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)
w_o_stage = Mesh(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)
w_top = Mesh(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)

# ----
mcol_2 = MeshColours(Mesh=mesh_uv, Colours=gradient_2)

# ---- group: 30 x 30, 40 - 90
w_o_stage_2 = Mesh(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)
w_top_sides_2 = Mesh(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)
w_top_2 = Mesh(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)

# ----
number_slider_15 = Slider(123, range=0..1000)
mesh_2 = Mesh(mcol)

# ---- group: 30 x 30, 50 - 90
w_top_3 = Mesh(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)
w_top_sides_3 = Mesh(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)
w_o_stage_3 = Mesh(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)

# ----
series = Series(Start=number_slider_15, Step=number_slider_15, Count="3")
X = UnitX(Factor=series)
move_3 = Move(Geometry=[w_o_stage_3, w_top_3, w_top_sides_3], Motion=X)  # -> Geometry, Transform

# ---- group: w/ max_order=2
mesh_3 = Mesh(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)  # disabled

# ---- group: w/ max_order=1
mesh_4 = Mesh(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)  # disabled
mesh_5 = Mesh(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)  # disabled
