# Grasshopper definition Scenario_03_11.ghx (Grasshopper 1.0.8)
# plug-ins: Heteroptera, MeshEdit Components, Pufferfish, Human, Weaverbird, Wallacei

py3 = Python3Script()  # -> out, shrunk_box; inputs box: Box, points: list of Point3d; disabled
# ---------- py3: Python ----------
import Rhino.Geometry as rg


pln = box.Plane

def interval_uvw_on_plane(plane, points):
    us = [(p - plane.Origin) * plane.XAxis for p in points]
    vs = [(p - plane.Origin) * plane.YAxis for p in points]
    ws = [(p - plane.Origin) * plane.ZAxis for p in points]

    return {
        "dom_u": (min(us), max(us)),
        "dom_v": (min(vs), max(vs)),
        "dom_w": (min(ws), max(ws)),
    }


bounds = interval_uvw_on_plane(box.Plane, points)
u_min, u_max = bounds["dom_u"]
v_min, v_max = bounds["dom_v"]

shrink_dist = 2.0
dom_u_new = rg.Interval(u_min - shrink_dist, u_max + shrink_dist)
dom_v_new = rg.Interval(v_min - shrink_dist, box.Y[1])

shrunk_box = rg.Box(pln, dom_u_new, dom_v_new, box.Z)
# ---------- end py3 ----------

toggle = BooleanToggle(True)  # disabled
lamcp = LAMCPBridge(enable=toggle)  # -> status; inputs enable: Boolean, port: Int32; disabled
#   port enable: Toggle to start (True) or stop (False) the local HTTP server.
#   port port: Port to listen on (loopback only). Defaults to 8765.
#   port status: Current server status string.
# ---------- lamcp: Python ----------
"""
LAMCP Bridge: local HTTP server inside Rhino 8 / Grasshopper CPython.

Exposes `POST /exec` (JSON: `{"code": "...", "timeout": 30}`) which
exec()s `code` and returns
`{"stdout": "...", "stderr": "...", "result": "...", "error": null|str}`.

Pair with the `lamcp` FastMCP server, which translates Claude's
`run_python_script` MCP tool calls into POSTs to this endpoint.

Binds to 127.0.0.1 only. NEVER expose beyond localhost â€” it exec()s
arbitrary Python with full Rhino API access.

LAMCP v0.1.0
"""

import contextlib
import io
import json
import threading
import traceback
from http.server import BaseHTTPRequestHandler
from http.server import HTTPServer

import Grasshopper
import scriptcontext as sc


SHARED_GLOBALS_KEY = "_lamcp_bridge_globals"
SERVER_KEY = "_lamcp_bridge_server"


def _exec_code(code, timeout):
    """Run `code` on the HTTP-server thread and capture stdout/stderr/result.

    NOTE: this is intentionally NOT marshalled to Rhino's UI thread for the
    spike â€” `Rhino.RhinoApp.InvokeOnUiThread` was queueing actions that
    never fired in Rhino 8 CPython. Most read-only RhinoCommon access is
    safe cross-thread; mutations may crash. Add Eto-based marshalling
    back here when we need it.
    """
    out = io.StringIO()
    err = io.StringIO()
    g = sc.sticky.setdefault(SHARED_GLOBALS_KEY, {"__name__": "__lamcp_bridge__"})
    error_text = None
    result_repr = None
    try:
        with contextlib.redirect_stdout(out), contextlib.redirect_stderr(err):
            exec(code, g, g)
            result_repr = repr(g.get("_"))
    except BaseException:
        error_text = traceback.format_exc()

    return {
        "stdout": out.getvalue(),
        "stderr": err.getvalue(),
        "result": result_repr,
        "error": error_text,
    }


class _ExecHandler(BaseHTTPRequestHandler):
    # Silence default request logging so it doesn't clog the Rhino command line.
    def log_message(self, fmt, *args):
        pass

    def _send(self, code, payload):
        body = json.dumps(payload).encode("utf-8")
        self.send_response(code)
        self.send_header("Content-Type", "application/json")
        self.send_header("Content-Length", str(len(body)))
        self.end_headers()
        self.wfile.write(body)

    def do_GET(self):
        if self.path == "/health":
            self._send(200, {"status": "ok"})
        else:
            self._send(404, {"error": "not found"})

    def do_POST(self):
        if self.path != "/exec":
            self._send(404, {"error": "not found"})
            return
        length = int(self.headers.get("Content-Length", "0"))
        try:
            raw = self.rfile.read(length).decode("utf-8")
            body = json.loads(raw)
            code = body.get("code", "")
            timeout = float(body.get("timeout", 30.0))
        except Exception as exc:
            self._send(400, {"error": "bad request: " + repr(exc)})
            return
        result = _exec_code(code, timeout)
        self._send(200, result)


def _start_server(port):
    server = HTTPServer(("127.0.0.1", port), _ExecHandler)
    thread = threading.Thread(
        target=server.serve_forever, daemon=True, name="lamcp-bridge"
    )
    thread.start()
    return {"server": server, "thread": thread, "port": port}


def _stop_server(state):
    try:
        state["server"].shutdown()
        state["server"].server_close()
    except Exception:
        pass


class LamcpBridgeComponent(Grasshopper.Kernel.GH_ScriptInstance):
    def RunScript(self, enable: bool, port: int):
        port = int(port) if port else 8765

        state = sc.sticky.get(SERVER_KEY)

        if not enable:
            if state is not None:
                _stop_server(state)
                del sc.sticky[SERVER_KEY]
            return "stopped"

        # Already running on the requested port: no-op.
        if (
            state is not None
            and state.get("port") == port
            and state["thread"].is_alive()
        ):
            return "listening on http://127.0.0.1:{}".format(port)

        # Port changed or server died: tear down and restart.
        if state is not None:
            _stop_server(state)
            del sc.sticky[SERVER_KEY]

        try:
            sc.sticky[SERVER_KEY] = _start_server(port)
        except OSError as exc:
            ghenv.Component.AddRuntimeMessage(  # noqa: F821
                Grasshopper.Kernel.GH_RuntimeMessageLevel.Error,
                "Failed to bind 127.0.0.1:{}: {}".format(port, exc),
            )
            return "error: {}".format(exc)

        return "listening on http://127.0.0.1:{}".format(port)
# ---------- end lamcp ----------

pln = Plane(PlaneXY(122.7538795, -3.740785054, 0))

# ----
# Unamplified outdoor 16-peices chamber srings
button = Button()
reload = Python3Script(reload=button)  # inputs reload: Boolean
# ---------- reload: Python ----------
# venv: rhino_compas_acoustics
# r: compas
# r: pyroomacoustics
# r: matplotlib
# r: librosa
# r: soundfile
# r: sounddevice
# r: sofar
# r: pyfar
# r: pyrato

import sys
import os
from compas_rhino import unload_modules


gh_path = ghenv.Component.OnPingDocument().FilePath
dire_path = os.path.dirname(os.path.dirname(gh_path))
target_path = os.path.join(dire_path, "src")

if target_path not in sys.path:
    sys.path.insert(0, target_path)

if reload:
    unload_modules('compas_acoustics')

try:
    import compas_acoustics as ca
except Exception as e:
    raise ValueError(e)
# ---------- end reload ----------

wlc_translations = GenePool(
    Decimals=2,
    Maximum=1.5,
    Minimum=-1,
    Value=[0.38, 0.57, 0.43, 1.13, 1.3, -0.18, 0.7, -0.51, 0.71, 1.09, 0.42, 0.97, 1.24, 1.3, 0.29, -0.05, 1.21, 0.56, 1.4, 0.57, 1.25, 0.8, 0.84, 0.55])
deplane = DeconstructPlane(Plane=pln)  # -> Origin, XAxis, YAxis, ZAxis
deplane_2 = DeconstructPlane(Plane=pln)  # -> Origin, XAxis, YAxis, ZAxis

# ----
# Shell geometry
number_slider = Slider(1, range=0..10)
wlc_shell_angle = Slider(111, range=100..145)
wlc_fan_angle = Slider(105, range=80..105)
number_slider_2 = Slider(4, range=0..10)
number_slider_3 = Slider(7, range=0..10)
number_slider_4 = Slider(5, range=0..10)
amp = Amplitude(Vector=deplane_2.YAxis, Amplitude=number_slider)
move = Move(Geometry=pln, Motion=amp)  # -> Geometry, Transform
py3_2 = Python3Script(
    pln=move.Geometry,
    radius=number_slider_4,
    fan_angle=wlc_fan_angle,
    shell_angle=wlc_shell_angle,
    div_arc=number_slider_3,
    div_shell=number_slider_2)  # -> out, shell; inputs pln: Plane, radius: Double, fan_angle: Double, shell_angle: Double, div_arc: Int32, div_shell: Int32
# ---------- py3_2: Python ----------
import Rhino.Geometry as rg
import math


class FlatHalfPoints:
    def __init__(self, plane: rg.Plane, points: list[rg.Point3d]):
        self.plane = plane
        self.original_points = [rg.Point3d(p) for p in points]
        self.points = [rg.Point3d(p) for p in points]

    @property
    def mirrored_plane(self):
        return rg.Plane(self.plane.Origin, self.plane.ZAxis, self.plane.YAxis)

    def unfolded_points(self, include=False, sort=False):
        M = rg.Transform.Mirror(self.mirrored_plane)

        def _mirrored(p):
            pt = rg.Point3d(p)
            pt.Transform(M)
            return pt
        
        to_mirror = self.points if include else self.points[1:]
        if sort:
            to_mirror.reverse()

        return [_mirrored(p) for p in to_mirror] + self.points

    def polyline(self, unfold=False):
        pts = self.unfolded_points(include=False, sort=True) if unfold else self.points

        if len(pts) < 2:
            return

        polyline = rg.Polyline()
        polyline.AddRange(pts)
        return polyline

    @classmethod
    def half_arc_points(cls, plane, radius, angle, count):

        if count < 2:
            count = 2

        rad_step = math.radians(angle / (count - 1))
        
        pts = []
        for i in range(count):
            x = radius * math.sin(rad_step * i)
            y = radius * math.cos(rad_step * i)

            pt = plane.PointAt(x, y, 0)
            pts.append(pt)
        return cls(plane, pts)

    def move_control_points(self, amplitudes: list[float], fix_gap=False):
        if len(self.points) - 1 != len(amplitudes):
            raise ValueError("Number of amplitudes is not equalivant to number of points - 1.")

        for i in range(len(self.points) - 1):
            amp = amplitudes[i]
            origin_pt = self.original_points[i]

            dire = origin_pt - self.plane.Origin
            dire.Unitize()

            self.points[i] = origin_pt + (dire * amp)

        if fix_gap:
            p1 = self.points[1]
            dire = self.plane.XAxis
            dist = self.mirrored_plane.DistanceTo(p1)

            self.points[0] = p1 + (dire * dist)

class Shell:
    def __init__(self, point_groups: list[FlatHalfPoints]):
        self.point_groups = point_groups

    @property
    def meshes(self):
        meshes = []

        for i in range(len(self.point_groups) - 1):
            mesh = rg.Mesh()

            curr_pts = self.point_groups[i].points
            next_pts = self.point_groups[i+1].points

            len_pts = len(curr_pts)
            if len(next_pts) != len_pts or len_pts < 3:
                continue

            vts = curr_pts + next_pts[:-1]
            mesh.Vertices.AddVertices(vts)

            for j in range(0, len_pts - 2):
                curr_a = j
                curr_b = j + 1
                next_a = len_pts + j
                next_b = len_pts + (j + 1)

                mesh.Faces.AddFace(curr_a, next_a, curr_b)
                mesh.Faces.AddFace(next_b, curr_b, next_a)
            
            # Add the last tri face
            idx_a = len_pts - 2
            idx_b = 2 * len_pts - 2
            idx_c = len_pts - 1
            mesh.Faces.AddFace(idx_a, idx_b, idx_c)

            meshes.append(mesh)

        return meshes

    @property
    def unfolded_meshes(self):

        all_meshes = []
        
        for mesh, pg in zip(self.meshes, self.point_groups):
            m = mesh.DuplicateMesh()
            M = rg.Transform.Mirror(pg.mirrored_plane)

            m.Transform(M)
            m.Flip(True, True, True)
            m.Append(mesh)

            all_meshes.append(m)

        return all_meshes

    @classmethod
    def create(cls, first_point_group, angle_deg, division):
        rad_step = math.radians(angle_deg / (division - 1))
        
        rot_axis = first_point_group.plane.XAxis
        rot_origin = first_point_group.points[-1]
        
        p_groups = []
        for i in range(division):
            R = rg.Transform.Rotation(rad_step * i, rot_axis, rot_origin)
            pln = rg.Plane(first_point_group.plane)
            pln.Transform(R)
            
            pts = [rg.Point3d(p) for p in first_point_group.points]
            for p in pts:
                p.Transform(R)

            pg = FlatHalfPoints(pln, pts)
            p_groups.append(pg)

        return Shell(p_groups)


# Main API ---------------------------------
half_arc_pts = FlatHalfPoints.half_arc_points(pln, radius, fan_angle, div_arc)

shell = Shell.create(half_arc_pts, shell_angle, div_shell)
# ---------- end py3_2 ----------
toggle_2 = BooleanToggle(False)
toggle_3 = BooleanToggle(True)
py3_3 = Python3Script(shell=py3_2.shell, fix_gap=toggle_2)  # -> out, shell; inputs offsets: list of Double, fix_gap: Boolean
# ---------- py3_3: Python ----------
if offsets:
    for idx, pg in enumerate(shell.point_groups):
        len_to_move = len(pg.points) - 1
        start_idx = idx * len_to_move
        offs = offsets[start_idx:start_idx + len_to_move]

        pg.move_control_points(offs, fix_gap=fix_gap)
# ---------- end py3_3 ----------
py3_4 = Python3Script(shell=py3_3.shell, unfold=toggle_3)  # -> out, points, polylines
# ---------- py3_4: Python ----------
from Grasshopper import DataTree
from Grasshopper.Kernel.Data import GH_Path


points = DataTree[object]()
polylines = DataTree[object]()


for idx, pg in enumerate(shell.point_groups):
    path = GH_Path(idx)

    if unfold:
        points.AddRange(pg.unfolded_points(include=False, sort=True), path)
    else:
        points.AddRange(pg.points, path)
    polylines.Add(pg.polyline(unfold))
# ---------- end py3_4 ----------
py3_5 = Python3Script(shell=py3_3.shell, unfold=toggle_3)  # -> out, meshes
# ---------- py3_5: Python ----------
from Grasshopper import DataTree
from Grasshopper.Kernel.Data import GH_Path


points = DataTree[object]()
polylines = DataTree[object]()

if unfold:
    meshes = shell.unfolded_meshes
else:
    meshes = shell.meshes
# ---------- end py3_5 ----------
clean = CombineClean(Meshes=py3_5.meshes)
branch = TreeBranch(Tree=py3_4.points, Path="0", MaintainPaths=True)
pline = PolyLine(Vertices=branch, Closed=invert(False))
panel = Panel("""0.1
0.07
0.05
0.04
0.04
0.03
0.03""")
mesh = Mesh(clean)
panel_2 = Panel("""0.01
0.04
0.15
0.45
0.77
0.8
0.8""")
mesh_2 = Mesh(mesh)  # disabled
conmat = Compas_acousticsConstructMaterial(absorption=panel, scattering=panel_2, name="stage_reflect")  # -> material; inputs absorption: list of Double, scattering: list of Double, name: String
#   port absorption: List of absorption coefficients for each frequency band. e.g. '0.1, 0.2, 0.3, 0.4, 0.5, 0.6, 0.7' for 7 frequency bands.
#   port scattering: Optional. List of scattering coefficients for each frequency band. e.g. '0.1, 0.2, 0.3, 0.4, 0.5, 0.6, 0.7' for 7 frequency bands.
#   port name: Name of the material preset in the library (e.g. 'concrete', 'carpet').
#   port material: AcousticMaterial object.
# ---------- conmat: Python ----------
"""Create an AcousticMaterial for AcousticObject(s)."""
# flake8: noqa
import Grasshopper
import System
from compas_acoustics.acoustic_material import AcousticMaterial


class ConstructMaterial(Grasshopper.Kernel.GH_ScriptInstance):

    def RunScript(self,
            absorption: System.Collections.Generic.List[float],
            scattering: System.Collections.Generic.List[float],
            name: str):
        if absorption is None:
            ghenv.Component.AddRuntimeMessage(
                Grasshopper.Kernel.GH_RuntimeMessageLevel.Warning,
                "Input parameter 'absorption' failed to collect data."
            )
            return
        if name is None:
            ghenv.Component.AddRuntimeMessage(
                Grasshopper.Kernel.GH_RuntimeMessageLevel.Warning,
                "Input parameter 'name' failed to collect data."
            )
            return

        return AcousticMaterial(
            name=name,
            absorption_coefficients=absorption,
            scattering_coefficients=scattering,
        )
# ---------- end conmat ----------
flip = MeshFlip(Mesh=mesh_2)  # disabled
merge = Merge(Data1=mesh_2, Data2=flip)  # disabled
obj = Compas_acousticsAcousticObject(geometry=mesh, material=conmat, name="stage_floor")  # -> acoustic_object; inputs geometry: GeometryBase, name: String
#   port geometry: Geometry of the AcousticObject.
#   port material: Material of the AcousticObject.
#   port name: Name of the AcousticObject.
#   port acoustic_object: AcousticObject object.
# ---------- obj: Python ----------
"""Create an AcousticObject with the specified geometry and material."""
# flake8: noqa
import Grasshopper
import Rhino
from compas_acoustics.geometry import AcousticObject
from compas_rhino.conversions import mesh_to_compas
from compas_rhino.conversions import polyline_to_compas

# TODO: Change the typeHintID in metadata.json from "mesh" to "geometrybase"

class CreateAcousticObject(Grasshopper.Kernel.GH_ScriptInstance):

    def RunScript(self, geometry: Rhino.Geometry.GeometryBase, material, name: str):

        if geometry is None:
            ghenv.Component.AddRuntimeMessage(
                Grasshopper.Kernel.GH_RuntimeMessageLevel.Warning, "No geometry provided."
            )
            return
        if material is None:
            ghenv.Component.AddRuntimeMessage(
                Grasshopper.Kernel.GH_RuntimeMessageLevel.Warning, "No material provided."
            )
            return

        # Gemetry conversion from Rhino to Compas
        # TODO: Figure out how to handle other geometry types (e.g., Brep, Surface, etc.)
        if isinstance(geometry, Rhino.Geometry.Mesh):
            geometry = mesh_to_compas(geometry)
        elif isinstance(geometry, Rhino.Geometry.Polyline):
            geometry = polyline_to_compas(geometry)
        elif isinstance(geometry, Rhino.Geometry.PolylineCurve):
            geometry = polyline_to_compas(geometry.ToPolyline())
        else:
            ghenv.Component.AddRuntimeMessage(
                Grasshopper.Kernel.GH_RuntimeMessageLevel.Error, "Unsupported geometry type."
            )
            return
        return AcousticObject(acoustic_geometry=geometry, material=material, name=name)
# ---------- end obj ----------
obj_2 = Compas_acousticsAcousticObject(geometry=pline, material=conmat, name="stage")  # -> acoustic_object; inputs geometry: GeometryBase, name: String; same code as obj
merge_2 = Merge(Data1=obj, Data2=obj_2)

rev = Reverse(Vector=deplane.YAxis)
neg = Negative(Value=Slider(0, range=0..10))
amp_2 = Amplitude(Vector=deplane_2.YAxis, Amplitude=neg)
amp_3 = Amplitude(Vector=rev, Amplitude=Slider(18, range=0..100))
move_2 = Move(Geometry=pln, Motion=amp_2)  # -> Geometry, Transform
move_3 = Move(Geometry=pln, Motion=amp_3)  # -> Geometry, Transform
# 1. acoustic criteria
# 2. previous geometry(comparison)
# v 3. fix spl_at_distance
# 4. refine meeting room scenario
number_slider_5 = Slider(65, range=0..100)
py3_6 = Python3Script(base_pln=move_3.Geometry, width=Slider(60, range=0..100), depth=Slider(60, range=0..100), height="9")  # -> out, box; inputs base_pln: Plane, width: Double, depth: Double, height: Double
# ---------- py3_6: Python ----------
import Rhino.Geometry as rg


box = rg.Box(
    base_pln,
    rg.Interval(- width / 2, width / 2),
    rg.Interval(- depth / 2, depth / 2),
    rg.Interval(-1, height - 1)
)
# ---------- end py3_6 ----------

# ----
# Simulation Boundary
panel_3 = Panel("7")
panel_4 = Panel("""0.15
0.25
0.40
0.60
0.75
0.85
0.90""")
smesh = SimpleMesh(Brep=py3_6.box)
panel_5 = Panel("""0.10
0.15
0.25
0.35
0.50
0.65
0.75""")
faceb = FaceBoundaries(Mesh=smesh)
repeat = RepeatData(Data="1", Length=panel_3)
repeat_2 = RepeatData(Data="0", Length=panel_3)
conmat_2 = Compas_acousticsConstructMaterial(absorption=repeat, scattering=repeat_2, name="air")  # -> material; inputs absorption: list of Double, scattering: list of Double, name: String; same code as conmat
conmat_3 = Compas_acousticsConstructMaterial(absorption=panel_4, scattering=panel_5, name="grass")  # -> material; inputs absorption: list of Double, scattering: list of Double, name: String; same code as conmat
cull_i = CullIndex(List=faceb, Indices="4", Wrap=True)
item = ListItem(List=faceb, Index="4", Wrap=True)
obj_3 = Compas_acousticsAcousticObject(geometry=cull_i, material=conmat_2)  # -> acoustic_object; inputs geometry: GeometryBase, name: String; same code as obj
obj_4 = Compas_acousticsAcousticObject(geometry=item, material=conmat_3)  # -> acoustic_object; inputs geometry: GeometryBase, name: String; same code as obj
merge_3 = Merge(Data1=obj_3, Data2=obj_4)  # -> flatten(Result)

# ----
# Audiences (1m space)
number_slider_6 = Slider(1, range=0..2)
number_slider_7 = Slider(1, range=0..2)
pi = Pi(Factor=1)
prot = RotatePlane(Plane=move_2.Geometry, Angle=pi)
py3_7 = Python3Script(
    pln=prot,
    dist_min="7.0",
    dist_max=Slider(40, range=0..100),
    theta_fan=Slider(90, range=60..100),
    row_spacing=number_slider_6,
    seat_spacing=number_slider_7,
    height="-0.4")  # -> out, fan_grid, b; inputs pln: Plane, dist_min: Double, dist_max: Double, theta_fan: Double, row_spacing: Double, seat_spacing: Double, height: Double
# ---------- py3_7: Python ----------
import math
from Grasshopper import DataTree
from Grasshopper.Kernel.Data import GH_Path
import Rhino.Geometry as rg


class FanGrid:
    def __init__(self, plane, height, d_min, d_max, theta_deg, row_spacing, seat_spacing):
        self.plane = plane
        self.height = height
        self.d_min = d_min
        self.d_max = d_max
        self.theta_deg = theta_deg
        self.row_spacing = row_spacing
        self.seat_spacing = seat_spacing

        self.points = []

    @property
    def theta_rad(self):
        return math.radians(self.theta_deg)

    @property
    def total_depth(self):
        return max(0.1, self.d_max - self.d_min)

    @property
    def n_rows(self):
        return int(self.total_depth // self.row_spacing + 1)

    @property
    def ns_seats_and_radius(self):
        ns = []
        rs = []

        for i in range(self.n_rows):
            r = self.d_min + i * self.row_spacing
            if r > self.d_max:
                r = self.d_max

            # Arc length at this radius
            arc_len = r * self.theta_rad
            n_seat = int(math.ceil(arc_len / self.seat_spacing) + 1)

            ns.append(n_seat)
            rs.append(r)
        return ns, rs
    
    @staticmethod
    def point_on_plane(plane, x, y, z):
        return plane.PointAt(x, y, z)

    @property
    def grid(self):
        ns_seats, rs = self.ns_seats_and_radius

        point_group = {}

        for row_idx in range(self.n_rows):
            n_seats = ns_seats[row_idx]

            point_group.setdefault(row_idx, [])

            for s_idx in range(n_seats):
                # t value from -1.0 to 1.0
                t = -1.0 + (2.0 / (ns_seats[row_idx] - 1) * s_idx)
                angle = t * (self.theta_rad / 2.0)

                # Local coordinates
                lx = rs[row_idx] * math.sin(angle)
                ly = rs[row_idx] * math.cos(angle)
                lz = self.height

                pt = self.point_on_plane(self.plane, lx, ly, lz)
                point_group[row_idx].append(pt)

        return point_group

    @property
    def half_grid(self):
        point_group = self.grid

        ns_seats, _ = self.ns_seats_and_radius
        half_ns = [int(n // 2.0 + 1) if n % 2 == 1 else int(n // 2.0) for n in ns_seats]

        return {k: vs[:half_ns[k]] for k, vs in point_group.items()}

    def mirror_half_grid_and_spls(self, spls_tree):
        ns_seats, _ = self.ns_seats_and_radius

        mirrored = []
        for n_seats, spls in zip(ns_seats, spls_tree):
            if n_seats % 2 == 0:
                all_spls = spls + list(reversed(spls))
            else:
                all_spls = spls[:-1] + list(reversed(spls))
            mirrored.append(all_spls)
        return mirrored

fan_grid = FanGrid(
    plane=pln,
    height=height,
    d_min=dist_min,
    d_max=dist_max,
    theta_deg=theta_fan,
    row_spacing=row_spacing,
    seat_spacing=seat_spacing
)

point_group = fan_grid.half_grid

b = DataTree[rg.Point3d]()
for row_idx, points in point_group.items():
    path = GH_Path(row_idx)
    b.AddRange(points, path)
# ---------- end py3_7 ----------
pt = Point(py3_7.b)
receiver = Compas_acousticsReceiver(position=pt)  # -> receiver; inputs position: Point3d, name: String
#   port position: Position of the receiver.
#   port name: Name of the receiver.
#   port receiver: Receiver object.
# ---------- receiver: Python ----------
"""Acoustic Receiver object (microphone, human ear, etc.)."""
# flake8: noqa
import Grasshopper
import Rhino
from compas_acoustics import Receiver

# TODO: Implement direction
class CreateReceiver(Grasshopper.Kernel.GH_ScriptInstance):

    def RunScript(self, position: Rhino.Geometry.Point3d, name: str):
        if position is None:
            position = Rhino.Geometry.Point3d(0, 0, 1)
        if name is None:
            name = "my_receiver"

        return Receiver(name, *position)
# ---------- end receiver ----------

chamber_strings_16 = Compas_acousticsOrchestraLayout(plane=pln)  # -> points, names; inputs plane: Plane
#   port plane: Plane the layout is built on. Defaults to WorldXY if omitted.
#   port points: Named performer positions.
#   port names: Names matching each point, e.g. 'violin_1'.
# ---------- chamber_strings_16: Python ----------
"""Named performer positions for a standard string ensemble formation, for use as Source/Receiver positions.

Options:
- string_quartet (4 players)
- chamber_strings (16 players)
- chamber_strings_24 (24 players)
- symphonic_strings_50 (50 players)"""
# flake8: noqa
import Grasshopper
import Rhino
from Rhino.Geometry import Point3d
from System.Windows.Forms import ToolStripSeparator

from compas_rhino.conversions import plane_to_compas_frame

from compas_acoustics.orchestra_layouts import (
    string_quartet,
    chamber_strings,
    medium_chamber_strings,
    symphonic_strings,
)


class OrchestraLayoutSelector(Grasshopper.Kernel.GH_ScriptInstance):
    LAYOUTS = {
        "string_quartet_4": string_quartet,
        "chamber_strings_16": chamber_strings,
        "chamber_strings_24": medium_chamber_strings,
        "symphonic_strings_50": symphonic_strings,
    }
    ITEMS = list(LAYOUTS.keys())

    def __init__(self):
        super().__init__()
        nickname = ghenv.Component.NickName
        self.layout_name = nickname if nickname in self.ITEMS else None

    def RunScript(self, plane: Rhino.Geometry.Plane):
        if self.layout_name not in self.ITEMS:
            ghenv.Component.AddRuntimeMessage(
                Grasshopper.Kernel.GH_RuntimeMessageLevel.Remark, "Right-click the icon to choose an orchestra layout."
            )
            ghenv.Component.Message = None
            return

        ghenv.Component.Message = self.layout_name
        frame = plane_to_compas_frame(plane) if plane is not None else None

        layout_fn = self.LAYOUTS[self.layout_name]
        points, names = layout_fn(frame)
        return [Point3d(*p) for p in points], names
    
    def AppendAdditionalMenuItems(self, menu):
        for name in self.ITEMS:
            item = menu.Items.Add(name, None, self.on_item_click)
            item.Checked = (name == self.layout_name)

        menu.Items.Add(ToolStripSeparator())

    def on_item_click(self, sender, event_info):
        name = str(sender)
        if name == self.layout_name:
            return
        self.layout_name = name
        ghenv.Component.NickName = name
        ghenv.Component.ExpireSolution(True)
# ---------- end chamber_strings_16 ----------
avr = Average(Input=chamber_strings_16.points)
pdecon = Deconstruct(Point=avr)  # -> XComponent, YComponent, ZComponent
pdecon_2 = Deconstruct(Point=deplane_2.Origin)  # -> XComponent, YComponent, ZComponent
py3_8 = Python3Script(
    pln=move.Geometry,
    radius=number_slider_4,
    fan_angle=wlc_fan_angle,
    shell_angle=wlc_shell_angle,
    div_arc=number_slider_3,
    div_shell=number_slider_2)  # -> out, shell; inputs pln: Plane, radius: Double, fan_angle: Double, shell_angle: Double, div_arc: Int32, div_shell: Int32; same code as py3_2
shuffler = GenePoolAndSliderShuffler(BooleanButton=Button())
pt_2 = ConstructPoint(XCoordinate=pdecon_2.XComponent, YCoordinate=pdecon.YComponent, ZCoordinate=pdecon.ZComponent)
omnidirectional = Compas_acousticsDirectivity()  # -> directivity
#   port directivity: Directivity pattern.
# ---------- omnidirectional: Python ----------
"""Preset picker for directivity patterns. Right-click to choose a pattern from the available options."""
# flake8: noqa
import Grasshopper
from System.Windows.Forms import ToolStripSeparator
from compas_acoustics.materials_library import MaterialsLibrary


class DirectivitySelector(Grasshopper.Kernel.GH_ScriptInstance):
    ITEMS = ["Bidirectional", "Hypercardioid", "Supercardioid", "Cardioid", "Omnidirectional"]

    def __init__(self):
        super().__init__()
        nickname = ghenv.Component.NickName
        self.directivity_name = nickname if nickname in self.ITEMS else None

    def RunScript(self):
        names = self.ITEMS
        if not names:
            ghenv.Component.AddRuntimeMessage(
                Grasshopper.Kernel.GH_RuntimeMessageLevel.Error, "No directivity patterns found."
            )
            return None

        if self.directivity_name not in names:
            ghenv.Component.AddRuntimeMessage(
                Grasshopper.Kernel.GH_RuntimeMessageLevel.Remark, "Right-click the icon to choose a directivity pattern."
            )
            ghenv.Component.Message = None
            return None

        ghenv.Component.Message = self.directivity_name
        return self.directivity_name.lower()

    def AppendAdditionalMenuItems(self, menu):
        for name in self.ITEMS:
            item = menu.Items.Add(name, None, self.on_item_click)
            item.Checked = (name == self.directivity_name)

        menu.Items.Add(ToolStripSeparator())

    def on_item_click(self, sender, event_info):
        name = str(sender)
        if name == self.directivity_name:
            return
        self.directivity_name = name
        ghenv.Component.NickName = name
        ghenv.Component.ExpireSolution(True)
# ---------- end omnidirectional ----------
dots = DotDisplay(Point=pt_2, Colour=RGB(0, 0, 0), Size=0.2)
toggle_4 = BooleanToggle(True)
py3_9 = Python3Script(shell=py3_8.shell, unfold=toggle_4)  # -> out, points, polylines; same code as py3_4
source = Compas_acousticsSource(position=pt_2, directivity=omnidirectional, name="test_spl_src")  # -> source; inputs position: Point3d, direction: Vector3d, directivity: String, name: String, sound_file: String
#   port position: Position of the source.
#   port direction: Direction of the source.
#   port directivity: Directivity of the source. Default is Omnidirectional. Options: - Bidirectional - Hypercardioid - Supercardioid - Cardioid - Omnidirectional
#   port name: Name of the source.
#   port sound_file: Sound file associated with the source.
#   port source: Source object.
# ---------- source: Python ----------
"""Acoustic Source object (speaker, human, etc.)."""
# flake8: noqa
import Grasshopper
import Rhino
from compas_acoustics import Source


class CreateSource(Grasshopper.Kernel.GH_ScriptInstance):
    ITEMS = ["bidirectional", "hypercardioid", "supercardioid", "cardioid", "omnidirectional"]

    def RunScript(self,
            position: Rhino.Geometry.Point3d,
            direction: Rhino.Geometry.Vector3d,
            directivity: str,
            name: str,
            sound_file: str):
        if position is None:
            position = Rhino.Geometry.Point3d(0, 0, 0)
        if direction is None:
            direction = Rhino.Geometry.Vector3d(1, 0, 0)

        if directivity is None:
            dirt = "omnidirectional"
        elif directivity not in self.ITEMS:
            ghenv.Component.AddRuntimeMessage(
                Grasshopper.Kernel.GH_RuntimeMessageLevel.Error, "Input parameter 'directivity' is not valid."
            )
            return None
        else:
            dirt = directivity

        if name is None:
            name = "my_source"

        return Source(
            name,
            *position,
            directivity=dirt,
            direction=[*direction],
            sound_file=sound_file
        )
# ---------- end source ----------
branch_2 = TreeBranch(Tree=py3_9.points, Path="0", MaintainPaths=True)
py3_10 = Python3Script(shell=py3_8.shell, unfold=toggle_4)  # -> out, meshes; same code as py3_5
pline_2 = PolyLine(Vertices=branch_2, Closed=invert(False))
mesh_3 = Mesh(pline_2)  # disabled
mjoin = MeshJoin(Meshes=flatten([py3_10.meshes, mesh_3]))
merge_4 = Merge(Data1=merge_3, Data2=merge_2)

amp_4 = Amplitude(Vector=deplane_2.YAxis, Amplitude="-1.0")
pt_3 = Point(chamber_strings_16.points)
move_4 = Move(Geometry=pt_3, Motion=amp_4)  # -> Geometry, Transform
txt = Text(chamber_strings_16.names)
source_2 = Compas_acousticsSource(position=pt_3, name=txt)  # -> source; inputs position: Point3d, direction: Vector3d, directivity: String, name: String, sound_file: String; same code as source
receiver_2 = Compas_acousticsReceiver(position=move_4.Geometry, name=txt)  # -> receiver; inputs position: Point3d, name: String; same code as receiver
scene = Compas_acousticsRoomScene(objects=flatten(merge_4), src=source_2, rcv=receiver_2)  # -> scene; inputs objects: list, name: String
#   port objects: List of AcousticObject
#   port src: List of Source objects.
#   port rcv: List of Receiver objects.
#   port name: Name of the room scene.
#   port scene: Room scene object.
# ---------- scene: Python ----------
"""Create a room scene with the specified objects, sources, and receivers."""
# flake8: noqa
import Grasshopper

import System
from compas_acoustics.scene import Scene
from compas_acoustics.source import Source
from compas_acoustics.receiver import Receiver


class CreateModelScene(Grasshopper.Kernel.GH_ScriptInstance):

    def RunScript(self,
            objects: System.Collections.Generic.List[object],
            src,
            rcv,
            name: str):

        if objects is None:
            ghenv.Component.AddRuntimeMessage(
                Grasshopper.Kernel.GH_RuntimeMessageLevel.Warning, "No objects provided."
            )
            return

        scene = Scene(name=name)
        scene.add_acoustic_objects(objects)

        scene.add_source(src)
        scene.add_receiver(rcv)
        return scene
# ---------- end scene ----------
simrt = Compas_acousticsSimulateRayTracing(
    scene=scene,
    max_order="2",
    n_rays=Slider(1000, range=0..1000),
    absorb_air=Toggle(False),
    energy_thres="1e-04",
    time_thres=Slider(0.2, range=0..1),
    seed=Slider(4, range=0..10))  # -> ir_graph; inputs sample_rate: Int32, max_order: Int32, n_rays: Int32, absorb_air: Boolean, energy_thres: Double, time_thres: Double, seed: Int32
#   port scene: Room scene object.
#   port sample_rate: Sample rate for the simulation.
#   port max_order: Maximum order of image sources.
#   port n_rays: Number of rays for ray tracing.
#   port absorb_air: Whether to consider air absorption.
#   port energy_thres: Energy threshold for ray tracing.
#   port time_thres: Time threshold for ray tracing.
#   port seed: Random seed for reproducibility.
#   port ir_graph: Impulse response graph structure.
# ---------- simrt: Python ----------
"""Simulate room acoustics using Image Source Method (ISM) and Ray Tracing (RT) to generate impulse response graph structure."""
# flake8: noqa
import Grasshopper

from compas_acoustics.simulator import Simulator

class SimulateRayTracing(Grasshopper.Kernel.GH_ScriptInstance):

    def RunScript(self,
            scene,
            sample_rate: int,
            max_order: int,
            n_rays: int,
            absorb_air: bool,
            energy_thres: float,
            time_thres: float,
            seed: int):

        if scene is None:
            ghenv.Component.AddRuntimeMessage(
                Grasshopper.Kernel.GH_RuntimeMessageLevel.Warning, "Input parameter 'scene' failed to collect data."
            )
            return

        if max_order is None:
            max_order = 2
        if n_rays is None:
            n_rays = 1000
        if absorb_air is None:
            absorb_air = True
        if energy_thres is None:
            energy_thres = 1e-7
        if time_thres is None:
            time_thres = 10.0

        sim = Simulator(scene)
        if sample_rate is not None:
            sim.sampling_rate = sample_rate

        sim.rir_from_ray_tracing(
            image_source_order=max_order,
            n_rays=n_rays,
            air_absorption=absorb_air,
            energy_thres=energy_thres,
            time_thres=time_thres,
            random_seed=seed,
        )

        ghenv.Component.Message = "{}Hz, order={}, rays={}, air={}, seed={}, energy_thres={}, time_thres={}".format(
            sim.sampling_rate, max_order, n_rays, absorb_air, seed if seed is not None else "random", energy_thres, time_thres
        )

        return sim.scene.ir_graph
# ---------- end simrt ----------
deirgraph = Compas_acousticsDeconstructIRGraph(ir_graph=simrt)  # -> ir, sources, receivers, edges; inputs receiver_idx: list of Int32
#   port ir_graph: Impulse response graph structure.
#   port receiver_idx: Index(s) of the receiver(s) to filter.
#   port ir: ImpulseResponse object(s).
#   port sources: Source object(s).
#   port receivers: Receiver object(s).
#   port edges: Relationships between sources and receivers as Line(s).
# ---------- deirgraph: Python ----------
"""Deconstruct impulse response graph structure into ImpulseResponse(s)."""
# flake8: noqa
import Grasshopper
from Grasshopper import DataTree
from Grasshopper.Kernel.Data import GH_Path
from Rhino.Geometry import Line
import System

class DeconstructIRGraph(Grasshopper.Kernel.GH_ScriptInstance):

    def RunScript(self,
            ir_graph,
            receiver_idx: System.Collections.Generic.List[int]):

        if ir_graph is None:
            ghenv.Component.AddRuntimeMessage(
                Grasshopper.Kernel.GH_RuntimeMessageLevel.Warning, "Input parameter 'ir_graph' failed to collect data."
            )

        ir_out = DataTree[object]()
        source_out = DataTree[object]()
        receiver_out = DataTree[object]()
        edge_out = DataTree[object]()

        # 1. Set order of receivers
        receiver_list = [
            ir_graph.node_attribute(node, 'data')
            for node in ir_graph.nodes()
            if ir_graph.node_attribute(node, 'type') == 'receiver'
        ]
        receiver_set = {rec.guid for rec in receiver_list}

        # 2. Make ir group as {receiver_0: [src_0, ...], ...}
        source_group = {}
        ir_group = {}

        for u, v in ir_graph.edges():
            ir = ir_graph.edge_attribute((u, v), 'data')
            data_u = ir_graph.node_attribute(u, 'data')
            data_v = ir_graph.node_attribute(v, 'data')

            if data_u.guid in receiver_set:
                rec, src = data_u, data_v
            elif data_v.guid in receiver_set:
                rec, src = data_v, data_u
            else:
                continue
            
            source_group.setdefault(rec.guid, []).append(src)
            ir_group.setdefault(rec.guid, []).append(ir)

        # 3. Filter receiver, optional
        if receiver_idx is None:
            indices = list(range(len(receiver_list)))
        else:
            indices = receiver_idx  # Already set to list access

        for idx in indices:
            rec = receiver_list[idx]
            path = GH_Path(idx)

            sources = source_group.get(rec.guid, [])
            irs = ir_group.get(rec.guid, [])

            receiver_out.Add(rec, path)
            source_out.AddRange(sources, path)
            ir_out.AddRange(irs, path)
            edge_out.AddRange([Line(*src.position, *rec.position) for src in sources], path)

        return ir_out, source_out, receiver_out, edge_out
# ---------- end deirgraph ----------
clean_2 = CleanTree(RemoveNulls=True, RemoveInvalid=True, RemoveEmpty=False, Tree=deirgraph.ir)

# ----
# OBJ 3: Target Early Stage Support to -14 dB
py3_11 = Python3Script(ir=clean_2)  # -> out, st1
# ---------- py3_11: Python ----------
from compas_acoustics import stage_acoustics as sa


st1 = sa.compute_ST1(ir)
# ---------- end py3_11 ----------
fitness = Compas_acousticsRegularizedFitness(values=py3_11.st1, target="-14")  # -> fitness; inputs values: list of Double, target: Double, k: Double
#   port values: A list of numerical values to evaluate.
#   port target: The target value to compare against.
#   port k: A regularization parameter that controls the weight of the STD in the loss function. Default is 1.0.
#   port fitness: The fitness score, a lower value indicates better fitness.
# ---------- fitness: Python ----------
"""A loss function that combines the Mean Absolute Error (MAE) and Standard Deviation (STD) of a list of values with respect to a target value. 
MAE evaluates the Accuracy to the target, while STD evaluates the Consistency of the values. 
The lower the fitness score, the better the fitness."""
# flake8: noqa
import Grasshopper
import System
from compas_acoustics.numerical.fitness import regularized_fitness


class RegularizedFitness(Grasshopper.Kernel.GH_ScriptInstance):
    def RunScript(self,
            values: System.Collections.Generic.List[float],
            target: float,
            k: float):
        if values is None:
            ghenv.Component.AddRuntimeMessage(
                Grasshopper.Kernel.GH_RuntimeMessageLevel.Warning,
                "Input parameter 'values' failed to collect data."
            )
            return
        if target is None:
            ghenv.Component.AddRuntimeMessage(
                Grasshopper.Kernel.GH_RuntimeMessageLevel.Warning,
                "Input parameter 'target' failed to collect data."
            )
            return
        if k is None:
            k = 1.0
        return regularized_fitness(values, target, k)
# ---------- end fitness ----------
wlc_target_st1 = Number(fitness)
panel_6 = Panel(wlc_target_st1)
panel_7 = Panel(py3_11.st1)

num = Number(wlc_target_st1)
scene_2 = Compas_acousticsRoomScene(objects=flatten(merge_4), sources=flatten(source), receivers=flatten(receiver))  # -> scene; inputs objects: list, sources: list, receivers: list, name: String
#   port objects: List of AcousticObject
#   port sources: List of Source objects.
#   port receivers: List of Receiver objects.
#   port name: Name of the room scene.
#   port scene: Room scene object.
# ---------- scene_2: Python ----------
"""Create a room scene with the specified objects, sources, and receivers."""
# flake8: noqa
import Grasshopper

import System
from compas_acoustics.scene import Scene
from compas_acoustics.source import Source
from compas_acoustics.receiver import Receiver


class CreateModelScene(Grasshopper.Kernel.GH_ScriptInstance):

    def RunScript(self,
            objects: System.Collections.Generic.List[object],
            sources: System.Collections.Generic.List[object],
            receivers: System.Collections.Generic.List[object],
            name: str):

        if objects is None:
            ghenv.Component.AddRuntimeMessage(
                Grasshopper.Kernel.GH_RuntimeMessageLevel.Warning, "No objects provided."
            )
            return
        if sources is None:
            ghenv.Component.AddRuntimeMessage(
                Grasshopper.Kernel.GH_RuntimeMessageLevel.Warning, "No sources provided."
            )
            return
        if receivers is None:
            ghenv.Component.AddRuntimeMessage(
                Grasshopper.Kernel.GH_RuntimeMessageLevel.Warning, "No receivers provided."
            )
            return

        scene = Scene(name=name)
        scene.add_acoustic_objects(objects)
        for src in sources:
            if isinstance(src, Source):
                scene.add_source(src)
            else:
                ghenv.Component.AddRuntimeMessage(
                    Grasshopper.Kernel.GH_RuntimeMessageLevel.Error,
                    f"Invalid source type: {type(src)}. Expected a Source object.",
                )
        for rcv in receivers:
            if isinstance(rcv, Receiver):
                scene.add_receiver(rcv)
            else:
                ghenv.Component.AddRuntimeMessage(
                    Grasshopper.Kernel.GH_RuntimeMessageLevel.Error,
                    f"Invalid receiver type: {type(rcv)}. Expected a Receiver object.",
                )

        return scene
# ---------- end scene_2 ----------
neg_2 = Negative(Value=Slider(0.2, range=0..1))
swatch = ColourSwatch(SwatchColor=RGB(189, 189, 189))
swatch_2 = ColourSwatch(SwatchColor=RGB(0, 0, 0))
swatch_3 = ColourSwatch(SwatchColor=RGB(145, 145, 145))

# ----
# Sound Pressure levels by ISM
number_slider_8 = Slider(85, range=0..150)
expression = Expression(x=number_slider_7, Expression="x * 0.6")
splsfromimagesourcemethod = Python3Script(
    scene=scene_2,
    ref_db=number_slider_8,
    target_db=Slider(45, range=0..150),
    radius=expression,
    max_order=Slider(2, range=0..2))  # -> out, spls; inputs ref_db: Double, target_db: Double, radius: Double, max_order: Int32
# ---------- splsfromimagesourcemethod: Python ----------
import numpy as np
from compas_acoustics.pra_converter import source_to_pra
from compas_acoustics.pra_converter import receivers_to_pra_mic_array
from compas_acoustics.pra_converter import scene_to_pra_room

def spls_from_image_source_method(room, sources, receivers, start_db, target_db, time_window=0.125):
    """
    Deterministic alternative to trace_rays_to_receivers, for use inside
    optimization loops where a noisy, n_rays-dependent objective is a
    problem: uses pyroomacoustics's compiled image-source engine to find
    every exact specular reflection path from each source to each receiver,
    up to room.max_order. No random sampling -- the same geometry always
    gives the same result.

    room must have been constructed with the reflection order you want,
    e.g. `scene_to_pra_room(scene, fs, max_order=3, ...)` -- max_order
    is baked into the compiled room engine at construction and cannot be
    changed on the room object afterwards.

    Parameters
    ----------
    time_window : float, default=0.125
        Only image sources arriving within this many seconds of the direct
        sound are summed into a receiver's total SPL. Without this, every
        visible image up to room.max_order gets summed as if it arrived
        simultaneously -- physically fine as *total energy*, but not what
        "SPL" means: a real meter (and human loudness perception) integrates
        over a short window, not the full reflection sequence, which is why
        that gave inflated readings especially close to the shell (more
        higher-order images are geometrically visible there, arriving well
        after the direct sound). The default, 0.125 s, is the IEC 61672
        "Fast" time constant -- the standard approximation of how long
        loudness perception actually integrates over.
    """
    for rcv in receivers:
        rcv.received_spls = []

    for source in sources:
        room.add_soundsource(source_to_pra(source))
    room.add_microphone_array(receivers_to_pra_mic_array(receivers, sample_rate=room.fs))

    room.image_source_model()

    sound_speed = float(getattr(room, 'c', 343.0))
    rcv_positions = np.array([rcv.position for rcv in receivers], dtype=float)
    rcv_radii = np.array([rcv.radius for rcv in receivers], dtype=float)

    for si, src in enumerate(room.sources):
        n_images = src.images.shape[1]
        if n_images == 0:
            continue

        # damping is amplitude-domain; square + band-average to get the
        # broadband energy reflection coefficient, matching how absorption
        # is averaged everywhere else in this module.
        energy_damping = np.mean(src.damping ** 2, axis=0)
        damping_db = 10.0 * np.log10(np.maximum(energy_damping, 1e-30))
        visible = np.asarray(room.visibility[si]).astype(bool)

        # Every (receiver, image source) pair at once: (n_receivers, n_images).
        diffs = src.images[None, :, :] - rcv_positions[:, :, None]
        distances = np.linalg.norm(diffs, axis=1)
        # Clamp to each receiver's own radius -- see the same clamp in
        # trace_rays_to_receivers for why (spl_at_distance is unbounded as
        # distance -> 0, and a receiver isn't a point).
        distances = np.maximum(distances, rcv_radii[:, None])

        arrival_time = distances / sound_speed
        within_window = arrival_time <= time_window

        spl_dist_drop = 20.0 * np.log10(distances / 1.0)  # spherical spread start at 1 meter
        raw_spls = start_db - spl_dist_drop + damping_db[None, :]
        mask = visible & within_window & (raw_spls > target_db)

        rows, cols = np.nonzero(mask)
        for m, k in zip(rows, cols):
            receivers[m].received_spls.append(float(raw_spls[m, k]))

    return [rcv.total_spl for rcv in receivers]


# Main code
room = scene_to_pra_room(
    scene, 16000, max_order=max_order, ray_tracing=False, air_absorption=False
)
sources = scene.sources
receivers = scene.receivers

if radius is not None:
    for rcv in receivers:
        rcv.radius = radius

spls = spls_from_image_source_method(
    room, sources, receivers, ref_db, target_db
)
# ---------- end splsfromimagesourcemethod ----------

panel_8 = Panel("{*;*;*;3}")  # disabled
panel_9 = Panel("{*;*;*;4}")  # disabled
panel_10 = Panel("{*;*;*;5}")  # disabled
boundary = BoundarySurfaces(Edges=pline)
Z = UnitZ(Factor=1)
end = EndPoints(Curve=py3_9.polylines)  # -> Start, End
rev_2 = Reverse(Vector=Z)
num_2 = Number(16.80518168)  # disabled
num_3 = Number(370)  # disabled
num_4 = Number(0.5746732026)  # disabled
ln = Line(StartPoint=end.Start, EndPoint=end.End)

# ----
# Display Result Number of Seats
toggle_5 = BooleanToggle(True)
unflatten = UnflattenTree(Tree=splsfromimagesourcemethod.spls, Guide=pt)
py3_12 = Python3Script(fan_grid=py3_7.fan_grid, spls_tree=unflatten, as_tree=toggle_5)  # -> out, points, spls; inputs spls_tree: tree, as_tree: Boolean
# ---------- py3_12: Python ----------
from Grasshopper import DataTree
from Grasshopper.Kernel.Data import GH_Path


point_group = fan_grid.grid

if as_tree:
    points = DataTree[object]()
    spls = DataTree[object]()

    for i, pts in enumerate(point_group.values()):
        path = GH_Path(i)
        points.AddRange(pts, path)

    spls_tree = [list(spls_tree.Branch(path)) for path in spls_tree.Paths]
    new_spls = fan_grid.mirror_half_grid_and_spls(spls_tree)

    for i, spl_list in enumerate(new_spls):
        path = GH_Path(i)
        spls.AddRange(spl_list, path)

else:
    points = [p for pts in point_group.values() for p in pts]

    spls_tree = [list(spls_tree.Branch(path)) for path in spls_tree.Paths]

    new_spls = fan_grid.mirror_half_grid_and_spls(spls_tree)
    spls = [spl for lst in new_spls for spl in lst]
# ---------- end py3_12 ----------
gradient = Gradient(
    LowerLimit=number_slider_8,
    UpperLimit=Slider(50, range=0..100),
    Parameter=flatten(py3_12.spls),
    stops=[0: RGB(234, 38, 0), 0.25: RGB(234, 126, 0), 0.5: RGB(254, 244, 84), 0.75: RGB(173, 203, 249), 1: RGB(75, 107, 169)])
del = DelaunayMesh(Points=flatten(py3_12.points), Plane=pln)
py3_13 = Python3Script(pts=flatten(py3_12.points), spls=flatten(py3_12.spls), target_db=Slider(65, range=0..100))  # -> out, spls_out, pts_out; inputs pts: list of Point3d, spls: list, target_db: Double
# ---------- py3_13: Python ----------
result = [(pt, spl) for pt, spl in zip(pts, spls) if spl >= target_db]

pts_out, spls_out = map(list, zip(*result)) if result else ([], [])
# ---------- end py3_13 ----------
lng = ListLength(List=py3_13.pts_out)
panel_11 = Panel(lng)
mcol = MeshColours(Mesh=del, Colours=gradient)

pts = Point(py3_12.points)
spls = Number(py3_12.spls)

# ----
# OBJ 1: Maximize number of seats
# (above 65 dB)
py3_14 = Python3Script(pts=pts, spls=spls, target_db=number_slider_5)  # -> out, spls_out, pts_out; inputs pts: list of Point3d, spls: list, target_db: Double; same code as py3_13
pt_4 = Point(flatten(py3_14.pts_out))
lng_2 = ListLength(List=pt_4)
panel_12 = Panel(lng_2)
neg_3 = Negative(Value=lng_2)
wlc_maximize_receiver_count = Number(neg_3)

# ----
# OBJ 2: Continuity of Seats in Row
number_slider_9 = Slider(1, range=0..1)
number_slider_10 = Slider(2, range=0..10)
py3_15 = Python3Script(spls=spls, target_db=number_slider_5, k=number_slider_9)  # -> out, fragment; inputs spls: tree, target_db: Double, k: Double
# ---------- py3_15: Python ----------
# In-row Continuity

def monotonic_falloff_penalty(values):
    n = len(values)
    if n < 2:
        return 0.0

    return sum(
        max(0.0, values[i+1] - values[i]) ** 2
        for i in range(n - 1)
    )

def row_holes_penalty(mask_list):
    total_frag = 0.0

    for row in mask_list:
        n = len(row)
        if n == 0:
            continue
        
        half = row[n // 2 :]
        if sum(1 for v in half if v == 1) < 3:
            continue
        
        # Find the edgest valid mask 
        last_valid_idx = (len(half) - 1) - half[::-1].index(1)

        hole_count = sum(1 for v in half[: last_valid_idx + 1] if v == 0)
        
        frag = (hole_count / float(len(half)))
        total_frag += frag

    return total_frag


dic = {
    "coverage_ratios": [],
    "valid_masks": [],
}

for row_idx, path in enumerate(spls.Paths):
    row = spls.Branch(path)

    if not row:
        continue

    # 1 is valid, 0 is invalid
    valid_mask = [1 if spl >= target_db else 0 for spl in row]

    valid_count = sum(valid_mask)

    # Coverage ratio in each row
    cover_ratio = valid_count / len(row)

    dic["coverage_ratios"].append(cover_ratio)
    dic["valid_masks"].append(valid_mask)


mono = monotonic_falloff_penalty(dic["coverage_ratios"])
patch = row_holes_penalty(dic["valid_masks"])

k = k if k else 1.0

fragment = mono + k * patch

print (mono, patch)
print (fragment)
# ---------- end py3_15 ----------
panel_13 = Panel(py3_15.fragment)
wlc_spl_continuity = Number(py3_15.fragment)

panel_14 = Panel(py3_15.out)
pt_5 = Point(flatten(pts))
num_5 = Number(spls)
num_6 = Number(lng_2)
num_7 = Number(wlc_spl_continuity)
entwine = Entwine(Branch00=num_5, Branch01=num_6, Branch02=num_7, Branch03=num, FlattenInputs=True)
entwine_2 = Entwine(Branch00=clean, Branch01=num_5, Branch02=pt_5, Branch03=num_6, Branch04=num_7, Branch05=num, FlattenInputs=True)
wallacei_x = WallaceiX(
    Genes=[wlc_fan_angle, wlc_shell_angle, wlc_translations],
    Objectives=[wlc_maximize_receiver_count, wlc_spl_continuity, wlc_target_st1],
    Data=entwine,
    Phenotype=entwine_2,
    allFitness="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",
    allFrontIdx="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",
    allGenomes="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",
    curFrontIdx="59|0;59|1;59|2;59|3;59|4;59|5;59|6;59|7;59|8;59|9;59|10;59|11;59|12;59|13;59|14;59|15;59|16;59|17;59|18;59|19;59|20;59|21;59|22;59|23;59|24;59|25;59|26;59|27;59|28;59|29;59|30;59|31;59|32;59|33;59|34;59|35;59|36;59|37;59|38;59|39;59|40;59|41;59|42;59|43;59|44;59|45;59|46;59|47;59|48;59|49",
    curFrontIdxSave="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",
    popGen="50,60",
    total="21754781",
    wlcDone=True)  # -> WallaceiGenomes, FitnessValues, Data, WPhenotypes
viewer = ParamViewer(wallacei_x.WPhenotypes)

data = Data(wallacei_x.WPhenotypes)
tstat = TreeStatistics(Tree=data)  # -> Paths, Length, Count
item_2 = ListItem(List=tstat.Paths, Index=Slider(2, range=0..20), Wrap=True)
branch_3 = TreeBranch(Tree=data, Path=item_2, MaintainPaths=True)
number_slider_11 = Slider(13, range=0..50)
pdecoder = DecodePhenotype(WallaceiPhenotype=branch_3)  # -> GeometriesList, MeshesList, NumbersList, TextList
bang = ExplodeTree(Data=pdecoder.NumbersList)  # -> _59401, _59403, _59404, _59405
target_sp1 = Panel(bang._59405)
number_of_seats = Panel(bang._59403)
spl_in_row_continiuty = Panel(bang._59404)

demesh = DeconstructMesh(Mesh=pdecoder.MeshesList)  # -> Vertices, Faces, Colours, Normals
conmesh = ConstructMesh(Vertices=demesh.Vertices, Faces=demesh.Faces)

weldvertices = MeshWeldVertices(Mesh=conmesh, Tolerance=0.01)  # -> RuntimeMessage, Mesh
wbsplitquads = WeaverbirdsConstantQuadsSplitSubdivision(MeshCurves=weldvertices.Mesh, Level=Slider(1, range=0..3), SmoothNakedEdges=2)
swatch_4 = ColourSwatch(SwatchColor=RGBA(145, 145, 145, 208))
faceb_2 = FaceBoundaries(Mesh=weldvertices.Mesh)
wbcatmullclark = WeaverbirdsCatmullClarkSubdivision(MeshCurves=wbsplitquads, Level=Slider(3, range=0..3), SmoothNakedEdges=2)
preview = CustomPreview(Geometry=wbcatmullclark, Material=swatch_2)

number_slider_12 = Slider(0.12, range=0..1)  # disabled
number_slider_13 = Slider(0.25, range=0..1)  # disabled
number_slider_14 = Slider(0.2, range=0..1)  # disabled
number_slider_15 = Slider(0.05, range=0..1)  # disabled
panel_15 = Panel("90 to 70")  # disabled
panel_16 = Panel("70 to 105")  # disabled
panel_17 = Panel("145 to 111")  # disabled
panel_18 = Panel("0 to 20")  # disabled
panel_19 = Panel("80 to 145")  # disabled
dom = ConstructDomain(DomainStart=number_slider_13, DomainEnd=1)  # disabled
wlc_shell_angle_2 = Slider(112, range=80..145)  # disabled
wlc_fan_angle_2 = Slider(91, range=80..105)  # disabled
number_slider_16 = Slider(20, range=0..20)  # disabled
panel_20 = Panel("""0
1""")  # disabled
number_slider_17 = Slider(0.5, range=0..1)  # disabled
toggle_6 = BooleanToggle(False)  # disabled
toggle_7 = BooleanToggle(False)  # disabled
toggle_8 = BooleanToggle(True)  # disabled
number_slider_18 = Slider(1, range=0..1)  # disabled
max = Maximum(A=number_slider_18, B=number_slider_12)  # disabled
max_2 = Maximum(A=number_slider_18, B=number_slider_13)  # disabled
max_3 = Maximum(A=number_slider_18, B=number_slider_14)  # disabled
max_4 = Maximum(A=number_slider_18, B=number_slider_15)  # disabled
max_5 = Maximum(A=number_slider_18, B=number_slider_14)  # disabled
max_6 = Maximum(A=number_slider_18, B=number_slider_13)  # disabled
min = Minimum(A=number_slider_18, B=number_slider_15)  # disabled
dom_2 = ConstructDomain(DomainStart=number_slider_15, DomainEnd=max)  # disabled
dom_3 = ConstructDomain(DomainStart=number_slider_14, DomainEnd=max_2)  # disabled
max_7 = Maximum(A=number_slider_18, B=number_slider_12)  # disabled
dom_4 = ConstructDomain(DomainStart=number_slider_12, DomainEnd=max_3)  # disabled
remap = RemapNumbers(Value=min, Source=number_slider_15, Target=panel_15)  # -> Mapped, Clipped; disabled
remap_2 = RemapNumbers(Value=max_4, Source=dom_2, Target=panel_16)  # -> Mapped, Clipped; disabled
remap_3 = RemapNumbers(Value=max_5, Source=dom_3, Target=panel_17)  # -> Mapped, Clipped; disabled
remap_4 = RemapNumbers(Value=max_6, Source=dom, Target=panel_18)  # -> Mapped, Clipped; disabled
remap_5 = RemapNumbers(Value=max_7, Source=dom_4, Target=panel_19)  # -> Mapped, Clipped; disabled
py3_16 = Python3Script(x=remap_5.Mapped, y=remap_3.Mapped)  # -> out, a; inputs x: Double, y: Double; disabled
# ---------- py3_16: Python ----------
a = x if x < y else y
# ---------- end py3_16 ----------
panel_21 = Panel(remap_3.Mapped)  # disabled
panel_22 = Panel(remap_4.Mapped)  # disabled
panel_23 = Panel(remap.Mapped)  # disabled
py3_17 = Python3Script(x=remap.Mapped, y=remap_2.Mapped)  # -> out, a; inputs x: Double, y: Double; disabled
# ---------- py3_17: Python ----------
a = x if x > y else y
# ---------- end py3_17 ----------
panel_24 = Panel(remap_2.Mapped)  # disabled
panel_25 = Panel(remap_5.Mapped)  # disabled
panel_26 = Panel(py3_16.a)  # disabled
panel_27 = Panel(py3_17.a)  # disabled
num_8 = Number(panel_27)  # disabled
num_9 = Number(panel_26)  # disabled
item_3 = ListItem(List=tstat.Paths, Index=panel_22, Wrap=True)  # disabled
branch_4 = TreeBranch(Tree=wallacei_x.WallaceiGenomes, Path=item_3, MaintainPaths=True)  # disabled
gdecoder = DecodeGenome(WallaceiGenome=branch_4)  # disabled
py3_18 = Python3Script(
    pln=move.Geometry,
    radius=number_slider_4,
    fan_angle=num_8,
    shell_angle=num_9,
    div_arc=number_slider_3,
    div_shell=number_slider_2)  # -> out, shell; inputs pln: Plane, radius: Double, fan_angle: Double, shell_angle: Double, div_arc: Int32, div_shell: Int32; disabled; same code as py3_2
py3_19 = Python3Script(
    pln=move.Geometry,
    radius=number_slider_4,
    fan_angle=num_8,
    shell_angle=num_9,
    div_arc=number_slider_3,
    div_shell=number_slider_2)  # -> out, shell; inputs pln: Plane, radius: Double, fan_angle: Double, shell_angle: Double, div_arc: Int32, div_shell: Int32; disabled; same code as py3_2
cull_i_2 = CullIndex(List=gdecoder, Indices=panel_20, Wrap=True)  # disabled
py3_20 = Python3Script(shell=py3_19.shell, offsets=cull_i_2, fix_gap=toggle_2)  # -> out, shell; inputs offsets: list of Double, fix_gap: Boolean; disabled; same code as py3_3
number_slider_19 = Slider(0.62, range=0..1)  # disabled
py3_21 = Python3Script(shell=py3_18.shell, unfold=toggle_6)  # -> out, points, polylines; disabled; same code as py3_4
py3_22 = Python3Script(shell=py3_18.shell, unfold=toggle_6)  # -> out, meshes; disabled; same code as py3_5
py3_23 = Python3Script(shell=py3_20.shell, unfold=toggle_7)  # -> out, meshes; disabled; same code as py3_5
py3_24 = Python3Script(shell=py3_20.shell, unfold=toggle_7)  # -> out, points, polylines; disabled; same code as py3_4
ln_2 = Line(StartPoint=py3_21.points, EndPoint=py3_24.points)  # disabled
line = LineSDL(Start=py3_21.points, Direction=ln_2, Length=number_slider_17)  # disabled
py3_25 = Python3Script(shell=py3_20.shell, unfold=toggle_8)  # -> out, points, polylines; disabled; same code as py3_4
yz = YZPlane(Origin=move.Geometry)  # disabled
number_slider_20 = Slider(0.08, range=0..0.1)  # disabled
number_slider_21 = Slider(0.2, range=0..1)  # disabled
number_slider_22 = Slider(0.05, range=0..0.1)  # disabled
mirror = Mirror(Geometry=py3_22.meshes, Plane=yz)  # -> Geometry, Transform; disabled
mirror_2 = Mirror(Geometry=py3_23.meshes, Plane=yz)  # -> Geometry, Transform; disabled
swatch_5 = ColourSwatch(SwatchColor=RGB(255, 0, 0))  # disabled
item_4 = ListItem(List=flatten(py3_25.polylines), Index=0, Wrap=True)  # disabled
swatch_6 = ColourSwatch(SwatchColor=RGB(255, 130, 130))  # disabled
displayarrowlines = DisplayArrowLines(Line=line, Unitize=True, Scale=number_slider_17, Offset=0, Thickness=2, Color=swatch_6, Size=number_slider_19)  # disabled
number_slider_23 = Slider(2, range=0..10)  # disabled
faceb_3 = FaceBoundaries(Mesh=py3_23.meshes)  # disabled
number_slider_24 = Slider(1, range=0..10)  # disabled
demesh_2 = DeconstructMesh(Mesh=mirror.Geometry)  # -> Vertices, Faces, Colours, Normals; disabled
demesh_3 = DeconstructMesh(Mesh=mirror_2.Geometry)  # -> Vertices, Faces, Colours, Normals; disabled
dots_2 = DotDisplay(Point=py3_24.points, Colour=swatch_5, Size=number_slider_20)  # disabled
dots_3 = DotDisplay(Point=py3_21.points, Colour=swatch_6, Size=number_slider_22)  # disabled
dash = DashPattern(Curve=py3_21.polylines, Pattern=number_slider_21)  # -> Dashes, Gaps; disabled
conmesh_2 = ConstructMesh(Vertices=demesh_2.Vertices, Faces=demesh_2.Faces)  # disabled
conmesh_3 = ConstructMesh(Vertices=demesh_3.Vertices, Faces=demesh_3.Faces)  # disabled
swatch_7 = ColourSwatch(SwatchColor=RGB(184, 184, 184))  # disabled
medges = MeshEdges(Mesh=conmesh_2)  # -> NakedEdges, InteriorEdges, NonManifoldEdges; disabled
previewlw = CustomPreviewLineweights(Geometry=py3_24.polylines, Shader=swatch_5, Thickness=number_slider_23, Absolute=False)  # disabled
swatch_8 = ColourSwatch(SwatchColor=RGB(120, 120, 120))  # disabled
previewlw_2 = CustomPreviewLineweights(Geometry=dash.Dashes, Shader=swatch_6, Thickness=number_slider_24, Absolute=False)  # disabled
faceb_4 = FaceBoundaries(Mesh=conmesh_3)  # disabled
dash_2 = DashPattern(Curve=[medges.NakedEdges, medges.InteriorEdges], Pattern=number_slider_21)  # -> Dashes, Gaps; disabled
previewlw_3 = CustomPreviewLineweights(Geometry=faceb_4, Shader=swatch_8, Thickness=number_slider_23, Absolute=False)  # disabled
preview_2 = CustomPreview(Geometry=conmesh_2, Material=swatch_7)  # disabled
preview_3 = CustomPreview(Geometry=conmesh_3, Material=swatch_8)  # disabled
swatch_9 = ColourSwatch(SwatchColor=RGB(150, 0, 0))  # disabled
previewlw_4 = CustomPreviewLineweights(Geometry=dash_2.Dashes, Shader=swatch_7, Thickness=number_slider_24, Absolute=False)  # disabled
previewlw_5 = CustomPreviewLineweights(Geometry=faceb_2, Shader=swatch_9, Absolute=False)  # disabled

clscrv = CloseCurve(Curve=item_4, CloseType=0, Bulge=0.5, Tolerance=0)  # -> Closed, R; disabled
Z_2 = UnitZ(Factor=1)  # disabled
rev_3 = Reverse(Vector=Z_2)  # disabled
swatch_10 = ColourSwatch(SwatchColor=RGBA(145, 145, 145, 77))  # disabled
boundary_2 = BoundarySurfaces(Edges=clscrv.Closed)  # disabled
extr = Extrude(Base=boundary_2, Direction=rev_3)  # disabled
cap = CapHoles(Brep=extr)  # disabled
preview_4 = CustomPreview(Geometry=cap, Material=swatch_10)  # disabled

wbthicken = WeaverbirdsMeshThicken(MeshCurves=wbcatmullclark, Distance=neg_2, OffsetType=0)
previewlw_6 = CustomPreviewLineweights(Geometry=faceb_2, Shader=ColourSwatch(SwatchColor=RGB(74, 74, 74)), Absolute=False)
wbedges = WeaverbirdsMeshEdges(MeshOrPolylines=conmesh)
pdecoder_2 = DecodePhenotype(WallaceiPhenotype=data)  # -> GeometriesList, flatten(MeshesList), NumbersList, TextList
dash_3 = DashPattern(Curve=[wbedges, ln], Pattern=Slider(0.22, range=0..1))  # -> Dashes, Gaps
lng_3 = ListLength(List=pdecoder_2.MeshesList)  # -> expr("x-1", Length)
range = Range(Domain=Domain(0, 1), Steps=lng_3)
swatch_11 = ColourSwatch(SwatchColor=RGBA(145, 145, 145, 77))
mesh_4 = Mesh([<mesh referenced from the Rhino model> x2])  # disabled
pt_6 = Point([<point referenced from the Rhino model> x418])  # disabled
previewlw_7 = CustomPreviewLineweights(Geometry=dash_3.Dashes, Shader=ColourSwatch(SwatchColor=RGB(110, 110, 110)), Absolute=False)
num_10 = Number(23.064517)  # disabled
num_11 = Number(48)  # disabled
num_12 = Number(0.666667)  # disabled
number_slider_25 = Slider(6.2, range=0..50)  # disabled
gradient_2 = Gradient(
    LowerLimit=0,
    UpperLimit=1,
    Parameter=range,
    stops=[0: RGB(243, 57, 0), 0.1: RGB(236, 27, 60), 0.2: RGB(210, 0, 118), 0.3: RGB(103, 0, 120), 0.4: RGB(39, 72, 161), 0.5: RGB(1, 192, 229), 0.6: RGB(18, 178, 90), 0.7: RGB(79, 186, 8), 0.8: RGB(220, 237, 32), 0.9: RGB(247, 159, 20), 1: RGB(243, 57, 0)])
X = UnitX(Factor=number_slider_25)  # disabled
py3_26 = Python3Script(x=[num_12, num_4])  # -> a; inputs x: Double; disabled
# ---------- py3_26: Python ----------
a = round(x, 3)
a = format(x, ".3f")
# ---------- end py3_26 ----------
py3_27 = Python3Script(x=[num_10, num_2])  # -> a; inputs x: Double; disabled; same code as py3_26
number_slider_26 = Slider(70, range=0..100)

srf = Surface(item)
dots_4 = DotDisplay(Point=py3_12.points, Colour=ColourSwatch(SwatchColor=RGB(61, 61, 61)), Size=0.2)  # disabled
preview_5 = CustomPreview(Geometry=srf, Material=ColourSwatch(SwatchColor=RGB(255, 255, 255)))
dots_5 = DotDisplay(Point=chamber_strings_16.points, Colour=ColourSwatch(SwatchColor=RGB(255, 189, 189)), Size=Slider(0.22, range=0..1))

number_slider_27 = Slider(25.5, range=0..50)  # disabled
Y = UnitY(Factor=number_slider_27)  # disabled
swatch_12 = ColourSwatch(SwatchColor=RGB(204, 255, 206))
panel_28 = Panel("ST1: ")  # disabled
panel_29 = Panel("Seats: ")  # disabled
panel_30 = Panel("Continuity: ")  # disabled
nv = NakedVertices(Mesh=pdecoder.MeshesList)  # -> ClothedIndex, NakedIndex, ClothedPts, NakedPts; disabled
preview_6 = CustomPreview(Geometry=flatten(wbcatmullclark), Material=gradient_2)
py3_28 = Python3Script(pts=nv.NakedPts)  # -> out, a; inputs pts: list of Point3d; disabled
# ---------- py3_28: Python ----------
import math


def sort_points_radially_xy(pts):
    if not pts:
        return []

    # 1. Calculate centroid (average X and Y)
    cx = sum(p.X for p in pts) / float(len(pts))
    cy = sum(p.Y for p in pts) / float(len(pts))

    # 2. Sort by polar angle relative to centroid
    # math.atan2(dy, dx) returns angle in radians [-pi, pi]
    sorted_pts = sorted(
        pts, key=lambda p: math.atan2(p.Y - cy, p.X - cx)  # Counter-clockwise
    )

    return sorted_pts


filtered = [p for p in pts if -1e-6 <= p.Z <= 1e-6]
a = sort_points_radially_xy(filtered)
# ---------- end py3_28 ----------
concat = Concatenate(
    FragmentA=panel_29,
    FragmentB=[num_11, num_3],
    FragmentC=panel_30,
    FragmentD=py3_26,
    FragmentE=panel_28,
    FragmentF=py3_27)  # disabled
number_slider_28 = Slider(359, range=0..359)  # disabled
previewlw_8 = CustomPreviewLineweights(Geometry=cull_i, Shader=ColourSwatch(SwatchColor=RGB(61, 61, 61)), Thickness=Slider(2, range=0..10), Absolute=False)
pt_7 = Point([<point referenced from the Rhino model> x2])  # disabled
number_slider_29 = Slider(2.6, range=0..10)  # disabled

# ----
# Display Result Number of Seats
number_slider_30 = Slider(50, range=0..100)
num_13 = Number(bang._59401)
gradient_3 = Gradient(
    LowerLimit=number_slider_8,
    UpperLimit=number_slider_30,
    Parameter=num_13,
    stops=[0: RGB(234, 38, 0), 0.25: RGB(234, 126, 0), 0.5: RGB(254, 244, 84), 0.75: RGB(173, 203, 249), 1: RGB(75, 107, 169)])
del_2 = DelaunayMesh(Points=pdecoder.GeometriesList, Plane=pln)
py3_29 = Python3Script(pts=pdecoder.GeometriesList, spls=num_13, target_db=Slider(65, range=0..100))  # -> out, spls_out, pts_out; inputs pts: list of Point3d, spls: list, target_db: Double; same code as py3_13
lng_4 = ListLength(List=py3_29.pts_out)
panel_31 = Panel(lng_4)
mcol_2 = MeshColours(Mesh=del_2, Colours=gradient_3)

pline_3 = PolyLine(Vertices=py3_28.a, Closed=invert(False))  # disabled
boundary_3 = BoundarySurfaces(Edges=pline_3)  # disabled
extr_2 = Extrude(Base=boundary_3, Direction=rev_2)
cap_2 = CapHoles(Brep=extr_2)
preview_7 = CustomPreview(Geometry=cap_2, Material=swatch_11)
swatch_13 = ColourSwatch(SwatchColor=RGB(0, 0, 0))  # disabled
bbox = BoundingBox(Content=wbcatmullclark, Plane=PlaneXY(0, 0, 0))  # -> Box, Box_2; disabled
pi_2 = Pi(Factor=1)  # disabled
cloud = CloudDisplay(Points=flatten(py3_12.points), Colours=gradient, Size=Slider(0.14, range=0..1), SpriteType=1)
volume = Volume(Geometry=bbox.Box)  # -> Volume, Centroid; disabled
rotate = Rotate(Geometry=cap_2, Angle=degrees(number_slider_28), Plane=volume.Centroid)  # -> Geometry, Transform; disabled
rotate_2 = Rotate(Geometry=wbcatmullclark, Angle=degrees(number_slider_28), Plane=volume.Centroid)  # -> Geometry, Transform; disabled
swatch_14 = ColourSwatch(SwatchColor=RGB(145, 145, 145))  # disabled
mesh_5 = Mesh(<mesh referenced from the Rhino model>)  # disabled
dots_6 = DotDisplay(Point=py3_13.pts_out, Colour=ColourSwatch(SwatchColor=RGB(61, 61, 61)), Size=Slider(0.07, range=0..1))
cloud_2 = CloudDisplay(Points=py3_13.pts_out, Colours=ColourSwatch(SwatchColor=RGB(102, 102, 102)), Size=Slider(0.5, range=0..1), SpriteType=0)
number_slider_31 = Slider(1, range=0..3)  # disabled
preview_8 = CustomPreview(Geometry=rotate.Geometry, Material=swatch_11)  # disabled
pt_8 = Point(pdecoder.GeometriesList)  # disabled
weldvertices_2 = MeshWeldVertices(Mesh=mesh_5, Tolerance=0.01)  # -> RuntimeMessage, Mesh; disabled
tag = TextTag(Location=chamber_strings_16.points, Text=chamber_strings_16.names, Colour=ColourSwatch(SwatchColor=RGB(0, 0, 0)))
preview_9 = CustomPreview(Geometry=rotate_2.Geometry, Material=swatch_2)  # disabled
number_slider_32 = Slider(0.15, range=0..1)  # disabled
number_slider_33 = Slider(3, range=0..3)  # disabled
rotate_3 = Rotate(Geometry=py3_29.pts_out, Angle=degrees(number_slider_28), Plane=volume.Centroid)  # -> Geometry, Transform; disabled
mindex = MemberIndex(Set=pt_8, Member=py3_29.pts_out)  # -> flatten(Index), Count; disabled
del_3 = DelaunayMesh(Points=chamber_strings_16.points, Plane=PlaneXY(0, 0, 0))
medges_2 = MeshEdges(Mesh=del_3)  # -> NakedEdges, InteriorEdges, NonManifoldEdges
dupln = RemoveDuplicateLines(Lines=[medges_2.InteriorEdges, medges_2.NakedEdges], Tolerance=0.01)
dash_4 = DashPattern(Curve=dupln, Pattern=Slider(0.03, range=0..1))  # -> Dashes, Gaps
number_slider_34 = Slider(0.15, range=0..1)  # disabled
swatch_15 = ColourSwatch(SwatchColor=RGB(61, 61, 61))  # disabled
wbsplitquads_2 = WeaverbirdsConstantQuadsSplitSubdivision(MeshCurves=weldvertices_2.Mesh, Level=number_slider_31, SmoothNakedEdges=2)  # disabled
rotate_4 = Rotate(Geometry=mcol_2, Angle=degrees(number_slider_28), Plane=volume.Centroid)  # -> Geometry, Transform; disabled
dots_7 = DotDisplay(Point=py3_29.pts_out, Colour=ColourSwatch(SwatchColor=RGB(61, 61, 61)), Size=Slider(0.15, range=0..1))
swatch_16 = ColourSwatch(SwatchColor=RGB(145, 145, 145))  # disabled
swatch_17 = ColourSwatch(SwatchColor=RGB(145, 145, 145))  # disabled
swatch_18 = ColourSwatch(SwatchColor=RGB(207, 207, 207))  # disabled
faceb_5 = FaceBoundaries(Mesh=weldvertices_2.Mesh)  # disabled
cull_i_3 = CullIndex(List=pt_8, Indices=mindex.Index, Wrap=True)  # disabled
dots_8 = DotDisplay(Point=rotate_3.Geometry, Colour=swatch_15, Size=number_slider_32)  # disabled
wbcatmullclark_2 = WeaverbirdsCatmullClarkSubdivision(MeshCurves=wbsplitquads_2, Level=number_slider_33, SmoothNakedEdges=2)  # disabled
preview_10 = CustomPreview(Geometry=wbcatmullclark_2, Material=swatch_17)  # disabled
previewlw_9 = CustomPreviewLineweights(Geometry=faceb_5, Shader=swatch_16, Absolute=False)  # disabled
dots_9 = DotDisplay(Point=cull_i_3, Colour=swatch_18, Size=number_slider_34)  # disabled
panel_32 = Panel("0 to 359")  # disabled
remap_6 = RemapNumbers(Value=number_slider_28, Source=panel_32, Target=Domain(0, 1))  # -> Mapped, Clipped; disabled
dom_5 = ConstructDomain(DomainStart=0, DomainEnd=remap_6.Mapped)  # disabled

number_slider_35 = Slider(72, range=0..100)  # disabled
number_slider_36 = Slider(55, range=0..100)  # disabled
number_slider_37 = Slider(50, range=0..100)  # disabled
panel_33 = Panel("{*;*;*;1}")  # disabled
number_slider_38 = Slider(65, range=0..100)  # disabled
number_slider_39 = Slider(0.5, range=0..1)  # disabled
swatch_19 = ColourSwatch(SwatchColor=RGB(102, 102, 102))  # disabled
swatch_20 = ColourSwatch(SwatchColor=RGB(145, 145, 145))  # disabled

# ----
# DO NOT TURN ON!!!!!!
distributor = DistributeToGrid(
    FitnessValues=wallacei_x.FitnessValues,
    WallaceiPhenotypes=wallacei_x.WPhenotypes,
    SizeOfTheGridInTheXDirection=number_slider_35,
    SizeOfTheGridInTheYDirection=number_slider_36,
    OutputOptions=0)  # -> DistributedFitnessValues, DistributedData, DistributedGeometries, DistributedMeshes, DistributedNumbers, GridLocations; disabled

split = SplitTree(Data=distributor.DistributedNumbers, Masks=flatten(panel_8))  # -> Positive, Negative; disabled
split_2 = SplitTree(Data=distributor.DistributedNumbers, Masks=flatten(panel_9))  # -> Positive, Negative; disabled
split_3 = SplitTree(Data=distributor.DistributedNumbers, Masks=flatten(panel_10))  # -> Positive, Negative; disabled
number_of_seats_2 = Panel(split.Positive)  # disabled
spl_in_row_continuity = Panel(split_2.Positive)  # disabled
target_st1 = Panel(split_3.Positive)  # disabled
pt_9 = Point(distributor.GridLocations)  # disabled
py3_30 = Python3Script(x=spl_in_row_continuity)  # -> a; inputs x: Double; disabled; same code as py3_26
py3_31 = Python3Script(x=target_st1)  # -> a; inputs x: Double; disabled; same code as py3_26
cloud_3 = CloudDisplay(Points=pt_6, Colours=swatch_19, Size=number_slider_39, SpriteType=0)  # disabled
move_5 = Move(Geometry=pt_9, Motion=X)  # -> Geometry, Transform; disabled
item_5 = ListItem(List=flatten(move_5.Transform), Index=0, Wrap=True)  # disabled
move_6 = Move(Geometry=move_5.Geometry, Motion=Y)  # -> Geometry, Transform; disabled
item_6 = ListItem(List=flatten(move_6.Transform), Index=0, Wrap=True)  # disabled
py3_32 = Python3Script(pt=pt_9, x=number_slider_35, y=number_slider_36)  # -> out, p; inputs pt: Point3d, x: Double, y: Double; disabled
# ---------- py3_32: Python ----------
import Rhino.Geometry as rg


p = pt + rg.Vector3d(x/2, 0, 0) + rg.Vector3d(0, y/2, 0)
# ---------- end py3_32 ----------
concat_2 = Concatenate(
    FragmentA=panel_29,
    FragmentB=number_of_seats_2,
    FragmentC=panel_30,
    FragmentD=py3_30,
    FragmentE=panel_28,
    FragmentF=py3_31)  # disabled
comp = Compound(Transforms=[item_5, item_6])  # disabled
transform = Transform(Geometry=pt_7, Transform=comp)  # disabled
panel_34 = Panel(py3_32.p)  # disabled
tag_2 = TextTag3D(Location=move_6.Geometry, Text=concat_2, Size=number_slider_29, Colour=swatch_13, Justification=4)  # disabled
tag_3 = TextTag3D(Location=transform, Text=concat, Size=number_slider_29, Colour=swatch_13, Justification=4)  # disabled

split_4 = SplitTree(Data=distributor.DistributedNumbers, Masks=flatten(panel_33))  # -> Positive, Negative; disabled
gradient_4 = Gradient(
    LowerLimit=number_slider_8,
    UpperLimit=number_slider_37,
    Parameter=split_4.Positive,
    stops=[0: RGB(234, 38, 0), 0.25: RGB(234, 126, 0), 0.5: RGB(254, 244, 84), 0.75: RGB(173, 203, 249), 1: RGB(75, 107, 169)])  # disabled
py3_33 = Python3Script(pts=distributor.DistributedGeometries, spls=split_4.Positive, target_db=number_slider_38)  # -> out, spls_out, pts_out; inputs pts: list of Point3d, spls: list, target_db: Double; disabled; same code as py3_13
del_4 = DelaunayMesh(Points=distributor.DistributedGeometries, Plane=pln)  # disabled
mcol_3 = MeshColours(Mesh=del_4, Colours=gradient_4)  # disabled
mesh_6 = Mesh(distributor.DistributedMeshes)  # disabled

rotate_5 = Rotate(Geometry=mesh_6, Angle=pi_2, Plane=py3_32.p)  # -> Geometry, Transform; disabled

number_slider_40 = Slider(1, range=0..3)  # disabled
weldvertices_3 = MeshWeldVertices(Mesh=rotate_5.Geometry, Tolerance=0.01)  # -> RuntimeMessage, Mesh; disabled
number_slider_41 = Slider(3, range=0..3)  # disabled
wbsplitquads_3 = WeaverbirdsConstantQuadsSplitSubdivision(MeshCurves=weldvertices_3.Mesh, Level=number_slider_40, SmoothNakedEdges=2)  # disabled
faceb_6 = FaceBoundaries(Mesh=weldvertices_3.Mesh)  # disabled
wbcatmullclark_3 = WeaverbirdsCatmullClarkSubdivision(MeshCurves=wbsplitquads_3, Level=number_slider_41, SmoothNakedEdges=2)  # disabled
preview_11 = CustomPreview(Geometry=wbcatmullclark_3, Material=swatch_20)  # disabled

rotate_6 = Rotate(Geometry=mcol_3, Angle=pi_2, Plane=py3_32.p)  # -> Geometry, Transform; disabled
rotate_7 = Rotate(Geometry=py3_33.pts_out, Angle=pi_2, Plane=py3_32.p)  # -> Geometry, Transform; disabled

cloud_4 = CloudDisplay(Points=rotate_7.Geometry, Colours=swatch_19, Size=number_slider_39, SpriteType=0)  # disabled

previewlw_10 = CustomPreviewLineweights(Geometry=faceb_6, Shader=swatch_14, Absolute=False)  # disabled

number_slider_42 = Slider(37, range=0..200)  # disabled
panel_35 = Panel("68767")  # disabled
panel_36 = Panel("3")  # disabled
number_slider_43 = Slider(4, range=0..10)  # disabled
number_slider_44 = Slider(95, range=0..200)  # disabled
scene_3 = Compas_acousticsRoomScene(objects=flatten(merge_4), sources=flatten(source_2), receivers=flatten(receiver))  # -> scene; inputs objects: list, sources: list, receivers: list, name: String; disabled; same code as scene_2
number_slider_45 = Slider(7, range=0..10)  # disabled
random = Random(Range=panel_35, Number=panel_36, Seed=2, Integers=False)  # disabled
panel_37 = Panel("255")  # disabled
number_slider_46 = Slider(3, range=0..3)  # disabled
traceraysscattered = Python3Script(scene=scene_3, ref_db=number_slider_44, target_db=number_slider_42, n_rays=number_slider_43, seed=number_slider_45)  # -> out, a; inputs ref_db: Double, target_db: Double, n_rays: Int32, seed: Int32; disabled
# ---------- traceraysscattered: Python ----------
import math
import numpy as np
from compas_acoustics import pra_converter as cpc

from compas.geometry import Point
from compas.geometry import Polyline

import pyroomacoustics as pra

from Grasshopper import DataTree
from Grasshopper.Kernel.Data import GH_Path


def random_directions(n_rays, seed=None, jitter=0.5):
    """n_rays unit direction vectors on the sphere via a jittered Fibonacci
    lattice -- much more even angular coverage per ray than i.i.d. random
    sampling, while still varying with `seed`.

    jitter : float in [0, 1]
        0 = exact deterministic lattice, no randomness.
        1 = perturbation on the order of one full lattice-cell spacing.
    """
    golden = np.pi * (3.0 - np.sqrt(5.0))
    i = np.arange(n_rays)
    z = 1.0 - 2.0 * (i + 0.5) / n_rays
    radius = np.sqrt(np.maximum(1.0 - z * z, 0.0))
    phi = i * golden

    directions = np.stack([radius * np.cos(phi), radius * np.sin(phi), z], axis=1)

    if jitter > 0:
        rng = np.random.default_rng(seed)
        cell_size = 2.0 / np.sqrt(n_rays)  # ~ spacing between neighboring lattice points
        directions += rng.normal(size=(n_rays, 3)) * cell_size * jitter
        directions /= np.linalg.norm(directions, axis=1, keepdims=True)

    return directions

def spl_at_distance(start_db, distance):
    """
    Calculate sound pressure level (Lp) in dB after geometric spreading over distance (meters).
    Only support omni directivity now.
    """
    if distance <= 0:
        return start_db

    sphere_area = 4.0 * math.pi * (distance ** 2)

    return start_db - 10.0 * math.log10(sphere_area)

def distance_between_db(from_db, to_db):
    if from_db <= to_db:
        return 0.0

    sphere_angle = 4.0 * math.pi
    exponent = (from_db - to_db) / 10.0

    return math.sqrt((10.0 ** exponent) / sphere_angle)

def trace_rays_scattered(room, sources, start_db, target_db, n_rays=50, max_order=100, seed=7, jitter=0.5):

    polyline_tree = []

    engine = room.room_engine
    walls = room.walls
    max_dist = float(engine.max_dist)

    for i, source in enumerate(sources):
        dire_lst = random_directions(n_rays, seed * (i + 1) + 7, jitter)
        
        polylines = []
        for dire in dire_lst:
            pos = np.asarray(source.position, dtype=float)
            db = start_db
            dist_travelled = 0.0
            # hits = []
            pts = [Point(*pos)]
            for _ in range(max_order):
                hit, wall_idx, hit_dist = engine.next_wall_hit(pos, pos + dire * max_dist, False)
                if wall_idx == -1:
                    break

                # Stop the loop when the sound reaches the target_db over the distance
                dist_travelled += hit_dist
                curr_spl = spl_at_distance(db, dist_travelled)
                if curr_spl <= target_db:
                    # Generate the stop point
                    dist_at_target = distance_between_db(db, target_db)
                    dist_end = dist_travelled - dist_at_target
                    pt_end = hit + (-dire * dist_end)
                    pts.append(Point(*pt_end))
                    break

                # hits.append({"point": hit, "distance": dist_travelled, "spl": curr_spl})
                pts.append(Point(*hit))
                wall_hitted = walls[wall_idx]

                # Attenuate absorption
                absorption = float(np.mean(np.asarray(wall_hitted.absorption, dtype=float)))
                remaining = 1.0 - absorption
                if remaining <= 0.0:
                    break

                db += 10.0 * math.log10(remaining)

                # Specular reflection update
                dire = np.asarray(wall_hitted.normal_reflect(dire), dtype=float)
                pos = hit

            polylines.append(Polyline(pts))
        polyline_tree.append(polylines)
    return polyline_tree

# Main code -------------
room = cpc.scene_to_pra_room(
    scene, 16000, max_order=1, ray_tracing=False, air_absorption=False
)
sources = scene.sources

polyline_tree = trace_rays_scattered(
    room, sources, ref_db, target_db, n_rays=n_rays, seed=seed
)

a = DataTree[object]()
for i, br in enumerate(polyline_tree):
    a.AddRange(br, GH_Path(i))
spl = spl_at_distance(ref_db, 283.5250)
print (spl)
# ---------- end traceraysscattered ----------
branch_5 = TreeBranch(Tree=traceraysscattered.a, Path=number_slider_46, MaintainPaths=True)  # disabled
draw = COMPASDraw(cg=traceraysscattered.a)  # -> graft(rg); disabled
#   port cg: The COMPAS geometry or datastructure to be drawn.
#   port rg: The Rhino geometry object.
# ---------- draw: Python ----------
# r: compas>=2.14.1
"""
Draws COMPAS geometry in Grasshopper.
"""

from typing import Any

import Grasshopper

from compas.scene import SceneObject


class CompasToRhinoGeometry(Grasshopper.Kernel.GH_ScriptInstance):
    def RunScript(self, cg):
        if not cg:
            return None

        return SceneObject(item=cg).draw()
# ---------- end draw ----------
number_slider_47 = Slider(3, range=0..10)  # disabled
mesh_7 = Mesh(mcol)  # disabled
mcx = MeshCurve(Mesh=mesh_7, Curve=draw)  # -> Points, Faces; disabled
crvdom = CurveDomain(Curve=draw)  # -> Curve, Domain; disabled
dedomain = DeconstructDomain(Domain=crvdom.Domain)  # -> Start, End; disabled
crv_cp = CurveClosestPoint(Point=mcx.Points, Curve=draw)  # -> Point, Parameter, Distance; disabled
dom_6 = ConstructDomain(DomainStart=dedomain.Start, DomainEnd=crv_cp.Parameter)  # disabled
subcrv = SubCurve(BaseCurve=draw, Domain=dom_6)  # disabled

rotate_8 = Rotate(Geometry=subcrv, Angle=degrees(number_slider_28), Plane=volume.Centroid)  # -> Geometry, Transform; disabled
crv = Curve(rotate_8.Geometry)  # disabled
subcrv_2 = SubCurve(BaseCurve=reparameterize(crv), Domain=dom_5)  # disabled

lng_5 = ListLength(List=flatten(crv))  # disabled
random_2 = Random(Range=Domain(0, 1), Number=lng_5, Seed=random, Integers=False)  # disabled
remap_7 = RemapNumbers(Value=random_2, Source=Domain(0, 1), Target=panel_37)  # -> simplify(Mapped), Clipped; disabled
panel_38 = Panel(lng_5)  # disabled
bang_2 = ExplodeTree(Data=remap_7.Mapped)  # -> Branch0, Branch1, Branch2; disabled
rgb = ColourRGB(Alpha=255, Red=bang_2.Branch0, Green=bang_2.Branch1, Blue=bang_2.Branch2)  # disabled
previewlw_11 = CustomPreviewLineweights(Geometry=flatten(subcrv_2), Shader=rgb, Thickness=number_slider_47, Absolute=False)  # disabled
