# Grasshopper definition Scenario_03_2.ghx (Grasshopper 1.0.8)
# plug-ins: MeshEdit Components, Chromodoris, Weaverbird, Wallacei

wlc_shell_angle = Slider(130, range=100..145)
wlc_fan_angle = Slider(161, range=160..210)
wlc_shell_angle_2 = Slider(145, range=100..145)
wlc_fan_angle_2 = Slider(207, range=160..210)
crv = Curve([<curve referenced from the Rhino model> x5])
wlc_x_offsets = GenePool(Decimals=2, Maximum=3, Minimum=0, Value=[1.12, 1.09, 1.72, 1.69, 2.25])
wlc_y_offsets = GenePool(Decimals=2, Maximum=8, Minimum=0, Value=[0.53, 1.66, 2.6, 3.78, 7.34])
divide = DivideCurve(Curve=crv, Count=Slider(7, range=0..10), Kinks=False)  # -> Points, Tangents, Parameters
pline = PolyLine(Vertices=divide.Points, Closed=False)  # -> flatten(Polyline)
loft = Loft(Curves=crv, Options={Adjust=False, Closed=False, LoftEnds=0, LoftSimp=0, LoftType=0, Rebuild=10, Refit=0.01})
mloft = MeshLoft(Polylines=pline, Cap=False)
area = Area(Geometry=loft)  # -> Area, Centroid
tri = Triangulate(Mesh=mloft)  # -> Mesh, Count
project = Project(Geometry=area.Centroid, Plane=PlaneXY(0, 0, 0))  # -> Geometry, Transform

lamcp = LAMCPBridge(enable=Toggle(True))  # -> status; inputs enable: Boolean, port: Int32
#   port enable: Toggle to start (True) or stop (False) the local HTTP server.
#   port port: Port to listen on (loopback only). Defaults to 8765.
#   port status: Current server status string.
# ---------- lamcp: Python ----------
"""
LAMCP Bridge: local HTTP server inside Rhino 8 / Grasshopper CPython.

Exposes `POST /exec` (JSON: `{"code": "...", "timeout": 30}`) which
exec()s `code` and returns
`{"stdout": "...", "stderr": "...", "result": "...", "error": null|str}`.

Pair with the `lamcp` FastMCP server, which translates Claude's
`run_python_script` MCP tool calls into POSTs to this endpoint.

Binds to 127.0.0.1 only. NEVER expose beyond localhost â€” it exec()s
arbitrary Python with full Rhino API access.

LAMCP v0.1.0
"""

import contextlib
import io
import json
import threading
import traceback
from http.server import BaseHTTPRequestHandler
from http.server import HTTPServer

import Grasshopper
import scriptcontext as sc


SHARED_GLOBALS_KEY = "_lamcp_bridge_globals"
SERVER_KEY = "_lamcp_bridge_server"


def _exec_code(code, timeout):
    """Run `code` on the HTTP-server thread and capture stdout/stderr/result.

    NOTE: this is intentionally NOT marshalled to Rhino's UI thread for the
    spike â€” `Rhino.RhinoApp.InvokeOnUiThread` was queueing actions that
    never fired in Rhino 8 CPython. Most read-only RhinoCommon access is
    safe cross-thread; mutations may crash. Add Eto-based marshalling
    back here when we need it.
    """
    out = io.StringIO()
    err = io.StringIO()
    g = sc.sticky.setdefault(SHARED_GLOBALS_KEY, {"__name__": "__lamcp_bridge__"})
    error_text = None
    result_repr = None
    try:
        with contextlib.redirect_stdout(out), contextlib.redirect_stderr(err):
            exec(code, g, g)
            result_repr = repr(g.get("_"))
    except BaseException:
        error_text = traceback.format_exc()

    return {
        "stdout": out.getvalue(),
        "stderr": err.getvalue(),
        "result": result_repr,
        "error": error_text,
    }


class _ExecHandler(BaseHTTPRequestHandler):
    # Silence default request logging so it doesn't clog the Rhino command line.
    def log_message(self, fmt, *args):
        pass

    def _send(self, code, payload):
        body = json.dumps(payload).encode("utf-8")
        self.send_response(code)
        self.send_header("Content-Type", "application/json")
        self.send_header("Content-Length", str(len(body)))
        self.end_headers()
        self.wfile.write(body)

    def do_GET(self):
        if self.path == "/health":
            self._send(200, {"status": "ok"})
        else:
            self._send(404, {"error": "not found"})

    def do_POST(self):
        if self.path != "/exec":
            self._send(404, {"error": "not found"})
            return
        length = int(self.headers.get("Content-Length", "0"))
        try:
            raw = self.rfile.read(length).decode("utf-8")
            body = json.loads(raw)
            code = body.get("code", "")
            timeout = float(body.get("timeout", 30.0))
        except Exception as exc:
            self._send(400, {"error": "bad request: " + repr(exc)})
            return
        result = _exec_code(code, timeout)
        self._send(200, result)


def _start_server(port):
    server = HTTPServer(("127.0.0.1", port), _ExecHandler)
    thread = threading.Thread(
        target=server.serve_forever, daemon=True, name="lamcp-bridge"
    )
    thread.start()
    return {"server": server, "thread": thread, "port": port}


def _stop_server(state):
    try:
        state["server"].shutdown()
        state["server"].server_close()
    except Exception:
        pass


class LamcpBridgeComponent(Grasshopper.Kernel.GH_ScriptInstance):
    def RunScript(self, enable: bool, port: int):
        port = int(port) if port else 8765

        state = sc.sticky.get(SERVER_KEY)

        if not enable:
            if state is not None:
                _stop_server(state)
                del sc.sticky[SERVER_KEY]
            return "stopped"

        # Already running on the requested port: no-op.
        if (
            state is not None
            and state.get("port") == port
            and state["thread"].is_alive()
        ):
            return "listening on http://127.0.0.1:{}".format(port)

        # Port changed or server died: tear down and restart.
        if state is not None:
            _stop_server(state)
            del sc.sticky[SERVER_KEY]

        try:
            sc.sticky[SERVER_KEY] = _start_server(port)
        except OSError as exc:
            ghenv.Component.AddRuntimeMessage(  # noqa: F821
                Grasshopper.Kernel.GH_RuntimeMessageLevel.Error,
                "Failed to bind 127.0.0.1:{}: {}".format(port, exc),
            )
            return "error: {}".format(exc)

        return "listening on http://127.0.0.1:{}".format(port)
# ---------- end lamcp ----------

reload = Python3Script(reload=Button())  # inputs reload: Boolean
# ---------- reload: Python ----------
# venv: rhino_compas_acoustics
# r: compas
# r: pyroomacoustics
# r: matplotlib
# r: librosa
# r: soundfile
# r: sounddevice
# r: sofar
# r: pyfar
# r: pyrato

import sys
import os
from compas_rhino import unload_modules


gh_path = ghenv.Component.OnPingDocument().FilePath
dire_path = os.path.dirname(os.path.dirname(gh_path))
target_path = os.path.join(dire_path, "src")

if target_path not in sys.path:
    sys.path.insert(0, target_path)

if reload:
    unload_modules('compas_acoustics')

try:
    import compas_acoustics as ca
except Exception as e:
    raise ValueError(e)
# ---------- end reload ----------

xy = XYPlane(Origin=project.Geometry)
pln = Plane(Plane(origin=(53.49523734, 7.24526873, 0), x=(0.9843087811, -0.1764545933, 0), y=(0.1764545933, 0.9843087811, 0)))
pln_2 = Plane(pln)
py3 = Python3Script(
    pln=pln_2,
    radius=Slider(5.9, range=0..10),
    pt_div=Slider(6, range=0..10),
    fan_angle=wlc_fan_angle,
    pln_div=Slider(5, range=0..10),
    shell_angle=wlc_shell_angle)  # -> out, pt_groups; inputs pln: Plane, radius: Double, pt_div: Int32, fan_angle: Double, pln_div: Int32, shell_angle: Double, offset: Double
# ---------- py3: Python ----------
import Rhino.Geometry as rg
import math


def arc_points(plane, radius, angle, division):

    if division < 2:
        division = 2

    deg_step = angle / (division - 1)

    pts = []
    for i in range(division):
        rdn = math.radians(i * deg_step + (180.0 - angle) / 2.0)
        x = radius * math.cos(rdn)
        y = radius * math.sin(rdn)
        
        pt = plane.PointAt(x, y, 0)
        pts.append(pt)
    
    return pts


def rotate_points(pts, angle):
    R = rg.Transform.Rotation(math.radians(angle), pln.XAxis, pts[0])
    
    return [pt.Transform(R) for pt in pts]


class FlatPoints:
    def __init__(self, plane, points):
        self.plane = plane
        self.points = points



# Main Code -------------
pt_groups = []

deg_step = shell_angle / (pln_div - 1)

for idx in range(pln_div):
    pts = arc_points(pln, radius, fan_angle, pt_div)

    R = rg.Transform.Rotation(math.radians(deg_step * idx), pln.XAxis, pts[0])

    for pt in pts:
        pt.Transform(R)
        
    new_pln = rg.Plane(pln)
    new_pln.Transform(R)

    pt_groups.append(FlatPoints(new_pln, pts))
# ---------- end py3 ----------
pln_3 = Plane(pln)
py3_2 = Python3Script(pt_groups=py3.pt_groups, x_offsets=wlc_x_offsets, y_offsets=wlc_y_offsets)  # -> out, a, b; inputs pt_groups: list, x_offsets: list, y_offsets: list
# ---------- py3_2: Python ----------
from Grasshopper import DataTree
from Grasshopper.Kernel.Data import GH_Path
import Rhino.Geometry as rg





# Main Code ----------------------
a = DataTree[rg.Point3d]()
b = DataTree[rg.Plane]()

for idx, flat in enumerate(pt_groups):
    path = GH_Path(idx)
    working_pts = [rg.Point3d(p) for p in flat.points]

    pts = working_pts[1:-1]
    pln = flat.plane

    # NOTE: This is hardcoded now
    for sign, j in zip((1, -1), (0, -1)):
        vec_x = x_offsets[idx] * pln.XAxis * sign
        Tx = rg.Transform.Translation(vec_x)

        pts[j].Transform(Tx)

    for j in (1, 2):
        vec_y = y_offsets[idx] * pln.YAxis
        Ty = rg.Transform.Translation(vec_y)
        pts[j].Transform(Ty)


    a.AddRange(working_pts, path)
    b.Add(flat.plane, path)
# ---------- end py3_2 ----------
py3_3 = Python3Script(
    pln=pln_3,
    radius=Slider(5.9, range=0..10),
    pt_div=Slider(6, range=0..10),
    fan_angle=wlc_fan_angle_2,
    pln_div=Slider(5, range=0..10),
    shell_angle=wlc_shell_angle_2)  # -> out, pt_groups; inputs pln: Plane, radius: Double, pt_div: Int32, fan_angle: Double, pln_div: Int32, shell_angle: Double, offset: Double; same code as py3
py3_4 = Python3Script(pt_groups=py3_3.pt_groups, x_offsets=wlc_x_offsets, y_offsets=wlc_y_offsets)  # -> out, a, b; inputs pt_groups: list, x_offsets: list, y_offsets: list; same code as py3_2
pline_2 = PolyLine(Vertices=py3_2.a, Closed=False)  # -> flatten(Polyline)
pln_4 = Plane(PlaneXY(122.7538795, -3.740785054, 0))
py3_5 = Python3Script(x=py3_3.pt_groups)  # -> out, a
# ---------- py3_5: Python ----------
a = x.points
# ---------- end py3_5 ----------
orient = Orient(Geometry=tri.Mesh, Source=xy, Target=pln)  # -> Geometry, Transform
pline_3 = PolyLine(Vertices=py3_4.a, Closed=False)  # -> flatten(Polyline)
branch = TreeBranch(Tree=py3_4.a, Path="0", MaintainPaths=True)
deplane = DeconstructPlane(Plane=pln)  # -> Origin, XAxis, YAxis, ZAxis
pline_4 = PolyLine(Vertices=py3_5.a, Closed=False)  # -> flatten(Polyline)
deplane_2 = DeconstructPlane(Plane=pln)  # -> Origin, XAxis, YAxis, ZAxis
rev = Reverse(Vector=deplane.YAxis)
mloft_2 = MeshLoft(Polylines=pline_3, Cap=False)
del = DelaunayMesh(Points=branch, Plane=PlaneXY(0, 0, 0))
neg = Negative(Value=Slider(0, range=0..10))
amp = Amplitude(Vector=deplane_2.YAxis, Amplitude=neg)
mloft_3 = MeshLoft(Polylines=pline_4, Cap=False)
amp_2 = Amplitude(Vector=rev, Amplitude=Slider(40, range=0..100))
move = Move(Geometry=pln, Motion=amp)  # -> Geometry, Transform
mjoin = MeshJoin(Meshes=flatten([mloft_2, del]))
clean = CombineClean(Meshes=mloft_3)
move_2 = Move(Geometry=pln, Motion=amp_2)  # -> Geometry, Transform
clean_2 = CombineClean(Meshes=mjoin)
py3_6 = Python3Script(base_pln=move_2.Geometry, width=Slider(100, range=0..100), depth=Slider(100, range=0..100), height="18")  # -> out, box; inputs base_pln: Plane, width: Double, depth: Double, height: Double
# ---------- py3_6: Python ----------
import Rhino.Geometry as rg


box = rg.Box(
    base_pln,
    rg.Interval(- width / 2, width / 2),
    rg.Interval(- depth / 2, depth / 2),
    rg.Interval(-1, height - 1)
)
# ---------- end py3_6 ----------

# ----
# OLD Stage
srf = Surface([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])  # disabled
crv_2 = Curve(srf)  # disabled
disc = Discontinuity(Curve=crv_2, Level=1)  # -> Points, Parameters; disabled
pline_5 = PolyLine(Vertices=disc.Points, Closed=invert(False))  # -> flatten(Polyline); disabled
flip = FlipCurve(Curve=pline_5)  # -> Curve, Flag; disabled
merge = Merge(Data1=pline_5, Data2=flip.Curve)  # disabled

mesh = Mesh(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)
tri_2 = Triangulate(Mesh=clean_2)  # -> Mesh, Count
panel = Panel("""0.1
0.07
0.05
0.04
0.04
0.03
0.03""")

triremesh = TriRemesh(Geometry=clean_2, Iterations=25)  # -> Triangulation, Dual, Creases
wbcatmullclark = WeaverbirdsCatmullClarkSubdivision(MeshCurves=triremesh.Triangulation, Level=1, SmoothNakedEdges=1)
faceb = FaceBoundaries(Mesh=wbcatmullclark)
preview = CustomPreview(Geometry=wbcatmullclark, Material=ColourSwatch(SwatchColor=RGB(145, 145, 145)))

chamber_strings_16 = Compas_acousticsOrchestraLayout(plane=pln)  # -> points, names; inputs plane: Plane
#   port plane: Plane the layout is built on. Defaults to WorldXY if omitted.
#   port points: Named performer positions.
#   port names: Names matching each point, e.g. 'violin_1'.
# ---------- chamber_strings_16: Python ----------
"""Named performer positions for a standard string ensemble formation, for use as Source/Receiver positions.

Options:
- string_quartet (4 players)
- chamber_strings (16 players)
- chamber_strings_24 (24 players)
- symphonic_strings_50 (50 players)"""
# flake8: noqa
import Grasshopper
import Rhino
from Rhino.Geometry import Point3d
from System.Windows.Forms import ToolStripSeparator

from compas_rhino.conversions import plane_to_compas_frame

from compas_acoustics.orchestra_layouts import (
    string_quartet,
    chamber_strings,
    medium_chamber_strings,
    symphonic_strings,
)


class OrchestraLayoutSelector(Grasshopper.Kernel.GH_ScriptInstance):
    LAYOUTS = {
        "string_quartet_4": string_quartet,
        "chamber_strings_16": chamber_strings,
        "chamber_strings_24": medium_chamber_strings,
        "symphonic_strings_50": symphonic_strings,
    }
    ITEMS = list(LAYOUTS.keys())

    def __init__(self):
        super().__init__()
        nickname = ghenv.Component.NickName
        self.layout_name = nickname if nickname in self.ITEMS else None

    def RunScript(self, plane: Rhino.Geometry.Plane):
        if self.layout_name not in self.ITEMS:
            ghenv.Component.AddRuntimeMessage(
                Grasshopper.Kernel.GH_RuntimeMessageLevel.Remark, "Right-click the icon to choose an orchestra layout."
            )
            ghenv.Component.Message = None
            return

        ghenv.Component.Message = self.layout_name
        frame = plane_to_compas_frame(plane) if plane is not None else None

        layout_fn = self.LAYOUTS[self.layout_name]
        points, names = layout_fn(frame)
        return [Point3d(*p) for p in points], names
    
    def AppendAdditionalMenuItems(self, menu):
        for name in self.ITEMS:
            item = menu.Items.Add(name, None, self.on_item_click)
            item.Checked = (name == self.layout_name)

        menu.Items.Add(ToolStripSeparator())

    def on_item_click(self, sender, event_info):
        name = str(sender)
        if name == self.layout_name:
            return
        self.layout_name = name
        ghenv.Component.NickName = name
        ghenv.Component.ExpireSolution(True)
# ---------- end chamber_strings_16 ----------
mesh_2 = Mesh(tri_2.Mesh)

# ----
# Simulation Boundary
panel_2 = Panel("7")
smesh = SimpleMesh(Brep=py3_6.box)
panel_3 = Panel("""0.15
0.25
0.40
0.60
0.75
0.85
0.90""")
panel_4 = Panel("""0.10
0.15
0.25
0.35
0.50
0.65
0.75""")
faceb_2 = FaceBoundaries(Mesh=smesh)
repeat = RepeatData(Data="1", Length=panel_2)
repeat_2 = RepeatData(Data="0", Length=panel_2)
conmat = Compas_acousticsConstructMaterial(absorption=repeat, scattering=repeat_2, name="air")  # -> material; inputs absorption: list of Double, scattering: list of Double, name: String
#   port absorption: List of absorption coefficients for each frequency band. e.g. '0.1, 0.2, 0.3, 0.4, 0.5, 0.6, 0.7' for 7 frequency bands.
#   port scattering: Optional. List of scattering coefficients for each frequency band. e.g. '0.1, 0.2, 0.3, 0.4, 0.5, 0.6, 0.7' for 7 frequency bands.
#   port name: Name of the material preset in the library (e.g. 'concrete', 'carpet').
#   port material: AcousticMaterial object.
# ---------- conmat: Python ----------
"""Create an AcousticMaterial for AcousticObject(s)."""
# flake8: noqa
import Grasshopper
import System
from compas_acoustics.acoustic_material import AcousticMaterial


class ConstructMaterial(Grasshopper.Kernel.GH_ScriptInstance):

    def RunScript(self,
            absorption: System.Collections.Generic.List[float],
            scattering: System.Collections.Generic.List[float],
            name: str):
        if absorption is None:
            ghenv.Component.AddRuntimeMessage(
                Grasshopper.Kernel.GH_RuntimeMessageLevel.Warning,
                "Input parameter 'absorption' failed to collect data."
            )
            return
        if name is None:
            ghenv.Component.AddRuntimeMessage(
                Grasshopper.Kernel.GH_RuntimeMessageLevel.Warning,
                "Input parameter 'name' failed to collect data."
            )
            return

        return AcousticMaterial(
            name=name,
            absorption_coefficients=absorption,
            scattering_coefficients=scattering,
        )
# ---------- end conmat ----------
conmat_2 = Compas_acousticsConstructMaterial(absorption=panel_3, scattering=panel_4, name="grass")  # -> material; inputs absorption: list of Double, scattering: list of Double, name: String; same code as conmat
item = ListItem(List=faceb_2, Index="4", Wrap=True)
cull_i = CullIndex(List=faceb_2, Indices="4", Wrap=True)
obj = Compas_acousticsAcousticObject(geometry=cull_i, material=conmat)  # -> acoustic_object; inputs geometry: GeometryBase, name: String
#   port geometry: Geometry of the AcousticObject.
#   port material: Material of the AcousticObject.
#   port name: Name of the AcousticObject.
#   port acoustic_object: AcousticObject object.
# ---------- obj: Python ----------
"""Create an AcousticObject with the specified geometry and material."""
# flake8: noqa
import Grasshopper
import Rhino
from compas_acoustics.geometry import AcousticObject
from compas_rhino.conversions import mesh_to_compas
from compas_rhino.conversions import polyline_to_compas

# TODO: Change the typeHintID in metadata.json from "mesh" to "geometrybase"

class CreateAcousticObject(Grasshopper.Kernel.GH_ScriptInstance):

    def RunScript(self, geometry: Rhino.Geometry.GeometryBase, material, name: str):

        if geometry is None:
            ghenv.Component.AddRuntimeMessage(
                Grasshopper.Kernel.GH_RuntimeMessageLevel.Warning, "No geometry provided."
            )
            return
        if material is None:
            ghenv.Component.AddRuntimeMessage(
                Grasshopper.Kernel.GH_RuntimeMessageLevel.Warning, "No material provided."
            )
            return

        # Gemetry conversion from Rhino to Compas
        # TODO: Figure out how to handle other geometry types (e.g., Brep, Surface, etc.)
        if isinstance(geometry, Rhino.Geometry.Mesh):
            geometry = mesh_to_compas(geometry)
        elif isinstance(geometry, Rhino.Geometry.Polyline):
            geometry = polyline_to_compas(geometry)
        elif isinstance(geometry, Rhino.Geometry.PolylineCurve):
            geometry = polyline_to_compas(geometry.ToPolyline())
        else:
            ghenv.Component.AddRuntimeMessage(
                Grasshopper.Kernel.GH_RuntimeMessageLevel.Error, "Unsupported geometry type."
            )
            return
        return AcousticObject(acoustic_geometry=geometry, material=material, name=name)
# ---------- end obj ----------
obj_2 = Compas_acousticsAcousticObject(geometry=item, material=conmat_2)  # -> acoustic_object; inputs geometry: GeometryBase, name: String; same code as obj

debrep = DeconstructBrep(Brep=py3_6.box)  # -> Faces, Edges, Vertices
panel_5 = Panel("1.5")  # disabled
number_slider = Slider(0.4, range=0..1)  # disabled
item_2 = ListItem(List=debrep.Faces, Index="4", Wrap=True)
number_slider_2 = Slider(100, range=0..100)  # disabled
Z = UnitZ(Factor=panel_5)  # disabled
neg_2 = Negative(Value=number_slider)  # disabled
move_3 = Move(Geometry=item_2, Motion=Z)  # -> Geometry, Transform; disabled
offset = OffsetCurve(Curve=move_3.Geometry, Distance=neg_2, Corners=1)  # disabled
mesh_uv = MeshSurface(Surface=move_3.Geometry, UCount=number_slider_2, VCount=number_slider_2, Overhang=True, Equalize=False)  # disabled
demesh = DeconstructMesh(Mesh=mesh_uv)  # -> Vertices, Faces, Colours, Normals; disabled

panel_6 = Panel("""0.01
0.04
0.15
0.45
0.77
0.8
0.8""")

mesh_3 = Mesh(mesh_2)  # disabled
flip_2 = MeshFlip(Mesh=mesh_3)  # disabled
merge_2 = Merge(Data1=mesh_3, Data2=flip_2)  # disabled

avr = Average(Input=chamber_strings_16.points)

# ----
# Audiences (1m space)
number_slider_3 = Slider(1, range=0..2)
pi = Pi(Factor=1)
prot = RotatePlane(Plane=move.Geometry, Angle=pi)
py3_7 = Python3Script(
    pln=prot,
    dist_min="8.0",
    dist_max=Slider(40, range=0..100),
    theta_fan=Slider(90, range=60..100),
    row_spacing=Slider(1, range=0..2),
    seat_spacing=number_slider_3,
    rake_slope=Slider(0, range=0..1))  # -> out, a; inputs pln: Plane, dist_min: Double, dist_max: Double, theta_fan: Double, row_spacing: Double, seat_spacing: Double, rake_slope: Double
# ---------- py3_7: Python ----------
import math
from Grasshopper import DataTree
from Grasshopper.Kernel.Data import GH_Path
import Rhino.Geometry as rg


def create_fan_receiver_grid(
    base_plane=rg.Plane.WorldXY,
    d_min=4.0,
    d_max=30.0,
    theta_fan=90.0,
    row_spacing=1.0,
    seat_spacing=1.0,
    receiver_height=1.2,
    rake_slope=0.1,  # 10% slope for sightline elevation clearance
    as_tree=True,
):
    """Generates an annular-sector receiver grid on a given Rhino Plane.

    Parameters:
    - base_plane: rg.Plane (Stage origin center, X=Right, Y=Facing Audience, Z=Up)
    - d_min: float (Distance to first row in meters)
    - d_max: float (Distance to last row in meters)
    - theta_fan: float (Total fan opening angle in degrees, e.g., 60-100)
    - row_spacing: float (Radial distance between seating rows in meters)
    - seat_spacing: float (Approximate lateral distance between receivers in meters)
    - receiver_height: float (Ear height above ground, standard = 1.2m)
    - rake_slope: float (Vertical rise per horizontal meter, e.g. 0.0 for flat, 0.1 for sloped)
    - as_tree: bool (True: DataTree with branch per row; False: flat list)
    """
    half_angle_rad = math.radians(theta_fan / 2.0)
    total_depth = max(0.1, d_max - d_min)
    num_rows = max(1, int(math.ceil(total_depth / row_spacing)) + 1)

    pt_tree = DataTree[rg.Point3d]()
    pt_flat = []

    for row_idx in range(num_rows):
        r = d_min + row_idx * row_spacing
        if r > d_max:
            r = d_max

        # Arc length at this radius
        arc_len = 2.0 * half_angle_rad * r
        num_seats = max(2, int(math.ceil(arc_len / seat_spacing)) + 1)

        # Elevation based on rake slope + ear height
        z_offset = (r - d_min) * rake_slope + receiver_height
        path = GH_Path(row_idx)

        for s_idx in range(num_seats):
            # Parameter t from -1.0 (left) to 1.0 (right)
            t = (
                -1.0 + (2.0 * s_idx / (num_seats - 1))
                if num_seats > 1
                else 0.0
            )
            angle = t * half_angle_rad

            # Local coordinates relative to stage plane
            # Stage facing Y-positive: X = r*sin(angle), Y = r*cos(angle)
            lx = r * math.sin(angle)
            ly = r * math.cos(angle)
            lz = z_offset

            # Map local (lx, ly, lz) to 3D world coordinates on base_plane
            world_pt = base_plane.PointAt(lx, ly, lz)

            if as_tree:
                pt_tree.Add(world_pt, path)
            else:
                pt_flat.append(world_pt)

        if r >= d_max:
            break

    return pt_tree if as_tree else pt_flat


# --- Grasshopper Component Inputs / Execution ---
# Connect 'Plane' (or default WorldXY) to P
stage_plane = pln if pln is not None else rg.Plane.WorldXY

# Run generator
receivers_tree = create_fan_receiver_grid(
    base_plane=stage_plane,
    d_min=dist_min,
    d_max=dist_max,
    theta_fan=theta_fan,
    row_spacing=row_spacing,
    seat_spacing=seat_spacing,
    receiver_height=-0.4,
    rake_slope=rake_slope,
    as_tree=True,
)

# Output
a = receivers_tree
# ---------- end py3_7 ----------
pt = Point(py3_7.a)
receiver = Compas_acousticsReceiver(position=pt)  # -> receiver; inputs position: Point3d, name: String
#   port position: Position of the receiver.
#   port name: Name of the receiver.
#   port receiver: Receiver object.
# ---------- receiver: Python ----------
"""Acoustic Receiver object (microphone, human ear, etc.)."""
# flake8: noqa
import Grasshopper
import Rhino
from compas_acoustics import Receiver

# TODO: Implement direction
class CreateReceiver(Grasshopper.Kernel.GH_ScriptInstance):

    def RunScript(self, position: Rhino.Geometry.Point3d, name: str):
        if position is None:
            position = Rhino.Geometry.Point3d(0, 0, 1)
        if name is None:
            name = "my_receiver"

        return Receiver(name, *position)
# ---------- end receiver ----------

tag = TextTag(Location=chamber_strings_16.points, Text=chamber_strings_16.names)  # disabled
conmat_3 = Compas_acousticsConstructMaterial(absorption=panel, scattering=panel_6, name="stage_reflect")  # -> material; inputs absorption: list of Double, scattering: list of Double, name: String; same code as conmat
omnidirectional = Compas_acousticsDirectivity()  # -> directivity
#   port directivity: Directivity pattern.
# ---------- omnidirectional: Python ----------
"""Preset picker for directivity patterns. Right-click to choose a pattern from the available options."""
# flake8: noqa
import Grasshopper
from System.Windows.Forms import ToolStripSeparator
from compas_acoustics.materials_library import MaterialsLibrary


class DirectivitySelector(Grasshopper.Kernel.GH_ScriptInstance):
    ITEMS = ["Bidirectional", "Hypercardioid", "Supercardioid", "Cardioid", "Omnidirectional"]

    def __init__(self):
        super().__init__()
        nickname = ghenv.Component.NickName
        self.directivity_name = nickname if nickname in self.ITEMS else None

    def RunScript(self):
        names = self.ITEMS
        if not names:
            ghenv.Component.AddRuntimeMessage(
                Grasshopper.Kernel.GH_RuntimeMessageLevel.Error, "No directivity patterns found."
            )
            return None

        if self.directivity_name not in names:
            ghenv.Component.AddRuntimeMessage(
                Grasshopper.Kernel.GH_RuntimeMessageLevel.Remark, "Right-click the icon to choose a directivity pattern."
            )
            ghenv.Component.Message = None
            return None

        ghenv.Component.Message = self.directivity_name
        return self.directivity_name.lower()

    def AppendAdditionalMenuItems(self, menu):
        for name in self.ITEMS:
            item = menu.Items.Add(name, None, self.on_item_click)
            item.Checked = (name == self.directivity_name)

        menu.Items.Add(ToolStripSeparator())

    def on_item_click(self, sender, event_info):
        name = str(sender)
        if name == self.directivity_name:
            return
        self.directivity_name = name
        ghenv.Component.NickName = name
        ghenv.Component.ExpireSolution(True)
# ---------- end omnidirectional ----------
dots = DotDisplay(Point=avr, Colour=RGB(0, 0, 0), Size=0.2)
source = Compas_acousticsSource(position=avr, directivity=omnidirectional, name="test_spl_src")  # -> source; inputs position: Point3d, direction: Vector3d, directivity: String, name: String, sound_file: String
#   port position: Position of the source.
#   port direction: Direction of the source.
#   port directivity: Directivity of the source. Default is Omnidirectional. Options: - Bidirectional - Hypercardioid - Supercardioid - Cardioid - Omnidirectional
#   port name: Name of the source.
#   port sound_file: Sound file associated with the source.
#   port source: Source object.
# ---------- source: Python ----------
"""Acoustic Source object (speaker, human, etc.)."""
# flake8: noqa
import Grasshopper
import Rhino
from compas_acoustics import Source


class CreateSource(Grasshopper.Kernel.GH_ScriptInstance):
    ITEMS = ["bidirectional", "hypercardioid", "supercardioid", "cardioid", "omnidirectional"]

    def RunScript(self,
            position: Rhino.Geometry.Point3d,
            direction: Rhino.Geometry.Vector3d,
            directivity: str,
            name: str,
            sound_file: str):
        if position is None:
            position = Rhino.Geometry.Point3d(0, 0, 0)
        if direction is None:
            direction = Rhino.Geometry.Vector3d(1, 0, 0)

        if directivity is None:
            dirt = "omnidirectional"
        elif directivity not in self.ITEMS:
            ghenv.Component.AddRuntimeMessage(
                Grasshopper.Kernel.GH_RuntimeMessageLevel.Error, "Input parameter 'directivity' is not valid."
            )
            return None
        else:
            dirt = directivity

        if name is None:
            name = "my_source"

        return Source(
            name,
            *position,
            directivity=dirt,
            direction=[*direction],
            sound_file=sound_file
        )
# ---------- end source ----------
obj_3 = Compas_acousticsAcousticObject(geometry=mesh_2, material=conmat_3, name="stage")  # -> acoustic_object; inputs geometry: GeometryBase, name: String; same code as obj
merge_3 = Merge(Data1=obj, Data2=obj_2, Data3=obj_3)
scene = Compas_acousticsRoomScene(objects=flatten(merge_3), sources=flatten(source), receivers=flatten(receiver))  # -> scene; inputs objects: list, sources: list, receivers: list, name: String
#   port objects: List of AcousticObject
#   port sources: List of Source objects.
#   port receivers: List of Receiver objects.
#   port name: Name of the room scene.
#   port scene: Room scene object.
# ---------- scene: Python ----------
"""Create a room scene with the specified objects, sources, and receivers."""
# flake8: noqa
import Grasshopper

import System
from compas_acoustics.scene import Scene
from compas_acoustics.source import Source
from compas_acoustics.receiver import Receiver


class CreateModelScene(Grasshopper.Kernel.GH_ScriptInstance):

    def RunScript(self,
            objects: System.Collections.Generic.List[object],
            sources: System.Collections.Generic.List[object],
            receivers: System.Collections.Generic.List[object],
            name: str):

        if objects is None:
            ghenv.Component.AddRuntimeMessage(
                Grasshopper.Kernel.GH_RuntimeMessageLevel.Warning, "No objects provided."
            )
            return
        if sources is None:
            ghenv.Component.AddRuntimeMessage(
                Grasshopper.Kernel.GH_RuntimeMessageLevel.Warning, "No sources provided."
            )
            return
        if receivers is None:
            ghenv.Component.AddRuntimeMessage(
                Grasshopper.Kernel.GH_RuntimeMessageLevel.Warning, "No receivers provided."
            )
            return

        scene = Scene(name=name)
        scene.add_acoustic_objects(objects)
        for src in sources:
            if isinstance(src, Source):
                scene.add_source(src)
            else:
                ghenv.Component.AddRuntimeMessage(
                    Grasshopper.Kernel.GH_RuntimeMessageLevel.Error,
                    f"Invalid source type: {type(src)}. Expected a Source object.",
                )
        for rcv in receivers:
            if isinstance(rcv, Receiver):
                scene.add_receiver(rcv)
            else:
                ghenv.Component.AddRuntimeMessage(
                    Grasshopper.Kernel.GH_RuntimeMessageLevel.Error,
                    f"Invalid receiver type: {type(rcv)}. Expected a Receiver object.",
                )

        return scene
# ---------- end scene ----------

number_slider_4 = Slider(5, range=0..10)  # disabled
number_slider_5 = Slider(5000, range=0..10000)  # disabled
number_slider_6 = Slider(7, range=0..10)  # disabled
panel_7 = Panel("1e-05")  # disabled
panel_8 = Panel("3")  # disabled
simrt = Compas_acousticsSimulateRayTracing(
    scene=scene,
    max_order=panel_8,
    n_rays=number_slider_5,
    energy_thres=panel_7,
    time_thres=number_slider_4,
    seed=number_slider_6)  # -> ir_graph; inputs sample_rate: Int32, max_order: Int32, n_rays: Int32, absorb_air: Boolean, energy_thres: Double, time_thres: Double, seed: Int32; disabled
#   port scene: Room scene object.
#   port sample_rate: Sample rate for the simulation.
#   port max_order: Maximum order of image sources.
#   port n_rays: Number of rays for ray tracing.
#   port absorb_air: Whether to consider air absorption.
#   port energy_thres: Energy threshold for ray tracing.
#   port time_thres: Time threshold for ray tracing.
#   port seed: Random seed for reproducibility.
#   port ir_graph: Impulse response graph structure.
# ---------- simrt: Python ----------
"""Simulate room acoustics using Image Source Method (ISM) and Ray Tracing (RT) to generate impulse response graph structure."""
# flake8: noqa
import Grasshopper

from compas_acoustics.simulator import Simulator

class SimulateRayTracing(Grasshopper.Kernel.GH_ScriptInstance):

    def RunScript(self,
            scene,
            sample_rate: int,
            max_order: int,
            n_rays: int,
            absorb_air: bool,
            energy_thres: float,
            time_thres: float,
            seed: int):

        if scene is None:
            ghenv.Component.AddRuntimeMessage(
                Grasshopper.Kernel.GH_RuntimeMessageLevel.Warning, "Input parameter 'scene' failed to collect data."
            )
            return

        if max_order is None:
            max_order = 2
        if n_rays is None:
            n_rays = 1000
        if absorb_air is None:
            absorb_air = True
        if energy_thres is None:
            energy_thres = 1e-7
        if time_thres is None:
            time_thres = 10.0

        sim = Simulator(scene)
        if sample_rate is not None:
            sim.sampling_rate = sample_rate

        sim.rir_from_ray_tracing(
            image_source_order=max_order,
            n_rays=n_rays,
            air_absorption=absorb_air,
            energy_thres=energy_thres,
            time_thres=time_thres,
            random_seed=seed,
        )

        ghenv.Component.Message = "{}Hz, order={}, rays={}, air={}, seed={}, energy_thres={}, time_thres={}".format(
            sim.sampling_rate, max_order, n_rays, absorb_air, seed if seed is not None else "random", energy_thres, time_thres
        )

        return sim.scene.ir_graph
# ---------- end simrt ----------
number_slider_7 = Slider(91, range=0..100)  # disabled
splfromirgraph = SPLFromIRGraph(ir_graph=simrt, reference_db=number_slider_7)  # -> spl_db, is_valid, positions, energies; inputs receiver_idx: list; disabled
# ---------- splfromirgraph: Python ----------
import math
import Grasshopper


class Script_Instance(Grasshopper.Kernel.GH_ScriptInstance):

    def RunScript(self,
            ir_graph,
            receiver_idx: list[object],
            reference_energy,
            reference_db):
        if ir_graph is None:
            ghenv.Component.AddRuntimeMessage(
                Grasshopper.Kernel.GH_RuntimeMessageLevel.Warning, "Input parameter 'ir_graph' failed to collect data."
            )
            return None, None, None, None

        receiver_list = [
            ir_graph.node_attribute(node, 'data')
            for node in ir_graph.nodes()
            if ir_graph.node_attribute(node, 'type') == 'receiver'
        ]
        receiver_set = {rec.guid for rec in receiver_list}

        ir_group = {}
        source_group = {}
        for u, v in ir_graph.edges():
            ir = ir_graph.edge_attribute((u, v), 'data')
            data_u = ir_graph.node_attribute(u, 'data')
            data_v = ir_graph.node_attribute(v, 'data')
            if data_u.guid in receiver_set:
                rec, src = data_u, data_v
            elif data_v.guid in receiver_set:
                rec, src = data_v, data_u
            else:
                continue
            ir_group.setdefault(rec.guid, []).append(ir)
            source_group.setdefault(rec.guid, []).append(src)

        indices = list(range(len(receiver_list))) if receiver_idx is None else receiver_idx

        def distance(a, b):
            return ((a.x - b.x) ** 2 + (a.y - b.y) ** 2 + (a.z - b.z) ** 2) ** 0.5

        def broadband_spl(source):
            # Energy-average across bands so a flat 120 dB source stays 120 dB broadband.
            bands = source.spl if isinstance(source.spl, (list, tuple)) else [source.spl]
            mean_energy = sum(10.0 ** (b / 10.0) for b in bands) / len(bands)
            return 10.0 * math.log10(mean_energy)

        energies = []
        nearest = []  # (distance, source) per receiver, for auto-calibration
        for idx in indices:
            rec = receiver_list[idx]
            irs = ir_group.get(rec.guid, [])
            srcs = source_group.get(rec.guid, [])
            total_energy = sum(float((response.ir ** 2).sum()) for response in irs)
            energies.append(total_energy)
            if srcs:
                d, s = min(((distance(rec, s), s) for s in srcs), key=lambda t: t[0])
            else:
                d, s = None, None
            nearest.append((d, s))

        # Auto-calibration (used unless you override both reference_* inputs):
        # anchor 0 dB physically using the receiver closest to its source, where
        # direct sound dominates, plus the known Source.spl level and free-field
        # 20*log10(distance) falloff -- no manual reference values required.
        candidates = [
            (d, e, s) for (d, s), e in zip(nearest, energies)
            if d is not None and e > 0
        ]
        auto_energy = auto_db = None
        if candidates:
            d_min, e_min, s_min = min(candidates, key=lambda c: c[0])
            auto_energy = e_min
            auto_db = broadband_spl(s_min) - 20.0 * math.log10(max(d_min, 1e-6))

        e_ref = reference_energy if (reference_energy is not None and reference_energy > 0) else auto_energy
        db_offset = reference_db if reference_db is not None else auto_db

        if e_ref is None or e_ref <= 0:
            positive = [e for e in energies if e > 0]
            e_ref = max(positive) if positive else 1.0
        if db_offset is None:
            db_offset = 0.0

        spl_db, is_valid = [], []
        for e in energies:
            if e <= 0:
                spl_db.append(None)
                is_valid.append(False)
            else:
                spl_db.append(db_offset + 10.0 * math.log10(e / e_ref))
                is_valid.append(True)

        positions = [receiver_list[idx] for idx in indices]

        ghenv.Component.Message = "auto-cal: {:.1f} dB @ {:.2f} m".format(
            auto_db, [d for d, s in nearest if d is not None][0]
        ) if (reference_db is None and auto_db is not None) else "manual reference"

        return spl_db, is_valid, positions, energies
# ---------- end splfromirgraph ----------

# ----
# Sound Pressure levels by ISM
number_slider_8 = Slider(95, range=0..150)
expression = Expression(x=number_slider_3, Expression="x * 0.6")
splsfromimagesourcemethod = Python3Script(
    scene=scene,
    ref_db=number_slider_8,
    target_db=Slider(40, range=0..150),
    radius=expression,
    max_order=Slider(2, range=0..2))  # -> out, spls; inputs ref_db: Double, target_db: Double, radius: Double, max_order: Int32
# ---------- splsfromimagesourcemethod: Python ----------
import numpy as np
from compas_acoustics.pra_converter import source_to_pra
from compas_acoustics.pra_converter import receivers_to_pra_mic_array
from compas_acoustics.pra_converter import scene_to_pra_room

def spls_from_image_source_method(room, sources, receivers, start_db, target_db):
    """
    Deterministic alternative to trace_rays_to_receivers, for use inside
    optimization loops where a noisy, n_rays-dependent objective is a
    problem: uses pyroomacoustics's compiled image-source engine to find
    every exact specular reflection path from each source to each receiver,
    up to room.max_order. No random sampling -- the same geometry always
    gives the same result.

    room must have been constructed with the reflection order you want,
    e.g. `scene_to_pra_room(scene, fs, max_order=3, ...)` -- max_order
    is baked into the compiled room engine at construction and cannot be
    changed on the room object afterwards.
    """
    for rcv in receivers:
        rcv.received_spls = []

    for source in sources:
        room.add_soundsource(source_to_pra(source))
    room.add_microphone_array(receivers_to_pra_mic_array(receivers, sample_rate=room.fs))

    room.image_source_model()

    rcv_positions = np.array([rcv.position for rcv in receivers], dtype=float)
    rcv_radii = np.array([rcv.radius for rcv in receivers], dtype=float)

    for si, src in enumerate(room.sources):
        n_images = src.images.shape[1]
        if n_images == 0:
            continue

        # damping is amplitude-domain; square + band-average to get the
        # broadband energy reflection coefficient, matching how absorption
        # is averaged everywhere else in this module.
        energy_damping = np.mean(src.damping ** 2, axis=0)
        damping_db = 10.0 * np.log10(np.maximum(energy_damping, 1e-30))
        visible = np.asarray(room.visibility[si]).astype(bool)

        # Every (receiver, image source) pair at once: (n_receivers, n_images).
        diffs = src.images[None, :, :] - rcv_positions[:, :, None]
        distances = np.linalg.norm(diffs, axis=1)
        # Clamp to each receiver's own radius -- see the same clamp in
        # trace_rays_to_receivers for why (spl_at_distance is unbounded as
        # distance -> 0, and a receiver isn't a point).
        distances = np.maximum(distances, rcv_radii[:, None])

        raw_spls = start_db - 10.0 * np.log10(4.0 * np.pi * distances ** 2) + damping_db[None, :]
        mask = visible & (raw_spls > target_db)

        rows, cols = np.nonzero(mask)
        for m, k in zip(rows, cols):
            receivers[m].received_spls.append(float(raw_spls[m, k]))

    return [rcv.total_spl for rcv in receivers]


# Main code
room = scene_to_pra_room(
    scene, 16000, max_order=max_order, ray_tracing=False, air_absorption=False
)
sources = scene.sources
receivers = scene.receivers

if radius is not None:
    for rcv in receivers:
        rcv.radius = radius

spls = spls_from_image_source_method(
    room, sources, receivers, ref_db, target_db
)
# ---------- end splsfromimagesourcemethod ----------

# ---- group: 30 x 30, 40 - 90
w_o_stage = Mesh(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)  # disabled
w_top_sides = Mesh(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)  # disabled
w_top = Mesh(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)  # disabled

# ---- group: 30 x 30, 50 - 90
w_top_2 = Mesh(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)  # disabled
w_top_sides_2 = Mesh(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)  # disabled
w_o_stage_2 = Mesh(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)  # disabled

# ----
pt_2 = Point(flatten(pt))
filteredpoints = Python3Script(pts=pt_2, spls=splsfromimagesourcemethod.spls, target_db=Slider(65, range=0..100))  # -> out, pts_out; inputs pts: list of Point3d, spls: list, target_db: Double
# ---------- filteredpoints: Python ----------
pts_out = [pt for pt, spl in zip(pts, spls) if spl >= target_db]
# ---------- end filteredpoints ----------
pt_3 = Point(filteredpoints.pts_out)
lng = ListLength(List=pt_3)
panel_9 = Panel(lng)
neg_3 = Negative(Value=lng)
wlc_maximize_receiver_count = Number(neg_3)
wallacei_x = WallaceiX(
    Genes=[wlc_x_offsets, wlc_y_offsets, wlc_fan_angle_2, wlc_shell_angle_2],
    Objectives=wlc_maximize_receiver_count,
    allFitness="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",
    allFrontIdx="18|0",
    allGenomes="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",
    curFrontIdx="19|0",
    curFrontIdxSave="0|28;1|0;1|1;2|0;2|1;3|0;4|0;5|0;6|0;7|0;8|0;9|0;10|0;11|0;11|1;12|0;12|1;12|2;13|0;14|0;14|1;15|0;16|0;17|0;18|0;19|0",
    popGen="30,20",
    total="1144766",
    wlcDone=True)  # -> WallaceiGenomes, FitnessValues, Data, WPhenotypes
sort = SortList(Keys=splsfromimagesourcemethod.spls)  # -> Keys, ValuesA
panel_10 = Panel(sort.Keys)
num = Number(splsfromimagesourcemethod.spls)
gradient = Gradient(
    LowerLimit=number_slider_8,
    UpperLimit=Slider(50, range=0..100),
    Parameter=num,
    stops=[0: RGB(234, 38, 0), 0.25: RGB(234, 126, 0), 0.5: RGB(254, 244, 84), 0.75: RGB(173, 203, 249), 1: RGB(75, 107, 169)])
del_2 = DelaunayMesh(Points=pt_2, Plane=PlaneXY(0, 0, 0))

number_slider_9 = Slider(65, range=0..200)  # disabled
number_slider_10 = Slider(95, range=0..200)  # disabled
number_slider_11 = Slider(152, range=0..1000)  # disabled
number_slider_12 = Slider(3, range=0..10)  # disabled
number_slider_13 = Slider(3, range=0..3)  # disabled
traceraysscattered = Python3Script(scene=scene, ref_db=number_slider_10, target_db=number_slider_9, n_rays=number_slider_11, seed=number_slider_12)  # -> out, a; inputs ref_db: Double, target_db: Double, n_rays: Int32, seed: Int32; disabled
# ---------- traceraysscattered: Python ----------
import math
import numpy as np
from compas_acoustics import pra_converter as cpc

from compas.geometry import Point
from compas.geometry import Polyline

import pyroomacoustics as pra

from Grasshopper import DataTree
from Grasshopper.Kernel.Data import GH_Path


def random_directions(n_rays, seed=None, jitter=0.5):
    """n_rays unit direction vectors on the sphere via a jittered Fibonacci
    lattice -- much more even angular coverage per ray than i.i.d. random
    sampling, while still varying with `seed`.

    jitter : float in [0, 1]
        0 = exact deterministic lattice, no randomness.
        1 = perturbation on the order of one full lattice-cell spacing.
    """
    golden = np.pi * (3.0 - np.sqrt(5.0))
    i = np.arange(n_rays)
    z = 1.0 - 2.0 * (i + 0.5) / n_rays
    radius = np.sqrt(np.maximum(1.0 - z * z, 0.0))
    phi = i * golden

    directions = np.stack([radius * np.cos(phi), radius * np.sin(phi), z], axis=1)

    if jitter > 0:
        rng = np.random.default_rng(seed)
        cell_size = 2.0 / np.sqrt(n_rays)  # ~ spacing between neighboring lattice points
        directions += rng.normal(size=(n_rays, 3)) * cell_size * jitter
        directions /= np.linalg.norm(directions, axis=1, keepdims=True)

    return directions

def spl_at_distance(start_db, distance):
    """
    Calculate sound pressure level (Lp) in dB after geometric spreading over distance (meters).
    Only support omni directivity now.
    """
    if distance <= 0:
        return start_db

    sphere_area = 4.0 * math.pi * (distance ** 2)

    return start_db - 10.0 * math.log10(sphere_area)

def distance_between_db(from_db, to_db):
    if from_db <= to_db:
        return 0.0

    sphere_angle = 4.0 * math.pi
    exponent = (from_db - to_db) / 10.0

    return math.sqrt((10.0 ** exponent) / sphere_angle)

def trace_rays_scattered(room, sources, start_db, target_db, n_rays=50, max_order=100, seed=7, jitter=0.5):

    polyline_tree = []

    engine = room.room_engine
    walls = room.walls
    max_dist = float(engine.max_dist)

    for i, source in enumerate(sources):
        dire_lst = random_directions(n_rays, seed * (i + 1) + 7, jitter)
        
        polylines = []
        for dire in dire_lst:
            pos = np.asarray(source.position, dtype=float)
            db = start_db
            dist_travelled = 0.0
            # hits = []
            pts = [Point(*pos)]
            for _ in range(max_order):
                hit, wall_idx, hit_dist = engine.next_wall_hit(pos, pos + dire * max_dist, False)
                if wall_idx == -1:
                    break

                # Stop the loop when the sound reaches the target_db over the distance
                dist_travelled += hit_dist
                curr_spl = spl_at_distance(db, dist_travelled)
                if curr_spl <= target_db:
                    # Generate the stop point
                    dist_at_target = distance_between_db(db, target_db)
                    dist_end = dist_travelled - dist_at_target
                    pt_end = hit + (-dire * dist_end)
                    pts.append(Point(*pt_end))
                    break

                # hits.append({"point": hit, "distance": dist_travelled, "spl": curr_spl})
                pts.append(Point(*hit))
                wall_hitted = walls[wall_idx]

                # Attenuate absorption
                absorption = float(np.mean(np.asarray(wall_hitted.absorption, dtype=float)))
                remaining = 1.0 - absorption
                if remaining <= 0.0:
                    break

                db += 10.0 * math.log10(remaining)

                # Specular reflection update
                dire = np.asarray(wall_hitted.normal_reflect(dire), dtype=float)
                pos = hit

            polylines.append(Polyline(pts))
        polyline_tree.append(polylines)
    return polyline_tree

# Main code -------------
room = cpc.scene_to_pra_room(
    scene, 16000, max_order=1, ray_tracing=False, air_absorption=False
)
sources = scene.sources

polyline_tree = trace_rays_scattered(
    room, sources, ref_db, target_db, n_rays=n_rays, seed=seed
)

a = DataTree[object]()
for i, br in enumerate(polyline_tree):
    a.AddRange(br, GH_Path(i))
spl = spl_at_distance(ref_db, 283.5250)
print (spl)
# ---------- end traceraysscattered ----------
branch_2 = TreeBranch(Tree=traceraysscattered.a, Path=number_slider_13, MaintainPaths=True)  # disabled
draw = COMPASDraw(cg=traceraysscattered.a)  # -> graft(rg); disabled
#   port cg: The COMPAS geometry or datastructure to be drawn.
#   port rg: The Rhino geometry object.
# ---------- draw: Python ----------
# r: compas>=2.14.1
"""
Draws COMPAS geometry in Grasshopper.
"""

from typing import Any

import Grasshopper

from compas.scene import SceneObject


class CompasToRhinoGeometry(Grasshopper.Kernel.GH_ScriptInstance):
    def RunScript(self, cg):
        if not cg:
            return None

        return SceneObject(item=cg).draw()
# ---------- end draw ----------
mesh_4 = Mesh(del_2)  # disabled
mcx = MeshCurve(Mesh=mesh_4, Curve=draw)  # -> Points, Faces; disabled
crvdom = CurveDomain(Curve=draw)  # -> Curve, Domain; disabled
dedomain = DeconstructDomain(Domain=crvdom.Domain)  # -> Start, End; disabled
crv_cp = CurveClosestPoint(Point=mcx.Points, Curve=draw)  # -> Point, Parameter, Distance; disabled
dom = ConstructDomain(DomainStart=dedomain.Start, DomainEnd=crv_cp.Parameter)  # disabled
subcrv = SubCurve(BaseCurve=draw, Domain=dom)  # disabled
lng_2 = ListLength(List=flatten(subcrv))  # disabled
panel_11 = Panel(lng_2)  # disabled

mcol = MeshColours(Mesh=del_2, Colours=gradient)
crv_3 = Curve(<curve referenced from the Rhino model>)  # disabled
cp = ControlPoints(Curve=crv_3)  # -> Points, Weights, Knots; disabled
panel_12 = Panel("""0
-1""")  # disabled
number_slider_14 = Slider(4, range=0..10)  # disabled
number_slider_15 = Slider(147, range=0..180)  # disabled
py3_8 = Python3Script(pts=cp.Points)  # -> out, a; inputs pts: list; disabled
end = EndPoints(Curve=crv_3)  # -> Start, End; disabled
cull_i_2 = CullIndex(List=cp.Points, Indices=panel_12, Wrap=True)  # disabled
item_3 = ListItem(List=cp.Points, Index=panel_12, Wrap=True)  # disabled
ln = Line(StartPoint=end.End, EndPoint=end.Start)  # disabled
range = Range(Domain=number_slider_15, Steps=number_slider_14)  # disabled
rotax = RotateAxis(Geometry=crv_3, Angle=degrees(range), Axis=ln)  # -> Geometry, Transform; disabled
loft_2 = Loft(Curves=rotax.Geometry, Options={Adjust=False, Closed=False, LoftEnds=0, LoftSimp=0, LoftType=0, Rebuild=10, Refit=0.01})  # disabled
