# Grasshopper definition gh_plugin_test.ghx (Grasshopper 1.0.8)

lamcp = LAMCPBridge(enable=Toggle(False))  # -> status; inputs enable: Boolean, port: Int32
#   port enable: Toggle to start (True) or stop (False) the local HTTP server.
#   port port: Port to listen on (loopback only). Defaults to 8765.
#   port status: Current server status string.
# ---------- lamcp: Python ----------
"""
LAMCP Bridge: local HTTP server inside Rhino 8 / Grasshopper CPython.

Exposes `POST /exec` (JSON: `{"code": "...", "timeout": 30}`) which
exec()s `code` and returns
`{"stdout": "...", "stderr": "...", "result": "...", "error": null|str}`.

Pair with the `lamcp` FastMCP server, which translates Claude's
`run_python_script` MCP tool calls into POSTs to this endpoint.

Binds to 127.0.0.1 only. NEVER expose beyond localhost â€” it exec()s
arbitrary Python with full Rhino API access.

LAMCP v0.1.0
"""

import contextlib
import io
import json
import threading
import traceback
from http.server import BaseHTTPRequestHandler
from http.server import HTTPServer

import Grasshopper
import scriptcontext as sc


SHARED_GLOBALS_KEY = "_lamcp_bridge_globals"
SERVER_KEY = "_lamcp_bridge_server"


def _exec_code(code, timeout):
    """Run `code` on the HTTP-server thread and capture stdout/stderr/result.

    NOTE: this is intentionally NOT marshalled to Rhino's UI thread for the
    spike â€” `Rhino.RhinoApp.InvokeOnUiThread` was queueing actions that
    never fired in Rhino 8 CPython. Most read-only RhinoCommon access is
    safe cross-thread; mutations may crash. Add Eto-based marshalling
    back here when we need it.
    """
    out = io.StringIO()
    err = io.StringIO()
    g = sc.sticky.setdefault(SHARED_GLOBALS_KEY, {"__name__": "__lamcp_bridge__"})
    error_text = None
    result_repr = None
    try:
        with contextlib.redirect_stdout(out), contextlib.redirect_stderr(err):
            exec(code, g, g)
            result_repr = repr(g.get("_"))
    except BaseException:
        error_text = traceback.format_exc()

    return {
        "stdout": out.getvalue(),
        "stderr": err.getvalue(),
        "result": result_repr,
        "error": error_text,
    }


class _ExecHandler(BaseHTTPRequestHandler):
    # Silence default request logging so it doesn't clog the Rhino command line.
    def log_message(self, fmt, *args):
        pass

    def _send(self, code, payload):
        body = json.dumps(payload).encode("utf-8")
        self.send_response(code)
        self.send_header("Content-Type", "application/json")
        self.send_header("Content-Length", str(len(body)))
        self.end_headers()
        self.wfile.write(body)

    def do_GET(self):
        if self.path == "/health":
            self._send(200, {"status": "ok"})
        else:
            self._send(404, {"error": "not found"})

    def do_POST(self):
        if self.path != "/exec":
            self._send(404, {"error": "not found"})
            return
        length = int(self.headers.get("Content-Length", "0"))
        try:
            raw = self.rfile.read(length).decode("utf-8")
            body = json.loads(raw)
            code = body.get("code", "")
            timeout = float(body.get("timeout", 30.0))
        except Exception as exc:
            self._send(400, {"error": "bad request: " + repr(exc)})
            return
        result = _exec_code(code, timeout)
        self._send(200, result)


def _start_server(port):
    server = HTTPServer(("127.0.0.1", port), _ExecHandler)
    thread = threading.Thread(
        target=server.serve_forever, daemon=True, name="lamcp-bridge"
    )
    thread.start()
    return {"server": server, "thread": thread, "port": port}


def _stop_server(state):
    try:
        state["server"].shutdown()
        state["server"].server_close()
    except Exception:
        pass


class LamcpBridgeComponent(Grasshopper.Kernel.GH_ScriptInstance):
    def RunScript(self, enable: bool, port: int):
        port = int(port) if port else 8765

        state = sc.sticky.get(SERVER_KEY)

        if not enable:
            if state is not None:
                _stop_server(state)
                del sc.sticky[SERVER_KEY]
            return "stopped"

        # Already running on the requested port: no-op.
        if (
            state is not None
            and state.get("port") == port
            and state["thread"].is_alive()
        ):
            return "listening on http://127.0.0.1:{}".format(port)

        # Port changed or server died: tear down and restart.
        if state is not None:
            _stop_server(state)
            del sc.sticky[SERVER_KEY]

        try:
            sc.sticky[SERVER_KEY] = _start_server(port)
        except OSError as exc:
            ghenv.Component.AddRuntimeMessage(  # noqa: F821
                Grasshopper.Kernel.GH_RuntimeMessageLevel.Error,
                "Failed to bind 127.0.0.1:{}: {}".format(port, exc),
            )
            return "error: {}".format(exc)

        return "listening on http://127.0.0.1:{}".format(port)
# ---------- end lamcp ----------
panel = Panel(lamcp)

# ----
# Material from Params
panel_2 = Panel("0.01, 0.01, 0.02, 0.02, 0.02, 0.05, 0.05")
# Option B: Create Multiple AcousticObjects with different Materials
panel_3 = Panel("concrete")
mat = Compas_acousticsMaterial(absorption=panel_2, scattering="0.01, 0.01, 0.03, 0.05, 0.1, 0.1, 0.1", name=panel_3)  # -> material; inputs absorption: String, scattering: String, name: String
#   port absorption: Comma-separated list of absorption coefficients for each frequency band. e.g. '0.1, 0.2, 0.3, 0.4, 0.5, 0.6, 0.7' for 7 frequency bands.
#   port scattering: Optional. Comma-separated list of scattering coefficients for each frequency band. e.g. '0.1, 0.2, 0.3, 0.4, 0.5, 0.6, 0.7' for 7 frequency bands.
#   port name: Name of the material preset in the library (e.g. 'concrete', 'carpet').
#   port material: AcousticMaterial object.
# ---------- mat: Python ----------
"""Create an AcousticMaterial for AcousticObject(s)."""
# flake8: noqa
import Grasshopper
from compas_acoustics.acoustic_material import AcousticMaterial


class CreateMaterial(Grasshopper.Kernel.GH_ScriptInstance):

    def RunScript(self, absorption: str, scattering: str, name: str):
        if absorption is None:
            ghenv.Component.AddRuntimeMessage(
                Grasshopper.Kernel.GH_RuntimeMessageLevel.Warning,
                "Input parameter 'absorption' failed to collect data."
            )
            return
        if name is None:
            ghenv.Component.AddRuntimeMessage(
                Grasshopper.Kernel.GH_RuntimeMessageLevel.Warning,
                "Input parameter 'name' failed to collect data."
            )
            return

        absorption = [float(x) for x in absorption.split(",")]
        scattering = [float(x) for x in scattering.split(",")] if scattering is not None else None

        return AcousticMaterial(
            name=name,
            absorption_coefficients=absorption,
            scattering_coefficients=scattering,
        )
# ---------- end mat ----------

# ----
# Rhino Geometry
brep = Brep(<brep referenced from the Rhino model>)
debrep = DeconstructBrep(Brep=brep)  # -> Faces, Edges, Vertices
py3 = Python3Script(geos=debrep.Faces)  # -> out, ceilings, walls, floors; inputs geos: list
# ---------- py3: Python ----------
ceilings = geos[6]
walls = geos[:5]
floors = geos[5]
# ---------- end py3 ----------

srf = Surface(<surface referenced from the Rhino model>)
carpet = Compas_acousticsMaterialLibrary()  # -> material
#   port material: AcousticMaterial object.
# ---------- carpet: Python ----------
"""Preset picker for AcousticMaterial. Right-click to choose a material from the materials_library folder."""
# flake8: noqa
import Grasshopper
from System.Windows.Forms import ToolStripSeparator
from compas_acoustics.materials_library import MaterialsLibrary


class MaterialLibraryPicker(Grasshopper.Kernel.GH_ScriptInstance):

    def __init__(self):
        super().__init__()
        self.library = MaterialsLibrary()
        nickname = ghenv.Component.NickName
        self.material_name = nickname if nickname in self.library.material_names else None

    def RunScript(self):
        names = sorted(self.library.material_names)
        if not names:
            ghenv.Component.AddRuntimeMessage(
                Grasshopper.Kernel.GH_RuntimeMessageLevel.Error, "No material presets found in the materials library."
            )
            return None

        if self.material_name not in names:
            ghenv.Component.AddRuntimeMessage(
                Grasshopper.Kernel.GH_RuntimeMessageLevel.Remark, "Right-click the icon to choose a material."
            )
            ghenv.Component.Message = None
            return None

        ghenv.Component.Message = self.material_name
        return self.library.material_from_name(self.material_name)

    def AppendAdditionalMenuItems(self, menu):
        for name in sorted(self.library.material_names):
            item = menu.Items.Add(name, None, self.on_item_click)
            item.Checked = (name == self.material_name)

        menu.Items.Add(ToolStripSeparator())

    def on_item_click(self, sender, event_info):
        name = str(sender)
        if name == self.material_name:
            return
        self.material_name = name
        ghenv.Component.NickName = name
        ghenv.Component.ExpireSolution(True)
# ---------- end carpet ----------
smesh = SimpleMesh(Brep=srf)
number_slider = Slider(2.6, range=0.01..3.99)
stop = Button()
play = Button()
obj = Compas_acousticsAcousticObject(geometry=smesh, material=carpet, name="test_panel")  # -> acoustic_object; inputs geometry: Mesh, name: String
#   port geometry: Geometry of the AcousticObject.
#   port material: Material of the AcousticObject.
#   port name: Name of the AcousticObject.
#   port acoustic_object: AcousticObject object.
# ---------- obj: Python ----------
"""Create an AcousticObject with the specified geometry and material."""
# flake8: noqa
import Grasshopper
import Rhino
from compas_acoustics.geometry import AcousticObject
from compas_rhino.conversions import mesh_to_compas

# TODO: Change the typeHintID in metadata.json from "mesh" to "geometrybase"

class CreateAcousticObject(Grasshopper.Kernel.GH_ScriptInstance):

    def RunScript(self, geometry: Rhino.Geometry.Mesh, material, name: str):

        if geometry is None:
            ghenv.Component.AddRuntimeMessage(
                Grasshopper.Kernel.GH_RuntimeMessageLevel.Warning, "No geometry provided."
            )
            return
        if material is None:
            ghenv.Component.AddRuntimeMessage(
                Grasshopper.Kernel.GH_RuntimeMessageLevel.Warning, "No material provided."
            )
            return

        # Gemetry conversion from Rhino to Compas
        # TODO: Figure out how to handle other geometry types (e.g., Brep, Surface, etc.)
        if isinstance(geometry, Rhino.Geometry.Mesh):
            geometry = mesh_to_compas(geometry)

        return AcousticObject(acoustic_geometry=geometry, material=material, name=name)
# ---------- end obj ----------

# ----
# Material from Library
# (should have only one component)
concrete = Compas_acousticsMaterialLibrary()  # -> material; same code as carpet
concrete_2 = Compas_acousticsMaterialLibrary()  # -> material; same code as carpet
concrete_3 = Compas_acousticsMaterialLibrary()  # -> material; same code as carpet

# ----
# Soruces
crv = Curve([<curve referenced from the Rhino model> x3])
lng = ListLength(List=crv)
hypercardioid = Compas_acousticsDirectivity()  # -> directivity
#   port directivity: Directivity pattern.
# ---------- hypercardioid: Python ----------
"""Preset picker for directivity patterns. Right-click to choose a pattern from the available options."""
# flake8: noqa
import Grasshopper
from System.Windows.Forms import ToolStripSeparator
from compas_acoustics.materials_library import MaterialsLibrary


class DirectivitySelector(Grasshopper.Kernel.GH_ScriptInstance):
    ITEMS = ["Bidirectional", "Hypercardioid", "Supercardioid", "Cardioid", "Omnidirectional"]

    def __init__(self):
        super().__init__()
        nickname = ghenv.Component.NickName
        self.directivity_name = nickname if nickname in self.ITEMS else None

    def RunScript(self):
        names = self.ITEMS
        if not names:
            ghenv.Component.AddRuntimeMessage(
                Grasshopper.Kernel.GH_RuntimeMessageLevel.Error, "No directivity patterns found."
            )
            return None

        if self.directivity_name not in names:
            ghenv.Component.AddRuntimeMessage(
                Grasshopper.Kernel.GH_RuntimeMessageLevel.Remark, "Right-click the icon to choose a directivity pattern."
            )
            ghenv.Component.Message = None
            return None

        ghenv.Component.Message = self.directivity_name
        return self.directivity_name.lower()

    def AppendAdditionalMenuItems(self, menu):
        for name in self.ITEMS:
            item = menu.Items.Add(name, None, self.on_item_click)
            item.Checked = (name == self.directivity_name)

        menu.Items.Add(ToolStripSeparator())

    def on_item_click(self, sender, event_info):
        name = str(sender)
        if name == self.directivity_name:
            return
        self.directivity_name = name
        ghenv.Component.NickName = name
        ghenv.Component.ExpireSolution(True)
# ---------- end hypercardioid ----------
cardioid = Compas_acousticsDirectivity()  # -> directivity; same code as hypercardioid
cardioid_2 = Compas_acousticsDirectivity()  # -> directivity; same code as hypercardioid
eval = EvaluateCurve(Curve=reparameterize(crv), Parameter="0")  # -> Point, Tangent, Angle
series = Series(Start=0, Step=1, Count=lng)
py3_2 = Python3Script(name="10_Orchestral.wav")  # -> out, path; inputs name: String
# ---------- py3_2: Python ----------
import sys
import os

gh_path = ghenv.Component.OnPingDocument().FilePath
dire_path = os.path.dirname(gh_path)
sound_path = os.path.join(dire_path, "sound_files", name)

path = sound_path
# ---------- end py3_2 ----------
py3_3 = Python3Script(name="adult_female_speech.wav")  # -> out, path; inputs name: String; same code as py3_2
py3_4 = Python3Script(name="flute_music.wav")  # -> out, path; inputs name: String; same code as py3_2
merge = Merge(Data1=hypercardioid, Data2=cardioid, Data3=cardioid_2)
concat = Concatenate(FragmentA="source_", FragmentB=series)
merge_2 = Merge(Data1=py3_3.path, Data2=py3_4.path, Data3=py3_2.path)
source = Compas_acousticsSource(position=eval.Point, direction=crv, directivity=merge, name=concat, sound_file=merge_2)  # -> source; inputs position: Point3d, direction: Vector3d, directivity: String, name: String, sound_file: String
#   port position: Position of the source.
#   port direction: Direction of the source.
#   port directivity: Directivity of the source. Default is Omnidirectional. Options: - Bidirectional - Hypercardioid - Supercardioid - Cardioid - Omnidirectional
#   port name: Name of the source.
#   port sound_file: Sound file associated with the source.
#   port source: Source object.
# ---------- source: Python ----------
"""Acoustic Source object (speaker, human, etc.)."""
# flake8: noqa
import Grasshopper
import Rhino
from compas_acoustics import Source


class CreateSource(Grasshopper.Kernel.GH_ScriptInstance):
    ITEMS = ["bidirectional", "hypercardioid", "supercardioid", "cardioid", "omnidirectional"]

    def RunScript(self,
            position: Rhino.Geometry.Point3d,
            direction: Rhino.Geometry.Vector3d,
            directivity: str,
            name: str,
            sound_file: str):
        if position is None:
            position = Rhino.Geometry.Point3d(0, 0, 0)
        if direction is None:
            direction = Rhino.Geometry.Vector3d(1, 0, 0)

        if directivity is None:
            dirt = "omnidirectional"
        elif directivity not in self.ITEMS:
            ghenv.Component.AddRuntimeMessage(
                Grasshopper.Kernel.GH_RuntimeMessageLevel.Error, "Input parameter 'directivity' is not valid."
            )
            return None
        else:
            dirt = directivity

        if name is None:
            name = "my_source"

        return Source(
            name,
            *position,
            directivity=dirt,
            direction=[*direction],
            sound_file=sound_file
        )
# ---------- end source ----------

# ----
# Acoustic Objects
data = Data(py3.walls)
lng_2 = ListLength(List=data)
series_2 = Series(Start=0, Step=1, Count=lng_2)
concat_2 = Concatenate(FragmentA="brick_wall_", FragmentB=series_2)
obj_2 = Compas_acousticsAcousticObject(geometry=py3.ceilings, material=concrete, name="plaster_ceiling")  # -> acoustic_object; inputs geometry: Mesh, name: String; same code as obj
obj_3 = Compas_acousticsAcousticObject(geometry=data, material=concrete_2, name=concat_2)  # -> acoustic_object; inputs geometry: Mesh, name: String; same code as obj
obj_4 = Compas_acousticsAcousticObject(geometry=py3.floors, material=concrete_3, name="carpet floor")  # -> acoustic_object; inputs geometry: Mesh, name: String; same code as obj
merge_3 = Merge(Data1=obj_2, Data2=obj_3, Data3=obj_4, Data4=obj)  # -> flatten(Result)

play_2 = Button()
stop_2 = Button()
player = Compas_acousticsAudioPlayer(sound=py3_3.path, play=play_2, stop=stop_2)  # inputs play: Boolean, stop: Boolean
#   port sound: Audio file path, numpy array, or Source object.
#   port play: Play the audio.
#   port stop: Stop the audio.
# ---------- player: Python ----------
"""Play audio files, accepting .wav, numpy arrays, and Source objects."""
# flake8: noqa
import Grasshopper
import System
from compas_acoustics import AudioPlayer
import scriptcontext as sc
import soundfile as sf


class PlayAudio(Grasshopper.Kernel.GH_ScriptInstance):

    def offer_buttons(self):
        component = ghenv.Component
        offered_key = "audio_player_buttons_offered_{}".format(component.InstanceGuid)
        if sc.sticky.get(offered_key):
            return
        sc.sticky[offered_key] = True

        doc = component.OnPingDocument()
        if doc is None:
            return

        targets = [(index, nickname) for index, nickname in ((1, "Play"), (2, "Stop")) if component.Params.Input[index].SourceCount == 0]
        if not targets:
            return

        def deferred(gh_doc):
            base = component.Attributes.Pivot
            for row, (index, nickname) in enumerate(targets):
                input_param = component.Params.Input[index]
                if input_param.SourceCount > 0:
                    continue

                button = Grasshopper.Kernel.Special.GH_ButtonObject()
                button.CreateAttributes()
                button.NickName = nickname
                button.Attributes.Pivot = System.Drawing.PointF(base.X - 180, base.Y - 15 + row * 30)
                gh_doc.AddObject(button, False)
                input_param.AddSource(button)
                button.ExpireSolution(True)

        doc.ScheduleSolution(1, deferred)

    def RunScript(self, sound, play: bool, stop: bool):
        self.offer_buttons()

        sample_rate = None

        if sound is None:
            return

        if isinstance(sound, str):  # file path
            try:
                sample_rate = sf.info(sound).samplerate
            except:
                pass
        elif hasattr(sound, "sound_file"):  # Source object
            sound = sound.sound_file
            try:
                sample_rate = sf.info(sound).samplerate
            except:
                pass
        elif hasattr(sound, "shape") and hasattr(sound, "ndim"):  # numpy array
            pass
        else:
            ghenv.Component.AddRuntimeMessage(
                Grasshopper.Kernel.GH_RuntimeMessageLevel.Error, "Input parameter 'sound' is not valid."
            )
            return

        player_key = "player"
        if player_key not in sc.sticky:
            sc.sticky[player_key] = AudioPlayer()

        player = sc.sticky[player_key]

        if play:
            player.play(sound, sample_rate)
        if stop:
            player.stop()
# ---------- end player ----------

# ----
# optional
number_slider_2 = Slider(0, range=0..10)  # disabled
number_slider_3 = Slider(1, range=0..10)  # disabled
relay = Relay([number_slider_2, number_slider_3])  # disabled

plot2dsettings = Compas_acousticsPlot2DSettings(title_height=Slider(0.56, range=0..1), axis_title_height=Slider(0.37, range=0..1), label_height=Slider(0.28, range=0..1))  # -> settings; inputs title_height: Double, axis_title_height: Double, label_height: Double
#   port title_height: Height of the chart title.
#   port axis_title_height: Height of the axis titles.
#   port label_height: Height of the axis labels.
#   port settings: Plotter2DSettings object.
# ---------- plot2dsettings: Python ----------
"""Settings for a 2D chart of the acoustic parameter."""
# flake8: noqa
import Grasshopper
from Grasshopper import DataTree
from Grasshopper.Kernel.Data import GH_Path
from compas_acoustics import Plotter2DSettings


class Plot2DSettings(Grasshopper.Kernel.GH_ScriptInstance):
    def RunScript(self,
            title_height: float,
            axis_title_height: float,
            label_height: float):
        return Plotter2DSettings(
            title_height=title_height,
            axis_title_height=axis_title_height,
            label_height=label_height,
        )
# ---------- end plot2dsettings ----------
srf_2 = Surface(<surface referenced from the Rhino model>)
planar = IsPlanar(Surface=srf_2, Interior=True)  # -> Planar, Plane

reload = Python3Script(reload=Button())  # inputs reload: Boolean
# ---------- reload: Python ----------
# venv: rhino_compas_acoustics
# r: compas
# r: pyroomacoustics
# r: matplotlib
# r: librosa
# r: soundfile
# r: sounddevice
# r: sofar
# r: pyfar
# r: pyrato

import sys
import os
from compas_rhino import unload_modules


gh_path = ghenv.Component.OnPingDocument().FilePath
dire_path = os.path.dirname(os.path.dirname(gh_path))
target_path = os.path.join(dire_path, "src")

if target_path not in sys.path:
    sys.path.insert(0, target_path)

if reload:
    unload_modules('compas_acoustics')

try:
    import compas_acoustics as ca
except Exception as e:
    raise ValueError(e)
# ---------- end reload ----------

py3_5 = Python3Script(name="mono_viola.wav")  # -> out, path; inputs name: String
# ---------- py3_5: Python ----------
import sys
import os

gh_path = ghenv.Component.OnPingDocument().FilePath
dire_path = os.path.dirname(os.path.dirname(gh_path))
sound_path = os.path.join(
    dire_path,
    "src",
    "compas_acoustics",
    "anechoic_soundfiles_library",
    name
)

path = sound_path
# ---------- end py3_5 ----------
dup = DuplicateData(Data=py3_5.path, Number="2", Order=True)  # -> graft(Data)
dup_2 = DuplicateData(Data=py3_5.path, Number="3", Order=True)
dup_3 = DuplicateData(Data=dup, Number="3", Order=True)
viewer = ParamViewer(dup_3)

galapagos = Galapagos(gene=number_slider)
multiconvolve = BooleanToggle(False)
save = Button()
py3_6 = Python3Script()  # -> out, chart; disabled
# ---------- py3_6: Python ----------
from compas_acoustics import ImpulseResponse
import Rhino.Geometry as rg

if isinstance(data, ImpulseResponse):
    array = data.ir

chart = array.tolist()
# ---------- end py3_6 ----------
number_slider_4 = Slider(0.001, range=0..0.001)  # disabled
num = Number(py3_6.chart)  # disabled
number_slider_5 = Slider(6.9, range=0..100)  # disabled
bnd = Bounds(Numbers=num)  # disabled
# Analyze RIR
lng_3 = ListLength(List=num)  # disabled
remap = RemapNumbers(Value=num, Source=bnd, Target=number_slider_5)  # -> Mapped, Clipped; disabled
series_3 = Series(Start=0, Step=number_slider_4, Count=lng_3)  # disabled
pt = ConstructPoint(XCoordinate=series_3, YCoordinate=remap.Mapped, ZCoordinate=0)  # disabled
pline = PolyLine(Vertices=pt, Closed=False)  # disabled

# ----
# Receivers
pt_2 = Point([<point referenced from the Rhino model> x2])

pt_3 = Point(pt_2)
item = ListItem(List=pt_3, Index=0, Wrap=True)  # -> Item, Item1
pdecon = Deconstruct(Point=item.Item1)  # -> XComponent, YComponent, ZComponent
pt_4 = ConstructPoint(XCoordinate=pdecon.XComponent, YCoordinate=pdecon.YComponent, ZCoordinate=number_slider)
merge_4 = Merge(Data1=item.Item, Data2=pt_4)

lng_4 = ListLength(List=merge_4)
series_4 = Series(Start=0, Step=1, Count=lng_4)
concat_3 = Concatenate(FragmentA="receiver_", FragmentB=series_4)
dots = DotDisplay(Point=merge_4, Colour=RGB(0, 0, 0), Size=0.1)
receiver = Compas_acousticsReceiver(position=merge_4, name=concat_3)  # -> receiver; inputs position: Point3d, name: String
#   port position: Position of the receiver.
#   port name: Name of the receiver.
#   port receiver: Receiver object.
# ---------- receiver: Python ----------
"""Acoustic Receiver object (microphone, human ear, etc.)."""
# flake8: noqa
import Grasshopper
import Rhino
from compas_acoustics import Receiver

# TODO: Implement direction
class CreateReceiver(Grasshopper.Kernel.GH_ScriptInstance):

    def RunScript(self, position: Rhino.Geometry.Point3d, name: str):
        if position is None:
            position = Rhino.Geometry.Point3d(0, 0, 1)
        if name is None:
            name = "my_receiver"

        return Receiver(name, *position)
# ---------- end receiver ----------

points = PointList(Points=merge_4, Size=Slider(0.487, range=0..1))
scene = Compas_acousticsRoomScene(objects=flatten(merge_3), sources=flatten(source), receivers=flatten(receiver), name="test_scene")  # -> scene; inputs objects: list, sources: list, receivers: list, name: String
#   port objects: List of AcousticObject
#   port sources: List of Source objects.
#   port receivers: List of Receiver objects.
#   port name: Name of the room scene.
#   port scene: Room scene object.
# ---------- scene: Python ----------
"""Create a room scene with the specified objects, sources, and receivers."""
# flake8: noqa
import Grasshopper

import System
from compas_acoustics.scene import Scene
from compas_acoustics.source import Source
from compas_acoustics.receiver import Receiver


class CreateModelScene(Grasshopper.Kernel.GH_ScriptInstance):

    def RunScript(self,
            objects: System.Collections.Generic.List[object],
            sources: System.Collections.Generic.List[object],
            receivers: System.Collections.Generic.List[object],
            name: str):

        if objects is None:
            ghenv.Component.AddRuntimeMessage(
                Grasshopper.Kernel.GH_RuntimeMessageLevel.Warning, "No objects provided."
            )
            return
        if sources is None:
            ghenv.Component.AddRuntimeMessage(
                Grasshopper.Kernel.GH_RuntimeMessageLevel.Warning, "No sources provided."
            )
            return
        if receivers is None:
            ghenv.Component.AddRuntimeMessage(
                Grasshopper.Kernel.GH_RuntimeMessageLevel.Warning, "No receivers provided."
            )
            return

        scene = Scene(name=name)
        scene.add_acoustic_objects(objects)
        for src in sources:
            if isinstance(src, Source):
                scene.add_source(src)
            else:
                ghenv.Component.AddRuntimeMessage(
                    Grasshopper.Kernel.GH_RuntimeMessageLevel.Error,
                    f"Invalid source type: {type(src)}. Expected a Source object.",
                )
        for rcv in receivers:
            if isinstance(rcv, Receiver):
                scene.add_receiver(rcv)
            else:
                ghenv.Component.AddRuntimeMessage(
                    Grasshopper.Kernel.GH_RuntimeMessageLevel.Error,
                    f"Invalid receiver type: {type(rcv)}. Expected a Receiver object.",
                )

        return scene
# ---------- end scene ----------
simrt = Compas_acousticsSimulateRayTracing(scene=scene, max_order=Slider(1, range=0..10), n_rays=Slider(500, range=0..1000), seed=Slider(6, range=0..100))  # -> ir_graph; inputs sample_rate: Int32, max_order: Int32, n_rays: Int32, absorb_air: Boolean, seed: Int32
#   port scene: Room scene object.
#   port sample_rate: Sample rate for the simulation.
#   port max_order: Maximum order of image sources.
#   port n_rays: Number of rays for ray tracing.
#   port absorb_air: Whether to consider air absorption.
#   port seed: Random seed for reproducibility.
#   port ir_graph: Impulse response graph structure.
# ---------- simrt: Python ----------
"""Simulate room acoustics using Image Source Method (ISM) and Ray Tracing (RT) to generate impulse response graph structure."""
# flake8: noqa
import Grasshopper

from compas_acoustics.simulator import Simulator

class SimulateRayTracing(Grasshopper.Kernel.GH_ScriptInstance):

    def RunScript(self,
            scene,
            sample_rate: int,
            max_order: int,
            n_rays: int,
            absorb_air: bool,
            seed: int):

        if scene is None:
            ghenv.Component.AddRuntimeMessage(
                Grasshopper.Kernel.GH_RuntimeMessageLevel.Warning, "Input parameter 'scene' failed to collect data."
            )
            return

        if max_order is None:
            max_order = 2
        if n_rays is None:
            n_rays = 1000
        if absorb_air is None:
            absorb_air = True

        sim = Simulator(scene)
        if sample_rate is not None:
            sim.sampling_rate = sample_rate

        sim.rir_from_ray_tracing(
            image_source_order=max_order,
            n_rays=n_rays,
            air_absorption=absorb_air,
            random_seed=seed,
        )

        ghenv.Component.Message = "{}Hz, order={}, rays={}, air={}, seed={}".format(
            sim.sampling_rate, max_order, n_rays, absorb_air, seed if seed is not None else "random"
        )

        return sim.scene.ir_graph
# ---------- end simrt ----------

# ----
# Simulate Rays
number_slider_6 = Slider(2, range=0..10)  # disabled
number_slider_7 = Slider(0, range=0..180)  # disabled
number_slider_8 = Slider(19, range=0..180)  # disabled
number_slider_9 = Slider(37, range=0..100)  # disabled
toggle = BooleanToggle(True)  # disabled
py3_7 = Python3Script(
    scene=scene,
    angle=number_slider_7,
    num_of_rays=number_slider_8,
    reflection_order=number_slider_6,
    include_scattering=toggle,
    seed=number_slider_9)  # -> out, specular_reflections, diffuse_reflections; inputs source_idx: list of Int32, angle: Int32, num_of_rays: Int32, reflection_order: Int32, seed: Int32; disabled
# ---------- py3_7: Python ----------
import ghpythonlib.treehelpers as th

from compas.geometry import Vector, Polyline
import compas_rhino.conversions as cv 
import compas_acoustics as ca


from Grasshopper import DataTree
from Grasshopper.Kernel.Data import GH_Path

########### trace the rays
simulator = ca.Simulator(scene, simulation_platform="pyroomacoustics")
# traced_rays = simulator.trace_rays(n_rays=500, max_reflection_order=reflection_order)

specular_reflections = DataTree[object]()
diffuse_reflections = DataTree[object]()

if source_idx:
    selected_sources = [scene.sources[i] for i in source_idx]
else:
    selected_sources = scene.sources

for i, src in enumerate(selected_sources):
    rayfield = simulator.trace_rays(
        n_rays=num_of_rays,
        max_reflection_order=reflection_order,
        direction=src.direction,
        angle=angle,
        sources=[src],
        include_scattering=include_scattering,
        random_seed=seed
    )

    for j, ray in enumerate(rayfield.rays):
        specular_reflections.Add(cv.polyline_to_rhino(Polyline(ray.points)), GH_Path(i))
        for scat_ray in ray.scattered_reflections:
            diffuse_reflections.Add(cv.polyline_to_rhino(Polyline(scat_ray.points)), GH_Path(i, j))
# ---------- end py3_7 ----------
number_slider_10 = Slider(0, range=0..10)  # disabled
py3_8 = Python3Script(x=number_slider_10)  # -> a; inputs x: Int32; disabled
# ---------- py3_8: Python ----------
a = f"{{{x};?}}"
# ---------- end py3_8 ----------
split = SplitTree(Data=py3_7.diffuse_reflections, Masks=flatten(py3_8))  # -> Positive, Negative; disabled
branch = TreeBranch(Tree=py3_7.specular_reflections, Path=number_slider_10, MaintainPaths=True)  # disabled

viewer_2 = ParamViewer(py3_7.specular_reflections)  # disabled

# ----
# Deconstruct ir_graph
number_slider_11 = Slider(0, range=0..10)
decirgraph = Compas_acousticsDeconstructIRGraph(ir_graph=simrt, receiver_idx=Slider(1, range=0..10))  # -> ir, sources, receivers, edges; inputs receiver_idx: list of Int32
#   port ir_graph: Impulse response graph structure.
#   port receiver_idx: Index(s) of the receiver(s) to filter.
#   port ir: ImpulseResponse object(s).
#   port sources: Source object(s).
#   port receivers: Receiver object(s).
#   port edges: Relationships between sources and receivers as Line(s).
# ---------- decirgraph: Python ----------
"""Deconstruct impulse response graph structure into ImpulseResponse(s)."""
# flake8: noqa
import Grasshopper
from Grasshopper import DataTree
from Grasshopper.Kernel.Data import GH_Path
from Rhino.Geometry import Line
import System

class DeconstructIRGraph(Grasshopper.Kernel.GH_ScriptInstance):

    def RunScript(self,
            ir_graph,
            receiver_idx: System.Collections.Generic.List[int]):

        if ir_graph is None:
            ghenv.Component.AddRuntimeMessage(
                Grasshopper.Kernel.GH_RuntimeMessageLevel.Warning, "Input parameter 'ir_graph' failed to collect data."
            )

        ir_out = DataTree[object]()
        source_out = DataTree[object]()
        receiver_out = DataTree[object]()
        edge_out = DataTree[object]()

        # 1. Set order of receivers
        receiver_list = [
            ir_graph.node_attribute(node, 'data')
            for node in ir_graph.nodes()
            if ir_graph.node_attribute(node, 'type') == 'receiver'
        ]
        receiver_set = {rec.guid for rec in receiver_list}

        # 2. Make ir group as {receiver_0: [src_0, ...], ...}
        source_group = {}
        ir_group = {}

        for u, v in ir_graph.edges():
            ir = ir_graph.edge_attribute((u, v), 'data')
            data_u = ir_graph.node_attribute(u, 'data')
            data_v = ir_graph.node_attribute(v, 'data')

            if data_u.guid in receiver_set:
                rec, src = data_u, data_v
            elif data_v.guid in receiver_set:
                rec, src = data_v, data_u
            else:
                continue
            
            source_group.setdefault(rec.guid, []).append(src)
            ir_group.setdefault(rec.guid, []).append(ir)

        # 3. Filter receiver, optional
        if receiver_idx is None:
            indices = list(range(len(receiver_list)))
        else:
            indices = receiver_idx  # Already set to list access

        for idx in indices:
            rec = receiver_list[idx]
            path = GH_Path(idx)

            sources = source_group.get(rec.guid, [])
            irs = ir_group.get(rec.guid, [])

            receiver_out.Add(rec, path)
            source_out.AddRange(sources, path)
            ir_out.AddRange(irs, path)
            edge_out.AddRange([Line(*src.position, *rec.position) for src in sources], path)

        return ir_out, source_out, receiver_out, edge_out
# ---------- end decirgraph ----------
draw = COMPASDraw(cg=decirgraph.sources)  # -> rg
#   port cg: The COMPAS geometry or datastructure to be drawn.
#   port rg: The Rhino geometry object.
# ---------- draw: Python ----------
# r: compas>=2.14.1
"""
Draws COMPAS geometry in Grasshopper.
"""

from typing import Any

import Grasshopper

from compas.scene import SceneObject


class CompasToRhinoGeometry(Grasshopper.Kernel.GH_ScriptInstance):
    def RunScript(self, cg):
        if not cg:
            return None

        return SceneObject(item=cg).draw()
# ---------- end draw ----------
draw_2 = COMPASDraw(cg=decirgraph.receivers)  # -> rg; same code as draw

item_2 = ListItem(List=decirgraph.ir, Index=0, Wrap=True)
analyseir = Compas_acousticsAnalyseImpulseResponse(ir=item_2)  # -> params
#   port ir: ImpulseResponse (IR) object.
#   port params: List of acoustic parameters ('EDT', 'T20', 'T30', 'C50', 'C80', 'D50', 'DRR', 'Ts', 'STI').
# ---------- analyseir: Python ----------
"""Analyse impulse response (IR) and return acoustic parameters such as EDT, T20, C50, etc."""
# flake8: noqa
import Grasshopper
from compas_acoustics.analyser import AcousticAnalyser
from compas_acoustics import AcousticParameter
from compas_acoustics import Defaults


class AnalyseIR(Grasshopper.Kernel.GH_ScriptInstance):
    def RunScript(self, ir):
        if ir is None:
            ghenv.Component.AddRuntimeMessage(Grasshopper.Kernel.GH_RuntimeMessageLevel.Warning, "Input parameter 'ir' failed to collect data.")
            return None

        analyser = AcousticAnalyser(ir.ir)
        analyser.analyse()

        return [AcousticParameter().from_analyser(analyser, name) for name in Defaults().PARAM_NAMES]
# ---------- end analyseir ----------
panel_4 = Panel(analyseir)
viewer_3 = ParamViewer(py3_7.diffuse_reflections)  # disabled
item_3 = ListItem(List=analyseir, Index=Slider(3, range=0..10), Wrap=True)

deparam = Compas_acousticsDeconstructParameter(param=item_3)  # -> name, values, overall, frequencies
#   port param: AcousticParameter (AP) object.
#   port name: Nmae of the acoustic parameter.
#   port values: Values of the acoustic parameter.
#   port overall: Overall value of the acoustic parameter.
#   port frequencies: Frequencies of the acoustic parameter.
# ---------- deparam: Python ----------
"""Deconstruct acoustic parameter."""
# flake8: noqa
import Grasshopper
from compas_acoustics.analyser import AcousticAnalyser
from compas_acoustics import AcousticParameter
from compas_acoustics import Defaults


class DeconstructParam(Grasshopper.Kernel.GH_ScriptInstance):
    def RunScript(self, param):
        if param is None:
            ghenv.Component.AddRuntimeMessage(Grasshopper.Kernel.GH_RuntimeMessageLevel.Warning, "Input parameter 'param' failed to collect data.")
            return None
        
        return param.title, param.values, param.overall, param.frequencies
# ---------- end deparam ----------
panel_5 = Panel(deparam.name)
panel_6 = Panel(deparam.values)
panel_7 = Panel(deparam.overall)
panel_8 = Panel(deparam.frequencies)

deparam_2 = Compas_acousticsDeconstructParameter(param=item_3)  # -> name, values, overall, frequencies; same code as deparam
plot2d = Compas_acousticsPlot2D(param=item_3, plane=planar.Plane, x_size=Slider(8, range=0..10), y_size=Slider(3.5, range=0..10))  # -> title, x_title, y_title, x_labels, y_labels, values, points, polyline, grid; inputs plane: Plane, x_size: Double, y_size: Double
#   port param: AcousticParameter (AP) object.
#   port plane: Plane to draw the chart.
#   port x_size: Width of the chart.
#   port y_size: Height of the chart.
#   port settings: Plotter2DSettings for the chart.
#   port title: Title of the chart.
#   port x_title: Title of the x-axis.
#   port y_title: Title of the y-axis.
#   port x_labels: Labels of the x-axis.
#   port y_labels: Labels of the y-axis.
#   port values: Data values of the acoustic parameter.
#   port points: Data points of the chart.
#   port polyline: Data polyline of the chart.
#   port grid: Grid of the chart.
# ---------- plot2d: Python ----------
"""Create a 2D chart of the acoustic parameter."""
# flake8: noqa
import Grasshopper
from Grasshopper import DataTree
from Grasshopper.Kernel.Data import GH_Path
import Rhino
from compas_acoustics import Plotter2D


class Plot2D(Grasshopper.Kernel.GH_ScriptInstance):
    def RunScript(self,
            param,
            plane: Rhino.Geometry.Plane,
            x_size: float,
            y_size: float,
            settings):
        if param is None:
            ghenv.Component.AddRuntimeMessage(Grasshopper.Kernel.GH_RuntimeMessageLevel.Warning, "Input parameter 'param' failed to collect data.")
            return None

        plotter = Plotter2D(param, settings)
        plotter.plot(plane=plane, width=x_size, height=y_size)

        title = plotter.title
        x_title = plotter.x_axis_title
        y_title = plotter.y_axis_title
        x_labels = plotter.x_tick_labels
        y_labels = plotter.y_tick_labels
        values = plotter.data_values

        points = plotter.data_points
        polyline = plotter.data_polyline

        # Draw grid
        grid = DataTree[object]()
        items = [
            plotter.x_axis_line,
            plotter.y_axis_line,
            plotter.x_axis_points,
            plotter.y_axis_points,
        ]

        for i, item in enumerate(items):
            path = GH_Path(i)
            if isinstance(item, list):
                grid.AddRange(item, path)
            else:
                grid.Add(item, path)
        
        return title, x_title, y_title, x_labels, y_labels, values, points, polyline, grid
# ---------- end plot2d ----------
viewer_4 = ParamViewer(decirgraph.ir)
panel_9 = Panel(deparam_2.name)
panel_10 = Panel(deparam_2.values)
panel_11 = Panel(deparam_2.overall)
geo = Geometry(plot2d.title)
panel_12 = Panel(geo)
panel_13 = Panel(deparam_2.frequencies)
auralise = Compas_acousticsAuralise(irs=decirgraph.ir, multiconvolve=multiconvolve, save=save)  # -> signals; inputs irs: tree, signals: tree, multiconvolve: Boolean, save_file_path: String, save_file_name: String, save: Boolean
#   port irs: ImpulseResponse object(s)
#   port signals: Optional source signal(s). If not provided, it will take the signal(s) from the Source object(s) in the scene.
#   port multiconvolve: Whether to convolve multiple signals with multiple impulse responses. If False, it will convolve each signal with the corresponding impulse response.
#   port save_file_path: File path to save the convolved signal(s). Default is the current working directory.
#   port save_file_name: File name for the saved convolved signal(s). Default is 'convolved_sound'.
#   port save: Whether to save the convolved signal(s) to a file.
#   port signals: Convolved signal(s).
# ---------- auralise: Python ----------
"""Auralise the room scene by convolving the impulse response with the source signal(s)."""
# flake8: noqa
import Grasshopper
from Grasshopper import DataTree
from Grasshopper.Kernel.Data import GH_Path
import System
import scriptcontext as sc
import numpy as np
import os

from compas_acoustics.auraliser import Auraliser


class Auralise(Grasshopper.Kernel.GH_ScriptInstance):

    def offer_buttons(self):
        component = ghenv.Component
        offered_key = "Auraliser_buttons_offered_{}".format(component.InstanceGuid)
        if sc.sticky.get(offered_key):
            return
        sc.sticky[offered_key] = True

        doc = component.OnPingDocument()
        if doc is None:
            return

        targets = [
            (index, nickname, comp) for index, nickname, comp in ((2, "Multiconvolve", "tog"), (5, "Save", "but"))
            if component.Params.Input[index].SourceCount == 0
        ]
        if not targets:
            return

        def deferred(gh_doc):
            base = component.Attributes.Pivot
            for row, (index, nickname, comp) in enumerate(targets):
                input_param = component.Params.Input[index]
                if input_param.SourceCount > 0:
                    continue

                if comp == "tog":
                    popout = Grasshopper.Kernel.Special.GH_BooleanToggle()
                elif comp == "but":
                    popout = Grasshopper.Kernel.Special.GH_ButtonObject()
                else:
                    continue
                popout.CreateAttributes()
                popout.NickName = nickname
                popout.Attributes.Pivot = System.Drawing.PointF(base.X - 280, base.Y - 20 + row * 60)
                gh_doc.AddObject(popout, False)
                input_param.AddSource(popout)
                popout.ExpireSolution(True)

        doc.ScheduleSolution(1, deferred)

    def RunScript(self,
            irs: Grasshopper.DataTree[object],
            signals: Grasshopper.DataTree[object],
            multiconvolve: bool,
            save_file_path: str,
            save_file_name: str,
            save: bool):

        self.offer_buttons()

        if irs is None:
            ghenv.Component.AddRuntimeMessage(
                Grasshopper.Kernel.GH_RuntimeMessageLevel.Warning, "Input parameter 'irs' failed to collect data."
            )
            return
        
        has_signals = signals is not None and signals.DataCount > 0
        if has_signals:
            if irs.BranchCount != signals.BranchCount:
                raise ValueError("DataTree branch count mismatch.")
            if any(len(irs.Branch(i)) != len(signals.Branch(i)) for i in range(irs.BranchCount)):
                raise ValueError("DataTree branch length mismatch.")

        signals_out = DataTree[object]()
        # 1. Data conversions
        for i in range(irs.BranchCount):
            path = irs.Paths[i]

            br = irs.Branch(i)
            sound_files = signals.Branch(i) if has_signals else [ir.source.sound_file for ir in br]

            ir_groups = {}
            sound_groups = {}

            for idx, (IR, sound_file) in enumerate(zip(br, sound_files)):
                receiver_id = str(IR.receiver.guid)

                ir_groups.setdefault(receiver_id, {})
                sound_groups.setdefault(receiver_id, {})
                
                sub_key = f"source_{idx}"

                # ir_data = IR.ir
                ir_data = IR.ir[:, np.newaxis] if IR.ir.ndim == 1 else IR.ir

                ir_groups[receiver_id][sub_key] = {
                    'ir': ir_data,
                    'sample_rate': IR.sample_rate,
                    'ambisonic_order': 0,
                    'channel_order': 'acn',
                    'normalisation': 'sn3d'
                }

                sound_groups[receiver_id][sub_key] = {
                    'filepath': sound_file
                }

            # 2. Construct auraliser(s) and convolve signals
            for i, receiver_id in enumerate(ir_groups.keys()):
                if multiconvolve:
                    tasks = [(receiver_id, ir_groups[receiver_id], sound_groups[receiver_id], f"{i}")]
                else:
                    tasks = [
                        (
                            sub_key,
                            {sub_key: ir_groups[receiver_id][sub_key]},
                            {sub_key: sound_groups[receiver_id][sub_key]},
                            f"{i}_{j}",
                        )
                        for j, sub_key in enumerate(ir_groups[receiver_id].keys())
                    ]
                
                for name, ir_data, sound_data, suffix in tasks:
                    auraliser = Auraliser(
                        name=name,
                        impulse_responses=ir_data,
                        anechoic_sounds=sound_data,
                        output_format="mono",
                        # sample_rate=ir_groups[receiver_id][f"source_{0}"]['sample_rate']
                        sample_rate=48000
                    )
                    convolved_matrix = auraliser.multiconvolution()
                    
                    signals_out.Add(convolved_matrix, path)

                    if save:
                        filepath = self.set_save_file_path(save_file_path, save_file_name, suffix)
                        auraliser.export_convolved_sound(filepath, convolved_matrix)
        return signals_out
    
    @staticmethod
    def set_save_file_path(save_file_path=None, save_file_name=None, suffix=0):
        if save_file_path:
            base_dir = save_file_path
        else:
            base_dir = os.path.dirname(ghenv.Component.OnPingDocument().FilePath)

        if save_file_name:
            base_filename = save_file_name
        else:
            base_filename = "convolved_sound"
        return os.path.join(base_dir, f"{base_filename}_mic_{suffix}.wav")
# ---------- end auralise ----------
item_4 = ListItem(List=auralise, Index=0, Wrap=True)  # -> Item, Item1, Item2
player_2 = Compas_acousticsAudioPlayer(sound=item_4.Item, play=play, stop=stop)  # inputs play: Boolean, stop: Boolean; same code as player
