# Grasshopper definition trace_rays_test.ghx (Grasshopper 1.0.8)

lamcp = LAMCPBridge(enable=Toggle(True))  # -> status; inputs enable: Boolean, port: Int32
#   port enable: Toggle to start (True) or stop (False) the local HTTP server.
#   port port: Port to listen on (loopback only). Defaults to 8765.
#   port status: Current server status string.
# ---------- lamcp: Python ----------
"""
LAMCP Bridge: local HTTP server inside Rhino 8 / Grasshopper CPython.

Exposes `POST /exec` (JSON: `{"code": "...", "timeout": 30}`) which
exec()s `code` and returns
`{"stdout": "...", "stderr": "...", "result": "...", "error": null|str}`.

Pair with the `lamcp` FastMCP server, which translates Claude's
`run_python_script` MCP tool calls into POSTs to this endpoint.

Binds to 127.0.0.1 only. NEVER expose beyond localhost â€” it exec()s
arbitrary Python with full Rhino API access.

LAMCP v0.1.0
"""

import contextlib
import io
import json
import threading
import traceback
from http.server import BaseHTTPRequestHandler
from http.server import HTTPServer

import Grasshopper
import scriptcontext as sc


SHARED_GLOBALS_KEY = "_lamcp_bridge_globals"
SERVER_KEY = "_lamcp_bridge_server"


def _exec_code(code, timeout):
    """Run `code` on the HTTP-server thread and capture stdout/stderr/result.

    NOTE: this is intentionally NOT marshalled to Rhino's UI thread for the
    spike â€” `Rhino.RhinoApp.InvokeOnUiThread` was queueing actions that
    never fired in Rhino 8 CPython. Most read-only RhinoCommon access is
    safe cross-thread; mutations may crash. Add Eto-based marshalling
    back here when we need it.
    """
    out = io.StringIO()
    err = io.StringIO()
    g = sc.sticky.setdefault(SHARED_GLOBALS_KEY, {"__name__": "__lamcp_bridge__"})
    error_text = None
    result_repr = None
    try:
        with contextlib.redirect_stdout(out), contextlib.redirect_stderr(err):
            exec(code, g, g)
            result_repr = repr(g.get("_"))
    except BaseException:
        error_text = traceback.format_exc()

    return {
        "stdout": out.getvalue(),
        "stderr": err.getvalue(),
        "result": result_repr,
        "error": error_text,
    }


class _ExecHandler(BaseHTTPRequestHandler):
    # Silence default request logging so it doesn't clog the Rhino command line.
    def log_message(self, fmt, *args):
        pass

    def _send(self, code, payload):
        body = json.dumps(payload).encode("utf-8")
        self.send_response(code)
        self.send_header("Content-Type", "application/json")
        self.send_header("Content-Length", str(len(body)))
        self.end_headers()
        self.wfile.write(body)

    def do_GET(self):
        if self.path == "/health":
            self._send(200, {"status": "ok"})
        else:
            self._send(404, {"error": "not found"})

    def do_POST(self):
        if self.path != "/exec":
            self._send(404, {"error": "not found"})
            return
        length = int(self.headers.get("Content-Length", "0"))
        try:
            raw = self.rfile.read(length).decode("utf-8")
            body = json.loads(raw)
            code = body.get("code", "")
            timeout = float(body.get("timeout", 30.0))
        except Exception as exc:
            self._send(400, {"error": "bad request: " + repr(exc)})
            return
        result = _exec_code(code, timeout)
        self._send(200, result)


def _start_server(port):
    server = HTTPServer(("127.0.0.1", port), _ExecHandler)
    thread = threading.Thread(
        target=server.serve_forever, daemon=True, name="lamcp-bridge"
    )
    thread.start()
    return {"server": server, "thread": thread, "port": port}


def _stop_server(state):
    try:
        state["server"].shutdown()
        state["server"].server_close()
    except Exception:
        pass


class LamcpBridgeComponent(Grasshopper.Kernel.GH_ScriptInstance):
    def RunScript(self, enable: bool, port: int):
        port = int(port) if port else 8765

        state = sc.sticky.get(SERVER_KEY)

        if not enable:
            if state is not None:
                _stop_server(state)
                del sc.sticky[SERVER_KEY]
            return "stopped"

        # Already running on the requested port: no-op.
        if (
            state is not None
            and state.get("port") == port
            and state["thread"].is_alive()
        ):
            return "listening on http://127.0.0.1:{}".format(port)

        # Port changed or server died: tear down and restart.
        if state is not None:
            _stop_server(state)
            del sc.sticky[SERVER_KEY]

        try:
            sc.sticky[SERVER_KEY] = _start_server(port)
        except OSError as exc:
            ghenv.Component.AddRuntimeMessage(  # noqa: F821
                Grasshopper.Kernel.GH_RuntimeMessageLevel.Error,
                "Failed to bind 127.0.0.1:{}: {}".format(port, exc),
            )
            return "error: {}".format(exc)

        return "listening on http://127.0.0.1:{}".format(port)
# ---------- end lamcp ----------

reload = Python3Script(reload=Button())  # inputs reload: Boolean
# ---------- reload: Python ----------
# venv: rhino_compas_acoustics
# r: compas
# r: pyroomacoustics
# r: matplotlib
# r: librosa
# r: soundfile
# r: sounddevice
# r: sofar
# r: pyfar
# r: pyrato

import sys
import os
from compas_rhino import unload_modules


gh_path = ghenv.Component.OnPingDocument().FilePath
dire_path = os.path.dirname(os.path.dirname(gh_path))
target_path = os.path.join(dire_path, "src")

if target_path not in sys.path:
    sys.path.insert(0, target_path)

if reload:
    unload_modules('compas_acoustics')

try:
    import compas_acoustics as ca
except Exception as e:
    raise ValueError(e)
# ---------- end reload ----------

pt = Point(Point(30.88932666, 12.68585919, 1.665652195))
pt_2 = Point(Point(52.69586196, 15.12393603, 11.31211074))
pt_3 = Point(Point(52.69586196, 17.69293316, 17.88406413))
pt_4 = Point(Point(42.44396484, 6.337533097, 2.994413152))
box = Box({Plane=PlaneXY(20.00053458, 0.5669237512, 0), X=Domain(0, 45.58007894), Y=Domain(0, 23.01213446), Z=Domain(0, 47.02530001)})
brickwall = Compas_acousticsMaterialLibrary()  # -> material
#   port material: AcousticMaterial object.
# ---------- brickwall: Python ----------
"""Preset picker for AcousticMaterial. Right-click to choose a material from the materials_library folder."""
# flake8: noqa
import Grasshopper
from System.Windows.Forms import ToolStripSeparator
from compas_acoustics.materials_library import MaterialsLibrary


class MaterialLibraryPicker(Grasshopper.Kernel.GH_ScriptInstance):

    def __init__(self):
        super().__init__()
        self.library = MaterialsLibrary()
        nickname = ghenv.Component.NickName
        self.material_name = nickname if nickname in self.library.material_names else None

    def RunScript(self):
        names = sorted(self.library.material_names)
        if not names:
            ghenv.Component.AddRuntimeMessage(
                Grasshopper.Kernel.GH_RuntimeMessageLevel.Error, "No material presets found in the materials library."
            )
            return None

        if self.material_name not in names:
            ghenv.Component.AddRuntimeMessage(
                Grasshopper.Kernel.GH_RuntimeMessageLevel.Remark, "Right-click the icon to choose a material."
            )
            ghenv.Component.Message = None
            return None

        ghenv.Component.Message = self.material_name
        return self.library.material_from_name(self.material_name)

    def AppendAdditionalMenuItems(self, menu):
        for name in sorted(self.library.material_names):
            item = menu.Items.Add(name, None, self.on_item_click)
            item.Checked = (name == self.material_name)

        menu.Items.Add(ToolStripSeparator())

    def on_item_click(self, sender, event_info):
        name = str(sender)
        if name == self.material_name:
            return
        self.material_name = name
        ghenv.Component.NickName = name
        ghenv.Component.ExpireSolution(True)
# ---------- end brickwall ----------
yz = YZPlane(Origin=Point(0, 0, 0))
ln = Line(StartPoint=pt, EndPoint=pt_2)
ln_2 = Line(StartPoint=pt_4, EndPoint=pt_3)
pt_5 = Point(Point(41.06241037, 7.089140158, 31.31499817))
smesh = SimpleMesh(Brep=box)
xy = XYPlane(Origin=Point(0, 0, 0))
Z = UnitZ(Factor=Slider(4, range=0..10))
X = UnitX(Factor=Slider(6.1, range=0..10))
xz = XZPlane(Origin=Point(0, 0, 0))
Y = UnitY(Factor=Slider(5, range=0..10))
receiver = Compas_acousticsReceiver(position=pt_5)  # -> receiver; inputs position: Point3d, name: String
#   port position: Position of the receiver.
#   port name: Name of the receiver.
#   port receiver: Receiver object.
# ---------- receiver: Python ----------
"""Acoustic Receiver object (microphone, human ear, etc.)."""
# flake8: noqa
import Grasshopper
import Rhino
from compas_acoustics import Receiver

# TODO: Implement direction
class CreateReceiver(Grasshopper.Kernel.GH_ScriptInstance):

    def RunScript(self, position: Rhino.Geometry.Point3d, name: str):
        if position is None:
            position = Rhino.Geometry.Point3d(0, 0, 1)
        if name is None:
            name = "my_receiver"

        return Receiver(name, *position)
# ---------- end receiver ----------
source = Compas_acousticsSource(position=pt_4, direction=ln_2)  # -> source; inputs position: Point3d, direction: Vector3d, directivity: String, name: String, sound_file: String
#   port position: Position of the source.
#   port direction: Direction of the source.
#   port directivity: Directivity of the source. Default is Omnidirectional. Options: - Bidirectional - Hypercardioid - Supercardioid - Cardioid - Omnidirectional
#   port name: Name of the source.
#   port sound_file: Sound file associated with the source.
#   port source: Source object.
# ---------- source: Python ----------
"""Acoustic Source object (speaker, human, etc.)."""
# flake8: noqa
import Grasshopper
import Rhino
from compas_acoustics import Source


class CreateSource(Grasshopper.Kernel.GH_ScriptInstance):
    ITEMS = ["bidirectional", "hypercardioid", "supercardioid", "cardioid", "omnidirectional"]

    def RunScript(self,
            position: Rhino.Geometry.Point3d,
            direction: Rhino.Geometry.Vector3d,
            directivity: str,
            name: str,
            sound_file: str):
        if position is None:
            position = Rhino.Geometry.Point3d(0, 0, 0)
        if direction is None:
            direction = Rhino.Geometry.Vector3d(1, 0, 0)

        if directivity is None:
            dirt = "omnidirectional"
        elif directivity not in self.ITEMS:
            ghenv.Component.AddRuntimeMessage(
                Grasshopper.Kernel.GH_RuntimeMessageLevel.Error, "Input parameter 'directivity' is not valid."
            )
            return None
        else:
            dirt = directivity

        if name is None:
            name = "my_source"

        return Source(
            name,
            *position,
            directivity=dirt,
            direction=[*direction],
            sound_file=sound_file
        )
# ---------- end source ----------
source_2 = Compas_acousticsSource(position=pt, direction=ln)  # -> source; inputs position: Point3d, direction: Vector3d, directivity: String, name: String, sound_file: String; same code as source
obj = Compas_acousticsAcousticObject(geometry=smesh, material=brickwall)  # -> acoustic_object; inputs geometry: GeometryBase, name: String
#   port geometry: Geometry of the AcousticObject.
#   port material: Material of the AcousticObject.
#   port name: Name of the AcousticObject.
#   port acoustic_object: AcousticObject object.
# ---------- obj: Python ----------
"""Create an AcousticObject with the specified geometry and material."""
# flake8: noqa
import Grasshopper
import Rhino
from compas_acoustics.geometry import AcousticObject
from compas_rhino.conversions import mesh_to_compas
from compas_rhino.conversions import polyline_to_compas

# TODO: Change the typeHintID in metadata.json from "mesh" to "geometrybase"

class CreateAcousticObject(Grasshopper.Kernel.GH_ScriptInstance):

    def RunScript(self, geometry: Rhino.Geometry.GeometryBase, material, name: str):

        if geometry is None:
            ghenv.Component.AddRuntimeMessage(
                Grasshopper.Kernel.GH_RuntimeMessageLevel.Warning, "No geometry provided."
            )
            return
        if material is None:
            ghenv.Component.AddRuntimeMessage(
                Grasshopper.Kernel.GH_RuntimeMessageLevel.Warning, "No material provided."
            )
            return

        # Gemetry conversion from Rhino to Compas
        # TODO: Figure out how to handle other geometry types (e.g., Brep, Surface, etc.)
        if isinstance(geometry, Rhino.Geometry.Mesh):
            geometry = mesh_to_compas(geometry)
        elif isinstance(geometry, Rhino.Geometry.Polyline):
            geometry = polyline_to_compas(geometry)
        elif isinstance(geometry, Rhino.Geometry.PolylineCurve):
            geometry = polyline_to_compas(geometry.ToPolyline())
        else:
            ghenv.Component.AddRuntimeMessage(
                Grasshopper.Kernel.GH_RuntimeMessageLevel.Error, "Unsupported geometry type."
            )
            return
        return AcousticObject(acoustic_geometry=geometry, material=material, name=name)
# ---------- end obj ----------
move = Move(Geometry=xy, Motion=Z)  # -> Geometry, Transform
move_2 = Move(Geometry=yz, Motion=X)  # -> Geometry, Transform
move_3 = Move(Geometry=xz, Motion=Y)  # -> Geometry, Transform
neg = Negative(Value=Slider(22, range=0..45))
neg_2 = Negative(Value=Slider(10, range=0..45))
deplane = DeconstructPlane(Plane=move.Geometry)  # -> Origin, XAxis, YAxis, ZAxis
deplane_2 = DeconstructPlane(Plane=move_2.Geometry)  # -> Origin, XAxis, YAxis, ZAxis
number_slider = Slider(91, range=0..100)
scene = Compas_acousticsRoomScene(objects=flatten(obj), sources=flatten([source_2, source]), receivers=flatten(receiver))  # -> scene; inputs objects: list, sources: list, receivers: list, name: String
#   port objects: List of AcousticObject
#   port sources: List of Source objects.
#   port receivers: List of Receiver objects.
#   port name: Name of the room scene.
#   port scene: Room scene object.
# ---------- scene: Python ----------
"""Create a room scene with the specified objects, sources, and receivers."""
# flake8: noqa
import Grasshopper

import System
from compas_acoustics.scene import Scene
from compas_acoustics.source import Source
from compas_acoustics.receiver import Receiver


class CreateModelScene(Grasshopper.Kernel.GH_ScriptInstance):

    def RunScript(self,
            objects: System.Collections.Generic.List[object],
            sources: System.Collections.Generic.List[object],
            receivers: System.Collections.Generic.List[object],
            name: str):

        if objects is None:
            ghenv.Component.AddRuntimeMessage(
                Grasshopper.Kernel.GH_RuntimeMessageLevel.Warning, "No objects provided."
            )
            return
        if sources is None:
            ghenv.Component.AddRuntimeMessage(
                Grasshopper.Kernel.GH_RuntimeMessageLevel.Warning, "No sources provided."
            )
            return
        if receivers is None:
            ghenv.Component.AddRuntimeMessage(
                Grasshopper.Kernel.GH_RuntimeMessageLevel.Warning, "No receivers provided."
            )
            return

        scene = Scene(name=name)
        scene.add_acoustic_objects(objects)
        for src in sources:
            if isinstance(src, Source):
                scene.add_source(src)
            else:
                ghenv.Component.AddRuntimeMessage(
                    Grasshopper.Kernel.GH_RuntimeMessageLevel.Error,
                    f"Invalid source type: {type(src)}. Expected a Source object.",
                )
        for rcv in receivers:
            if isinstance(rcv, Receiver):
                scene.add_receiver(rcv)
            else:
                ghenv.Component.AddRuntimeMessage(
                    Grasshopper.Kernel.GH_RuntimeMessageLevel.Error,
                    f"Invalid receiver type: {type(rcv)}. Expected a Receiver object.",
                )

        return scene
# ---------- end scene ----------
rot3d = Rotate3D(Geometry=move.Geometry, Angle=degrees(neg), Center=deplane.Origin, Axis=deplane.XAxis)  # -> Geometry, Transform
rot3d_2 = Rotate3D(Geometry=move_2.Geometry, Angle=degrees(neg_2), Center=deplane_2.Origin, Axis=deplane_2.XAxis)  # -> Geometry, Transform
deplane_3 = DeconstructPlane(Plane=rot3d_2.Geometry)  # -> Origin, XAxis, YAxis, ZAxis
rot3d_3 = Rotate3D(Geometry=rot3d_2.Geometry, Angle=degrees(Slider(22, range=0..45)), Center=deplane_3.Origin, Axis=deplane_3.YAxis)  # -> Geometry, Transform
_3px = PlanePlanePlane(PlaneA=rot3d.Geometry, PlaneB=rot3d_3.Geometry, PlaneC=move_3.Geometry)  # -> Point, LineAB, LineAC, LineBC
number_slider_2 = Slider(10, range=0..10)
number_slider_3 = Slider(10, range=0..10)
py3 = Python3Script(scene=scene)  # -> out, a; disabled
# ---------- py3: Python ----------
import math
import numpy as np
from compas_acoustics import pra_converter as cpc

from compas.geometry import Point
from compas.geometry import Polyline


def spl_at_distance(start_db, distance):
    """
    Calculate sound pressure level (Lp) in dB after geometric spreading over distance (meters).
    Only support omni directivity now.
    """
    if distance <= 0:
        return start_db

    sphere_area = 4.0 * math.pi * (distance ** 2)

    return start_db - 10.0 * math.log10(sphere_area)

def distance_between_db(from_db, to_db):
    if from_db <= to_db:
        return 0.0

    sphere_angle = 4.0 * math.pi
    exponent = (from_db - to_db) / 10.0

    return math.sqrt((10.0 ** exponent) / sphere_angle)

def trace_rays_single(room, sources, start_db, target_db, max_order=100):

    polylines = []

    engine = room.room_engine
    walls = room.walls
    max_dist = float(engine.max_dist)

    for source in sources:
        dire = np.asarray(source.direction.unitized(), dtype=float)
        pos = np.asarray(source.position, dtype=float)

        dist_travelled = 0.0
        # hits = []
        pts = [Point(*pos)]
        for _ in range(max_order):
            hit, wall_idx, hit_dist = engine.next_wall_hit(pos, pos + dire * max_dist, False)
            if wall_idx == -1:
                break

            # hit = np.asarray(hit, dtype=float)

            # Stop the loop when the sound reaches the target_db over the distance
            dist_travelled += hit_dist
            curr_spl = spl_at_distance(start_db, dist_travelled)
            if curr_spl <= target_db:
                # Generate the stop point: the distance from the source at which
                # the level crosses target_db, then walk back that far from the hit.
                dist_at_target = distance_between_db(start_db, target_db)
                dist_end = dist_travelled - dist_at_target
                pt_end = hit + (-dire * dist_end)
                pts.append(Point(*pt_end))
                break

            # hits.append({"point": hit, "distance": dist_travelled, "spl": curr_spl})
            pts.append(Point(*hit))
            wall_hitted = walls[wall_idx]

            # Attenuate absorption
            absorption = float(np.mean(np.asarray(wall_hitted.absorption, dtype=float)))
            remaining = 1.0 - absorption
            start_db += 10.0 * math.log10(remaining)

            # Specular reflection update
            dire = np.asarray(wall_hitted.normal_reflect(dire), dtype=float)
            pos = hit

        polylines.append(Polyline(pts))
    return polylines


# Main code -------------
room = cpc.scene_to_pra_room(
    scene, 16000, max_order=1, ray_tracing=False, air_absorption=False
)
sources = scene.sources
start_db = 91.0
target_db = 30.0

polyline = trace_rays_single(room, sources, start_db, target_db)

print (polyline)
a = polyline

spl = spl_at_distance(start_db, 283.5250)
print (spl)
# ---------- end py3 ----------
py3_2 = Python3Script(scene=scene)  # -> out, a; disabled
# ---------- py3_2: Python ----------
import math
import numpy as np
from compas_acoustics import pra_converter as cpc

from compas.geometry import Point
from compas.geometry import Polyline


def spl_at_distance(start_db, distance):
    """
    Calculate sound pressure level (Lp) in dB after geometric spreading over distance (meters).
    Only support omni directivity now.
    """
    if distance <= 0:
        return start_db

    sphere_area = 4.0 * math.pi * (distance ** 2)

    return start_db - 10.0 * math.log10(sphere_area)

def distance_between_db(from_db, to_db):
    if from_db <= to_db:
        return 0.0

    sphere_angle = 4.0 * math.pi
    exponent = (from_db - to_db) / 10.0

    return math.sqrt((10.0 ** exponent) / sphere_angle)

def trace_single_ray(room, source, start_db, target_db, max_order=100):

    engine = room.room_engine
    walls = room.walls
    max_dist = float(engine.max_dist)

    dire = np.asarray(source.direction.unitized(), dtype=float)
    pos = np.asarray(source.position, dtype=float)

    dist_travelled = 0.0
    # hits = []
    pts = [Point(*pos)]
    for _ in range(max_order):
        hit, wall_idx, hit_dist = engine.next_wall_hit(pos, pos + dire * max_dist, False)
        if wall_idx == -1:
            break

        # hit = np.asarray(hit, dtype=float)

        # Stop the loop when the sound reaches the target_db over the distance
        dist_travelled += hit_dist
        curr_spl = spl_at_distance(start_db, dist_travelled)
        if curr_spl <= target_db:
            # Generate the stop point: the distance from the source at which
            # the level crosses target_db, then walk back that far from the hit.
            dist_at_target = distance_between_db(start_db, target_db)
            dist_end = dist_travelled - dist_at_target
            pt_end = hit + (-dire * dist_end)
            pts.append(Point(*pt_end))
            break

        # hits.append({"point": hit, "distance": dist_travelled, "spl": curr_spl})
        pts.append(Point(*hit))
        wall_hitted = walls[wall_idx]

        # Attenuate absorption
        absorption = float(np.mean(np.asarray(wall_hitted.absorption, dtype=float)))
        remaining = 1.0 - absorption
        start_db += 10.0 * math.log10(remaining)

        # Specular reflection update
        dire = np.asarray(wall_hitted.normal_reflect(dire), dtype=float)
        pos = hit

    return Polyline(pts)



# Main code -------------
room = cpc.scene_to_pra_room(
    scene, 16000, max_order=1, ray_tracing=False, air_absorption=False
)
source = scene.sources[0]
start_db = 91.0
target_db = 30.0

polyline = trace_single_ray(room, source, start_db, target_db)

print (polyline)
a = polyline

spl = spl_at_distance(start_db, 283.5250)
print (spl)
# ---------- end py3_2 ----------
number_slider_4 = Slider(5.4, range=0..10)
mirror = Mirror(Geometry=rot3d_3.Geometry, Plane=PlaneYZ(0, 0, 0))  # -> Geometry, Transform
_3px_2 = PlanePlanePlane(PlaneA=rot3d.Geometry, PlaneB=mirror.Geometry, PlaneC=move_3.Geometry)  # -> Point, LineAB, LineAC, LineBC
merge = Merge(Data1=_3px.LineAB, Data2=_3px.LineAC, Data3=_3px.LineBC, Data4=_3px_2.LineAB, Data5=_3px_2.LineBC)
ppx = PlanePlane(PlaneA=rot3d.Geometry, PlaneB=rot3d_3.Geometry)
ppx_2 = PlanePlane(PlaneA=rot3d.Geometry, PlaneB=mirror.Geometry)
ppx_3 = PlanePlane(PlaneA=rot3d.Geometry, PlaneB=move_3.Geometry)
ppx_4 = PlanePlane(PlaneA=rot3d_3.Geometry, PlaneB=move_3.Geometry)
ppx_5 = PlanePlane(PlaneA=mirror.Geometry, PlaneB=move_3.Geometry)
draw = COMPASDraw(cg=py3.a)  # -> rg; disabled
#   port cg: The COMPAS geometry or datastructure to be drawn.
#   port rg: The Rhino geometry object.
# ---------- draw: Python ----------
# r: compas>=2.14.1
"""
Draws COMPAS geometry in Grasshopper.
"""

from typing import Any

import Grasshopper

from compas.scene import SceneObject


class CompasToRhinoGeometry(Grasshopper.Kernel.GH_ScriptInstance):
    def RunScript(self, cg):
        if not cg:
            return None

        return SceneObject(item=cg).draw()
# ---------- end draw ----------
draw_2 = COMPASDraw(cg=py3_2.a)  # -> rg; disabled; same code as draw
len = Length(Curve=draw_2)  # disabled
traceraysscattered = Python3Script(scene=scene, n_rays=Slider(62, range=0..100), seed=Slider(7, range=0..10))  # -> out, a; inputs n_rays: Int32, seed: Int32
# ---------- traceraysscattered: Python ----------
import math
import numpy as np
from compas_acoustics import pra_converter as cpc

from compas.geometry import Point
from compas.geometry import Polyline

import pyroomacoustics as pra

from Grasshopper import DataTree
from Grasshopper.Kernel.Data import GH_Path


def random_directions(n_rays, seed=None):
    """
    Generate n_rays unit direction vectors, uniformly distributed on the sphere, from the given random seed.
    """
    rng = np.random.default_rng(seed)
    vectors = rng.normal(size=(n_rays, 3))
    return vectors / np.linalg.norm(vectors, axis=1, keepdims=True)

def spl_at_distance(start_db, distance):
    """
    Calculate sound pressure level (Lp) in dB after geometric spreading over distance (meters).
    Only support omni directivity now.
    """
    if distance <= 0:
        return start_db

    sphere_area = 4.0 * math.pi * (distance ** 2)

    return start_db - 10.0 * math.log10(sphere_area)

def distance_between_db(from_db, to_db):
    if from_db <= to_db:
        return 0.0

    sphere_angle = 4.0 * math.pi
    exponent = (from_db - to_db) / 10.0

    return math.sqrt((10.0 ** exponent) / sphere_angle)

def trace_rays_scattered(room, sources, start_db, target_db, n_rays=50, max_order=100, seed=7):

    polyline_tree = []

    engine = room.room_engine
    walls = room.walls
    max_dist = float(engine.max_dist)

    for i, source in enumerate(sources):
        dire_lst = random_directions(n_rays, seed * (i + 1) + 7)

        polylines = []
        for dire in dire_lst:
            pos = np.asarray(source.position, dtype=float)
            dist_travelled = 0.0
            # hits = []
            pts = [Point(*pos)]
            for _ in range(max_order):
                hit, wall_idx, hit_dist = engine.next_wall_hit(pos, pos + dire * max_dist, False)
                if wall_idx == -1:
                    break

                # Stop the loop when the sound reaches the target_db over the distance
                dist_travelled += hit_dist
                curr_spl = spl_at_distance(start_db, dist_travelled)
                if curr_spl <= target_db:
                    # Generate the stop point
                    dist_at_target = distance_between_db(start_db, target_db)
                    dist_end = dist_travelled - dist_at_target
                    pt_end = hit + (-dire * dist_end)
                    pts.append(Point(*pt_end))
                    break

                # hits.append({"point": hit, "distance": dist_travelled, "spl": curr_spl})
                pts.append(Point(*hit))
                wall_hitted = walls[wall_idx]

                # Attenuate absorption
                absorption = float(np.mean(np.asarray(wall_hitted.absorption, dtype=float)))
                remaining = 1.0 - absorption
                start_db += 10.0 * math.log10(remaining)

                # Specular reflection update
                dire = np.asarray(wall_hitted.normal_reflect(dire), dtype=float)
                pos = hit

            polylines.append(Polyline(pts))
        polyline_tree.append(polylines)
    return polyline_tree

# Main code -------------
room = cpc.scene_to_pra_room(
    scene, 16000, max_order=1, ray_tracing=False, air_absorption=False
)
sources = scene.sources
start_db = 91.0
target_db = 30.0

polyline_tree = trace_rays_scattered(room, sources, start_db, target_db, n_rays=n_rays, seed=seed)

a = DataTree[object]()
for i, br in enumerate(polyline_tree):
    a.AddRange(br, GH_Path(i))
spl = spl_at_distance(start_db, 283.5250)
print (spl)
# ---------- end traceraysscattered ----------
traceraysscattered_2 = Python3Script(scene=scene, n_rays=Slider(87, range=0..100), seed=Slider(7, range=0..10))  # -> out, a; inputs n_rays: Int32, seed: Int32
# ---------- traceraysscattered_2: Python ----------
import math
import numpy as np
from compas_acoustics import pra_converter as cpc

from compas.geometry import Point
from compas.geometry import Vector
from compas.geometry import Line
from compas.geometry import Polyline

import pyroomacoustics as pra

from Grasshopper import DataTree
from Grasshopper.Kernel.Data import GH_Path


def spl_at_distance(start_db, distance):
    """
    Calculate sound pressure level (Lp) in dB after geometric spreading over distance (meters).
    Only support omni directivity now.
    """
    if distance <= 0:
        return start_db

    sphere_area = 4.0 * math.pi * (distance ** 2)

    return start_db - 10.0 * math.log10(sphere_area)

def distance_between_spl(from_db, to_db):
    if from_db <= to_db:
        return 0.0

    sphere_angle = 4.0 * math.pi
    exponent = (from_db - to_db) / 10.0

    return math.sqrt((10.0 ** exponent) / sphere_angle)

def sum_spl(spl_list):
    if not spl_list:
        return 0.0
    valids = [spl for spl in spl_list if spl >= 0.0]
    if not valids:
        return 0.0

    return 10.0 * math.log10(sum(10 ** (spl / 10) for spl in valids))

def random_directions(n_rays, seed=None, jitter=0.5):
    """
    n_rays unit direction vectors on the sphere via a jittered Fibonacci
    lattice -- much more even angular coverage per ray than i.i.d. random
    sampling, while still varying with `seed`.

    jitter : float in [0, 1]
        0 = exact deterministic lattice, no randomness.
        1 = perturbation on the order of one full lattice-cell spacing.
    """
    golden = np.pi * (3.0 - np.sqrt(5.0))
    i = np.arange(n_rays)
    z = 1.0 - 2.0 * (i + 0.5) / n_rays
    radius = np.sqrt(np.maximum(1.0 - z * z, 0.0))
    phi = i * golden

    directions = np.stack([radius * np.cos(phi), radius * np.sin(phi), z], axis=1)

    if jitter > 0:
        rng = np.random.default_rng(seed)
        cell_size = 2.0 / np.sqrt(n_rays)  # ~ spacing between neighboring lattice points
        directions += rng.normal(size=(n_rays, 3)) * cell_size * jitter
        directions /= np.linalg.norm(directions, axis=1, keepdims=True)

    return directions

def receive_ray_segment(receiver, segment, from_spl):
    """
    Check if a ray segment passes through the receiver in its radius, and then calcuate the remained sound pressure level (spl).
    
    Parameters
    ----------
    receiver : Receiver
        compas_acoustics Receiver with radius.
    segment : Line

    from_spl : float
        sound pressure level from the last hit.

    Returns
    -------
    bool
        Is the ray segment pass through the receiver or not.
    float
        Remained sound pressure level.


    """
    seg_len = segment.length
    dire = segment.direction

    r_vec = Vector.from_start_end(segment.start, receiver.position)

    # Project length (dot product)
    t_proj = r_vec.dot(dire)
    if t_proj <= 0.0 or t_proj > seg_len:
        return False, 0.0

    # Vertical distance using Pythagorean theorem
    d_perp_sq = r_vec.length ** 2 - t_proj ** 2
    if d_perp_sq <= receiver.radius**2:
        end_spl = spl_at_distance(from_spl, t_proj)
        return True, end_spl
    
    return False, 0.0

def trace_rays_to_receivers(
    room, sources, receivers, start_db, target_db, n_rays=50, max_order=100, seed=7, jitter=0.5
):
    
    for rcv in receivers:
        rcv.received_spls = []

    engine = room.room_engine
    walls = room.walls
    max_dist = float(engine.max_dist)

    for i, source in enumerate(sources):
        dire_lst = random_directions(n_rays, seed * (i + 1) + 7, jitter)
        
        for dire in dire_lst:
            pos = np.asarray(source.position, dtype=float)
            db = start_db
            dist_travelled = 0.0

            for _ in range(max_order):
                hit, wall_idx, hit_dist = engine.next_wall_hit(pos, pos + dire * max_dist, False)
                if wall_idx == -1:
                    break

                seg = Line(Point(*pos), Point(*hit))
                for rcv in receivers:
                    captured, end_spl = receive_ray_segment(rcv, seg, db)
                    if captured:
                        rcv.received_spls.append(end_spl)
                        
                # Stop the loop when the sound reaches the target_db over the distance
                dist_travelled += hit_dist
                curr_spl = spl_at_distance(db, dist_travelled)
                if curr_spl <= target_db:
                    break
                
                wall_hitted = walls[wall_idx]

                # Attenuate absorption
                absorption = float(np.mean(np.asarray(wall_hitted.absorption, dtype=float)))
                remaining = 1.0 - absorption
                if remaining <= 0.0:
                    break

                db += 10.0 * math.log10(remaining)

                # Specular reflection update
                dire = np.asarray(wall_hitted.normal_reflect(dire), dtype=float)
                pos = hit

    return [rcv.total_spl for rcv in receivers]


# Main code -------------
room = cpc.scene_to_pra_room(
    scene, 16000, max_order=1, ray_tracing=False, air_absorption=False
)
sources = scene.sources
receivers = scene.receivers
for rcv in receivers:
    rcv.radius = 1.0
start_db = 91.0
target_db = 30.0

received_spls = trace_rays_to_receivers(
    room, sources, receivers, start_db, target_db, n_rays=n_rays, seed=seed
)

# a = DataTree[object]()
# for i, br in enumerate(polyline_tree):
#     a.AddRange(br, GH_Path(i))
# spl = spl_at_distance(start_db, 283.5250)
# print (spl)

print (scene.receivers[0].received_spls)
print (received_spls)
# ---------- end traceraysscattered_2 ----------
number_slider_5 = Slider(6, range=0..100)
crv = Curve([ppx, ppx_2, ppx_3, ppx_4, ppx_5])
ext = ExtendCurve(Curve=merge, Type=0, Start=number_slider_4, End=number_slider_4)
draw_3 = COMPASDraw(cg=traceraysscattered.a)  # -> rg; same code as draw
explode = Explode(Curve=draw_3, Recursive=True)  # -> Segments, Vertices
item = ListItem(List=explode.Segments, Index=Slider(0, range=0..10), Wrap=True)  # -> flatten(Item)
ext_2 = ExtendCurve(Curve=crv, Type=0, Start=number_slider_5, End=number_slider_5)
panel = Panel(draw_3)
